# Grasshopper definition Triangle Holes.ghx (Grasshopper 0.9.76)

number_slider = Slider(5, range=0..10)
hexgrid = Hexagonal(Plane=PlaneXY(0, 0, 0), Size=1, ExtentX=number_slider, ExtentY=number_slider)  # -> Cells, Points
area = Area(Geometry=hexgrid.Cells)  # -> Area, Centroid
extr = ExtrudePoint(Base=hexgrid.Cells, Point=area.Centroid)
flatten = FlattenTree(Tree=extr, Path="{0}")
debrep = DeconstructBrep(Brep=flatten)  # -> Faces, Edges, Vertices
join = BrepJoin(Breps=flatten)  # -> Breps, Closed
flatten_2 = FlattenTree(Tree=debrep.Faces, Path="{0}")
crv = Curve(flatten_2)
bbox = BoundingBox(Content=join.Breps, Plane=PlaneXY(0, 0, 0))  # -> Box, Box_2
crv_2 = Curve(join.Breps)
md_slider = MDSlider(
    slider_value=Point(0.4570729325, 0.4687805176, 0.5),
    SliderMode=0,
    x_domain=Domain(0, 1),
    y_domain=Domain(0, 1),
    z_domain=Domain(0, 1))
neg = Negative(Value=Slider(0.17, range=0..0.5))
debrep_2 = DeconstructBrep(Brep=bbox.Box)  # -> Faces, Edges, Vertices
area_2 = Area(Geometry=crv)  # -> Area, Centroid
offset = Offset(Curve=crv_2, Distance=neg, Plane=PlaneXY(0, 0, 0), Corners=1)
item = ListItem(List=debrep_2.Faces, Index=0, Wrap=True)
srf = Surface(reparameterize(item))
evalsrf = EvaluateSurface(Surface=srf, Point=md_slider)  # -> Point, Normal, Frame
dist = Distance(PointA=evalsrf.Point, PointB=area_2.Centroid)
dom = ConstructDomain(DomainStart=Slider(0.11, range=0..1), DomainEnd=Slider(0.95, range=0..1))
bnd = Bounds(Numbers=dist)
remap = RemapNumbers(Value=dist, Source=bnd, Target=dom)  # -> Mapped, Clipped
graft = GraftTree(Tree=remap.Mapped, IncludeEmptyLists=True, IncludeNullItems=True)
dom_2 = ConstructDomain(DomainStart=graft, DomainEnd=Slider(0.05, range=0..0.1))  # -> simplify(Domain)
range = Range(Domain=Slider(0.326, range=0..1), Steps=10)
Z = UnitZ(Factor=range)
range_2 = Range(Domain=dom_2, Steps=10)
scale = Scale(Geometry=graft(crv), Center=graft(area_2.Centroid), Factor=range_2)  # -> simplify(Geometry), Transform
neg_2 = Negative(Value=Z)
panel = Panel(range_2)
move = Move(Geometry=scale.Geometry, Motion=neg_2)  # -> simplify(Geometry), Transform
move_2 = Move(Geometry=offset, Motion=neg_2)  # -> simplify(graft(Geometry)), Transform
flip = FlipMatrix(Data=move.Geometry)
range_3 = Range(Domain=Domain(0, 1), Steps=10)
merge = Merge(Data1=flip, Data2=move_2.Geometry)
gradient = Gradient(LowerLimit=0, UpperLimit=1, Parameter=range_3, stops=[0: RGB(105, 192, 255), 0.674: RGB(43, 90, 166)])
boundary = BoundarySurfaces(Edges=merge)
graft_2 = GraftTree(Tree=gradient, IncludeEmptyLists=True, IncludeNullItems=True)
preview = CustomPreview(Geometry=boundary, Shader=graft_2)
