# Grasshopper definition Light Cage.ghx (Grasshopper 0.9.76)

pt = ConstructPoint(XCoordinate=0, YCoordinate=0, ZCoordinate=0)
Z = UnitZ(Factor=1)
line = LineSDL(Start=pt, Direction=Z, Length=Slider(100, range=0..100))
divide = DivideCurve(Curve=reparameterize(line), Count=10, Kinks=False)  # -> Points, Tangents, Parameters
graph = GraphMapper(
    divide.Parameters,
    x0=0,
    x1=1,
    y0=0,
    y1=1,
    container_name="Bezier",
    cpx=[0, 0.3903768659, 1, 1],
    cpy=[0.2981449366, 0, 0.1438029408, 1])
dom = ConstructDomain(DomainStart=Slider(47, range=0..100), DomainEnd="0")
remap = RemapNumbers(Value=graph, Source=Domain(0, 1), Target=dom)  # -> Mapped, Clipped
X = UnitX(Factor=remap.Mapped)
move = Move(Geometry=divide.Points, Motion=X)  # -> Geometry, Transform
intcrv = Interpolate(Vertices=move.Geometry, Degree=3, Periodic=False, KnotStyle=1)  # -> Curve, Length, Domain
revsrf = Revolution(Curve=intcrv.Curve, Axis=line, Domain=Domain(0, 6.283185307))
number_slider = Slider(300, range=0..300)
edges = BrepEdges(Brep=revsrf)  # -> Naked, Interior, NonManifold
crv = Curve(edges.Naked)
mod = Modulus(A=number_slider, B="2")
addition = Addition(A=number_slider, B=mod)
divide_2 = DivideCurve(Curve=crv, Count=addition, Kinks=False)  # -> Points, Tangents, Parameters
lng = ListLength(List=divide_2.Points)
random = Random(Range=Domain(0, 1), Number=lng, Seed=2)
division = Division(A=lng, B="2")
sort = SortList(Keys=random, ValuesA=divide_2.Points)  # -> Keys, ValuesA
split = SplitList(List=sort.ValuesA, Index=division)  # -> ListA, ListB
ln = Line(StartPoint=split.ListA, EndPoint=split.ListB)
vec = Vector(ln)
eval = EvaluateLength(Curve=ln, Length=Slider(0.5, range=0..1), Normalized=True)  # -> Point, Tangent, Parameter
random_2 = Random(Range=Slider(40, range=0..100), Number=division, Seed=Slider(2342, range=0..10000))
Z_2 = UnitZ(Factor=eval.Point)
rad = Radians(Degrees=random_2)
vrot = Rotate(Vector=Z_2, Axis=vec, Angle=rad)
pl = ConstructPlane(Origin=eval.Point, XAxis=vec, YAxis=vrot)
number_slider_2 = Slider(1, range=0..1)
graft = GraftTree(Tree=pl, IncludeEmptyLists=True, IncludeNullItems=True)
neg = Negative(Value=number_slider_2)
srf = Surface(reparameterize(revsrf))
merge = Merge(Data1=neg, Data2=number_slider_2)
pl_offset = PlaneOffset(BasePlane=graft, Offset=merge)  # -> simplify(Plane)
sec = BrepPlane(Brep=srf, Plane=pl_offset)  # -> reparameterize(simplify(Curves)), Points
pshift = ShiftPaths(Data=sec.Curves, Offset=-1)
lng_2 = ListLength(List=pshift)
cls = Closed(Curve=pshift)  # -> Closed, Periodic
equals = Equality(FirstNumber=lng_2, SecondNumber="2")  # -> Equality, Inequality
ma = MassAddition(Input=cls.Closed)  # -> Result, PartialResults
equals_2 = Equality(FirstNumber=ma.Result, SecondNumber="0")  # -> Equality, Inequality
and = GateAnd(A=equals_2.Equality, B=equals.Equality)
cull = CullPattern(List=pshift, CullPattern=and)
number_slider_3 = Slider(100, range=0..100)
prune = PruneTree(Tree=cull, Minimum="1", Maximum=0)
item = ListItem(List=prune, Index=0, Wrap=True)
item_2 = ListItem(List=prune, Index="1", Wrap=True)
divide_3 = DivideCurve(Curve=item, Count=number_slider_3, Kinks=False)  # -> simplify(Points), Tangents, Parameters
divide_4 = DivideCurve(Curve=item_2, Count=number_slider_3, Kinks=False)  # -> simplify(Points), Tangents, Parameters
ln_2 = Line(StartPoint=divide_3.Points, EndPoint=divide_4.Points)
eval_2 = EvaluateLength(Curve=ln_2, Length="0.5", Normalized=True)  # -> Point, Tangent, Parameter
pdecon = Deconstruct(Point=eval_2.Point)  # -> XComponent, YComponent, ZComponent
bnd = Bounds(Numbers=flatten(pdecon.ZComponent))
dom_2 = ConstructDomain(DomainStart=Slider(1.5, range=0..2), DomainEnd=Slider(0.1, range=0..1))
remap_2 = RemapNumbers(Value=pdecon.ZComponent, Source=bnd, Target=dom_2)  # -> Mapped, Clipped
scale = Scale(Geometry=ln_2, Center=eval_2.Point, Factor=remap_2.Mapped)  # -> Geometry, Transform
loft = Loft(Curves=scale.Geometry, Options={Adjust=False, Closed=False, LoftEnds=0, LoftSimp=0, LoftType=0, Rebuild=10, Refit=0.01})
mesh = Mesh(loft)
demesh = DeconstructMesh(Mesh=mesh)  # -> Vertices, Faces, Colours, Normals
pdecon_2 = Deconstruct(Point=demesh.Vertices)  # -> XComponent, YComponent, ZComponent
bnd_2 = Bounds(Numbers=flatten(pdecon_2.ZComponent))
remap_3 = RemapNumbers(Value=pdecon_2.ZComponent, Source=bnd_2, Target=Domain(0, 1))  # -> simplify(Mapped), Clipped
gradient = Gradient(LowerLimit=0, UpperLimit=1, Parameter=remap_3.Mapped, stops=[0.15: RGB(251, 255, 41), 0.85: RGB(220, 0, 40)])
mcol = MeshColours(Mesh=mesh, Colours=gradient)
