# Grasshopper definition Mushroom Hat.ghx (Grasshopper 0.9.76)

number_slider = Slider(100, range=0..100)
planesrf = PlaneSurface(Plane=PlaneXY(0, 0, 0), XSize=number_slider, YSize=number_slider)
area = Area(Geometry=planesrf)  # -> Area, Centroid
polygon = Polygon(Plane=area.Centroid, Radius=Slider(14, range=0..100), Segments=6, FilletRadius=0)  # -> Polygon, Length
cp = ControlPoints(Curve=polygon.Polygon)  # -> Points, Weights, Knots
number_slider_2 = Slider(10, range=0..100)
cull_i = CullIndex(List=cp.Points, Indices="0", Wrap=True)
shift = ShiftList(List=cull_i, Shift=Slider(2, range=0..10), Wrap=True)
number_slider_3 = Slider(47, range=0..100)
ln = Line(StartPoint=cull_i, EndPoint=shift)
pi = Pi(Factor=Slider(4, range=0..10))
subtraction = Subtraction(A=number_slider_2, B="1")
join = JoinCurves(Curves=ln, Preserve=False)
sdivide = DivideSurface(Surface=planesrf, UCount=number_slider_3, VCount=number_slider_3)  # -> Points, Normals, Parameters
runion = RegionUnion(Curves=join)
range = Range(Domain=pi, Steps=subtraction)
area_2 = Area(Geometry=runion)  # -> Area, Centroid
boundary = BoundarySurfaces(Edges=runion)  # -> reparameterize(Surfaces)
sin = Sine(Value=range)
bnd = Bounds(Numbers=sin)
dom = ConstructDomain(DomainStart=Slider(0.11, range=0..1), DomainEnd=Slider(0.43, range=0..1))
srf_cp = SurfaceClosestPoint(Point=sdivide.Points, Surface=boundary)  # -> Point, UVPoint, Distance
cir = Circle(Plane=area_2.Centroid, Radius=Slider(38, range=0..100))
remap = RemapNumbers(Value=sin, Source=bnd, Target=dom)  # -> Mapped, Clipped
bnd_2 = Bounds(Numbers=flatten(srf_cp.Distance))
dom_2 = ConstructDomain(DomainStart=Slider(55, range=0..100), DomainEnd=Slider(0, range=0..100))
scale = Scale(Geometry=boundary, Center=area_2.Centroid, Factor=remap.Mapped)  # -> Geometry, Transform
divide = DivideCurve(Curve=cir, Count=number_slider_2, Kinks=False)  # -> Points, Tangents, Parameters
remap_2 = RemapNumbers(Value=srf_cp.Distance, Source=bnd_2, Target=dom_2)  # -> Mapped, Clipped
vec2pt = Vector2Pt(PointA=area_2.Centroid, PointB=divide.Points, Unitize=False)  # -> Vector, Length
Z = UnitZ(Factor=remap_2.Mapped)
move = Move(Geometry=scale.Geometry, Motion=vec2pt.Vector)  # -> Geometry, Transform
graft = GraftTree(Tree=move.Geometry, IncludeEmptyLists=True, IncludeNullItems=True)
move_2 = Move(Geometry=sdivide.Points, Motion=Z)  # -> Geometry, Transform
flatten = FlattenTree(Tree=move_2.Geometry, Path="{0}")
srf_cp_2 = SurfaceClosestPoint(Point=flatten, Surface=reparameterize(graft))  # -> simplify(Point), UVPoint, simplify(Distance)
addition = Addition(A=number_slider_3, B="1")
srfgrid = SurfaceFromPoints(Points=flatten, UCount=addition, Interpolate=False)
flip = FlipMatrix(Data=srf_cp_2.Distance)
srf_cp_3 = SurfaceClosestPoint(Point=flatten, Surface=reparameterize(srfgrid))  # -> Point, UVPoint, Distance
ma = MassAddition(Input=flip)  # -> Result, PartialResults
evalsrf = EvaluateSurface(Surface=reparameterize(srfgrid), Point=srf_cp_3.UVPoint)  # -> Point, Normal, Frame
bnd_3 = Bounds(Numbers=flatten(ma.Result))
remap_3 = RemapNumbers(Value=ma.Result, Source=bnd_3, Target=Slider(73.42, range=0..100))  # -> flatten(Mapped), Clipped
amp = Amplitude(Vector=evalsrf.Normal, Amplitude=remap_3.Mapped)
move_3 = Move(Geometry=evalsrf.Point, Motion=amp)  # -> Geometry, Transform
srfgrid_2 = SurfaceFromPoints(Points=move_3.Geometry, UCount=addition, Interpolate=False)
preview = CustomPreview(
    Geometry=srfgrid_2,
    Shader={ambient=RGB(0, 0, 0), diffuse=RGB(255, 105, 180), emission=RGB(76, 32, 54), shine=0.5, specular=RGB(255, 255, 255), transparency=0})
