# Grasshopper definition Egg Bullet.ghx (Grasshopper 0.9.76)
# plug-ins: MeshEdit Components, Kangaroo Components, Kangaroo2 Components

number_slider = Slider(100, range=0..100)
number_slider_2 = Slider(20, range=0..100)
planesrf = PlaneSurface(Plane=PlaneXY(0, 0, 0), XSize=number_slider, YSize=number_slider)
sdivide = DivideSurface(Surface=planesrf, UCount=number_slider_2, VCount=number_slider_2)  # -> Points, Normals, Parameters
area = Area(Geometry=planesrf)  # -> Area, Centroid
addition = Addition(A=number_slider_2, B="1")
flatten = FlattenTree(Tree=sdivide.Points, Path="{0}")
Z = UnitZ(Factor=Slider(68, range=0..100))
move = Move(Geometry=area.Centroid, Motion=Z)  # -> Geometry, Transform
frompoints = MeshFromPoints(Points=flatten, UDirection=addition, VDirection=addition)
explode = MeshExplode(Mesh=frompoints, Interpolate=False)
medges = MeshEdges(Mesh=explode)  # -> NakedEdges, InteriorEdges, NonManifoldEdges
sph = Sphere(Base=move.Geometry, Radius=Slider(18, range=0..100))
xy = XYPlane(Origin=move.Geometry)
join = JoinCurves(Curves=medges.NakedEdges, Preserve=False)
medges_2 = MeshEdges(Mesh=frompoints)  # -> NakedEdges, InteriorEdges, NonManifoldEdges
sec = BrepPlane(Brep=sph, Plane=xy)  # -> Curves, Points
cp = ControlPoints(Curve=join)  # -> Points, Weights, Knots
graft = GraftTree(Tree=flatten, IncludeEmptyLists=True, IncludeNullItems=True)
srfsplit = SurfaceSplit(Surface=sph, Curves=sec.Curves)
duppt = RemoveDuplicatePts(Points=cp.Points, Tolerance=0.01)
join_2 = JoinCurves(Curves=medges_2.NakedEdges, Preserve=False)
dispatch = Dispatch(List=duppt, DispatchPattern=[True, False])  # -> ListA, ListB
bbox = BoundingBox(Content=srfsplit, Plane=PlaneXY(0, 0, 0))  # -> Box, Box_2
cp_2 = ControlPoints(Curve=join_2)  # -> Points, Weights, Knots
area_2 = Area(Geometry=bbox.Box)  # -> Area, Centroid
pline = PolyLine(Vertices=dispatch.ListA, Closed=False)
pline_2 = PolyLine(Vertices=dispatch.ListB, Closed=False)
duppt_2 = RemoveDuplicatePts(Points=cp_2.Points, Tolerance=0.01)
Z_2 = UnitZ(Factor=1)
pdecon = Deconstruct(Point=area_2.Centroid)  # -> XComponent, YComponent, ZComponent
merge = Merge(Data1=medges_2.NakedEdges, Data2=medges_2.InteriorEdges, Data3=pline, Data4=pline_2)  # -> flatten(Result)
neg = Negative(Value=Slider(4.55, range=0..10))
sort = SortList(Keys=pdecon.ZComponent, ValuesA=srfsplit)  # -> Keys, ValuesA
dupln = RemoveDuplicateLines(Lines=merge, Tolerance=0.01)
Z_3 = UnitZ(Factor=neg)
anchor = Anchor(Point=duppt_2, Strength=1000)  # -> flatten(A)
length_line = LengthLine(Line=dupln, Strength=Slider(10, range=0..100))  # -> flatten(Spring)
show = Show(G=frompoints)  # -> flatten(G)
item = ListItem(List=sort.ValuesA, Index=0, Wrap=True)
item_2 = ListItem(List=sort.ValuesA, Index="1", Wrap=True)
project = Project(Geometry=item_2, Plane=planesrf)  # -> Geometry, Transform
crv = Curve(project.Geometry)
incurve = PointInCurve(Point=flatten, Curve=crv)  # -> Relationship, Point
equals = Equality(FirstNumber=incurve.Relationship, SecondNumber=Slider(2, range=0..10))  # -> Equality, Inequality
graft_2 = GraftTree(Tree=equals.Equality, IncludeEmptyLists=True, IncludeNullItems=True)
dispatch_2 = Dispatch(List=graft, DispatchPattern=graft_2)  # -> ListA, ListB
pt = Point(dispatch_2.ListA)
project_2 = ProjectPoint(Point=pt, Direction=Z_2, Geometry=item_2)  # -> Point, Index
onpoint = OnPoint(
    Points=pt,
    TargetPoints=project_2.Point,
    Strength=Slider(200, range=0..200),
    Reference="C:\Users\flowf\AppData\Roaming\Grasshopper\Libraries\KangarooSolver.dll")  # -> out, flatten(A); inputs Points: list of Point3d, TargetPoints: list of Point3d, Strength: Double
# ---------- onpoint: C# ----------
    A = new OnPoint(Points, TargetPoints, Strength);
# ---------- onpoint: C# additional code ----------
  public class OnPoint : GoalObject
  {
    public double Strength;
    public List<Point3d> _tpts;

    public OnPoint()
    {
    }

    public OnPoint(List<int> V, List<Point3d> TPts, double k)
    {
      int L = V.Count;
      PIndex = V.ToArray();
      Move = new Vector3d[L];
      Weighting = new double[L];
      for (int i = 0; i < L; i++)
      {
        Weighting[i] = k;
      }
      _tpts = TPts;
      Strength = k;
    }

    public OnPoint(List<Point3d> V, List<Point3d> TPts, double k)
    {
      int L = V.Count;
      PPos = V.ToArray();
      Move = new Vector3d[L];
      Weighting = new double[L];
      for (int i = 0; i < L; i++)
      {
        Weighting[i] = k;
      }
      _tpts = TPts;
      Strength = k;
    }

    public override void Calculate(List<KangarooSolver.Particle> p)
    {
      List<Point3d> ptList = new List<Point3d>();


      for (int i = 0; i < PIndex.Length; i++)
      {
        Point3d ThisPt = p[PIndex[i]].Position;

        Point3d TargetPt = _tpts[i];

        if(TargetPt == null){
          Move[i] = Vector3d.ZAxis;
        }else{
          Move[i] = TargetPt - ThisPt;
        }

        Weighting[i] = Strength;
      }

    }

  }
# ---------- end onpoint ----------
load = Load(Point=flatten, ForceVector=Z_3)  # -> flatten(Unary)
bbox_2 = BoundingBox(Content=item, Plane=PlaneXY(0, 0, 0))  # -> Box, Box_2
debrep = DeconstructBrep(Brep=bbox_2.Box)  # -> Faces, Edges, Vertices
area_3 = Area(Geometry=debrep.Faces)  # -> Area, Centroid
merge_2 = Merge(Data1=show, Data2=anchor, Data3=onpoint.A, Data4=length_line, Data5=load)
pdecon_2 = Deconstruct(Point=area_3.Centroid)  # -> XComponent, YComponent, ZComponent
sort_2 = SortList(Keys=pdecon_2.ZComponent, ValuesA=area_3.Centroid)  # -> Keys, reverse(ValuesA)
number_slider_3 = Slider(22, range=0..100)
solver = Solver(GoalObjects=merge_2, Reset=Button(), Threshold=1e-15, Tolerance=0.01, On=Toggle(True))  # -> I, V, O
number_slider_4 = Slider(0, range=0..1)
item_3 = ListItem(List=sort_2.ValuesA, Index=0, Wrap=True)
item_4 = ListItem(List=solver.O, Index=0, Wrap=True)
random = Random(Range=Domain(0, 1), Number=number_slider_3, Seed=Slider(234, range=0..1000))
scale_nu = ScaleNU(Geometry=item, Plane=item_3, ScaleX=1, ScaleY=1, ScaleZ=Slider(1.8, range=0..10))  # -> Geometry, Transform
random_2 = Random(Range=Domain(0, 1), Number=number_slider_3, Seed=Slider(423, range=0..1000))
dom = ConstructDomain(DomainStart=Slider(9.29, range=0..20), DomainEnd=number_slider_4)
dom_2 = ConstructDomain(DomainStart=Slider(2.96, range=0..20), DomainEnd=number_slider_4)
msmooth = SmoothMesh(Mesh=item_4, Strength=0.5, SkipNaked=True, Iterations=Slider(1, range=0..10))
merge_3 = Merge(Data1=scale_nu.Geometry, Data2=item_2)
remap = RemapNumbers(Value=random, Source=Domain(0, 1), Target=dom)  # -> Mapped, Clipped
remap_2 = RemapNumbers(Value=random, Source=Domain(0, 1), Target=dom_2)  # -> Mapped, Clipped
join_3 = BrepJoin(Breps=flatten(merge_3))  # -> Breps, Closed
scale = Scale(Geometry=join_3.Breps, Center=move.Geometry, Factor=Slider(0.82, range=0..1))  # -> Geometry, Transform
bbox_3 = BoundingBox(Content=scale.Geometry, Plane=PlaneXY(0, 0, 0))  # -> Box, Box_2
box_corners = BoxCorners(Box=bbox_3.Box)  # -> CornerA, CornerB, CornerC, CornerD, CornerE, CornerF, CornerG, CornerH
ln = Line(StartPoint=box_corners.CornerA, EndPoint=box_corners.CornerC)
eval = EvaluateLength(Curve=ln, Length=0.5, Normalized=True)  # -> Point, Tangent, Parameter
ln_2 = Line(StartPoint=eval.Point, EndPoint=area.Centroid)
eval_2 = EvaluateLength(Curve=ln_2, Length=random, Normalized=True)  # -> Point, Tangent, Parameter
cir = Circle(Plane=eval_2.Point, Radius=remap.Mapped)
eval_3 = EvaluateCurve(Curve=reparameterize(cir), Parameter=random_2)  # -> Point, Tangent, Angle
sph_2 = Sphere(Base=eval_3.Point, Radius=remap_2.Mapped)
preview = CustomPreview(Geometry=msmooth, Shader=ColourSwatch(SwatchColor=RGBA(0, 229, 255, 123)))
merge_4 = Merge(Data1=scale.Geometry, Data2=sph_2)  # -> flatten(Result)
preview_2 = CustomPreview(Geometry=merge_4, Shader=ColourSwatch(SwatchColor=RGB(255, 144, 0)))
