# Grasshopper definition Drop Bubble.ghx (Grasshopper 0.9.76)
# plug-ins: Kangaroo Components, Weaverbird, TSplinesGH

pt = ConstructPoint(XCoordinate=0, YCoordinate=0, ZCoordinate=0)
number_slider = Slider(20, range=0..100)
sph = Sphere(Base=pt, Radius=Slider(100, range=0..100))
sdivide = DivideSurface(Surface=sph, UCount=number_slider, VCount=number_slider)  # -> flatten(Points), Normals, Parameters
pdecon = Deconstruct(Point=sdivide.Points)  # -> XComponent, YComponent, ZComponent
pt_2 = ConstructPoint(XCoordinate=0, YCoordinate=0, ZCoordinate=pdecon.ZComponent)
dist = Distance(PointA=pt, PointB=pt_2)
bnd = Bounds(Numbers=dist)
remap = RemapNumbers(Value=dist, Source=bnd, Target=Domain(0, 1))  # -> Mapped, Clipped
graph = GraphMapper(remap.Mapped, x0=0, x1=1, y0=0, y1=1, container_name="Bezier", cpx=[0, 0.4257396758, 1, 1], cpy=[0, 0, 0, 0.4125797153])
graph_2 = GraphMapper(
    remap.Mapped,
    x0=0,
    x1=1,
    y0=0,
    y1=1,
    container_name="Bezier",
    cpx=[0, 0.004348091315, 0.4797106683, 1],
    cpy=[0, 0.6275362372, 0.7318840623, 0.702898562])
larger = LargerThan(FirstNumber=pdecon.ZComponent, SecondNumber=0)  # -> LargerThan, OrEqualTo
multiplication = Multiplication(A=larger.LargerThan, B=graph)
addition = Addition(A=number_slider, B="1")
addition_2 = Addition(A=multiplication, B=graph_2)
scale_nu = ScaleNU(Geometry=sdivide.Points, Plane=pt, ScaleX=1, ScaleY=1, ScaleZ=addition_2)  # -> Geometry, Transform
srfgrid = SurfaceFromPoints(Points=scale_nu.Geometry, UCount=addition, Interpolate=False)
bbox = BoundingBox(Content=srfgrid, Plane=PlaneXY(0, 0, 0))  # -> Box, Box_2
pop3d = Populate3D(Region=bbox.Box, Count=100, Seed=1)
voronoi³ = Voronoi3D(Points=pop3d, Box=bbox.Box)  # -> graft(Cells), Boundary
sint = SolidIntersection(BrepsA=voronoi³.Cells, BrepsB=srfgrid)
lng = ListLength(List=sint)
equals = Equality(FirstNumber=lng, SecondNumber="0")  # -> Equality, Inequality
cull = CullPattern(List=voronoi³.Cells, CullPattern=equals.Equality)
area = Area(Geometry=cull)  # -> Area, Centroid
brepinc = PointInBrep(Brep=srfgrid, Point=area.Centroid, Strict=False)
cull_2 = CullPattern(List=cull, CullPattern=brepinc)
merge = Merge(Data1=sint, Data2=cull_2)  # -> flatten(Result)
edges = BrepEdges(Brep=merge)  # -> Naked, Interior, NonManifold
edges_2 = BrepEdges(Brep=srfgrid)  # -> Naked, Interior, NonManifold
crv = Curve(edges.Interior)
crv_2 = Curve(edges_2.Interior)
graft = GraftTree(Tree=crv, IncludeEmptyLists=True, IncludeNullItems=True)
end = EndPoints(Curve=graft)  # -> Start, End
merge_2 = Merge(Data1=end.Start, Data2=end.End)  # -> simplify(Result)
crv_cp = CurveClosestPoint(Point=merge_2, Curve=crv_2)  # -> Point, Parameter, Distance
smaller = SmallerThan(FirstNumber=crv_cp.Distance, SecondNumber=Slider(0.01, range=0..0.01))  # -> SmallerThan, OrEqualTo
mm = MassMultiplication(Input=smaller.SmallerThan)  # -> Result, PartialResults
bool = Boolean(mm.Result)
not = GateNot(A=bool)
pshift = ShiftPaths(Data=not, Offset=-1)
cull_3 = CullPattern(List=crv, CullPattern=pshift)  # -> flatten(List)
end_2 = EndPoints(Curve=cull_3)  # -> Start, End
ln = Line(StartPoint=end_2.Start, EndPoint=end_2.End)
dupln = RemoveDuplicateLines(Lines=ln, Tolerance=0.01)
tpipe = TsPipe(InCurves=dupln, DefaultRadius=Slider(3, range=0..10), CurveSegments=Slider(2, range=0..10))
mesh = Mesh(tpipe)
wbcatmullclark = WeaverbirdsCatmullClarkSubdivision(MeshCurves=mesh, Level=Slider(3, range=0..10), SmoothNakedEdges=1)
pt_3 = Point(pt)
demesh = DeconstructMesh(Mesh=wbcatmullclark)  # -> Vertices, Faces, Colours, Normals
dist_2 = Distance(PointA=pt_3, PointB=demesh.Vertices)
bnd_2 = Bounds(Numbers=dist_2)
remap_2 = RemapNumbers(Value=dist_2, Source=bnd_2, Target=Domain(0, 1))  # -> Mapped, Clipped
gradient = Gradient(LowerLimit=0, UpperLimit=1, Parameter=remap_2.Mapped, stops=[0.15: RGB(92, 50, 0), 0.85: RGB(255, 170, 0)])
mcol = MeshColours(Mesh=wbcatmullclark, Colours=gradient)
