# Grasshopper definition Flower Pattern.ghx (Grasshopper 0.9.76)

hexgrid = Hexagonal(Plane=PlaneXY(0, 0, 0), Size=Slider(10, range=0..10), ExtentX=Slider(20, range=0..100), ExtentY=Slider(20, range=0..100))  # -> simplify(flatten(Cells)), simplify(flatten(Points))
bbox = BoundingBox(Content=hexgrid.Cells, Plane=PlaneXY(0, 0, 0), UnionBox=True)  # -> Box, Box_2
debrep = DeconstructBrep(Brep=bbox.Box)  # -> Faces, Edges, Vertices
pop2d = Populate2D(Region=debrep.Faces, Count=Slider(5, range=0..10), Seed=Slider(172, range=0..1000))  # -> graft(Population)
explode = Explode(Curve=hexgrid.Cells, Recursive=True)  # -> simplify(Segments), Vertices
partition = PartitionList(List=explode.Segments, Size="2")
pt = Point(hexgrid.Points)
dist = Distance(PointA=pop2d, PointB=pt)  # -> simplify(Distance)
join = JoinCurves(Curves=partition, Preserve=False)  # -> simplify(Curves)
graft = GraftTree(Tree=pt, IncludeEmptyLists=True, IncludeNullItems=True)  # -> simplify(Tree)
pshift = ShiftPaths(Data=join, Offset=-1)
min = Minimum(A=dist, B=Slider(132.1, range=0..1000))
extr = ExtrudePoint(Base=pshift, Point=graft)
flip = FlipMatrix(Data=min)
area = Area(Geometry=extr)  # -> Area, Centroid
ma = MassAddition(Input=flip)  # -> Result, PartialResults
dom = ConstructDomain(DomainStart=Slider(0.15, range=0..1), DomainEnd=Slider(1, range=0..1))
dom_2 = ConstructDomain(DomainStart=Slider(50, range=0..100), DomainEnd=Slider(1, range=0..1))
vec2pt = Vector2Pt(PointA=graft, PointB=area.Centroid, Unitize=False)  # -> Vector, Length
Z = UnitZ(Factor=1)
bnd = Bounds(Numbers=flatten(ma.Result))
rad = Radians(Degrees="90")
vrot = Rotate(Vector=vec2pt.Vector, Axis=Z, Angle=rad)
remap = RemapNumbers(Value=ma.Result, Source=bnd, Target=dom)  # -> Mapped, Clipped
remap_2 = RemapNumbers(Value=ma.Result, Source=bnd, Target=dom_2)  # -> Mapped, Clipped
remap_3 = RemapNumbers(Value=ma.Result, Source=bnd, Target=Domain(0, 1))  # -> Mapped, Clipped
pl = ConstructPlane(Origin=area.Centroid, XAxis=vec2pt.Vector, YAxis=vrot)
Z_2 = UnitZ(Factor=remap_2.Mapped)
Z_3 = UnitZ(Factor=Slider(5, range=0..100))
scale_nu = ScaleNU(Geometry=extr, Plane=pl, ScaleX=remap.Mapped, ScaleY=1, ScaleZ=1)  # -> Geometry, Transform
move = Move(Geometry=scale_nu.Geometry, Motion=Z_2)  # -> Geometry, Transform
graft_2 = GraftTree(Tree=move.Geometry, IncludeEmptyLists=True, IncludeNullItems=True)  # -> simplify(Tree)
graft_3 = GraftTree(Tree=extr, IncludeEmptyLists=True, IncludeNullItems=True)  # -> simplify(Tree)
merge = Merge(Data1=graft_3, Data2=graft_2)
gradient = Gradient(LowerLimit=0, UpperLimit=1, Parameter=remap_3.Mapped, stops=[0.15: RGB(255, 66, 66), 0.85: RGB(87, 0, 16)])
loft = Loft(Curves=merge, Options={Adjust=False, Closed=False, LoftEnds=0, LoftSimp=0, LoftType=0, Rebuild=10, Refit=0.01})
merge_2 = Merge(Data1=merge, Data2=loft)
pshift_2 = ShiftPaths(Data=merge_2, Offset=-1)
join_2 = BrepJoin(Breps=pshift_2)  # -> Breps, Closed
preview = CustomPreview(Geometry=join_2.Breps, Shader=gradient)
