# Grasshopper definition Rock Tile.ghx (Grasshopper 0.9.76)

number_slider = Slider(10, range=0..10)
number_slider_2 = Slider(7, range=0..10)
multiplication = Multiplication(A=number_slider, B="2")
multiplication_2 = Multiplication(A=number_slider, B="3")
multiplication_3 = Multiplication(A=number_slider, B="3")
sqgrid = Square(Plane=PlaneXY(0, 0, 0), Size=number_slider, ExtentX=number_slider_2, ExtentY=number_slider_2)  # -> Cells, Points
rectangle = Rectangle(Plane=PlaneXY(0, 0, 0), XSize=number_slider, YSize=number_slider, Radius=0)  # -> Rectangle, Length
rectangle_2 = Rectangle(Plane=PlaneXY(0, 0, 0), XSize=multiplication, YSize=multiplication, Radius=0)  # -> Rectangle, Length
rectangle_3 = Rectangle(Plane=PlaneXY(0, 0, 0), XSize=multiplication, YSize=number_slider, Radius=0)  # -> Rectangle, Length
rectangle_4 = Rectangle(Plane=PlaneXY(0, 0, 0), XSize=number_slider, YSize=multiplication, Radius=0)  # -> Rectangle, Length
rectangle_5 = Rectangle(Plane=PlaneXY(0, 0, 0), XSize=multiplication_2, YSize=multiplication, Radius=0)  # -> Rectangle, Length
rectangle_6 = Rectangle(Plane=PlaneXY(0, 0, 0), XSize=multiplication, YSize=multiplication_3, Radius=0)  # -> Rectangle, Length
explode = Explode(Curve=sqgrid.Cells, Recursive=True)  # -> Segments, Vertices
panel = Panel("""1;1
1;4
3;3
5;0""")
panel_2 = Panel("""1;2
2;4
0;5
5;1""")
item = ListItem(List=explode.Vertices, Index=0, Wrap=True)  # -> simplify(Item)
path = DataPath(panel)
path_2 = DataPath(panel_2)
path_3 = DataPath("0;3")
path_4 = DataPath("3;2")
path_5 = DataPath("4;3")
path_6 = DataPath("2;0")
branch = TreeBranch(Tree=item, Path=path, MaintainPaths=True)
branch_2 = TreeBranch(Tree=item, Path=path_2, MaintainPaths=True)
branch_3 = TreeBranch(Tree=item, Path=path_3, MaintainPaths=True)
branch_4 = TreeBranch(Tree=item, Path=path_5, MaintainPaths=True)
branch_5 = TreeBranch(Tree=item, Path=path_4, MaintainPaths=True)
branch_6 = TreeBranch(Tree=item, Path=path_6, MaintainPaths=True)
move = Move(Geometry=rectangle_2.Rectangle, Motion=branch_2)  # -> Geometry, Transform
move_2 = Move(Geometry=rectangle.Rectangle, Motion=branch)  # -> Geometry, Transform
move_3 = Move(Geometry=rectangle_4.Rectangle, Motion=branch_3)  # -> Geometry, Transform
move_4 = Move(Geometry=rectangle_6.Rectangle, Motion=branch_4)  # -> Geometry, Transform
move_5 = Move(Geometry=rectangle_3.Rectangle, Motion=branch_5)  # -> Geometry, Transform
move_6 = Move(Geometry=rectangle_5.Rectangle, Motion=branch_6)  # -> Geometry, Transform
merge = Merge(
    Data1=move_2.Geometry,
    Data2=move.Geometry,
    Data3=move_5.Geometry,
    Data4=move_3.Geometry,
    Data5=move_6.Geometry,
    Data6=move_4.Geometry)
number_slider_3 = Slider(15, range=0..15)
subtraction = Subtraction(A=number_slider_2, B="1")
flatten = FlattenTree(Tree=merge, Path="{0}")
num = Number(number_slider)
num_2 = Number(number_slider)
num_3 = Number(subtraction)
group = Group(Objects=flatten)
multiplication_4 = Multiplication(A=num_3, B=num_2)
multiplication_5 = Multiplication(A=num, B=subtraction)
multiplication_6 = Multiplication(A=number_slider_3, B=multiplication_4)
series = Series(Start=0, Step=multiplication_5, Count=number_slider_3)
addition = Addition(A=multiplication_6, B=number_slider_3)
X = UnitX(Factor=series)
Y = UnitY(Factor=series)
move_7 = Move(Geometry=group, Motion=X)  # -> Geometry, Transform
planesrf = PlaneSurface(Plane=PlaneXY(0, 0, 0), XSize=multiplication_6, YSize=addition)  # -> reparameterize(Plane)
graft = GraftTree(Tree=move_7.Geometry, IncludeEmptyLists=True, IncludeNullItems=True)
X_2 = UnitX(Factor=multiplication_6)
move_8 = Move(Geometry=graft, Motion=Y)  # -> Geometry, Transform
move_9 = Move(Geometry=planesrf, Motion=X_2)  # -> Geometry, Transform
ungroup = Ungroup(Group=move_8.Geometry)  # -> flatten(Objects)
cp = ControlPoints(Curve=ungroup)  # -> simplify(Points), Weights, Knots
merge_2 = Merge(Data1=planesrf, Data2=move_9.Geometry)
graft_2 = GraftTree(Tree=cp.Points, IncludeEmptyLists=True, IncludeNullItems=True)
srf_cp = SurfaceClosestPoint(Point=graft_2, Surface=reparameterize(merge_2))  # -> Point, UVPoint, Distance
sort = SortList(Keys=srf_cp.Distance, ValuesA=srf_cp.UVPoint)  # -> Keys, ValuesA
sph = Sphere(Base=PlaneXY(0, 0, 0), Radius=Slider(100, range=0..100))  # -> reparameterize(Sphere)
item_2 = ListItem(List=sort.ValuesA, Index=0, Wrap=True)
evalsrf = EvaluateSurface(Surface=sph, Point=item_2)  # -> Point, Normal, Frame
pshift = ShiftPaths(Data=evalsrf.Point, Offset=-1)
pline = PolyLine(Vertices=pshift, Closed=False)
boundary = BoundarySurfaces(Edges=pline)
area = Area(Geometry=flatten(boundary))  # -> Area, Centroid
flatten_2 = FlattenTree(Tree=boundary, Path="{0}")
pt = ConstructPoint(XCoordinate=0, YCoordinate=0, ZCoordinate=0)
sort_2 = SortList(Keys=area.Area, ValuesA=flatten_2)  # -> Keys, ValuesA
lng = ListLength(List=flatten_2)
subtraction_2 = Subtraction(A=lng, B="1")
evalsrf_2 = EvaluateSurface(Surface=reparameterize(sort_2.ValuesA), Point=pt)  # -> Point, Normal, Frame
range = Range(Domain=Domain(0, 1), Steps=subtraction_2)
amp = Amplitude(Vector=evalsrf_2.Normal, Amplitude=Slider(10, range=0..100))
gradient = Gradient(LowerLimit=0, UpperLimit=1, Parameter=range, stops=[0: RGB(207, 207, 207), 1: RGB(158, 158, 158)])
extr = Extrude(Base=sort_2.ValuesA, Direction=amp)
preview = CustomPreview(Geometry=extr, Shader=gradient)
