# Grasshopper definition Recursive Stair.ghx (Grasshopper 0.9.76)
# plug-ins: Python Interpreter

python = PythonScript(
    x=Slider(531, range=0..1000),
    y=Slider(332, range=0..1000),
    z=Slider(43, range=0..1000),
    angle=Slider(8.68, range=0..100),
    steps=Slider(100, range=0..100))  # -> out, a; inputs steps: Int32
# ---------- python: Python ----------
import rhinoscriptsyntax as rs
import Rhino.Geometry as geo
import scriptcontext as sc



def buildStair(list, basePlane, ite):
    if ite > 0:
        step = rs.AddRectangle(basePlane, x, y*ite/steps)
        step = rs.AddPlanarSrf(step)
        step = rs.ExtrudeSurface(step, rs.AddLine([0,0,0],[0,0,z]))
        modPlane = rs.MovePlane(basePlane,rs.EvaluatePlane(basePlane,(0,0)) + (rs.EvaluatePlane(basePlane,(0,1)) - rs.EvaluatePlane(basePlane,(0,0)))*y*ite/steps + geo.Point3d(0,0,z))
        modPlane = rs.RotatePlane(modPlane,-angle,[0,0,1])
        list.append(step)
        buildStair(list,modPlane,ite-1)


stepList = []
buildStair(stepList, rs.WorldXYPlane(),steps)

a = stepList
# ---------- end python ----------
lng = ListLength(List=python.a)  # -> expr("x-1", Length)
range = Range(Domain=Domain(0, 1), Steps=lng)
gradient = Gradient(LowerLimit=0, UpperLimit=1, Parameter=range, stops=[0.15: RGB(255, 130, 160), 0.85: RGB(220, 0, 40)])
preview = CustomPreview(Geometry=python.a, Shader=gradient)
panel = Panel(python.out)
