# Grasshopper definition Basic Torque.gh (Grasshopper 0.9.76)
# plug-ins: Kangaroo Components, Kangaroo2 Components

timer = Timer(TimerInterval=20, Target=counter)  # disabled
counter = Counter(Reset=Toggle(False))
number_slider = Slider(1, range=0..1)
number_slider_2 = Slider(0.356, range=0..1)
division = Division(A=counter, B=Slider(50, range=0..1000))
mod = Modulus(A=division, B="1")
cir = Circle(Plane=PlaneXY(0, 0, 0), Radius=number_slider)
number_slider_3 = Slider(3, range=0..10)
eval = EvaluateCurve(Curve=reparameterize(cir), Parameter=mod)  # -> Point, Tangent, Angle
X = UnitX(Factor=number_slider_3)
number_slider_4 = Slider(0.15, range=0..1)
move = Move(Geometry=cir, Motion=X)  # -> Geometry, Transform
merge = Merge(Data1=cir, Data2=move.Geometry)
eval_2 = EvaluateCurve(Curve=reparameterize(move.Geometry), Parameter=Slider(0.633, range=0..1))  # -> Point, Tangent, Angle
neg = Negative(Value=number_slider_4)
area = Area(Geometry=move.Geometry)  # -> Area, Centroid
number_slider_5 = Slider(3, range=0..10)
ln = Line(StartPoint=eval.Point, EndPoint=eval_2.Point)
offset = Offset(Curve=merge, Distance=neg, Plane=PlaneXY(0, 0, 0), Corners=1)
offset_2 = Offset(Curve=merge, Distance=number_slider_4, Plane=PlaneXY(0, 0, 0), Corners=1)
merge_2 = Merge(Data1=offset, Data2=offset_2)
show = Show(G=ln)
c_script = CSharpScript(
    pt=eval_2.Point,
    center=area.Centroid,
    radius=number_slider,
    clockwise=Toggle(True),
    strength=Slider(0.5, range=0..1),
    Reference="C:\Users\flowf\AppData\Roaming\Grasshopper\Libraries\KangarooSolver.dll")  # -> out, A; inputs pt: Point3d, center: Point3d, radius: Double, clockwise: Boolean, strength: Double
# ---------- c_script: C# ----------
    A = new Torque(pt, center, radius, clockwise, strength);
# ---------- c_script: C# additional code ----------
  public class Torque : GoalObject
  {
    public double Strength;
    public double Radius;
    public Point3d CenterPt;
    public bool Clockwise;

    public Torque()
    {
    }

    public Torque(int pt, Point3d center, double radius, bool clockwise, double strength)
    {
      PIndex = new int[1] { pt };
      Move = new Vector3d[1];
      Weighting = new double[1];
      Strength = strength;
      Clockwise = clockwise;
      CenterPt = center;
      Radius = radius;
    }

    public Torque(Point3d pt, Point3d center, double radius, bool clockwise, double strength)
    {
      PPos = new Point3d[1] { pt };
      Move = new Vector3d[1];
      Weighting = new double[1];
      Strength = strength;
      Clockwise = clockwise;
      CenterPt = center;
      Radius = radius;
    }

    public override void Calculate(List<KangarooSolver.Particle> p)
    {
      Point3d currentPt = p[PIndex[0]].Position;

      Vector3d nextPt = CenterPt - currentPt;
      Vector3d force = nextPt * (nextPt.Length - Radius);

      Vector3d ptOnCrv = (Vector3d) currentPt + force - (Vector3d) CenterPt;
      ptOnCrv.Rotate(Math.PI * 0.0001, new Vector3d(0, 0, 1));
      ptOnCrv = ptOnCrv + (Vector3d) CenterPt;
      Vector3d torqueVector = ptOnCrv - (Vector3d) currentPt;

      if(Clockwise){
        Move[0] = force - torqueVector * Strength;
      }else{
        Move[0] = force + torqueVector * Strength;
      }
      Weighting[0] = 1.0;
    }

    /*
      public override object Output(List<KangarooSolver.Particle> p)
    {
      return new Line(p[PIndex[0]].Position, p[PIndex[1]].Position);
    }
    */
  }
# ---------- end c_script ----------
oncurve = OnCurve(Points=eval_2.Point, Curve=move.Geometry, Strength=Slider(100, range=0..100))  # disabled
length_line = LengthLine(Line=ln, Length=number_slider_3, Strength=10)
anchor = Anchor(Point=eval.Point, Strength=1000)
panel = Panel(c_script.out)
Z = UnitZ(Factor=number_slider_4)
loft = Loft(Curves=merge_2, Options={Adjust=False, Closed=False, LoftEnds=0, LoftSimp=0, LoftType=0, Rebuild=10, Refit=0.01})
merge_3 = Merge(
    Data1=flatten(show),
    Data2=flatten(length_line),
    Data3=flatten(anchor),
    Data4=flatten(oncurve),
    Data5=flatten(c_script.A))
extr = Extrude(Base=loft, Direction=Z)
preview = CustomPreview(Geometry=extr, Shader=ColourSwatch(SwatchColor=RGB(27, 117, 125)))
solver = Solver(
    GoalObjects=merge_3,
    Reset=Button(),
    Restart=False,
    Parallel=True,
    Threshold=1e-15,
    Tolerance=0.001,
    AddCurrent=False,
    On=Toggle(True))  # -> V, simplify(O)
bang = ExplodeTree(Data=solver.O)  # -> Branch0, Branch1
item = ListItem(List=solver.O, Index=0, Wrap=True)
end = EndPoints(Curve=item)  # -> Start, End
num = Number(number_slider_4)
merge_4 = Merge(Data1=end.Start, Data2=end.End)
neg_2 = Negative(Value=num)
offset_3 = Offset(Curve=item, Distance=neg_2, Plane=PlaneXY(0, 0, 0), Corners=1)
offset_4 = Offset(Curve=item, Distance=num, Plane=PlaneXY(0, 0, 0), Corners=1)
cir_2 = Circle(Plane=merge_4, Radius=num)
merge_5 = Merge(Data1=offset_3, Data2=offset_4)
loft_2 = Loft(Curves=merge_5, Options={Adjust=False, Closed=False, LoftEnds=0, LoftSimp=0, LoftType=0, Rebuild=10, Refit=0.01})
crv = Curve(loft_2)
merge_6 = Merge(Data1=cir_2, Data2=crv)  # -> flatten(Result)
Z_2 = UnitZ(Factor=num)
runion = RegionUnion(Curves=merge_6)
move_2 = Move(Geometry=runion, Motion=Z_2)  # -> Geometry, Transform
boundary = BoundarySurfaces(Edges=move_2.Geometry)
extr_2 = Extrude(Base=boundary, Direction=Z_2)
preview_2 = CustomPreview(Geometry=extr_2, Shader=ColourSwatch(SwatchColor=RGB(0, 234, 255)))
