# Grasshopper definition Fractal Shell.ghx (Grasshopper 0.9.76)

range = Range(Domain=Domain(0, 1), Steps=Slider(100, range=0..100))
consec = ConsecutiveDomains(Numbers=range, Additive=True)
X = UnitX(Factor=1)
pt = ConstructPoint(XCoordinate=0, YCoordinate=0, ZCoordinate=0)
dedomain = DeconstructDomain(Domain=consec)  # -> Start, End
line = LineSDL(Start=pt, Direction=X, Length=Slider(1000, range=0..1000))
bnd = Bounds(Numbers=dedomain.Start)
remap = RemapNumbers(Value=dedomain.Start, Source=bnd, Target=Domain(0, 1))  # -> Mapped, Clipped
eval = EvaluateLength(Curve=line, Length=remap.Mapped, Normalized=True)  # -> Point, Tangent, Parameter
lng = ListLength(List=eval.Point)
subtraction = Subtraction(A=lng, B="1")
pi = Pi(Factor=Slider(6, range=0..10))
range_2 = Range(Domain=pi, Steps=subtraction)
rotate = Rotate(Geometry=eval.Point, Angle=range_2, Plane=pt)  # -> Geometry, Transform
cull_i = CullIndex(List=rotate.Geometry, Indices=0, Wrap=True)
intcrv = Interpolate(Vertices=rotate.Geometry, Degree=3, Periodic=False, KnotStyle=1)  # -> flatten(Curve), Length, Domain
vec2pt = Vector2Pt(PointA=cull_i, PointB=pt, Unitize=False)  # -> Vector, Length
project = ProjectPoint(Point=cull_i, Direction=vec2pt.Vector, Geometry=intcrv.Curve)  # -> Point, Index
ln = Line(StartPoint=cull_i, EndPoint=project.Point)  # -> simplify(graft(Line))
end = EndPoints(Curve=ln)  # -> Start, End
divide = DivideCurve(Curve=reparameterize(ln), Count=10, Kinks=False)  # -> simplify(Points), Tangents, Parameters
lng_2 = ListLength(List=divide.Tangents)
Z = UnitZ(Factor=1)
series = Series(Start=0, Step=1, Count=lng_2)
pi_2 = Pi(Factor=Slider(0.5, range=0..1))
tstat = TreeStatistics(Tree=divide.Points)  # -> Paths, Length, Count
pi_3 = Pi(Factor=1)
bnd_2 = Bounds(Numbers=series)
vrot = Rotate(Vector=divide.Tangents, Axis=Z, Angle=pi_2)
lng_3 = ListLength(List=tstat.Paths)
remap_2 = RemapNumbers(Value=series, Source=bnd_2, Target=pi_3)  # -> Mapped, Clipped
series_2 = Series(Start=0, Step=1, Count=lng_3)
dom = ConstructDomain(DomainStart=Slider(0, range=0..100), DomainEnd=Slider(100, range=0..100))
sin = Sine(Value=remap_2.Mapped)
bnd_3 = Bounds(Numbers=series_2)
bnd_4 = Bounds(Numbers=sin)
remap_3 = RemapNumbers(Value=series_2, Source=bnd_3, Target=dom)  # -> simplify(graft(Mapped)), Clipped
bnd_5 = Bounds(Numbers=sin)
number_slider = Slider(211, range=0..300)
remap_4 = RemapNumbers(Value=sin, Source=bnd_4, Target=Domain(0, 1))  # -> Mapped, Clipped
remap_5 = RemapNumbers(Value=sin, Source=bnd_5, Target=remap_3.Mapped)  # -> Mapped, Clipped
graph = GraphMapper(
    remap_4.Mapped,
    x0=0,
    x1=1,
    y0=0,
    y1=1,
    container_name="Bezier",
    cpx=[0, 0.2137468904, 0.4982556403, 1],
    cpy=[0, 0.5115224123, 0.8155062199, 1])
multiplication = Multiplication(A=remap_3.Mapped, B=Slider(2.27, range=0..10))  # -> simplify(Result)
neg = Negative(Value=remap_5.Mapped)
bnd_6 = Bounds(Numbers=graph)
dom_2 = ConstructDomain(DomainStart=Slider(0, range=0..100), DomainEnd=multiplication)
remap_6 = RemapNumbers(Value=simplify(graph), Source=simplify(bnd_6), Target=dom_2)  # -> Mapped, Clipped
amp = Amplitude(Vector=simplify(vrot), Amplitude=simplify(neg))
Z_2 = UnitZ(Factor=remap_6.Mapped)
move = Move(Geometry=divide.Points, Motion=amp)  # -> Geometry, Transform
move_2 = Move(Geometry=move.Geometry, Motion=Z_2)  # -> Geometry, Transform
intcrv_2 = Interpolate(Vertices=move_2.Geometry, Degree=3, Periodic=False, KnotStyle=1)  # -> flatten(Curve), Length, Domain
makepair = MakePair(x=intcrv_2.Curve, loop=Toggle(False))  # -> out, A; inputs x: tree, loop: Boolean
# ---------- makepair: C# ----------
    DataTree<object> tree = new DataTree<object>();
    for(int i = 0; i < x.BranchCount; i++){
      List<object> planes = x.Branches[i];
      GH_Path pathO = x.Paths[i];
      int[] sample = new int[pathO.Length + 1];

      for(int t = 0; t < pathO.Length - 1; t++){
        sample[t] = pathO[t];
      }


      for(int n = 0; n < x.Branches[i].Count; n++){
        sample[pathO.Length - 1] = i;
        sample[pathO.Length] = n;

        GH_Path path = new GH_Path(sample);
        if(n < x.Branches[i].Count - 1){
          tree.Add(planes[n], path);
          tree.Add(planes[n + 1], path);
        }else if(loop){
          tree.Add(planes[x.Branches[i].Count - 1], path);
          tree.Add(planes[0], path);
        }

      }
    }

    A = tree;
# ---------- end makepair ----------
loft = Loft(Curves=makepair.A, Options={Adjust=False, Closed=False, LoftEnds=0, LoftSimp=0, LoftType=0, Rebuild=10, Refit=0.01})
lng_4 = ListLength(List=flatten(loft))  # -> expr("x-1", simplify(Length))
range_3 = Range(Domain=Domain(0, 1), Steps=lng_4)
gradient = Gradient(LowerLimit=0, UpperLimit=1, Parameter=range_3, stops=[0.0186: RGB(0, 18, 48), 1: RGB(135, 185, 255)])
preview = CustomPreview(Geometry=flatten(loft), Shader=gradient)
