# Grasshopper definition Texture Displacement.gh (Grasshopper 0.9.76)
# plug-ins: Weaverbird

number_slider = Slider(2, range=0..10)
custom_mesh_settings = SettingsCustom(
    StitchSeams=True,
    SimplePlanes=False,
    Refine=True,
    MinCount=16,
    MaxCount=400,
    AspectRatio=20,
    MaxDistance=0,
    MaxAngle=20,
    MinEdge=number_slider,
    MaxEdge=number_slider)
sph = Sphere(Base=PlaneXY(0, 0, 0), Radius=Slider(100, range=0..100))  # -> reparameterize(Sphere)
mesh = MeshBrep(Brep=sph, Settings=custom_mesh_settings)
mesh_2 = Mesh(mesh)
wbcatmullclark = WeaverbirdsCatmullClarkSubdivision(MeshCurves=mesh, Level=Slider(2, range=0..10), SmoothNakedEdges=1)
c_script = CSharpScript(m=mesh_2)  # -> out, A; inputs m: Mesh
# ---------- c_script: C# ----------
    A = m.TextureCoordinates;
# ---------- end c_script ----------
image = ImageSampler(
    c_script.A,
    FilePath="D:\User\Documents\odrive\Google Drive\JH\Projects\[051] GrasshopperHowtos\GH Files\GrasshopperHowtos\0018 Texture Displacement\noise1.jpg",
    Filter="Value",
    Interpolate=False,
    Umax=1,
    Umin=0,
    Vmax=1,
    Vmin=0,
    Wrap=1)
image_2 = ImageSampler(
    c_script.A,
    FilePath="D:\User\Documents\odrive\Google Drive\JH\Projects\[051] GrasshopperHowtos\GH Files\GrasshopperHowtos\0018 Texture Displacement\noise2.jpg",
    Filter="Value",
    Interpolate=False,
    Umax=1,
    Umin=0,
    Vmax=1,
    Vmin=0,
    Wrap=2)
image_3 = ImageSampler(
    c_script.A,
    FilePath="D:\User\Documents\odrive\Google Drive\JH\Projects\[051] GrasshopperHowtos\GH Files\GrasshopperHowtos\0018 Texture Displacement\noise1.jpg",
    Filter="Colour",
    Interpolate=False,
    Umax=1,
    Umin=0,
    Vmax=1,
    Vmin=0,
    Wrap=1)
image_4 = ImageSampler(
    c_script.A,
    FilePath="D:\User\Documents\odrive\Google Drive\JH\Projects\[051] GrasshopperHowtos\GH Files\GrasshopperHowtos\0018 Texture Displacement\noise2.jpg",
    Filter="Colour",
    Interpolate=False,
    Umax=1,
    Umin=0,
    Vmax=1,
    Vmin=0,
    Wrap=2)
mcol = MeshColours(Mesh=mesh_2, Colours=image_4)
demesh = DeconstructMesh(Mesh=mcol)  # -> Vertices, Faces, Colours, Normals
remap = RemapNumbers(Value=image_2, Source=Domain(0, 1), Target=Slider(100, range=0..100))  # -> Mapped, Clipped
amp = Amplitude(Vector=demesh.Normals, Amplitude=remap.Mapped)
move = Move(Geometry=demesh.Vertices, Motion=amp)  # -> Geometry, Transform
conmesh = ConstructMesh(Vertices=move.Geometry, Faces=demesh.Faces, Colours=demesh.Colours)
wbcatmullclark_2 = WeaverbirdsCatmullClarkSubdivision(MeshCurves=conmesh, Level=1, SmoothNakedEdges=1)
