# Grasshopper definition Hexagonal Bagworm.ghx (Grasshopper 0.9.76)
# plug-ins: Kangaroo Components

pt = ConstructPoint(XCoordinate=0, YCoordinate=0, ZCoordinate=0)
number_slider = Slider(20, range=0..100)
sph = Sphere(Base=pt, Radius=Slider(100, range=0..100))
number_slider_2 = Slider(4, range=0..10)
sdivide = DivideSurface(Surface=sph, UCount=number_slider, VCount=Slider(14, range=0..20))  # -> simplify(Points), Normals, Parameters
pi = Pi(Factor=1)
division = Division(A=pi, B=number_slider)
flip = FlipMatrix(Data=sdivide.Points)
group = Group(Objects=flip)
flatten = FlattenTree(Tree=group, Path="{0}")
lng = ListLength(List=flatten)
subtraction = Subtraction(A=lng, B=number_slider_2)
subtraction_2 = Subtraction(A=subtraction, B=1)
firstlastitem = FirstLastItem(list=flatten(group))  # -> first_item, rest_item, last_item
dom = ConstructDomain(DomainStart=number_slider_2, DomainEnd=subtraction_2)
subset = SubList(List=flatten, Domain=dom, Wrap=True)  # -> List, Index
dispatch = Dispatch(List=subset.List, DispatchPattern=[True, False])  # -> simplify(ListA), simplify(ListB)
rotate = Rotate(Geometry=dispatch.ListA, Angle=division, Plane=PlaneXY(0, 0, 0))  # -> Geometry, Transform
weave = Weave(Pattern=[0, 1], Stream0=rotate.Geometry, Stream1=dispatch.ListB, NullGaps=False)
dom_2 = ConstructDomain(DomainStart=Slider(256, range=0..500), DomainEnd=Slider(46, range=0..100))
ungroup = Ungroup(Group=weave)  # -> simplify(Objects)
duppt = RemoveDuplicatePts(Points=ungroup, Tolerance=0.01)
pline = PolyLine(Vertices=duppt, Closed=True)
tstat = TreeStatistics(Tree=pline)  # -> Paths, Length, Count
lng_2 = ListLength(List=tstat.Paths)  # -> expr("x-1", Length)
range = Range(Domain=dom_2, Steps=lng_2)
area = Area(Geometry=pline)  # -> Area, Centroid
graft = GraftTree(Tree=range, IncludeEmptyLists=True, IncludeNullItems=True)  # -> simplify(Tree)
Z = UnitZ(Factor=graft)
move = Move(Geometry=area.Centroid, Motion=Z)  # -> Geometry, Transform
explode = Explode(Curve=pline, Recursive=True)  # -> Segments, Vertices
end = EndPoints(Curve=explode.Segments)  # -> simplify(Start), simplify(End)
eval = EvaluateLength(Curve=explode.Segments, Length=0.5, Normalized=True)  # -> Point, Tangent, Parameter
extr = ExtrudePoint(Base=explode.Segments, Point=move.Geometry)
vec2pt = Vector2Pt(PointA=end.Start, PointB=move.Geometry, Unitize=False)  # -> Vector, Length
vec2pt_2 = Vector2Pt(PointA=end.End, PointB=move.Geometry, Unitize=False)  # -> Vector, Length
vec2pt_3 = Vector2Pt(PointA=eval.Point, PointB=move.Geometry, Unitize=False)  # -> Vector, Length
number_slider_3 = Slider(14, range=0..100)
merge = Merge(Data1=simplify(graft(end.Start)), Data2=simplify(graft(end.End)))
merge_2 = Merge(Data1=simplify(graft(vec2pt.Vector)), Data2=simplify(graft(vec2pt_2.Vector)))
line = LineSDL(Start=eval.Point, Direction=vec2pt_3.Vector, Length=number_slider_3)
line_2 = LineSDL(Start=merge, Direction=merge_2, Length=number_slider_3)
number_slider_4 = Slider(2, range=0..10)
end_2 = EndPoints(Curve=line)  # -> Start, End
end_3 = EndPoints(Curve=line_2)  # -> Start, End
scale = Scale(Geometry=line, Center=end_2.End, Factor=number_slider_4)  # -> Geometry, Transform
scale_2 = Scale(Geometry=line_2, Center=end_3.End, Factor=number_slider_4)  # -> Geometry, Transform
scale_3 = Scale(Geometry=scale.Geometry, Center=eval.Point, Factor=Slider(1.5, range=0..10))  # -> simplify(graft(Geometry)), Transform
md_slider = MDSlider(slider_value=Point(0.5, 0.5, 0.5), SliderMode=0, x_domain=Domain(0, 1), y_domain=Domain(0, 1), z_domain=Domain(0, 1))
weave_2 = Weave(Pattern=[0, 1], Stream0=scale_2.Geometry, Stream1=scale_3.Geometry, NullGaps=False)
loft = Loft(Curves=weave_2, Options={Adjust=False, Closed=False, LoftEnds=0, LoftSimp=0, LoftType=3, Rebuild=10, Refit=0.01})
evalsrf = EvaluateSurface(Surface=reparameterize(loft), Point=md_slider)  # -> Point, Normal, Frame
amp = Amplitude(Vector=evalsrf.Normal, Amplitude=Slider(1, range=0..10))
extr_2 = Extrude(Base=loft, Direction=amp)
smesh = SimpleMesh(Brep=extr_2)
meshnormalize = MeshNormalize(mesh=smesh)  # -> out, A; inputs mesh: Mesh
# ---------- meshnormalize: C# ----------
    if(mesh != null){
      mesh.Normals.ComputeNormals();

      A = mesh;
    }
# ---------- end meshnormalize ----------
preview = CustomPreview(Geometry=meshnormalize.A, Shader=ColourSwatch(SwatchColor=RGB(255, 191, 82)))

# ==== cluster FirstLastItem
list = ClusterInput()
lng = ListLength(List=list)  # -> expr("x-1", Length)
cull_i = CullIndex(List=list, Indices=lng, Wrap=False)
item = ListItem(List=list, Index=lng, Wrap=False)  # -> simplify(Element)
item_2 = ListItem(List=list, Index=0, Wrap=False)  # -> simplify(Element)
cull_i_2 = CullIndex(List=cull_i, Indices=0, Wrap=False)  # -> simplify(List)
rest_item = ClusterOutput(cull_i_2)
last_item = ClusterOutput(item)
first_item = ClusterOutput(item_2)
