# Grasshopper definition 0021 Packed Chair.ghx (Grasshopper 0.9.76)
# plug-ins: MeshEdit Components, Kangaroo Components, Kangaroo2 Components

number_slider = Slider(100, range=0..100)
rectangle = Rectangle(Plane=PlaneXY(0, 0, 0), XSize=number_slider, YSize=number_slider, Radius=0)  # -> Rectangle, Length
num = Number(number_slider)
area = Area(Geometry=rectangle.Rectangle)  # -> Area, Centroid
pop2d = Populate2D(Region=rectangle.Rectangle, Count=Slider(200, range=0..1000), Seed=1)
pop2d_2 = Populate2D(Region=rectangle.Rectangle, Count=Slider(2, range=0..10), Seed=Slider(332, range=0..1000))
division = Division(A=num, B=2.5)
graft = GraftTree(Tree=pop2d_2, IncludeEmptyLists=True, IncludeNullItems=True)
cir = Circle(Plane=area.Centroid, Radius=division)
dist = Distance(PointA=graft, PointB=pop2d)  # -> simplify(Distance)
min = Minimum(A=dist, B=Slider(40, range=0..100))
bnd = Bounds(Numbers=flatten(min))
dom = ConstructDomain(DomainStart=Slider(0.5, range=0..1), DomainEnd=Slider(1, range=0..10))
remap = RemapNumbers(Value=min, Source=bnd, Target=dom)  # -> Mapped, Clipped
scale = Scale(Geometry=pop2d, Center=graft, Factor=remap.Mapped)  # -> Geometry, Transform
vec2pt = Vector2Pt(PointA=pop2d, PointB=scale.Geometry, Unitize=False)  # -> Vector, Length
flip = FlipMatrix(Data=vec2pt.Vector)
ma = MassAddition(Input=flip)  # -> flatten(Result), PartialResults
move = Move(Geometry=pop2d, Motion=ma.Result)  # -> Geometry, Transform
del = DelaunayMesh(Points=move.Geometry, Plane=PlaneXY(0, 0, 0))
rad = Radians(Degrees=Slider(0, range=0..100))
medges = MeshEdges(Mesh=del)  # -> NakedEdges, InteriorEdges, NonManifoldEdges
explode = MeshExplode(Mesh=del, Interpolate=False)
crv = Curve(medges.NakedEdges)
end = EndPoints(Curve=crv)  # -> Start, End
merge = Merge(Data1=end.Start, Data2=end.End)
graft_2 = GraftTree(Tree=explode, IncludeEmptyLists=True, IncludeNullItems=True)
duppt = RemoveDuplicatePts(Points=merge, Tolerance=0.01)
meshcp = MeshClosestPoint(Point=duppt, Mesh=graft_2)  # -> Point, Index, Parameter
dist_2 = Distance(PointA=duppt, PointB=meshcp.Point)
smaller = SmallerThan(FirstNumber=dist_2, SecondNumber=Slider(0.01, range=0..0.01))  # -> SmallerThan, OrEqualTo
ma_2 = MassAddition(Input=smaller.SmallerThan)  # -> flatten(Result), PartialResults
not = GateNot(A=ma_2.Result)
cull = CullPattern(List=explode, CullPattern=not)
mjoin = MeshJoin(Meshes=cull)
weld = WeldMesh(Mesh=mjoin, Angle=3.141592654)
meshnormalize = MeshNormalize(mesh=weld)  # -> out, A; inputs mesh: Mesh
# ---------- meshnormalize: C# ----------
    if(mesh != null){
      mesh.Normals.ComputeNormals();

      A = mesh;
    }
# ---------- end meshnormalize ----------
mesh = Mesh(meshnormalize.A)
demesh = DeconstructMesh(Mesh=mesh)  # -> Vertices, Faces, Colours, Normals
lng = ListLength(List=demesh.Vertices)
series = Series(Start=0, Step=1, Count=lng)  # -> simplify(Series)
int = Integer(graft(series))
vn = VertexNeighbours(Mesh=mesh, VertexNumber=int)  # -> simplify(Vertex), simplify(Neighbours), Normal
ln = Line(StartPoint=vn.Vertex, EndPoint=vn.Neighbours)
eval = EvaluateLength(Curve=ln, Length=Slider(0.5, range=0..1), Normalized=True)  # -> Point, Tangent, Parameter
ln_2 = Line(StartPoint=vn.Vertex, EndPoint=eval.Point)
ln_3 = Line(StartPoint=eval.Point, EndPoint=vn.Neighbours)
show = Show(G=ln_2)
duppt_2 = RemoveDuplicatePts(Points=flatten(eval.Point), Tolerance=0.01)
length_line = LengthLine(Line=ln_2, Length=ln_2, Strength=10)
equallength = EqualLength(Line=ln_2, Strength=Slider(1000, range=0..1000))
angle = Angle(LineA=ln_2, LineB=ln_3, RestAngle=rad, Strength=Slider(1000, range=0..1000))
flatten = FlattenTree(Tree=show, Path="{0}")
cpc = CurvePointCollide(Points=duppt_2, Curve=cir, Plane=PlaneXY(0, 0, 0), Interior=Toggle(True), Strength=Slider(1, range=0..1))
merge_2 = Merge(Data1=flatten(flatten), Data2=flatten(length_line), Data3=flatten(equallength), Data4=flatten(angle), Data5=flatten(cpc))
lng_2 = ListLength(List=flatten)
expression = Expression(x=lng_2, Expression="x-1")
solver = Solver(
    GoalObjects=merge_2,
    Reset=Button(),
    Restart=False,
    Parallel=True,
    Threshold=1e-15,
    Tolerance=0.01,
    AddCurrent=False,
    On=Toggle(False))  # -> V, O
subset = SubList(List=solver.O, Domain=expression, Wrap=True)  # -> List, Index
unflatten = UnflattenTree(Tree=subset.List, Guide=show)
end_2 = EndPoints(Curve=unflatten)  # -> Start, End
incurve = PointInCurve(Point=end_2.End, Curve=cir)  # -> Relationship, Point
lng_3 = ListLength(List=end_2.End)
larger = LargerThan(FirstNumber=lng_3, SecondNumber=2)  # -> LargerThan, OrEqualTo
equals = Equality(FirstNumber=incurve.Relationship, SecondNumber=2)  # -> Equality, Inequality
ma_3 = MassAddition(Input=equals.Equality)  # -> Result, PartialResults
lng_4 = ListLength(List=equals.Equality)
equals_2 = Equality(FirstNumber=lng_4, SecondNumber=ma_3.Result)  # -> Equality, Inequality
and = GateAnd(A=larger.LargerThan, B=equals_2.Equality)
cull_2 = CullPattern(List=end_2.End, CullPattern=and)  # -> simplify(List)
prune = PruneTree(Tree=cull_2, Minimum=1, Maximum=0)
number_slider_2 = Slider(40, range=0..1000)
fcircle = CircleFit(Points=prune)  # -> Circle, Radius, Deviation
subtraction = Subtraction(A=number_slider_2, B=Slider(0.1, range=0..0.1))
boundary = BoundarySurfaces(Edges=fcircle.Circle)
Z = UnitZ(Factor=number_slider_2)
Z_2 = UnitZ(Factor=subtraction)
extr = Extrude(Base=boundary, Direction=Z)
extr_2 = Extrude(Base=cir, Direction=Z_2)
flatten_2 = FlattenTree(Tree=extr, Path="{0}")
cap = CapHoles(Brep=extr_2)
lng_5 = ListLength(List=flatten_2)
preview = CustomPreview(Geometry=cap, Shader=ColourSwatch(SwatchColor=RGBA(0, 0, 0, 100)))
random = Random(Range=Domain(0, 1), Number=lng_5, Seed=2)
gradient = Gradient(LowerLimit=0, UpperLimit=1, Parameter=random, stops=[0.15: RGB(255, 226, 130), 0.85: RGB(219, 146, 0)])
preview_2 = CustomPreview(Geometry=flatten_2, Shader=gradient)
