# Grasshopper definition Trigometry Pipe.ghx (Grasshopper 0.9.76)

number_slider = Slider(42, range=0..100)
series = Series(Start=0, Step=Slider(59, range=0..100), Count=number_slider)
series_2 = Series(Start=0, Step=Slider(2.02, range=0..10), Count=number_slider)
series_3 = Series(Start=series, Step=Slider(6.459, range=0..10), Count=number_slider)
rad = Radians(Degrees=series_3)
neg = Negative(Value="1")
number_slider_2 = Slider(30, range=0..100)
cos = Cosine(Value=rad)
sin = Sine(Value=rad)
dom = ConstructDomain(DomainStart=neg, DomainEnd="1")
remap = RemapNumbers(Value=sin, Source=dom, Target=number_slider_2)  # -> Mapped, Clipped
remap_2 = RemapNumbers(Value=cos, Source=dom, Target=number_slider_2)  # -> Mapped, Clipped
pt = ConstructPoint(XCoordinate=series_2, YCoordinate=remap.Mapped, ZCoordinate=remap_2.Mapped)
intcrv = Interpolate(Vertices=pt, Degree=3, Periodic=False, KnotStyle=1)  # -> simplify(flatten(Curve)), Length, Domain
pipe = Pipe(Curve=intcrv.Curve, Radius=1, Caps=0)
preview = CustomPreview(
    Geometry=pipe,
    Shader={ambient=RGB(0, 0, 0), diffuse=RGB(255, 105, 180), emission=RGB(76, 32, 54), shine=0.5, specular=RGB(255, 255, 255), transparency=0})
