# Grasshopper definition Moon Module.ghx (Grasshopper 0.9.76)

number_slider = Slider(100, range=0..100)
addition = Addition(A=number_slider, B=Slider(20, range=0..100))
cir = Circle(Plane=PlaneXY(0, 0, 0), Radius=number_slider)
Y = UnitY(Factor=addition)
crv = Curve(cir)
pi = Pi(Factor="2")
move = Move(Geometry=crv, Motion=Y)  # -> Geometry, Transform
range = Range(Domain=pi, Steps="3")
cull_i = CullIndex(List=reverse(range), Indices=0, Wrap=True)  # -> reverse(List)
num = Number(addition)
rotate = Rotate(Geometry=move.Geometry, Angle=cull_i, Plane=PlaneXY(0, 0, 0))  # -> Geometry, Transform
series = Series(Start=0, Step=num, Count=Slider(10, range=0..10))
Z = UnitZ(Factor=1)
X = UnitX(Factor=1)
rad = Radians(Degrees=Slider(30, range=0..100))
rdiff = RegionDifference(CurvesA=crv, CurvesB=rotate.Geometry)
Y_2 = UnitY(Factor=series)
vrot = Rotate(Vector=X, Axis=Z, Angle=rad)
panel = Panel("""True
True
False""")
amp = Amplitude(Vector=vrot, Amplitude=num)
move_2 = Move(Geometry=rdiff, Motion=Y_2)  # -> Geometry, Transform
num_2 = Number(addition)
devec = DeconstructVector(Vector=amp)  # -> XComponent, YComponent, ZComponent
dispatch = Dispatch(List=move_2.Geometry, DispatchPattern=panel)  # -> ListA, ListB
multiplication = Multiplication(A=devec.XComponent, B=2)
geo = Geometry(dispatch.ListA)
group = Group(Objects=geo)
move_3 = Move(Geometry=group, Motion=amp)  # -> Geometry, Transform
Y_3 = UnitY(Factor=num_2)
series_2 = Series(Start=0, Step=multiplication, Count=Slider(10, range=0..10))
move_4 = Move(Geometry=move_3.Geometry, Motion=Y_3)  # -> Geometry, Transform
merge = Merge(Data1=group, Data2=move_4.Geometry)  # -> simplify(graft(Result))
X_2 = UnitX(Factor=series_2)
move_5 = Move(Geometry=merge, Motion=X_2)  # -> simplify(Geometry), Transform
ungroup = Ungroup(Group=move_5.Geometry)  # -> simplify(Objects)
number_slider_2 = Slider(50, range=0..100)
dispatch_2 = Dispatch(List=ungroup, DispatchPattern=[True, False])  # -> ListA, ListB
geo_2 = Geometry(ungroup)
geo_3 = Geometry(dispatch_2.ListA)
area = Area(Geometry=geo_2)  # -> Area, Centroid
Z_2 = UnitZ(Factor=number_slider_2)
explode = Explode(Curve=geo_3, Recursive=True)  # -> Segments, Vertices
move_6 = Move(Geometry=area.Centroid, Motion=Z_2)  # -> simplify(graft(Geometry)), Transform
explode_2 = Explode(Curve=geo_2, Recursive=True)  # -> Segments, Vertices
fcircle = CircleFit(Points=explode.Vertices)  # -> Circle, Radius, Deviation
multiplication_2 = Multiplication(A=number_slider_2, B=2)
area_2 = Area(Geometry=fcircle.Circle)  # -> Area, Centroid
merge_2 = Merge(Data1=move_6.Geometry, Data2=explode_2.Vertices)
Z_3 = UnitZ(Factor=number_slider_2)
Z_4 = UnitZ(Factor=multiplication_2)
boundary = BoundarySurfaces(Edges=geo_2)
boundary_2 = BoundarySurfaces(Edges=fcircle.Circle)
neg = Negative(Value=Z_3)
sfit = SphereFit(Points=merge_2)  # -> Center, Radius, Sphere
extr = Extrude(Base=boundary, Direction=Z_4)  # -> graft(Extrusion)
move_7 = Move(Geometry=area_2.Centroid, Motion=neg)  # -> Geometry, Transform
merge_3 = Merge(Data1=explode.Vertices, Data2=move_7.Geometry)
sfit_2 = SphereFit(Points=merge_3)  # -> Center, Radius, Sphere
bbox = BoundingBox(Content=sfit_2.Sphere, Plane=PlaneXY(0, 0, 0))  # -> Box, Box_2
move_8 = Move(Geometry=bbox.Box, Motion=Z_3)  # -> Geometry, Transform
sdiff = SolidDifference(BrepsA=sfit_2.Sphere, BrepsB=move_8.Geometry)
sint = SolidIntersection(BrepsA=sfit.Sphere, BrepsB=extr)
merge_4 = Merge(Data1=sdiff, Data2=sint)  # -> flatten(Result)
preview = CustomPreview(Geometry=merge_4, Shader=ColourSwatch(SwatchColor=RGB(73, 93, 173)))
