# Grasshopper definition Gradient Tile.ghx (Grasshopper 0.9.76)
# plug-ins: MeshEdit Components, Weaverbird, Noise 4D

pt = ConstructPoint(XCoordinate=0, YCoordinate=0, ZCoordinate=0)
sqgrid = Square(Plane=pt, Size=Slider(20, range=0..20), ExtentX=5, ExtentY=5)  # -> Cells, Points
rad = Radians(Degrees=Slider(45, range=0..100))
neg = Negative(Value=rad)
rotate = Rotate(Geometry=sqgrid.Cells, Angle=neg, Plane=pt)  # -> flatten(Geometry), Transform
centerpoint = CenterPoint(B=rotate.Geometry)
dist = Distance(PointA=pt, PointB=centerpoint)
bnd = Bounds(Numbers=flatten(dist))
dom = ConstructDomain(DomainStart=Slider(1, range=0..1), DomainEnd=Slider(10, range=0..10))
remap = RemapNumbers(Value=dist, Source=bnd, Target=dom)  # -> Mapped, Clipped
round = Round(Number=remap.Mapped)  # -> Nearest, Floor, Ceiling
mplane = MeshPlane(Boundary=rotate.Geometry, WidthCount=round.Nearest, HeightCount=round.Nearest)  # -> Mesh, Area
explode = MeshExplode(Mesh=mplane.Mesh, Interpolate=False)  # -> simplify(Faces)
medges = MeshEdges(Mesh=explode)  # -> NakedEdges, InteriorEdges, NonManifoldEdges
join = JoinCurves(Curves=medges.NakedEdges, Preserve=False)  # -> simplify(Curves)
neg_2 = Negative(Value=Slider(0.1, range=0..0.1))
offset = Offset(Curve=join, Distance=neg_2, Plane=PlaneXY(0, 0, 0), Corners=1)
mplane_2 = MeshPlane(Boundary=offset, WidthCount=10, HeightCount=10)  # -> Mesh, Area
demesh = DeconstructMesh(Mesh=mplane_2.Mesh)  # -> Vertices, Faces, Colours, Normals
perlin = PerlinNoise(Values=demesh.Vertices, Time=0, Scale=Slider(0.5, range=0..1))
bnd_2 = Bounds(Numbers=flatten(perlin))
bnd_3 = Bounds(Numbers=round.Nearest)
remap_2 = RemapNumbers(Value=round.Nearest, Source=bnd_3, Target=Domain(0, 1))  # -> Mapped, Clipped
remap_3 = RemapNumbers(Value=perlin, Source=bnd_2, Target=Slider(0.5, range=0..1))  # -> Mapped, Clipped
gradient = Gradient(LowerLimit=0, UpperLimit=1, Parameter=remap_2.Clipped, stops=[0.15: RGB(194, 126, 0), 0.85: RGB(196, 162, 47)])
Z = UnitZ(Factor=remap_3.Mapped)
move = Move(Geometry=demesh.Vertices, Motion=Z)  # -> Geometry, Transform
conmesh = ConstructMesh(Vertices=move.Geometry, Faces=demesh.Faces)  # -> simplify(Mesh)
graft = GraftTree(Tree=gradient, IncludeEmptyLists=True, IncludeNullItems=True)
neg_3 = Negative(Value=Slider(1, range=0..1))
wbthicken = WeaverbirdsMeshThicken(MeshCurves=conmesh, Distance=neg_3, OffsetType=0)
pshift = ShiftPaths(Data=simplify(wbthicken), Offset=-1)
preview = CustomPreview(Geometry=pshift, Shader=graft)

# ==== cluster CenterPoint
B = ClusterInput()
box_corners = BoxCorners(Box=B)  # -> CornerA, CornerB, CornerC, CornerD, CornerE, CornerF, CornerG, CornerH
ln = Line(PointA=box_corners.CornerA, PointB=box_corners.CornerG)
eval = EvaluateCurve(Curve=ln, Parameter=0.5)  # -> Point, Tangent, Angle
P = ClusterOutput(eval.Point)
