# Grasshopper definition Porous Fruit.ghx (Grasshopper 0.9.76)
# plug-ins: MeshEdit Components, Weaverbird

sph = Sphere(Base=PlaneXY(0, 0, 0), Radius=Slider(100, range=0..100))
popgeo = PopulateGeometry(Geometry=sph, Count=Slider(50, range=0..1000), Seed=1)
facet = FacetDome(Points=popgeo)  # -> Pattern, Dome
area = Area(Geometry=facet.Pattern)  # -> Area, Centroid
scale = Scale(Geometry=facet.Pattern, Center=area.Centroid, Factor=Slider(0.1, range=0..2))  # -> Geometry, Transform
merge = Merge(Data1=graft(facet.Pattern), Data2=graft(scale.Geometry))  # -> simplify(Result)
loft = Loft(Curves=merge, Options={Adjust=False, Closed=False, LoftEnds=0, LoftSimp=0, LoftType=0, Rebuild=10, Refit=0.01})
smesh = SimpleMesh(Brep=loft)
flatten = FlattenTree(Tree=smesh, Path="{0}")
mjoin = MeshJoin(Meshes=flatten)
neg = Negative(Value=Slider(100, range=0..100))
flatten_2 = FlattenTree(Tree=smesh, Path="{0}")
weldvertices = MeshWeldVertices(Mesh=mjoin, Tolerance=0.01)  # -> RuntimeMessage, Mesh
wbthicken = WeaverbirdsMeshThicken(MeshCurves=weldvertices.Mesh, Distance=5, OffsetType=0)
wbthicken_2 = WeaverbirdsMeshThicken(MeshCurves=flatten_2, Distance=neg, OffsetType=0)
merge_2 = Merge(Data1=flatten(wbthicken), Data2=flatten(wbthicken_2))  # -> flatten(Result)
mjoin_2 = MeshJoin(Meshes=merge_2)
weldvertices_2 = MeshWeldVertices(Mesh=mjoin_2, Tolerance=0.01)  # -> RuntimeMessage, Mesh
pt = ConstructPoint(XCoordinate=0, YCoordinate=0, ZCoordinate=0)
wbcatmullclark = WeaverbirdsCatmullClarkSubdivision(MeshCurves=weldvertices_2.Mesh, Level=Slider(3, range=0..10), SmoothNakedEdges=1)
demesh = DeconstructMesh(Mesh=wbcatmullclark)  # -> Vertices, Faces, Colours, Normals
dist = Distance(PointA=pt, PointB=demesh.Vertices)
bnd = Bounds(Numbers=dist)
remap = RemapNumbers(Value=dist, Source=bnd, Target=Domain(0, 1))  # -> Mapped, Clipped
gradient = Gradient(LowerLimit=0, UpperLimit=1, Parameter=remap.Mapped, stops=[0: RGB(220, 0, 40), 1: RGB(255, 130, 160)])
conmesh = ConstructMesh(Vertices=demesh.Vertices, Faces=demesh.Faces, Colours=gradient)
