# Grasshopper definition Minimal Twisting.ghx (Grasshopper 0.9.76)
# plug-ins: MeshEdit Components, Weaverbird

number_slider = Slider(21, range=0..30)
number_slider_2 = Slider(78, range=0..100)
rad = Radians(Degrees=Slider(22, range=0..100))
rectangle = Rectangle(Plane=PlaneXY(0, 0, 0), XSize=Slider(297, range=0..1000), YSize=Slider(252, range=0..1000), Radius=0)  # -> Rectangle, Length
multiplication = Multiplication(A=number_slider, B=number_slider_2)
series = Series(Start=0, Step=rad, Count=number_slider)
series_2 = Series(Start=0, Step=number_slider_2, Count=number_slider)
area = Area(Geometry=rectangle.Rectangle)  # -> Area, Centroid
Z = UnitZ(Factor=1)
Z_2 = UnitZ(Factor=series_2)
line = LineSDL(Start=area.Centroid, Direction=Z, Length=multiplication)
rotate = Rotate(Geometry=rectangle.Rectangle, Angle=series, Plane=area.Centroid)  # -> Geometry, Transform
move = Move(Geometry=rotate.Geometry, Motion=Z_2)  # -> Geometry, Transform
makepair = MakePair(x=move.Geometry)  # -> out, A; inputs x: tree, loop: Boolean
# ---------- makepair: C# ----------
    DataTree<object> tree = new DataTree<object>();
    for(int i = 0; i < x.BranchCount; i++){
      List<object> planes = x.Branches[i];
      GH_Path pathO = x.Paths[i];
      int[] sample = new int[pathO.Length + 1];

      for(int t = 0; t < pathO.Length - 1; t++){
        sample[t] = pathO[t];
      }


      for(int n = 0; n < x.Branches[i].Count; n++){
        sample[pathO.Length - 1] = i;
        sample[pathO.Length] = n;

        GH_Path path = new GH_Path(sample);
        if(n < x.Branches[i].Count - 1){
          tree.Add(planes[n], path);
          tree.Add(planes[n + 1], path);
        }else if(loop){
          tree.Add(planes[x.Branches[i].Count - 1], path);
          tree.Add(planes[0], path);
        }

      }
    }

    A = tree;
# ---------- end makepair ----------
panel = Panel(makepair.A)
loft = Loft(Curves=makepair.A, Options={Adjust=False, Closed=False, LoftEnds=0, LoftSimp=0, LoftType=3, Rebuild=10, Refit=0.01})
debrep = DeconstructBrep(Brep=loft)  # -> Faces, Edges, Vertices
group = Group(Objects=debrep.Faces)
dispatch = Dispatch(List=flatten(group), DispatchPattern=[True, False])  # -> ListA, ListB
ungroup = Ungroup(Group=dispatch.ListA)
ungroup_2 = Ungroup(Group=dispatch.ListB)
dispatch_2 = Dispatch(List=ungroup_2, DispatchPattern=[True, False])  # -> ListA, ListB
dispatch_3 = Dispatch(List=ungroup, DispatchPattern=[True, False])  # -> ListA, ListB
merge = Merge(Data1=dispatch_3.ListB, Data2=dispatch_2.ListA)
group_2 = Group(Objects=dispatch_3.ListA)  # -> flatten(Group)
group_3 = Group(Objects=dispatch_2.ListB)  # -> flatten(Group)
merge_2 = Merge(Data1=group_2, Data2=group_3)
ungroup_3 = Ungroup(Group=merge_2)
crv = Curve(ungroup_3)
centerpoint = CenterPoint(B=crv)
scale = Scale(Geometry=crv, Center=centerpoint, Factor=Slider(0.7, range=0..1))  # -> Geometry, Transform
graft = GraftTree(Tree=crv, IncludeEmptyLists=True, IncludeNullItems=True)  # -> simplify(Tree)
graft_2 = GraftTree(Tree=scale.Geometry, IncludeEmptyLists=True, IncludeNullItems=True)  # -> simplify(Tree)
item = ListItem(List=scale.Geometry, Index=1, Wrap=True)
item_2 = ListItem(List=scale.Geometry, Index=0, Wrap=True)
merge_3 = Merge(Data1=graft, Data2=graft_2)
flip = FlipCurve(Curve=item)  # -> Curve, Flag
merge_4 = Merge(Data1=item_2, Data2=flip.Curve)
loft_2 = Loft(Curves=merge_3, Options={Adjust=False, Closed=False, LoftEnds=0, LoftSimp=0, LoftType=0, Rebuild=10, Refit=0.01})  # -> flatten(Loft)
item_3 = ListItem(List=reverse(move.Geometry), Index=0, Wrap=True)
item_4 = ListItem(List=move.Geometry, Index=0, Wrap=True)
loft_3 = Loft(Curves=merge_4, Options={Adjust=True, Closed=False, LoftEnds=0, LoftSimp=0, LoftType=0, Rebuild=10, Refit=0.01})  # -> flatten(Loft)
merge_5 = Merge(Data1=item_4, Data2=item_3)
smesh = SimpleMesh(Brep=merge)
smesh_2 = SimpleMesh(Brep=loft_2)
smesh_3 = SimpleMesh(Brep=loft_3)
boundary = BoundarySurfaces(Edges=merge_5)
smesh_4 = SimpleMesh(Brep=boundary)
flip_2 = MeshFlip(Mesh=smesh)
merge_6 = Merge(Data1=flatten(smesh_4), Data2=flatten(flip_2), Data3=flatten(smesh_2), Data4=flatten(smesh_3))
mjoin = MeshJoin(Meshes=merge_6)
weldvertices = MeshWeldVertices(Mesh=mjoin, Tolerance=0.01)  # -> RuntimeMessage, Mesh
wbcatmullclark = WeaverbirdsCatmullClarkSubdivision(MeshCurves=weldvertices.Mesh, Level=Slider(3, range=0..10), SmoothNakedEdges=1)
crv_2 = Curve(line)
demesh = DeconstructMesh(Mesh=wbcatmullclark)  # -> Vertices, Faces, Colours, Normals
crv_cp = CurveClosestPoint(Point=demesh.Vertices, Curve=crv_2)  # -> Point, Parameter, Distance
pdecon = Deconstruct(Point=demesh.Vertices)  # -> XComponent, YComponent, ZComponent
bnd = Bounds(Numbers=crv_cp.Distance)
bnd_2 = Bounds(Numbers=pdecon.ZComponent)
remap = RemapNumbers(Value=crv_cp.Distance, Source=bnd, Target=Domain(0, 1))  # -> Mapped, Clipped
remap_2 = RemapNumbers(Value=pdecon.ZComponent, Source=bnd_2, Target=Domain(0, 1))  # -> Mapped, Clipped
gradient = Gradient(LowerLimit=0, UpperLimit=1, Parameter=remap_2.Mapped, stops=[0: RGB(15, 0, 219), 1: RGB(130, 172, 255)])
multiplication_2 = Multiplication(A=remap.Mapped, B=gradient)
mcol = MeshColours(Mesh=wbcatmullclark, Colours=multiplication_2)

# ==== cluster CenterPoint
B = ClusterInput()
box_corners = BoxCorners(Box=B)  # -> CornerA, CornerB, CornerC, CornerD, CornerE, CornerF, CornerG, CornerH
ln = Line(PointA=box_corners.CornerA, PointB=box_corners.CornerG)
eval = EvaluateCurve(Curve=ln, Parameter=0.5)  # -> Point, Tangent, Angle
P = ClusterOutput(eval.Point)
