# Grasshopper definition Spiral Cactus.ghx (Grasshopper 0.9.76)

pt = ConstructPoint(XCoordinate=0, YCoordinate=0, ZCoordinate=0)
X = UnitX(Factor=1)
line = LineSDL(Start=pt, Direction=X, Length=Slider(100, range=0..100))
number_slider = Slider(100, range=0..100)
pi = Pi(Factor=Slider(4, range=0..10))
divide = DivideCurve(Curve=line, Count=number_slider, Kinks=False)  # -> Points, Tangents, Parameters
range = Range(Domain=pi, Steps=number_slider)
graph = GraphMapper(
    divide.Parameters,
    x0=0,
    x1=1,
    y0=0,
    y1=1,
    container_name="Bezier",
    cpx=[0, 0.4039855003, 1, 1],
    cpy=[0, 0, 0.5144927502, 1])
rotate = Rotate(Geometry=divide.Points, Angle=range, Plane=PlaneXY(0, 0, 0))  # -> Geometry, Transform
pi_2 = Pi(Factor="2")
pi_3 = Pi(Factor="2")
dom = ConstructDomain(DomainStart=Slider(66.64, range=0..100), DomainEnd=Slider(4.11, range=0..100))
division = Division(A=pi_2, B=Slider(5, range=0..10))
range_2 = Range(Domain=pi_3, Steps=Slider(5, range=0..10))  # -> reverse(Range)
division_2 = Division(A=division, B=2)
intcrv = Interpolate(Vertices=rotate.Geometry, Degree=3, Periodic=False, KnotStyle=1)  # -> Curve, Length, Domain
remap = RemapNumbers(Value=graph, Source=Domain(0, 1), Target=dom)  # -> Mapped, Clipped
cull_i = CullIndex(List=range_2, Indices=0, Wrap=True)  # -> reverse(List)
number_slider_2 = Slider(60, range=0..100)
neg = Negative(Value=division_2)
Z = UnitZ(Factor=Slider(20, range=0..100))
Z_2 = UnitZ(Factor=remap.Mapped)
neg_2 = Negative(Value=Slider(45.89, range=0..100))
merge = Merge(Data1=neg, Data2=division_2)
multiplication = Multiplication(A=neg_2, B=2)
move = Move(Geometry=intcrv.Curve, Motion=Z)  # -> Geometry, Transform
move_2 = Move(Geometry=rotate.Geometry, Motion=Z_2)  # -> Geometry, Transform
rotate_2 = Rotate(Geometry=intcrv.Curve, Angle=merge, Plane=PlaneXY(0, 0, 0))  # -> Geometry, Transform
graft = GraftTree(Tree=cull_i, IncludeEmptyLists=True, IncludeNullItems=True)  # -> simplify(Tree)
merge_2 = Merge(Data1="0", Data2=neg_2, Data3=multiplication)
intcrv_2 = Interpolate(Vertices=move_2.Geometry, Degree=3, Periodic=False, KnotStyle=1)  # -> Curve, Length, Domain
weave = Weave(Pattern=[0, 1], Stream0=rotate_2.Geometry, Stream1=intcrv_2.Curve, NullGaps=False)
ext = ExtendCurve(Curve=weave, Type=0, Start=Slider(0, range=0..100), End=merge_2)  # -> reparameterize(Curve)
range_3 = Range(Domain=Domain(0, 1), Steps=number_slider_2)
graph_2 = GraphMapper(
    range_3,
    x0=0,
    x1=1,
    y0=0,
    y1=1,
    container_name="Bezier",
    cpx=[0, 0.6014492512, 0.7565219402, 1],
    cpy=[0, 0.1449275613, 0.5318841934, 1])
eval = EvaluateCurve(Curve=graft(ext), Parameter=graph_2)  # -> simplify(Point), Tangent, Angle
flip = FlipMatrix(Data=eval.Point)
firstlastitem = FirstLastItem(list=flip)  # -> first_item, rest_item, last_item
tree_branch_index = TreeBranchIndex(T=eval.Tangent, i=1)
pline = PolyLine(Vertices=flip, Closed=True)
boundary = BoundarySurfaces(Edges=pline)  # -> flatten(Surfaces)
ln = Line(StartPoint=firstlastitem.first_item, EndPoint=firstlastitem.last_item)
dom_2 = ConstructDomain(DomainStart=Slider(0, range=0..100), DomainEnd=Slider(41, range=0..100))
midpoint = MidPoint(crv=ln)  # -> flatten(pt)
range_4 = Range(Domain=dom_2, Steps=expr("x-1", number_slider_2))
range_5 = Range(Domain=Domain(0, 1), Steps=expr("x-1", number_slider_2))
cull_i_2 = CullIndex(List=tree_branch_index, Indices=0, Wrap=True)
cull_i_3 = CullIndex(List=midpoint, Indices=0, Wrap=True)
rad = Radians(Degrees=range_4)
gradient = Gradient(LowerLimit=0, UpperLimit=1, Parameter=range_5, stops=[0: RGB(0, 135, 32), 1: RGB(215, 255, 130)])
rot3d = Rotate3D(Geometry=boundary, Angle=rad, Center=cull_i_3, Axis=cull_i_2)  # -> Geometry, Transform
md_slider = MDSlider(slider_value=Point(0.5, 0.5, 0.5), SliderMode=0, x_domain=Domain(0, 1), y_domain=Domain(0, 1), z_domain=Domain(0, 1))
rotate_3 = Rotate(Geometry=rot3d.Geometry, Angle=graft, Plane=PlaneXY(0, 0, 0))  # -> simplify(Geometry), Transform
evalsrf = EvaluateSurface(Surface=reparameterize(rotate_3.Geometry), Point=md_slider)  # -> Point, Normal, Frame
amp = Amplitude(Vector=evalsrf.Normal, Amplitude=Slider(1, range=0..10))
extr = Extrude(Base=rotate_3.Geometry, Direction=amp)
preview = CustomPreview(Geometry=extr, Shader=gradient)

# ==== cluster FirstLastItem
list = ClusterInput()
lng = ListLength(List=list)  # -> expr("x-1", Length)
cull_i = CullIndex(List=list, Indices=lng, Wrap=False)
item = ListItem(List=list, Index=lng, Wrap=False)  # -> simplify(Element)
item_2 = ListItem(List=list, Index=0, Wrap=False)  # -> simplify(Element)
cull_i_2 = CullIndex(List=cull_i, Indices=0, Wrap=False)  # -> simplify(List)
rest_item = ClusterOutput(cull_i_2)
last_item = ClusterOutput(item)
first_item = ClusterOutput(item_2)

# ==== cluster MidPoint: Middle Point of Curve
crv = ClusterInput()
num = Number(0.5)
eval = EvaluateLength(Curve=crv, Length=num, Normalized=True)  # -> Point, Tangent, Parameter
pt = ClusterOutput(eval.Point)

# ==== cluster TreeBranchIndex
T = ClusterInput()
i = ClusterInput()
viewer = ParamViewer(T)
item = ListItem(List=viewer, Index=i, Wrap=False)
branch = TreeBranch(Tree=T, Path=item, MaintainPaths=True)
B = ClusterOutput(branch)
