# Grasshopper definition Sine Pendant.ghx (Grasshopper 0.9.76)

number_slider = Slider(100, range=0..100)
pt = ConstructPoint(XCoordinate=0, YCoordinate=0, ZCoordinate=0)
sph = Sphere(Base=pt, Radius=number_slider)
multiplication = Multiplication(A=number_slider, B=2)
box_corners = BoxCorners(Box=sph)  # -> CornerA, CornerB, CornerC, CornerD, CornerE, CornerF, CornerG, CornerH
division = Division(A=multiplication, B=Slider(12, range=0..100))
contour = Contour(Shape=sph, Point=box_corners.CornerA, Direction=Vector(0, 0, 1), Distance=division)  # -> reparameterize(simplify(Contours))
multiplication_2 = Multiplication(A=Slider(5, range=0..10), B="2")
divide = DivideCurve(Curve=contour, Count=multiplication_2, Kinks=False)  # -> Points, Tangents, simplify(Parameters)
shatter = Shatter(Curve=contour, Parameters=divide.Parameters)
midpoint = MidPoint(crv=shatter)
srf_cp = SurfaceClosestPoint(Point=simplify(midpoint), Surface=reparameterize(sph))  # -> Point, UVPoint, Distance
end = EndPoints(Curve=shatter)  # -> Start, End
number_slider_2 = Slider(0, range=0..100)
item = ListItem(List=srf_cp.Point, Index=0, Wrap=True)
evalsrf = EvaluateSurface(Surface=reparameterize(sph), Point=srf_cp.UVPoint)  # -> Point, Normal, Frame
pdecon = Deconstruct(Point=item)  # -> XComponent, YComponent, ZComponent
deplane = DeconstructPlane(Plane=evalsrf.Frame)  # -> Origin, XAxis, YAxis, ZAxis
pt_2 = ConstructPoint(XCoordinate=0, YCoordinate=0, ZCoordinate=0)
pt_3 = ConstructPoint(XCoordinate=pdecon.XComponent, YCoordinate=pdecon.YComponent, ZCoordinate=0)
dispatch = Dispatch(List=deplane.YAxis, DispatchPattern=[True, False])  # -> ListA, ListB
dispatch_2 = Dispatch(List=evalsrf.Normal, DispatchPattern=[True, False])  # -> ListA, ListB
dist = Distance(PointA=pt_2, PointB=pt_3)
rev = Reverse(Vector=dispatch.ListB)
bnd = Bounds(Numbers=flatten(dist))
remap = RemapNumbers(Value=dist, Source=bnd, Target=Domain(0, 1))  # -> Mapped, Clipped
graph = GraphMapper(remap.Mapped, x0=0, x1=1, y0=0, y1=1, container_name="Bezier", cpx=[0, 0, 0, 1], cpy=[0, 0.4782608747, 1, 1])
pt_4 = Point(pt)
dom = ConstructDomain(DomainStart=Slider(31.48, range=0..100), DomainEnd=Slider(0, range=0..100))
remap_2 = RemapNumbers(Value=graph, Source=Domain(0, 1), Target=dom)  # -> Mapped, Clipped
rad = Radians(Degrees=remap_2.Mapped)
neg = Negative(Value=rad)
vrot = Rotate(Vector=rev, Axis=dispatch_2.ListB, Angle=neg)
vrot_2 = Rotate(Vector=dispatch.ListA, Axis=dispatch_2.ListA, Angle=rad)
weave = Weave(Pattern=[0, 1], Stream0=vrot_2, Stream1=vrot, NullGaps=False)
arc = ArcSED(Start=end.Start, End=end.End, Direction=weave)  # -> Arc, Plane, Radius
join = JoinCurves(Curves=arc.Arc, Preserve=False)  # -> flatten(Curves)
reb = RebuildCurve(Curve=join, Degree=Slider(3, range=0..10), Count=Slider(70, range=0..100), Tangents=False)
dispatch_3 = Dispatch(List=reb, DispatchPattern=[True, False])  # -> ListA, ListB
scale = Scale(Geometry=dispatch_3.ListB, Center=pt_4, Factor=Slider(0.87, range=0..1))  # -> Geometry, Transform
weave_2 = Weave(Pattern=[0, 1], Stream0=dispatch_3.ListA, Stream1=scale.Geometry, NullGaps=False)
loft = Loft(Curves=weave_2, Options={Adjust=False, Closed=False, LoftEnds=0, LoftSimp=0, LoftType=3, Rebuild=10, Refit=0.01})
preview = CustomPreview(Geometry=loft, Shader=ColourSwatch(SwatchColor=RGB(74, 168, 79)))

# ==== cluster MidPoint: Middle Point of Curve
crv = ClusterInput()
num = Number(0.5)
eval = EvaluateLength(Curve=crv, Length=num, Normalized=True)  # -> Point, Tangent, Parameter
pt = ClusterOutput(eval.Point)
