# Grasshopper definition Sine Pendant_organized.ghx (Grasshopper 0.9.76)

fold_size = Slider(0.8, range=-0.1..1)
radius = Slider(100, range=0..100)
fold_nubmer = Slider(10, range=0..20)
wave_scale_ratio = Slider(0.3, range=0..1)
min_wavelength_scale = Slider(2, range=0..2)
max_wavelength_scale = Slider(1, range=0..2)
min_wave_amplitude_scale = Slider(1.2, range=0..1.5)
max_wave_amplitude_scale = Slider(3, range=0..4)
wave_number = Slider(5, range=0..10)

# ---- group: Step1 / Step1-1
pt = ConstructPoint(XCoordinate=0, YCoordinate=0, ZCoordinate=0)
num = Number(radius)
sph = Sphere(Base=pt, Radius=num)
srf = Surface(sph)

# ---- group: Step1 / Step1-2
num_2 = Number(fold_nubmer)
mod = Modulus(A=num_2, B="2")
multiplication = Multiplication(A=num, B=2)
addition = Addition(A=num_2, B=mod)
num_3 = Number("10")
subtraction = Subtraction(A=multiplication, B=num_3)
division = Division(A=subtraction, B=addition)

# ---- group: Step1 / Step 1-3
box_corners = BoxCorners(Box=srf)  # -> CornerA, CornerB, CornerC, CornerD, CornerE, CornerF, CornerG, CornerH
division_2 = Division(A=num_3, B="2")
Z = UnitZ(Factor=division_2)
move = Move(Geometry=box_corners.CornerA, Motion=Z)  # -> Geometry, Transform
contour = Contour(Shape=srf, Point=move.Geometry, Direction=Vector(0, 0, 1), Distance=division)  # -> reparameterize(simplify(Contours))

# ---- group: Step2 / Step 2-1
multiplication_2 = Multiplication(A=wave_number, B="2")
divide = DivideCurve(Curve=contour, Count=multiplication_2, Kinks=False)  # -> Points, Tangents, simplify(Parameters)
shatter = Shatter(Curve=contour, Parameters=divide.Parameters)
dispatch = Dispatch(List=shatter, DispatchPattern=[True, False])  # -> ListA, ListB
crv = Curve(dispatch.ListA)
end = EndPoints(Curve=crv)  # -> Start, End
ln = Line(StartPoint=end.Start, EndPoint=end.End)

# ---- group: Step2 / Step2-2
num_4 = Number(wave_scale_ratio)
end_2 = EndPoints(Curve=contour)  # -> Start, End
pdecon = Deconstruct(Point=end_2.Start)  # -> XComponent, YComponent, ZComponent
subtraction_2 = Subtraction(A="2", B=num_4)
flatten = FlattenTree(Tree=pdecon.ZComponent, Path="{0}")
bnd = Bounds(Numbers=flatten)
dom = ConstructDomain(DomainStart=num_4, DomainEnd=subtraction_2)
eval = EvaluateLength(Curve=ln, Length="0.5", Normalized=True)  # -> Point, Tangent, Parameter
remap = RemapNumbers(Value=pdecon.ZComponent, Source=bnd, Target=dom)  # -> Mapped, Clipped
scale = Scale(Geometry=simplify(ln), Center=eval.Point, Factor=remap.Mapped)  # -> simplify(Geometry), Transform

# ---- group: Step2 / Step2-3
end_3 = EndPoints(Curve=scale.Geometry)  # -> Start, End
weave = Weave(Pattern=[0, 1], Stream0=end_3.Start, Stream1=end_3.End, NullGaps=False)
pline = PolyLine(Vertices=weave, Closed=True)
flatten_2 = FlattenTree(Tree=pline, Path="{0}")

# ---- group: Step2 / Step2-4
neg = Negative(Value="1")
neg_2 = Negative(Value="2")
toggle = BooleanToggle(False)
shift = ShiftList(List=flatten_2, Shift=neg, Wrap=toggle)
shift_2 = ShiftList(List=shift, Shift="1", Wrap=toggle)
shift_3 = ShiftList(List=flatten_2, Shift=neg_2, Wrap=toggle)
shift_4 = ShiftList(List=flatten_2, Shift="2", Wrap=toggle)
graft = GraftTree(Tree=shift_2, IncludeEmptyLists=True, IncludeNullItems=True)  # -> simplify(Tree)
graft_2 = GraftTree(Tree=shift_4, IncludeEmptyLists=True, IncludeNullItems=True)  # -> simplify(Tree)
graft_3 = GraftTree(Tree=shift_3, IncludeEmptyLists=True, IncludeNullItems=True)  # -> simplify(Tree)
merge = Merge(Data1=graft_3, Data2=graft)
merge_2 = Merge(Data1=graft, Data2=graft_2)

# ---- group: Step2 / Step2-5
explode = Explode(Curve=merge_2, Recursive=True)  # -> simplify(Segments), Vertices
explode_2 = Explode(Curve=merge, Recursive=True)  # -> simplify(Segments), Vertices
path_mapper = PathMapper(explode_2.Segments, source="{A;B}(i)", target="{A;i}(B)")
path_mapper_2 = PathMapper(explode.Segments, source="{A;B}(i)", target="{A;i}(B)")
rev = ReverseList(List=path_mapper_2)
group = Group(Objects=path_mapper)
group_2 = Group(Objects=rev)
pshift = ShiftPaths(Data=group, Offset=-1)
pshift_2 = ShiftPaths(Data=group_2, Offset=-1)
dispatch_2 = Dispatch(List=pshift, DispatchPattern=[True, False])  # -> ListA, ListB
dispatch_3 = Dispatch(List=pshift_2, DispatchPattern=[True, False])  # -> ListA, ListB
merge_3 = Merge(Data1=dispatch_2.ListB, Data2=dispatch_3.ListA)

# ---- group: Step3 / Step3-1
ungroup = Ungroup(Group=merge_3)
item = ListItem(List=ungroup, Index=0, Wrap=True)
item_2 = ListItem(List=ungroup, Index="1", Wrap=True)
crv_2 = Curve(item)
crv_3 = Curve(item_2)
eval_2 = EvaluateLength(Curve=crv_2, Length="0.5", Normalized=True)  # -> Point, Tangent, Parameter
eval_3 = EvaluateLength(Curve=crv_3, Length="0.5", Normalized=True)  # -> Point, Tangent, Parameter
vec2pt = Vector2Pt(PointA=eval_3.Point, PointB=eval_2.Point, Unitize=False)  # -> Vector, Length
pl = ConstructPlane(Origin=eval_3.Point, XAxis=eval_3.Tangent, YAxis=vec2pt.Vector)

# ---- group: Step3 / Step3-2
crv_4 = Curve(item)
len = Length(Curve=crv_4)
flatten_3 = FlattenTree(Tree=len, Path="{0}")
num_5 = Number(min_wavelength_scale)
num_6 = Number(max_wavelength_scale)
num_7 = Number(min_wave_amplitude_scale)
num_8 = Number(max_wave_amplitude_scale)
bnd_2 = Bounds(Numbers=flatten_3)
dom_2 = ConstructDomain(DomainStart=num_5, DomainEnd=num_6)
dom_3 = ConstructDomain(DomainStart=num_7, DomainEnd=num_8)
num_9 = Number(len)
remap_2 = RemapNumbers(Value=num_9, Source=bnd_2, Target=dom_2)  # -> Mapped, Clipped
remap_3 = RemapNumbers(Value=num_9, Source=bnd_2, Target=dom_3)  # -> Mapped, Clipped
scale_nu = ScaleNU(Geometry=crv_4, Plane=pl, ScaleX=remap_2.Mapped, ScaleY=remap_3.Mapped, ScaleZ=1)  # -> Geometry, Transform

# ---- group: Step3 / Step3-3
crv_5 = Curve(scale_nu.Geometry)
end_4 = EndPoints(Curve=crv_3)  # -> Start, End
end_5 = EndPoints(Curve=crv_5)  # -> Start, End
ln_2 = Line(StartPoint=end_4.End, EndPoint=end_5.End)
ln_3 = Line(StartPoint=end_4.Start, EndPoint=end_5.Start)
merge_4 = Merge(Data1=ln_3, Data2=ln_2, Data3=crv_5)

# ---- group: Step4 / Step4-1
pshift_3 = ShiftPaths(Data=merge_4, Offset=-1)
join = JoinCurves(Curves=pshift_3, Preserve=False)  # -> simplify(Curves)
cp = ControlPoints(Curve=join)  # -> Points, Weights, Knots
cull_i = CullIndex(List=reverse(cp.Points), Indices="0", Wrap=True)  # -> reverse(List)
nurbs = NurbsCurve(Vertices=cull_i, Degree="6", Periodic=Toggle(True))  # -> simplify(Curve), Length, Domain

# ---- group: Step4 / Step4-2
flatten_4 = FlattenTree(Tree=nurbs.Curve, Path="{0}")
num_10 = Number(fold_size)
dispatch_4 = Dispatch(List=flatten_4, DispatchPattern=[True, False])  # -> ListA, ListB
bbox = BoundingBox(Content=flatten_4, Plane=PlaneXY(0, 0, 0), UnionBox=True)  # -> Box, Box_2
area = Area(Geometry=bbox.Box)  # -> Area, Centroid
scale_2 = Scale(Geometry=dispatch_4.ListB, Center=area.Centroid, Factor=num_10)  # -> Geometry, Transform
crv_6 = Curve(dispatch_4.ListA)
weave_2 = Weave(Pattern=[0, 1], Stream0=crv_6, Stream1=scale_2.Geometry, NullGaps=False)

# ---- group: Step4 / Step4-3
loft = Loft(Curves=weave_2, Options={Adjust=False, Closed=False, LoftEnds=0, LoftSimp=0, LoftType=3, Rebuild=10, Refit=0.01})
preview = CustomPreview(Geometry=loft, Shader=ColourSwatch(SwatchColor=RGB(109, 230, 232)))
