# Grasshopper definition Maze Tile.ghx (Grasshopper 0.9.76)

number_slider = Slider(100, range=0..100)
rectangle = Rectangle(Plane=PlaneXY(0, 0, 0), XSize=number_slider, YSize=number_slider, Radius=0)  # -> Rectangle, Length
explode = Explode(Curve=rectangle.Rectangle, Recursive=True)  # -> Segments, Vertices
area = Area(Geometry=rectangle.Rectangle)  # -> Area, Centroid
dispatch = Dispatch(List=explode.Segments, DispatchPattern=[True, False])  # -> ListA, ListB
yz = YZPlane(Origin=area.Centroid)
crv = Curve(dispatch.ListA)
pcx = CurvePlane(Curve=crv, Plane=yz)  # -> flatten(Points), ParamsC, ParamsP
multiplication = Multiplication(A=Slider(6, range=0..10), B="2")
pline = PolyLine(Vertices=pcx.Points, Closed=False)
midpoint = MidPoint(crv=pline)
multiplication_2 = Multiplication(A=multiplication, B="2")
scale = Scale(Geometry=pline, Center=midpoint, Factor="2")  # -> Geometry, Transform
divide = DivideCurve(Curve=scale.Geometry, Count=multiplication_2, Kinks=False)  # -> Points, Tangents, Parameters
dispatch_2 = Dispatch(List=divide.Points, DispatchPattern=[True, False])  # -> ListA, ListB
vec = VectorXYZ(XComponent="1", YComponent="1", ZComponent=0)  # -> Vector, Length
pt = Point(dispatch_2.ListB)
line = LineSDL(Start=pt, Direction=vec.Vector, Length=Slider(10000, range=0..10000))
mirror = Mirror(Geometry=line, Plane=yz)  # -> Geometry, Transform
number_slider_2 = Slider(2, range=0..10)
merge = Merge(Data1=line, Data2=mirror.Geometry)  # -> flatten(Result)
join = JoinCurves(Curves=merge, Preserve=False)
neg = Negative(Value=number_slider_2)
graft = GraftTree(Tree=join, IncludeEmptyLists=True, IncludeNullItems=True)  # -> simplify(Tree)
merge_2 = Merge(Data1=number_slider_2, Data2=neg)  # -> flatten(Result)
offset = Offset(Curve=graft, Distance=merge_2, Plane=PlaneXY(0, 0, 0), Corners=1)
number_slider_3 = Slider(12, range=0..20)
pshift = ShiftPaths(Data=offset, Offset=-1)
loft = Loft(Curves=pshift, Options={Adjust=False, Closed=False, LoftEnds=0, LoftSimp=0, LoftType=0, Rebuild=10, Refit=0.01})
crv_2 = Curve(flatten(loft))
sqgrid = Square(Plane=PlaneXY(0, 0, 0), Size=number_slider, ExtentX=number_slider_3, ExtentY=number_slider_3)  # -> flatten(Cells), Points
rdiff = RegionDifference(CurvesA=rectangle.Rectangle, CurvesB=crv_2)
area_2 = Area(Geometry=sqgrid.Cells)  # -> Area, Centroid
Z = UnitZ(Factor=Slider(30, range=0..100))
boundary = BoundarySurfaces(Edges=rdiff)
graft_2 = GraftTree(Tree=area_2.Centroid, IncludeEmptyLists=True, IncludeNullItems=True)
extr = Extrude(Base=boundary, Direction=Z)
xy = XYPlane(Origin=area.Centroid)
lng = ListLength(List=area_2.Centroid)
random = Random(Range=Slider(3, range=0..10), Number=lng, Seed=Slider(23, range=0..100), Integers=True)
orient = Orient(Geometry=extr, Source=xy, Target=graft_2)  # -> simplify(Geometry), Transform
division = Division(A=random, B=2)
pi = Pi(Factor=division)
graft_3 = GraftTree(Tree=pi, IncludeEmptyLists=True, IncludeNullItems=True)
rotate = Rotate(Geometry=orient.Geometry, Angle=graft_3, Plane=graft_2)  # -> Geometry, Transform
preview = CustomPreview(Geometry=rotate.Geometry, Shader=ColourSwatch(SwatchColor=RGB(255, 139, 71)))

# ==== cluster MidPoint: Middle Point of Curve
crv = ClusterInput()
num = Number(0.5)
eval = EvaluateLength(Curve=crv, Length=num, Normalized=True)  # -> Point, Tangent, Parameter
pt = ClusterOutput(eval.Point)
