# Grasshopper definition Alien Egg.ghx (Grasshopper 0.9.76)

number_slider = Slider(100, range=0..100)
number_slider_2 = Slider(50, range=0..100)
box = CenterBox(Base=PlaneXY(0, 0, 0), X=number_slider, Y=number_slider, Z=Slider(30, range=0..100))
dom = ConstructDomain(DomainStart=Slider(30, range=0..100), DomainEnd=Slider(90, range=0..100))
pop3d = Populate3D(Region=box, Count=Slider(8, range=0..100), Seed=1)
lng = ListLength(List=pop3d)
random = Random(Range=dom, Number=lng, Seed=Slider(32, range=0..100))
sph = Sphere(Base=pop3d, Radius=random)
lng_2 = ListLength(List=sph)
series = Series(Start=0, Step=1, Count=lng_2)  # -> graft(Series)
cull_i = CullIndex(List=sph, Indices=series, Wrap=True)  # -> simplify(List)
graft = GraftTree(Tree=sph, IncludeEmptyLists=True, IncludeNullItems=True)
popgeo = PopulateGeometry(Geometry=sph, Count=Slider(300, range=0..1000), Seed=1)  # -> simplify(Population)
bbx = BrepBrep(BrepA=graft, BrepB=cull_i)  # -> simplify(Curves), Points
facet = FacetDome(Points=popgeo)  # -> Pattern, Dome
pshift = ShiftPaths(Data=bbx.Curves, Offset=-1)
pull = PullPoint(Point=popgeo, Geometry=pshift, ClosestOnly=True)  # -> simplify(ClosestPoint), simplify(Distance)
min = Minimum(A=pull.Distance, B=Slider(50, range=0..100))
bnd = Bounds(Numbers=flatten(min))
remap = RemapNumbers(Value=min, Source=bnd, Target=Domain(0, 1))  # -> Mapped, Clipped
graph = GraphMapper(remap.Mapped, x0=0, x1=1, y0=0, y1=1, container_name="Bezier", cpx=[0, 0.3576810658, 1, 1], cpy=[0, 0, 0.5533333421, 1])
dom_2 = ConstructDomain(DomainStart=Slider(1, range=0..1), DomainEnd=Slider(0.01, range=0..1))
remap_2 = RemapNumbers(Value=graph, Source=Domain(0, 1), Target=dom_2)  # -> Mapped, Clipped
gradient = Gradient(LowerLimit=0, UpperLimit=1, Parameter=graph, stops=[0: RGB(80, 0, 219), 0.662: RGB(255, 182, 130)])
scale = Scale(Geometry=facet.Pattern, Center=popgeo, Factor=remap_2.Mapped)  # -> Geometry, Transform
boundary = BoundarySurfaces(Edges=scale.Geometry)
preview = CustomPreview(Geometry=boundary, Shader=gradient)
