# Grasshopper definition Fish Jump.ghx (Grasshopper 0.9.76)

number_slider = Slider(30, range=0..100)
pt = ConstructPoint(XCoordinate=0, YCoordinate=0, ZCoordinate=0)
Z = UnitZ(Factor=1)
line = LineSDL(Start=pt, Direction=Z, Length=Slider(100, range=0..100))
Z_2 = UnitZ(Factor=number_slider)
end = EndPoints(Curve=line)  # -> Start, End
number_slider_2 = Slider(4.1, range=0..10)
move = Move(Geometry=end.End, Motion=Z_2)  # -> Geometry, Transform
yz = YZPlane(Origin=move.Geometry)
cir = Circle(Plane=yz, Radius=number_slider)
pipe = Pipe(Curve=cir, Radius=number_slider_2, Caps=0)
pipe_2 = Pipe(Curve=line, Radius=number_slider_2, Caps=Toggle(True))
merge = Merge(Data1=pipe_2, Data2=pipe)
X = UnitX(Factor=Slider(100, range=0..100))
sunion = SolidUnion(Breps=merge)
move_2 = Move(Geometry=pt, Motion=X)  # -> Geometry, Transform
mirror = Mirror(Geometry=move_2.Geometry, Plane=PlaneYZ(0, 0, 0))  # -> Geometry, Transform
merge_2 = Merge(Data1=move_2.Geometry, Data2=mirror.Geometry)
xy = XYPlane(Origin=Point(0, 0, 0))
xy_2 = XYPlane(Origin=merge_2)
xy_3 = XYPlane(Origin=Point(0, 0, 0))
orient = Orient(Geometry=sunion, Source=xy, Target=xy_2)  # -> Geometry, Transform
orient_2 = Orient(Geometry=move.Geometry, Source=xy, Target=xy_2)  # -> Geometry, Transform
avr = Average(Input=orient_2.Geometry)
preview = CustomPreview(Geometry=orient.Geometry, Shader=ColourSwatch(SwatchColor=RGB(31, 214, 255)))
item = ListItem(List=orient_2.Geometry, Index=0, Wrap=True)
item_2 = ListItem(List=orient_2.Geometry, Index=1, Wrap=True)
Z_3 = UnitZ(Factor=Slider(43, range=0..100))
move_3 = Move(Geometry=avr, Motion=Z_3)  # -> Geometry, Transform
arc = Arc3Pt(PointA=item, PointB=move_3.Geometry, PointC=item_2)  # -> Arc, Plane, Radius
pt_2 = ConstructPoint(XCoordinate=0, YCoordinate=0, ZCoordinate=0)
Y = UnitY(Factor=1)
line_2 = LineSDL(Start=pt_2, Direction=Y, Length=Slider(11.1, range=0..20))
Z_4 = UnitZ(Factor=Slider(3.9, range=0..10))
eval = EvaluateLength(Curve=line_2, Length="0.5", Normalized=True)  # -> Point, Tangent, Parameter
vec2pt = Vector2Pt(PointA=eval.Point, PointB=pt_2, Unitize=False)  # -> Vector, Length
move_4 = Move(Geometry=pt_2, Motion=Z_4)  # -> Geometry, Transform
neg = Negative(Value=Slider(13, range=0..30))
move_5 = Move(Geometry=line_2, Motion=vec2pt.Vector)  # -> Geometry, Transform
X_2 = UnitX(Factor=neg)
end_2 = EndPoints(Curve=move_5.Geometry)  # -> Start, End
move_6 = Move(Geometry=move_5.Geometry, Motion=X_2)  # -> Geometry, Transform
X_3 = UnitX(Factor=Slider(48, range=0..100))
arc_2 = Arc3Pt(PointA=end_2.Start, PointB=move_4.Geometry, PointC=end_2.End)  # -> Arc, Plane, Radius
eval_2 = EvaluateLength(Curve=move_6.Geometry, Length="0.5", Normalized=True)  # -> Point, Tangent, Parameter
move_7 = Move(Geometry=pt_2, Motion=X_3)  # -> Geometry, Transform
scale = Scale(Geometry=move_6.Geometry, Center=eval_2.Point, Factor=Slider(2, range=0..10))  # -> Geometry, Transform
merge_3 = Merge(Data1=end_2.Start, Data2=move_7.Geometry)
merge_4 = Merge(Data1=arc_2.Arc, Data2=scale.Geometry)
neg_2 = Negative(Value=Slider(10, range=0..10))
avr_2 = Average(Input=merge_3)
Y_2 = UnitY(Factor=neg_2)
move_8 = Move(Geometry=avr_2, Motion=Y_2)  # -> Geometry, Transform
xz = XZPlane(Origin=Point(0, 0, 0))
arc_3 = Arc3Pt(PointA=move_7.Geometry, PointB=move_8.Geometry, PointC=end_2.Start)  # -> Arc, Plane, Radius
mirror_2 = Mirror(Geometry=move_8.Geometry, Plane=xz)  # -> Geometry, Transform
mirror_3 = Mirror(Geometry=arc_3.Arc, Plane=xz)  # -> Geometry, Transform
merge_5 = Merge(Data1=move_8.Geometry, Data2=mirror_2.Geometry)
merge_6 = Merge(Data1=arc_3.Arc, Data2=mirror_3.Geometry)
avr_3 = Average(Input=merge_5)
Z_5 = UnitZ(Factor=Slider(6.1, range=0..15))
move_9 = Move(Geometry=avr_3, Motion=Z_5)  # -> Geometry, Transform
arc_4 = Arc3Pt(PointA=move_8.Geometry, PointB=move_9.Geometry, PointC=mirror_2.Geometry)  # -> Arc, Plane, Radius
merge_7 = Merge(Data1=arc_2.Arc, Data2=arc_4.Arc)
netsurf = NetworkSurface(CurvesU=merge_6, CurvesV=merge_7, Continuity=2)
loft = Loft(Curves=merge_4, Options={Adjust=False, Closed=False, LoftEnds=0, LoftSimp=0, LoftType=0, Rebuild=10, Refit=0.01})
xy_4 = XYPlane(Origin=Point(0, 0, 0))
merge_8 = Merge(Data1=netsurf, Data2=loft)
mirror_4 = Mirror(Geometry=merge_8, Plane=xy_4)  # -> Geometry, Transform
merge_9 = Merge(Data1=merge_8, Data2=mirror_4.Geometry)
join = BrepJoin(Breps=merge_9)  # -> Breps, Closed
bbox = BoundingBox(Content=join.Breps, Plane=PlaneXY(0, 0, 0))  # -> Box, Box_2
divide = DivideCurve(Curve=arc.Arc, Count=Slider(3, range=0..10), Kinks=False)  # -> Points, Tangents, Parameters
area = Area(Geometry=bbox.Box)  # -> Area, Centroid
Z_6 = UnitZ(Factor=1)
pl = ConstructPlane(Origin=divide.Points, XAxis=divide.Tangents, YAxis=Z_6)
orient_3 = Orient(Geometry=join.Breps, Source=area.Centroid, Target=pl)  # -> Geometry, Transform
preview_2 = CustomPreview(Geometry=orient_3.Geometry, Shader=ColourSwatch(SwatchColor=RGB(255, 94, 94)))
