# Grasshopper definition Linear Pine.ghx (Grasshopper 0.9.76)
# plug-ins: MeshEdit Components, Kangaroo Components, PlanktonGh, Weaverbird, Noise 4D

pt = ConstructPoint(XCoordinate=0, YCoordinate=0, ZCoordinate=0)
msphere = MeshSphere(Base=pt, Radius=10, UCount=10, VCount=20)
sequence = Sequence(Frames=Slider(4, range=0..10))
meshmachine = MeshMachine(
    Geometry=msphere,
    Length=Slider(3.23, range=0..10),
    Flip=1,
    PullStrength=0.8,
    CurvatureAdaptivity=0,
    BoundaryScale=1,
    BoundaryDistance=5,
    Exponent=2,
    Background=0.5,
    Iterations=Slider(5, range=0..10),
    Reset=sequence)
timer = Timer(TimerInterval=20, Target=counter)  # disabled
pmesh = PlanktonMesh(meshmachine)
rev = ReverseList(List=pmesh)
counter = Counter(Reset=Toggle(False))
item = ListItem(List=rev, Index=0, Wrap=True)
multiplication = Multiplication(A=counter, B=Slider(0.05, range=0..0.1))
mesh = Mesh(item)
explode = MeshExplode(Mesh=mesh, Interpolate=False)
area = Area(Geometry=explode)  # -> Area, Centroid
perlin = PerlinNoise(Values=area.Centroid, Time=multiplication, Scale=Slider(0.15, range=0..1))
wbframe = WeaverbirdsPictureFrame(MeshPolylines=explode, Distance=Slider(19.9, range=0..30), InsetType=0)  # -> simplify(OutMesh)
neg = Negative(Value="1")
number_slider = Slider(2, range=0..10)
merge = Merge(Data1=neg, Data2="1")
wbthicken = WeaverbirdsMeshThicken(MeshCurves=wbframe, Distance=5, OffsetType=0)
dom = ConstructDomain(DomainStart=Slider(3, range=0..10), DomainEnd=Slider(10, range=0..10))
remap = RemapNumbers(Value=perlin, Source=merge, Target=dom)  # -> graft(Mapped), Clipped
wbthicken_2 = WeaverbirdsMeshThicken(MeshCurves=wbframe, Distance=remap.Mapped, OffsetType=0)
wbcatmullclark = WeaverbirdsCatmullClarkSubdivision(MeshCurves=wbthicken, Level=number_slider, SmoothNakedEdges=1)
wbcatmullclark_2 = WeaverbirdsCatmullClarkSubdivision(MeshCurves=wbthicken_2, Level=number_slider, SmoothNakedEdges=1)
demesh = DeconstructMesh(Mesh=wbcatmullclark)  # -> Vertices, Faces, Colours, Normals
dist = Distance(PointA=pt, PointB=demesh.Vertices)
bnd = Bounds(Numbers=flatten(dist))
remap_2 = RemapNumbers(Value=dist, Source=bnd, Target=Domain(0, 1))  # -> Mapped, Clipped
gradient = Gradient(LowerLimit=0, UpperLimit=1, Parameter=remap_2.Mapped, stops=[0: RGB(161, 0, 29), 1: RGB(255, 204, 216)])
mcol = MeshColours(Mesh=wbcatmullclark_2, Colours=gradient)
