# Grasshopper definition Ginkgo Window.ghx (Grasshopper 0.9.76)

number_slider = Slider(5, range=0..10)
number_slider_2 = Slider(10, range=0..10)
number_slider_3 = Slider(20, range=0..20)
number_slider_4 = Slider(5, range=0..20)
multiplication = Multiplication(A=number_slider_2, B="2")
multiplication_2 = Multiplication(A=number_slider, B="2")
neg = Negative(Value=number_slider)
pt = ConstructPoint(XCoordinate=0, YCoordinate=0, ZCoordinate=0)
pt_2 = ConstructPoint(XCoordinate=number_slider, YCoordinate=number_slider_2, ZCoordinate=0)
pt_3 = ConstructPoint(XCoordinate=neg, YCoordinate=number_slider_2, ZCoordinate=0)
pt_4 = ConstructPoint(XCoordinate=0, YCoordinate=multiplication, ZCoordinate=0)
merge = Merge(Data1=pt, Data2=pt_3, Data3=pt_4, Data4=pt_2)
pline = PolyLine(Vertices=merge, Closed=True)
area = Area(Geometry=pline)  # -> Area, Centroid
ellipse = Ellipse(Plane=area.Centroid, Radius1=number_slider, Radius2=number_slider_2)  # -> Ellipse, Focus1, Focus2
crv_cp = CurveClosestPoint(Point=merge, Curve=reparameterize(ellipse.Ellipse))  # -> Point, Parameter, Distance
shatter = Shatter(Curve=reparameterize(ellipse.Ellipse), Parameters=crv_cp.Parameter)
series = Series(Start=0, Step=multiplication_2, Count=number_slider_3)
series_2 = Series(Start=0, Step=multiplication, Count=number_slider_4)
X = UnitX(Factor=series)
split = SplitList(List=shatter, Index=Slider(2, range=0..10))  # -> ListA, ListB
bbox = BoundingBox(Content=split.ListB, Plane=PlaneXY(0, 0, 0))  # -> Box, Box_2
area_2 = Area(Geometry=bbox.Box)  # -> Area, Centroid
Y = UnitY(Factor=number_slider_2)
X_2 = UnitX(Factor=number_slider)
Y_2 = UnitY(Factor=series_2)
addition = Addition(A=X_2, B=Y)
rotate = Rotate(Geometry=split.ListB, Angle="Rad(180)", Plane=area_2.Centroid)  # -> Geometry, Transform
merge_2 = Merge(Data1=split.ListA, Data2=rotate.Geometry)  # -> flatten(Result)
graft = GraftTree(Tree=Y_2, IncludeEmptyLists=True, IncludeNullItems=True)
multiplication_3 = Multiplication(A=multiplication, B=number_slider_4)
join = JoinCurves(Curves=merge_2, Preserve=False)
multiplication_4 = Multiplication(A=multiplication_2, B=number_slider_3)
neg_2 = Negative(Value=Slider(0.6, range=0..1))
offset = Offset(Curve=join, Distance=neg_2, Plane=PlaneXY(0, 0, 0), Corners=1)
merge_3 = Merge(Data1=flatten(join), Data2=flatten(offset))
planesrf = PlaneSurface(Plane=pt, XSize=multiplication_4, YSize=multiplication_3)
neg_3 = Negative(Value=multiplication_4)
neg_4 = Negative(Value=multiplication_3)
number_slider_5 = Slider(8, range=0..10)
num = Number(Slider(10, range=0..10))
mod = Modulus(A=num, B=2)
number_slider_6 = Slider(2, range=0..10)
explode = Explode(Curve=offset, Recursive=True)  # -> Segments, Vertices
explode_2 = Explode(Curve=merge_3, Recursive=True)  # -> simplify(Segments), Vertices
addition_2 = Addition(A=num, B=mod)
series_3 = Series(Start=neg_3, Step=multiplication_4, Count="3")
series_4 = Series(Start=neg_4, Step=multiplication_3, Count="3")
srf = Surface(reparameterize(planesrf))
range = Range(Domain=Domain(0, 1), Steps=addition_2)
X_3 = UnitX(Factor=series_3)
reb = RebuildCurve(Curve=explode_2.Segments, Degree=number_slider_6, Count=number_slider_5, Tangents=False)
tstat = TreeStatistics(Tree=reb)  # -> Paths, Length, Count
graft_2 = GraftTree(Tree=series_4, IncludeEmptyLists=True, IncludeNullItems=True)
item = ListItem(List=reverse(tstat.Paths), Index=0, Wrap=True)
move = Move(Geometry=srf, Motion=X_3)  # -> Geometry, Transform
Y_3 = UnitY(Factor=graft_2)
branch = TreeBranch(Tree=reb, Path=item, MaintainPaths=True)
split_2 = SplitList(List=branch, Index=Slider(1, range=0..1))  # -> ListA, ListB
item_2 = ListItem(List=split_2.ListB, Index=0, Wrap=True)
item_3 = ListItem(List=split_2.ListB, Index=1, Wrap=True)
flip = FlipCurve(Curve=item_2)  # -> Curve, Flag
eval = EvaluateLength(Curve=split_2.ListA, Length=range, Normalized=True)  # -> Point, Tangent, Parameter
tweencrv = TweenCurve(CurveA=flip.Curve, CurveB=item_3, Factor=range, BlendType=0)
end = EndPoints(Curve=tweencrv)  # -> Start, End
move_2 = Move(Geometry=move.Geometry, Motion=Y_3)  # -> Geometry, Transform
panel = Panel("""2
1
2
1
0
1
2
1
2""")
pt_5 = Point(end.Start)
group = Group(Objects=reb)  # -> flatten(Group)
vec2pt = Vector2Pt(PointA=end.Start, PointB=end.End, Unitize=False)  # -> Vector, Length
flatten = FlattenTree(Tree=move_2.Geometry, Path="{0}")
vec2pt_2 = Vector2Pt(PointA=end.Start, PointB=eval.Point, Unitize=False)  # -> Vector, Length
cir = Circle(Plane=PlaneXY(0, 0, 0), Radius=Slider(100, range=0..100))
Z = UnitZ(Factor=Slider(200, range=0..1000))
int = Integer(panel)
vlen = VectorLength(Vector=vec2pt.Vector)
vlen_2 = VectorLength(Vector=vec2pt_2.Vector)
pl = ConstructPlane(Origin=end.Start, XAxis=vec2pt_2.Vector, YAxis=Vector(0, 1, 0))
pl_2 = ConstructPlane(Origin=end.Start, XAxis=vec2pt.Vector, YAxis=Vector(0, 1, 0))
extr = Extrude(Base=cir, Direction=Z)
multiplication_5 = Multiplication(A=int, B=Slider(0.01, range=0..1))
orient = Orient(Geometry=tweencrv, Source=pl_2, Target=pl)  # -> Geometry, Transform
division = Division(A=vlen_2, B=vlen)
transpose = Transpose(srf=extr)  # -> out, A; inputs srf: Surface
# ---------- transpose: C# ----------
    A = srf.Transpose();
# ---------- end transpose ----------
srf_2 = Surface(reparameterize(transpose.A))
scale = Scale(Geometry=orient.Geometry, Center=end.Start, Factor=division)  # -> Geometry, Transform
reb_2 = RebuildCurve(Curve=scale.Geometry, Degree=number_slider_6, Count=number_slider_5, Tangents=False)
group_2 = Group(Objects=reb_2)  # -> flatten(Group)
merge_4 = Merge(Data1=group, Data2=group_2)
group_3 = Group(Objects=merge_4)
move_3 = Move(Geometry=group_3, Motion=X)  # -> Geometry, Transform
group_4 = Group(Objects=move_3.Geometry)
move_4 = Move(Geometry=group_4, Motion=addition)  # -> Geometry, Transform
merge_5 = Merge(Data1=group_4, Data2=move_4.Geometry)
move_5 = Move(Geometry=merge_5, Motion=graft)  # -> simplify(Geometry), Transform
flatten_2 = FlattenTree(Tree=move_5.Geometry, Path="{0}")
rev = ReverseList(List=flatten_2)
cull_i = CullIndex(List=rev, Indices=0, Wrap=True)
ungroup = Ungroup(Group=cull_i)  # -> simplify(Objects)
ungroup_2 = Ungroup(Group=ungroup)
ungroup_3 = Ungroup(Group=ungroup_2)  # -> simplify(Objects)
cp = ControlPoints(Curve=ungroup_3)  # -> Points, Weights, Knots
graft_3 = GraftTree(Tree=cp.Points, IncludeEmptyLists=True, IncludeNullItems=True)  # -> simplify(Tree)
srf_cp = SurfaceClosestPoint(Point=graft_3, Surface=flatten)  # -> Point, UVPoint, simplify(Distance)
addition_3 = Addition(A=srf_cp.Distance, B=multiplication_5)  # -> simplify(Result)
sort = SortList(Keys=addition_3, ValuesA=srf_cp.UVPoint)  # -> Keys, ValuesA
item_4 = ListItem(List=sort.ValuesA, Index=0, Wrap=True)  # -> simplify(Item)
evalsrf = EvaluateSurface(Surface=srf_2, Point=item_4)  # -> simplify(Point), Normal, Frame
pshift = ShiftPaths(Data=evalsrf.Point, Offset=-1)
nurbs = NurbsCurve(Vertices=pshift, Degree="2", Periodic=False)  # -> Curve, Length, Domain
pshift_2 = ShiftPaths(Data=nurbs.Curve, Offset=-1)
group_5 = Group(Objects=pshift_2)
pshift_3 = ShiftPaths(Data=group_5, Offset=-1)
item_5 = ListItem(List=pshift_3, Index=2, Wrap=True)
item_6 = ListItem(List=pshift_3, Index=0, Wrap=True)
item_7 = ListItem(List=pshift_3, Index=1, Wrap=True)
ungroup_4 = Ungroup(Group=item_5)
ungroup_5 = Ungroup(Group=item_7)
ungroup_6 = Ungroup(Group=item_6)
cp_2 = ControlPoints(Curve=ungroup_4)  # -> simplify(Points), Weights, Knots
group_6 = Group(Objects=cp_2.Points)  # -> simplify(Group)
pshift_4 = ShiftPaths(Data=group_6, Offset=-1)
join_2 = JoinCurves(Curves=ungroup_6, Preserve=False)  # -> simplify(Curves)
lng = ListLength(List=pshift_4)
join_3 = JoinCurves(Curves=ungroup_5, Preserve=False)  # -> simplify(Curves)
series_5 = Series(Start=0, Step=1, Count=lng)
pdecon = Deconstruct(Point=cp_2.Points)  # -> XComponent, YComponent, ZComponent
merge_6 = Merge(Data1=join_2, Data2=join_3)
lng_2 = ListLength(List=cp_2.Points)  # -> expr("x-1", Length)
mod_2 = Modulus(A=series_5, B=2)  # -> simplify(Result)
pt_6 = ConstructPoint(XCoordinate=0, YCoordinate=0, ZCoordinate=pdecon.ZComponent)
range_2 = Range(Domain=Slider(5, range=0..10), Steps=lng_2)  # -> simplify(Range)
graft_4 = GraftTree(Tree=mod_2, IncludeEmptyLists=True, IncludeNullItems=True)
vec2pt_3 = Vector2Pt(PointA=cp_2.Points, PointB=pt_6, Unitize=False)  # -> Vector, Length
number_slider_7 = Slider(0.9, range=0..1)
multiplication_6 = Multiplication(A=range_2, B=graft_4)
amp = Amplitude(Vector=vec2pt_3.Vector, Amplitude=multiplication_6)
pt_7 = ConstructPoint(XCoordinate=0, YCoordinate=0, ZCoordinate=0)
crv = Curve(join_3)
move_6 = Move(Geometry=cp_2.Points, Motion=amp)  # -> Geometry, Transform
nurbs_2 = NurbsCurve(Vertices=move_6.Geometry, Degree=3, Periodic=False)  # -> simplify(Curve), Length, Domain
scale_nu = ScaleNU(Geometry=crv, Plane=pt_7, ScaleX=number_slider_7, ScaleY=number_slider_7, ScaleZ=1)  # -> Geometry, Transform
pshift_5 = ShiftPaths(Data=nurbs_2.Curve, Offset=-1)
merge_7 = Merge(Data1=crv, Data2=scale_nu.Geometry)
loft = Loft(Curves=merge_6, Options={Adjust=False, Closed=False, LoftEnds=0, LoftSimp=0, LoftType=0, Rebuild=10, Refit=0.01})
loft_2 = Loft(Curves=merge_7, Options={Adjust=False, Closed=False, LoftEnds=0, LoftSimp=0, LoftType=0, Rebuild=10, Refit=0.01})
loft_3 = Loft(Curves=pshift_5, Options={Adjust=False, Closed=False, LoftEnds=0, LoftSimp=0, LoftType=3, Rebuild=10, Refit=0.01})
merge_8 = Merge(Data1=loft_2, Data2=loft)
preview = CustomPreview(Geometry=merge_8, Shader=ColourSwatch(SwatchColor=RGB(40, 114, 161)))
preview_2 = CustomPreview(Geometry=loft_3, Shader=ColourSwatch(SwatchColor=RGB(161, 200, 255)))
