# Grasshopper definition Wood Joint.ghx (Grasshopper 0.9.76)
# plug-ins: Kangaroo Components

number_slider = Slider(1000, range=0..1000)
number_slider_2 = Slider(800, range=0..1000)
number_slider_3 = Slider(100, range=0..100)
pt = ConstructPoint(XCoordinate=0, YCoordinate=0, ZCoordinate=0)
subtraction = Subtraction(A=number_slider, B=number_slider_3)
subtraction_2 = Subtraction(A=number_slider_2, B=number_slider_3)
multiplication = Multiplication(A=number_slider_3, B=2)
pt_2 = ConstructPoint(XCoordinate=number_slider_3, YCoordinate=0, ZCoordinate=0)
subtraction_3 = Subtraction(A=number_slider, B=multiplication)
rectangle = Rectangle(Plane=pt, XSize=subtraction, YSize=subtraction_2, Radius=0)  # -> Rectangle, Length
number_slider_4 = Slider(2, range=0..10)
rectangle_2 = Rectangle(Plane=pt_2, XSize=subtraction_3, YSize=number_slider_3, Radius=0)  # -> Rectangle, Length
explode = Explode(Curve=rectangle.Rectangle, Recursive=True)  # -> Segments, Vertices
boundary = BoundarySurfaces(Edges=rectangle_2.Rectangle)
num = Number(number_slider_3)
duppt = RemoveDuplicatePts(Points=explode.Vertices, Tolerance=0.01)
subtraction_4 = Subtraction(A=Slider(700, range=0..1000), B=num)
rectangle_3 = Rectangle(Plane=duppt, XSize=number_slider_3, YSize=number_slider_3, Radius=0)  # -> Rectangle, Length
shift = ShiftList(List=rectangle_3.Rectangle, Shift=1, Wrap=True)
split = SplitList(List=rectangle_3.Rectangle, Index=number_slider_4)  # -> ListA, ListB
boundary_2 = BoundarySurfaces(Edges=rectangle_3.Rectangle)
split_2 = SplitList(List=shift, Index=number_slider_4)  # -> ListA, ListB
multiplication_2 = Multiplication(A=number_slider_3, B=2)
bbox = BoundingBox(Content=split.ListA, Plane=PlaneXY(0, 0, 0), UnionBox=True)  # -> Box, Box_2
bbox_2 = BoundingBox(Content=split.ListB, Plane=PlaneXY(0, 0, 0), UnionBox=True)  # -> Box, Box_2
Z = UnitZ(Factor=subtraction_4)
bbox_3 = BoundingBox(Content=split_2.ListA, Plane=PlaneXY(0, 0, 0), UnionBox=True)  # -> Box, Box_2
bbox_4 = BoundingBox(Content=split_2.ListB, Plane=PlaneXY(0, 0, 0), UnionBox=True)  # -> Box, Box_2
multiplication_3 = Multiplication(A=number_slider_3, B=2)
subtraction_5 = Subtraction(A=number_slider, B=multiplication_2)
merge = Merge(Data1=bbox.Box, Data2=bbox_2.Box)
debrep = DeconstructBrep(Brep=merge)  # -> Faces, Edges, Vertices
Z_2 = UnitZ(Factor=num)
extr = Extrude(Base=boundary, Direction=Z_2)
subtraction_6 = Subtraction(A=number_slider_2, B=multiplication_3)
explode_2 = Explode(Curve=rectangle_3.Rectangle, Recursive=True)  # -> Segments, Vertices
merge_2 = Merge(Data1=bbox_3.Box, Data2=bbox_4.Box)
item = ListItem(List=debrep.Edges, Index=0, Wrap=True)
graft = GraftTree(Tree=rectangle_3.Rectangle, IncludeEmptyLists=True, IncludeNullItems=True)  # -> simplify(Tree)
division = Division(A=subtraction_5, B=number_slider)
area = Area(Geometry=merge)  # -> Area, Centroid
extr_2 = Extrude(Base=boundary_2, Direction=Z)
division_2 = Division(A=subtraction_6, B=number_slider_2)
duppt_2 = RemoveDuplicatePts(Points=explode_2.Vertices, Tolerance=0.01)  # -> simplify(UniquePoints)
end = EndPoints(Curve=item)  # -> Start, End
debrep_2 = DeconstructBrep(Brep=merge_2)  # -> Faces, Edges, Vertices
division_3 = Division(A="1", B="3")
area_2 = Area(Geometry=merge_2)  # -> Area, Centroid
graft_2 = GraftTree(Tree=extr_2, IncludeEmptyLists=True, IncludeNullItems=True)  # -> simplify(Tree)
merge_3 = Merge(Data1=end.Start, Data2=end.End)  # -> simplify(Result)
scale = Scale(Geometry=graft, Center=duppt_2, Factor=division_3)  # -> Geometry, Transform
move = Move(Geometry=scale.Geometry, Motion=Z)  # -> Geometry, Transform
boundary_3 = BoundarySurfaces(Edges=move.Geometry)
extr_3 = Extrude(Base=boundary_3, Direction=Z_2)
division_4 = Division(A=number_slider_3, B=number_slider)
graft_3 = GraftTree(Tree=merge, IncludeEmptyLists=True, IncludeNullItems=True)
item_2 = ListItem(List=debrep_2.Edges, Index=1, Wrap=True)
scale_nu = ScaleNU(Geometry=merge_2, Plane=area_2.Centroid, ScaleX=1, ScaleY=division_2, ScaleZ=1)  # -> Geometry, Transform
merge_4 = Merge(Data1=graft_2, Data2=simplify(extr_3))
scale_nu_2 = ScaleNU(Geometry=graft_3, Plane=merge_3, ScaleX=division_4, ScaleY=1, ScaleZ=1)  # -> Geometry, Transform
scale_nu_3 = ScaleNU(Geometry=merge, Plane=area.Centroid, ScaleX=division, ScaleY=1, ScaleZ=1)  # -> Geometry, Transform
area_3 = Area(Geometry=scale_nu_2.Geometry)  # -> Area, simplify(Centroid)
graft_4 = GraftTree(Tree=scale_nu.Geometry, IncludeEmptyLists=True, IncludeNullItems=True)  # -> simplify(Tree)
num_2 = Number(division_3)
graft_5 = GraftTree(Tree=scale_nu_3.Geometry, IncludeEmptyLists=True, IncludeNullItems=True)  # -> simplify(Tree)
scale_nu_4 = ScaleNU(Geometry=scale_nu_2.Geometry, Plane=area_3.Centroid, ScaleX=1, ScaleY=num_2, ScaleZ=1)  # -> simplify(Geometry), Transform
num_3 = Number(number_slider_3)
Z_3 = UnitZ(Factor=num_3)
scale_nu_5 = ScaleNU(Geometry=scale_nu_4.Geometry, Plane=area_3.Centroid, ScaleX=num_2, ScaleY=1, ScaleZ=1)  # -> Geometry, Transform
division_5 = Division(A=Z_3, B=2)
extr_4 = Extrude(Base=scale_nu_4.Geometry, Direction=Z_3)
extr_5 = Extrude(Base=scale_nu_5.Geometry, Direction=division_5)  # -> simplify(Extrusion)
sdiff = SolidDifference(BrepsA=extr_4, BrepsB=extr_5)
extr_6 = Extrude(Base=graft_5, Direction=Z_3)
extr_7 = Extrude(Base=graft_4, Direction=Z_3)
merge_5 = Merge(Data1=sdiff, Data2=extr_6)
rotate = Rotate(Geometry=sdiff, Angle=1.570796327, Plane=area_3.Centroid)  # -> Geometry, Transform
bbox_5 = BoundingBox(Content=rotate.Geometry, Plane=PlaneXY(0, 0, 0))  # -> Box, Box_2
sunion = SolidUnion(Breps=merge_5)
area_4 = Area(Geometry=bbox_5.Box)  # -> Area, Centroid
mirror = Mirror(Geometry=rotate.Geometry, Plane=area_4.Centroid)  # -> simplify(Geometry), Transform
rev = ReverseList(List=mirror.Geometry)
flip = FlipMatrix(Data=rev)
merge_6 = Merge(Data1=flip, Data2=extr_7)
sunion_2 = SolidUnion(Breps=merge_6)
flatten = FlattenTree(Tree=sunion, Path="{0}")
flatten_2 = FlattenTree(Tree=sunion_2, Path="{0}")
group = Group(Objects=flatten)
group_2 = Group(Objects=flatten_2)
vec = Vector(Z)
merge_7 = Merge(Data1=group_2, Data2=group)
sunion_3 = SolidUnion(Breps=merge_4)  # -> flatten(Result)
move_2 = Move(Geometry=merge_7, Motion=vec)  # -> Geometry, Transform
group_3 = Group(Objects=sunion_3)
merge_8 = Merge(Data1=group_3, Data2=move_2.Geometry)
lng = ListLength(List=merge_8)
range = Range(Domain=Domain(0, 1), Steps=expr("x-1", lng))
gradient = Gradient(LowerLimit=0, UpperLimit=1, Parameter=range, stops=[0: RGB(255, 238, 130), 1: RGB(184, 152, 73)])
series = Series(Start=0, Step=Slider(200, range=0..200), Count=lng)
Z_4 = UnitZ(Factor=series)
move_3 = Move(Geometry=merge_8, Motion=Z_4)  # -> Geometry, Transform
preview = CustomPreview(Geometry=move_3.Geometry, Shader=gradient)
