# Grasshopper definition Star Tile.ghx (Grasshopper 0.9.76)

number_slider = Slider(10, range=0..10)
cos = Cosine(Value="Rad(30)")
rad = Radians(Degrees="60")
rad_2 = Radians(Degrees="60")
multiplication = Multiplication(A=number_slider, B="2")
multiplication_2 = Multiplication(A=number_slider, B=cos)
cos_2 = Cosine(Value=rad)
sin = Sine(Value=rad_2)
series = Series(Start=0, Step=multiplication, Count=Slider(10, range=0..10))
multiplication_3 = Multiplication(A=multiplication_2, B="4")
vec = VectorXYZ(XComponent=cos_2, YComponent=sin, ZComponent=0)  # -> Vector, Length
X = UnitX(Factor=series)
polygon = Polygon(Plane=PlaneXY(0, 0, 0), Radius=number_slider, Segments="6", FilletRadius=0)  # -> Polygon, Length
amp = Amplitude(Vector=vec.Vector, Amplitude=multiplication)
move = Move(Geometry=polygon.Polygon, Motion=X)  # -> Geometry, Transform
panel = Panel("""True
True
False""")
move_2 = Move(Geometry=move.Geometry, Motion=amp)  # -> Geometry, Transform
rev = ReverseList(List=panel)
dispatch = Dispatch(List=move.Geometry, DispatchPattern=panel)  # -> ListA, ListB
dispatch_2 = Dispatch(List=move_2.Geometry, DispatchPattern=rev)  # -> ListA, ListB
group = Group(Objects=dispatch_2.ListB)
group_2 = Group(Objects=dispatch.ListB)
merge = Merge(Data1=group_2, Data2=group)
ungroup = Ungroup(Group=merge)  # -> simplify(Objects)
crv = Curve(ungroup)
explode = Explode(Curve=crv, Recursive=True)  # -> Segments, Vertices
area = Area(Geometry=crv)  # -> Area, Centroid
eval = EvaluateLength(Curve=explode.Segments, Length="0.5", Normalized=True)  # -> simplify(Point), Tangent, Parameter
graft = GraftTree(Tree=area.Centroid, IncludeEmptyLists=True, IncludeNullItems=True)
scale = Scale(Geometry=eval.Point, Center=graft, Factor=Slider(0.71, range=0..1))  # -> simplify(graft(Geometry)), Transform
end = EndPoints(Curve=explode.Segments)  # -> simplify(graft(Start)), simplify(graft(End))
scale_2 = Scale(Geometry=eval.Point, Center=graft, Factor="2")  # -> simplify(graft(Geometry)), Transform
merge_2 = Merge(Data1=end.Start, Data2=scale.Geometry, Data3=end.End)
merge_3 = Merge(Data1=end.Start, Data2=scale_2.Geometry, Data3=end.End)
pline = PolyLine(Vertices=merge_2, Closed=False)  # -> simplify(Polyline)
pline_2 = PolyLine(Vertices=merge_3, Closed=False)  # -> simplify(Polyline)
pshift = ShiftPaths(Data=pline, Offset=-1)
merge_4 = Merge(Data1=pline, Data2=pline_2)
join = JoinCurves(Curves=pshift, Preserve=False)  # -> simplify(Curves)
join_2 = JoinCurves(Curves=merge_4, Preserve=False)  # -> simplify(Curves)
flip = FlipCurve(Curve=join_2)  # -> Curve, Flag
crv_2 = Curve(dispatch_2.ListA)
pshift_2 = ShiftPaths(Data=join, Offset=-1)
crv_3 = Curve(dispatch.ListA)
pshift_3 = ShiftPaths(Data=flip.Curve, Offset=-2)
merge_5 = Merge(Data1=pshift_2, Data2=pshift_3)
bang = ExplodeTree(Data=merge_5)  # -> Branch0, Branch1
weave = Weave(Pattern=reverse(panel), Stream0=bang.Branch1, Stream1=crv_2, NullGaps=False)
weave_2 = Weave(Pattern=panel, Stream0=bang.Branch0, Stream1=crv_3, NullGaps=False)
num = Number(multiplication_3)
group_3 = Group(Objects=weave_2)
group_4 = Group(Objects=weave)
series_2 = Series(Start=0, Step=num, Count=Slider(5, range=0..10))
merge_6 = Merge(Data1=group_3, Data2=group_4)
Y = UnitY(Factor=series_2)
group_5 = Group(Objects=merge_6)
move_3 = Move(Geometry=group_5, Motion=Y)  # -> simplify(Geometry), Transform
ungroup_2 = Ungroup(Group=move_3.Geometry)  # -> simplify(Objects)
flatten = FlattenTree(Tree=ungroup_2, Path="{0}")
ungroup_3 = Ungroup(Group=flatten)
flatten_2 = FlattenTree(Tree=ungroup_3, Path="{0}")
cp = ControlPoints(Curve=flatten_2)  # -> Points, Weights, Knots
lng = ListLength(List=cp.Points)  # -> flatten(Length)
neg = Negative(Value=Slider(1.3, range=0..10))
graft_2 = GraftTree(Tree=flatten_2, IncludeEmptyLists=True, IncludeNullItems=True)  # -> simplify(Tree)
offset = Offset(Curve=graft_2, Distance=neg, Plane=PlaneXY(0, 0, 0), Corners=1)  # -> simplify(Curve)
bnd = Bounds(Numbers=lng)
dom = ConstructDomain(DomainStart=Slider(7.5, range=0..100), DomainEnd=Slider(10, range=0..100))
merge_7 = Merge(Data1=graft_2, Data2=offset)
boundary = BoundarySurfaces(Edges=offset)
Z = UnitZ(Factor=Slider(5, range=0..10))
remap = RemapNumbers(Value=lng, Source=bnd, Target=dom)  # -> Mapped, Clipped
remap_2 = RemapNumbers(Value=lng, Source=bnd, Target=Domain(0, 1))  # -> Mapped, Clipped
boundary_2 = BoundarySurfaces(Edges=merge_7)
gradient = Gradient(
    LowerLimit=0,
    UpperLimit=1,
    Parameter=remap_2.Clipped,
    stops=[0: RGB(255, 255, 255), 0.24: RGB(38, 108, 158), 1: RGB(117, 221, 255)])
Z_2 = UnitZ(Factor=remap.Mapped)
graft_3 = GraftTree(Tree=Z_2, IncludeEmptyLists=True, IncludeNullItems=True)
extr = Extrude(Base=boundary_2, Direction=graft_3)
extr_2 = Extrude(Base=boundary, Direction=Z)
graft_4 = GraftTree(Tree=gradient, IncludeEmptyLists=True, IncludeNullItems=True)
preview = CustomPreview(Geometry=extr, Shader=ColourSwatch(SwatchColor=RGB(158, 158, 158)))
preview_2 = CustomPreview(Geometry=extr_2, Shader=graft_4)
