# Grasshopper definition Undulant Portrait.gh (Grasshopper 0.9.76)
# plug-ins: Kangaroo Components

number_slider = Slider(75, range=0..100)
number_slider_2 = Slider(10, range=0..10)
num = Number(number_slider_2)
pt = ConstructPoint(XCoordinate=0, YCoordinate=0, ZCoordinate=0)
division = Division(A=num, B=Slider(1.5, range=1..4))
multiplication = Multiplication(A=number_slider_2, B=number_slider)
sqgrid = Square(Plane=pt, Size=number_slider_2, ExtentX=number_slider, ExtentY=number_slider)  # -> Cells, Points
planesrf = PlaneSurface(Plane=pt, XSize=multiplication, YSize=multiplication)
pt_2 = Point(sqgrid.Points)
srf = Surface(reparameterize(planesrf))
flip = FlipMatrix(Data=pt_2)
pline = PolyLine(Vertices=flip, Closed=False)  # -> simplify(Polyline)
explode = Explode(Curve=pline, Recursive=True)  # -> Segments, Vertices
number_slider_3 = Slider(30, range=0..100)
num_2 = Number(division)
eval = EvaluateLength(Curve=explode.Segments, Length="0.5", Normalized=True)  # -> Point, Tangent, Parameter
srf_cp = SurfaceClosestPoint(Point=eval.Point, Surface=srf)  # -> Point, UVPoint, Distance
image = ImageSampler(
    srf_cp.UVPoint,
    FilePath="D:\User\Documents\odrive\Google Drive\JH\Projects\[051] GrasshopperHowtos\GH Files\GrasshopperHowtos\0058 Undulant Portrait\rf_image.jpg",
    Filter="Value",
    Interpolate=False,
    Umax=1,
    Umin=0,
    Vmax=1,
    Vmin=0,
    Wrap=1)
divide = DivideCurve(Curve=explode.Segments, Count=number_slider_3, Kinks=False)  # -> simplify(Points), Tangents, Parameters
neg = Negative(Value="1")
dom = ConstructDomain(DomainStart=neg, DomainEnd="1")
bnd = Bounds(Numbers=flatten(image))
dom_2 = ConstructDomain(DomainStart=Slider(1, range=0..1), DomainEnd=Slider(0, range=0..1))
remap = RemapNumbers(Value=image, Source=bnd, Target=dom_2)  # -> simplify(Mapped), Clipped
division_2 = Division(A="1", B=Slider(7, range=0..10))
division_3 = Division(A=remap.Mapped, B=division_2)
round = Round(Number=division_3)  # -> Nearest, Floor, Ceiling
num_3 = Number(round.Nearest)
bnd_2 = Bounds(Numbers=flatten(num_3))
multiplication_2 = Multiplication(A=num_3, B="2")
remap_2 = RemapNumbers(Value=num_3, Source=bnd_2, Target=Domain(0, 1))  # -> Mapped, Clipped
pi = Pi(Factor=multiplication_2)
multiplication_3 = Multiplication(A=num_2, B=remap_2.Mapped)
graft = GraftTree(Tree=pi, IncludeEmptyLists=True, IncludeNullItems=True)
neg_2 = Negative(Value=multiplication_3)
range = Range(Domain=graft, Steps=number_slider_3)  # -> simplify(Range)
dom_3 = ConstructDomain(DomainStart=neg_2, DomainEnd=multiplication_3)
sin = Sine(Value=range)
graft_2 = GraftTree(Tree=dom_3, IncludeEmptyLists=True, IncludeNullItems=True)
remap_3 = RemapNumbers(Value=sin, Source=dom, Target=graft_2)  # -> simplify(Mapped), Clipped
Y = UnitY(Factor=remap_3.Mapped)
move = Move(Geometry=divide.Points, Motion=Y)  # -> simplify(Geometry), Transform
pshift = ShiftPaths(Data=move.Geometry, Offset=-1)
duppt = RemoveDuplicatePts(Points=pshift, Tolerance=0.01)
nurbs = NurbsCurve(Vertices=duppt, Degree=3, Periodic=False)  # -> Curve, Length, Domain
panel = Panel(round.Nearest)
preview = CustomPreview(Geometry=nurbs.Curve, Shader=ColourSwatch(SwatchColor=RGB(0, 0, 0)))
