# Grasshopper definition Parallelogram Tile.ghx (Grasshopper 0.9.76)

hexgrid = Hexagonal(Plane=PlaneXY(0, 0, 0), Size=Slider(10, range=0..10), ExtentX=Slider(10, range=0..30), ExtentY=Slider(10, range=0..30))  # -> simplify(Cells), Points
number_slider = Slider(5, range=0..10)
explode = Explode(Curve=hexgrid.Cells, Recursive=True)  # -> simplify(Segments), Vertices
partition = PartitionList(List=explode.Segments, Size="2")  # -> simplify(Chunks)
item = ListItem(List=partition, Index=0, Wrap=True)
item_2 = ListItem(List=partition, Index=1, Wrap=True)
end = EndPoints(Curve=item)  # -> Start, End
divide = DivideCurve(Curve=item, Count=number_slider, Kinks=False)  # -> Points, Tangents, Parameters
divide_2 = DivideCurve(Curve=item_2, Count=number_slider, Kinks=False)  # -> Points, Tangents, Parameters
pline = PolyLine(Vertices=divide.Points, Closed=False)
vec2pt = Vector2Pt(PointA=end.End, PointB=divide_2.Points, Unitize=False)  # -> Vector, Length
move = Move(Geometry=pline, Motion=vec2pt.Vector)  # -> simplify(Geometry), Transform
lng = ListLength(List=move.Geometry)
series = Series(Start=0, Step=1, Count=lng)
consec = ConsecutiveDomains(Numbers=series, Additive=Toggle(False))  # -> simplify(Domains)
subset = SubList(List=move.Geometry, Domain=consec, Wrap=True)  # -> List, Index
bbox = BoundingBox(Content=flatten(hexgrid.Cells), Plane=PlaneXY(0, 0, 0), UnionBox=True)  # -> Box, Box_2
graft = GraftTree(Tree=subset.List, IncludeEmptyLists=True, IncludeNullItems=True)  # -> simplify(Tree)
debrep = DeconstructBrep(Brep=bbox.Box)  # -> Faces, Edges, Vertices
cp = ControlPoints(Curve=graft)  # -> simplify(Points), Weights, Knots
popgeo = PopulateGeometry(Geometry=debrep.Faces, Count=Slider(5, range=0..10), Seed=1)
graft_2 = GraftTree(Tree=popgeo, IncludeEmptyLists=True, IncludeNullItems=True)
flatten = FlattenTree(Tree=cp.Points, Path="{0}")
dist = Distance(PointA=graft_2, PointB=flatten)
min = Minimum(A=dist, B=Slider(70, range=0..100))
bnd = Bounds(Numbers=flatten(min))
remap = RemapNumbers(Value=min, Source=bnd, Target=Domain(0, 1))  # -> Mapped, Clipped
graph = GraphMapper(remap.Mapped, x0=0, x1=1, y0=0, y1=1, container_name="Bezier", cpx=[0, 0.3927532732, 0.5376808047, 1], cpy=[0, 0, 1, 1])
dom = ConstructDomain(DomainStart=Slider(250, range=0..400), DomainEnd=Slider(0, range=0..100))
remap_2 = RemapNumbers(Value=graph, Source=Domain(0, 1), Target=dom)  # -> simplify(Mapped), Clipped
flip = FlipMatrix(Data=remap_2.Mapped)
avr = Average(Input=flip)  # -> flatten(ArithmeticMean)
unflatten = UnflattenTree(Tree=avr, Guide=cp.Points)
Z = UnitZ(Factor=unflatten)
move_2 = Move(Geometry=cp.Points, Motion=Z)  # -> Geometry, Transform
intcrv = Interpolate(Vertices=move_2.Geometry, Degree=3, Periodic=False, KnotStyle=1)  # -> simplify(Curve), Length, Domain
pline_2 = PolyLine(Vertices=move_2.Geometry, Closed=False)
pshift = ShiftPaths(Data=intcrv.Curve, Offset=-1)
range = Range(Domain=Domain(0, 1), Steps=expr("x-1", number_slider))
loft = Loft(Curves=pshift, Options={Adjust=False, Closed=False, LoftEnds=0, LoftSimp=0, LoftType=0, Rebuild=10, Refit=0.01})
project = Project(Geometry=pshift, Plane=PlaneXY(0, 0, 0))  # -> Geometry, Transform
gradient = Gradient(LowerLimit=0, UpperLimit=1, Parameter=range, stops=[0: RGB(130, 79, 12), 1: RGB(219, 206, 175)])
loft_2 = Loft(
    Curves=project.Geometry,
    Options={Adjust=False, Closed=False, LoftEnds=0, LoftSimp=0, LoftType=0, Rebuild=10, Refit=0.01})
merge = Merge(Data1=loft_2, Data2=loft)
loft_3 = Loft(Curves=merge, Options={Adjust=False, Closed=False, LoftEnds=0, LoftSimp=0, LoftType=0, Rebuild=10, Refit=0.01})
merge_2 = Merge(Data1=loft_3, Data2=loft_2, Data3=loft)
join = BrepJoin(Breps=merge_2)  # -> Breps, Closed
pshift_2 = ShiftPaths(Data=join.Breps, Offset=-1)
remap_3 = RemapNumbers(Value=range, Source=Domain(0, 1), Target=Slider(0, range=0..100))  # -> Mapped, Clipped
Z_2 = UnitZ(Factor=remap_3.Mapped)
move_3 = Move(Geometry=pshift_2, Motion=Z_2)  # -> Geometry, Transform
preview = CustomPreview(Geometry=move_3.Geometry, Shader=gradient)
