# Grasshopper definition Star Pillow.ghx (Grasshopper 0.9.76)
# plug-ins: MeshEdit Components, Kangaroo Components, PlanktonGh, Kangaroo2 Components

pt = ConstructPoint(XCoordinate=0, YCoordinate=0, ZCoordinate=0)
polygon = Polygon(Plane=pt, Radius=Slider(100, range=0..100), Segments=Slider(7, range=0..10), FilletRadius=0)  # -> Polygon, Length
explode = Explode(Curve=polygon.Polygon, Recursive=True)  # -> simplify(graft(Segments)), Vertices
midpoint = MidPoint(crv=explode.Segments)
end = EndPoints(Curve=explode.Segments)  # -> Start, End
scale = Scale(Geometry=midpoint, Center=pt, Factor=Slider(0.67, range=0..1))  # -> Geometry, Transform
merge = Merge(Data1=end.Start, Data2=scale.Geometry, Data3=end.End)
number_slider = Slider(10, range=0..10)
pline = PolyLine(Vertices=merge, Closed=False)
join = JoinCurves(Curves=flatten(pline), Preserve=False)
custom_mesh_settings = SettingsCustom(
    StitchSeams=True,
    SimplePlanes=False,
    Refine=True,
    MinCount=16,
    MaxCount=400,
    AspectRatio=20,
    MaxDistance=0,
    MaxAngle=20,
    MinEdge=number_slider,
    MaxEdge=number_slider)
boundary = BoundarySurfaces(Edges=join)
mesh = MeshBrep(Brep=boundary, Settings=custom_mesh_settings)
medges = MeshEdges(Mesh=mesh)  # -> NakedEdges, InteriorEdges, NonManifoldEdges
join_2 = JoinCurves(Curves=medges.NakedEdges, Preserve=False)
cp = ControlPoints(Curve=join_2)  # -> Points, Weights, Knots
duppt = RemoveDuplicatePts(Points=cp.Points, Tolerance=0.01)
toggle = BooleanToggle(False)
multiplication = Multiplication(A=number_slider, B=Slider(1.41, range=1..2))
sequence = Sequence(Frames=Slider(3, range=0..10))
meshmachine = MeshMachine(
    Geometry=mesh,
    Length=multiplication,
    FixVertices=duppt,
    Flip=1,
    PullStrength=0.8,
    CurvatureAdaptivity=0,
    BoundaryScale=1,
    BoundaryDistance=5,
    Exponent=2,
    Background=0.5,
    Iterations=Slider(1, range=0..10),
    Reset=sequence)
pmesh = PlanktonMesh(meshmachine)
rev = ReverseList(List=pmesh)
item = ListItem(List=rev, Index=0, Wrap=True)
number_slider_2 = Slider(1, range=0..1)
mesh_2 = Mesh(item)
demesh = DeconstructMesh(Mesh=mesh_2)  # -> Vertices, Faces, Colours, Normals
cp_2 = ClosestPoint(Point=demesh.Vertices, Cloud=duppt)  # -> ClosestPoint, CPIndex, Distance
neg = Negative(Value=number_slider_2)
larger = LargerThan(FirstNumber=cp_2.Distance, SecondNumber=0)  # -> LargerThan, OrEqualTo
merge_2 = Merge(Data1=neg, Data2=number_slider_2)  # -> graft(Result)
dispatch = Dispatch(List=demesh.Vertices, DispatchPattern=larger.LargerThan)  # -> ListA, ListB
Z = UnitZ(Factor=merge_2)  # -> simplify(UnitVector)
move = Move(Geometry=dispatch.ListA, Motion=Z)  # -> simplify(Geometry), Transform
weave = Weave(Pattern=larger.LargerThan, Stream0=dispatch.ListB, Stream1=move.Geometry, NullGaps=False)  # -> simplify(Weave)
conmesh = ConstructMesh(Vertices=weave, Faces=demesh.Faces)  # -> simplify(Mesh)
bang = ExplodeTree(Data=conmesh)  # -> Branch0, Branch1
flip = MeshFlip(Mesh=bang.Branch0)
merge_3 = Merge(Data1=flip, Data2=bang.Branch1)  # -> flatten(Result)
mjoin = MeshJoin(Meshes=merge_3)
medges_2 = MeshEdges(Mesh=mjoin)  # -> NakedEdges, InteriorEdges, NonManifoldEdges
weldvertices = MeshWeldVertices(Mesh=mjoin, Tolerance=0.01)  # -> RuntimeMessage, Mesh
merge_4 = Merge(Data1=medges_2.NakedEdges, Data2=medges_2.InteriorEdges)
dupln = RemoveDuplicateLines(Lines=merge_4, Tolerance=0.01)
pt_2 = Point(duppt)
length_line = LengthLine(Line=dupln, Length=dupln, Strength=10)
pressure = Pressure(M=mjoin, Strength=Slider(0.106, range=0..0.3))
anchor = Anchor(Point=pt_2, Strength=1000)
show = Show(G=weldvertices.Mesh)
merge_5 = Merge(Data1=flatten(show), Data2=flatten(anchor), Data3=flatten(length_line), Data4=flatten(pressure))
sequence_2 = Sequence(Frames=Slider(10, range=0..10))
solver = Solver(GoalObjects=merge_5, Reset=sequence_2, Threshold=1e-15, Tolerance=0.01, On=Toggle(True))  # -> I, V, O
item_2 = ListItem(List=solver.O, Index=0, Wrap=True)  # -> flatten(Item)
rev_2 = ReverseList(List=item_2)
item_3 = ListItem(List=rev_2, Index=0, Wrap=True)
demesh_2 = DeconstructMesh(Mesh=item_3)  # -> Vertices, Faces, Colours, Normals
pdecon = Deconstruct(Point=demesh_2.Vertices)  # -> XComponent, YComponent, ZComponent
bnd = Bounds(Numbers=pdecon.ZComponent)
remap = RemapNumbers(Value=pdecon.ZComponent, Source=bnd, Target=Domain(0, 1))  # -> Mapped, Clipped
gradient = Gradient(
    LowerLimit=0,
    UpperLimit=1,
    Parameter=remap.Mapped,
    stops=[0: RGB(234, 38, 0), 0.173: RGB(234, 126, 0), 0.512: RGB(254, 244, 84), 0.839: RGB(255, 116, 41), 1: RGB(255, 31, 31)])
mcol = MeshColours(Mesh=item_3, Colours=gradient)

# ==== cluster MidPoint: Middle Point of Curve
crv = ClusterInput()
num = Number(0.5)
eval = EvaluateLength(Curve=crv, Length=num, Normalized=True)  # -> Point, Tangent, Parameter
pt = ClusterOutput(eval.Point)
