# Grasshopper definition Closed Spirograph.ghx (Grasshopper 0.9.76)

multiplication = Multiplication(A=Slider(4, range=0..10), B="2")
multiplication_2 = Multiplication(A="2", B=Slider(0, range=0..5))
dom = ConstructDomain(DomainStart=Slider(10, range=0..100), DomainEnd=Slider(63, range=0..100))
number_slider = Slider(100, range=0..100)
number_slider_2 = Slider(0, range=0..1)
range = Range(Domain=dom, Steps=Slider(10, range=0..10))
lng = ListLength(List=range)
series = Series(Start=multiplication, Step=multiplication_2, Count=lng)
graft = GraftTree(Tree=series, IncludeEmptyLists=True, IncludeNullItems=True)  # -> simplify(Tree)
graft_2 = GraftTree(Tree=range, IncludeEmptyLists=True, IncludeNullItems=True)  # -> simplify(Tree)
number_slider_3 = Slider(100, range=0..100)
pt = ConstructPoint(XCoordinate=0, YCoordinate=0, ZCoordinate=0)
pi = Pi(Factor=graft)
subtraction = Subtraction(A=number_slider, B=graft_2)
cir = Circle(Plane=pt, Radius=number_slider)
cir_2 = Circle(Plane=pt, Radius=subtraction)
eval = EvaluateLength(Curve=cir_2, Length=number_slider_2, Normalized=True)  # -> Point, Tangent, Parameter
num = Number(pi)
range_2 = Range(Domain=Domain(0, 1), Steps=number_slider_3)
range_3 = Range(Domain=pi, Steps=number_slider_3)
cir_3 = Circle(Plane=eval.Point, Radius=graft_2)
multiplication_3 = Multiplication(A=num, B=number_slider_2)
eval_2 = EvaluateLength(Curve=cir_2, Length=range_2, Normalized=True)  # -> simplify(Point), Tangent, Parameter
item = ListItem(List=eval_2.Point, Index=0, Wrap=True)
md_slider = MDSlider(
    slider_value=Point(0.2411313738, 0.5486538227, 0.5),
    SliderMode=0,
    x_domain=Domain(0, 1),
    y_domain=Domain(0, 1),
    z_domain=Domain(0, 1))
boundary = BoundarySurfaces(Edges=cir_3)
cir_4 = Circle(Plane=item, Radius=graft_2)
evalsrf = EvaluateSurface(Surface=reparameterize(boundary), Point=md_slider)  # -> Point, Normal, Frame
boundary_2 = BoundarySurfaces(Edges=cir_4)
rotate = Rotate(Geometry=evalsrf.Point, Angle=multiplication_3, Plane=eval.Point)  # -> Geometry, Transform
evalsrf_2 = EvaluateSurface(Surface=reparameterize(boundary_2), Point=md_slider)  # -> Point, Normal, Frame
flatten = FlattenTree(Tree=boundary, Path="{0}")
panel = Panel(graft_2)
number_slider_4 = Slider(2.64, range=0..10)
orient = Orient(Geometry=evalsrf_2.Point, Source=item, Target=eval_2.Point)  # -> Geometry, Transform
rotate_2 = Rotate(Geometry=orient.Geometry, Angle=range_3, Plane=eval_2.Point)  # -> Geometry, Transform
cull_i = CullIndex(List=rotate_2.Geometry, Indices=0, Wrap=True)
lng_2 = ListLength(List=flatten)
rev = ReverseList(List=flatten)
intcrv = Interpolate(Vertices=cull_i, Degree=3, Periodic=True, KnotStyle=1)  # -> Curve, Length, Domain
series_2 = Series(Start=number_slider_4, Step=number_slider_4, Count=lng_2)
neg = Negative(Value=series_2)
pipe = Pipe(Curve=intcrv.Curve, Radius=Slider(0.5, range=0..1), Caps=0)
Z = UnitZ(Factor=neg)
Z_2 = UnitZ(Factor=1)
move = Move(Geometry=rev, Motion=Z)  # -> Geometry, Transform
preview = CustomPreview(Geometry=pipe, Shader=ColourSwatch(SwatchColor=RGB(0, 99, 13)))
neg_2 = Negative(Value=Z_2)
line = LineSDL(Start=rotate.Geometry, Direction=neg_2, Length=Slider(200, range=0..200))
boundary_3 = BoundarySurfaces(Edges=move.Geometry)
pipe_2 = Pipe(Curve=line, Radius=Slider(0.77, range=0..1), Caps=0)
preview_2 = CustomPreview(Geometry=pipe_2, Shader=ColourSwatch(SwatchColor=RGB(107, 107, 107)))
preview_3 = CustomPreview(Geometry=boundary_3, Shader=ColourSwatch(SwatchColor=RGBA(89, 205, 255, 60)))
