# Grasshopper definition Flower Bowl.ghx (Grasshopper 0.9.76)
# plug-ins: Anemone

number_slider = Slider(12, range=0..100)
cir = Circle(Plane=PlaneXY(0, 0, 0), Radius=Slider(100, range=0..100))
division = Division(A="360", B=number_slider)
divide = DivideCurve(Curve=cir, Count=number_slider, Kinks=False)  # -> Points, Tangents, Parameters
division_2 = Division(A=division, B="2")
rad = Radians(Degrees=division_2)
number_slider_2 = Slider(10, range=0..10)
rotate = Rotate(Geometry=divide.Points, Angle=rad, Plane=PlaneXY(0, 0, 0))  # -> Geometry, Transform
fastloopstart = FastLoopStart(I=number_slider_2, D0=rotate.Geometry)  # -> port, Counter, Data, Data_2
pline = PolyLine(Vertices=fastloopstart.Data, Closed=True)
explode = Explode(Curve=pline, Recursive=True)  # -> Segments, Vertices
eval = EvaluateLength(Curve=explode.Segments, Length="0.5", Normalized=True)  # -> Point, Tangent, Parameter
end = EndPoints(Curve=graft(explode.Segments))  # -> simplify(Start), simplify(End)
merge = Merge(Data1=end.Start, Data2=end.End)  # -> simplify(Result)
dom = ConstructDomain(DomainStart=Slider(15, range=0..100), DomainEnd=Slider(0, range=0..10))
dom_2 = ConstructDomain(DomainStart=Slider(57, range=0..100), DomainEnd=Slider(0, range=0..100))
rotate_2 = Rotate(Geometry=merge, Angle=1.570796327, Plane=simplify(graft(eval.Point)))  # -> simplify(Geometry), Transform
remap = RemapNumbers(Value=fastloopstart.Counter, Source=number_slider_2, Target=dom)  # -> Mapped, Clipped
remap_2 = RemapNumbers(Value=fastloopstart.Counter, Source=number_slider_2, Target=dom_2)  # -> Mapped, Clipped
weave = Weave(Pattern=[0, 1], Stream0=merge, Stream1=rotate_2.Geometry, NullGaps=False)
rad_2 = Radians(Degrees=remap_2.Mapped)
neg = Negative(Value=Slider(37, range=0..100))
neg_2 = Negative(Value=rad_2)
pline_2 = PolyLine(Vertices=weave, Closed=True)
pline_3 = PolyLine(Vertices=merge, Closed=False)
rad_3 = Radians(Degrees=neg)
rotax = RotateAxis(Geometry=pline_2, Angle=neg_2, Axis=pline_3)  # -> Geometry, Transform
explode_2 = Explode(Curve=rotax.Geometry, Recursive=True)  # -> simplify(Segments), Vertices
midpoint = MidPoint(crv=explode_2.Segments)
boundary = BoundarySurfaces(Edges=rotax.Geometry)  # -> reparameterize(Surfaces)
item = ListItem(List=explode_2.Vertices, Index="3", Wrap=True)
flatten = FlattenTree(Tree=item, Path="{0}")
srf_cp = SurfaceClosestPoint(Point=midpoint, Surface=boundary)  # -> Point, UVPoint, Distance
neg_3 = Negative(Value=remap.Mapped)
evalsrf = EvaluateSurface(Surface=boundary, Point=srf_cp.UVPoint)  # -> Point, simplify(Normal), Frame
graft = GraftTree(Tree=explode_2.Segments, IncludeEmptyLists=True, IncludeNullItems=True)
amp = Amplitude(Vector=evalsrf.Normal, Amplitude=neg_3)
end_2 = EndPoints(Curve=graft)  # -> Start, End
move = Move(Geometry=midpoint, Motion=amp)  # -> simplify(Geometry), Transform
graft_2 = GraftTree(Tree=move.Geometry, IncludeEmptyLists=True, IncludeNullItems=True)  # -> simplify(Tree)
merge_2 = Merge(Data1=end_2.Start, Data2=graft_2, Data3=end_2.End)
nurbs = NurbsCurve(Vertices=merge_2, Degree=2, Periodic=False)  # -> Curve, Length, Domain
pshift = ShiftPaths(Data=nurbs.Curve, Offset=-1)
dispatch = Dispatch(List=pshift, DispatchPattern=[True, False])  # -> ListA, ListB
netsurf = NetworkSurface(CurvesU=dispatch.ListA, CurvesV=dispatch.ListB, Continuity=2)
flatten_2 = FlattenTree(Tree=netsurf, Path="{0}")
fastloopend = FastLoopEnd(port=fastloopstart.port, Exit=False, Data=flatten, Data_2=flatten_2, RecordData=True, TimeOutVal=0)  # -> D0, D1
srf = Surface(simplify(fastloopend.D1))
tstat = TreeStatistics(Tree=srf)  # -> Paths, Length, Count
lng = ListLength(List=tstat.Paths)
range = Range(Domain=Domain(0, 1), Steps=expr("x-1", lng))
gradient = Gradient(LowerLimit=0, UpperLimit=1, Parameter=range, stops=[0: RGB(130, 159, 255), 1: RGB(255, 157, 0)])
preview = CustomPreview(Geometry=srf, Shader=graft(gradient))

# ==== cluster MidPoint: Middle Point of Curve
crv = ClusterInput()
num = Number(0.5)
eval = EvaluateLength(Curve=crv, Length=num, Normalized=True)  # -> Point, Tangent, Parameter
pt = ClusterOutput(eval.Point)
