# Grasshopper definition Cracked Wall.ghx (Grasshopper 0.9.76)
# plug-ins: Python Interpreter, Anemone, Weaverbird

number_slider = Slider(300, range=0..300)
number_slider_2 = Slider(300, range=0..500)
rectangle = Rectangle(Plane=PlaneXY(0, 0, 0), XSize=number_slider_2, YSize=number_slider, Radius=0)  # -> Rectangle, Length
boundary = BoundarySurfaces(Edges=rectangle.Rectangle)
loop_start = LoopStart(Repeat=Slider(20, range=0..20), Data=boundary)  # -> port, Counter, Data
area = Area(Geometry=loop_start.Data)  # -> Area, Centroid
sort = SortList(Keys=area.Area, ValuesA=loop_start.Data)  # -> reverse(Keys), reverse(ValuesA)
item = ListItem(List=sort.Keys, Index=0, Wrap=True)
division = Division(A=item, B=Slider(1.5, range=0..10))
larger = LargerThan(FirstNumber=sort.Keys, SecondNumber=division)  # -> LargerThan, OrEqualTo
num = Number(Slider(0.608, range=0..1))
dispatch = Dispatch(List=sort.ValuesA, DispatchPattern=larger.LargerThan)  # -> ListA, ListB
srf = Surface(dispatch.ListA)
edges = BrepEdges(Brep=srf)  # -> Naked, Interior, NonManifold
len = Length(Curve=edges.Naked)
division_2 = Division(A=num, B=2)
sort_2 = SortList(Keys=len, ValuesA=edges.Naked)  # -> Keys, reverse(ValuesA)
srf_2 = Surface(dispatch.ListB)
neg = Negative(Value=division_2)
subset = SubList(List=sort_2.ValuesA, Domain="1", Wrap=True)  # -> List, Index
tstat = TreeStatistics(Tree=subset.List)  # -> Paths, Length, Count
lng = ListLength(List=tstat.Paths)
random = Random(Range=Slider(10000, range=0..10000), Number=lng, Seed=loop_start.Counter)
dom = ConstructDomain(DomainStart=neg, DomainEnd=division_2)
int = Integer(random)
random_2 = Random(Range=dom, Number="2", Seed=int)
addition = Addition(A=random_2, B="0.5")
eval = EvaluateLength(Curve=subset.List, Length=addition, Normalized=True)  # -> Point, Tangent, Parameter
pline = PolyLine(Vertices=eval.Point, Closed=False)
len_2 = Length(Curve=pline)
eval_2 = EvaluateLength(Curve=pline, Length="0.5", Normalized=True)  # -> Point, Tangent, Parameter
Z = UnitZ(Factor=1)
division_3 = Division(A=len_2, B=Slider(15, range=0..30))
vrot = Rotate(Vector=eval_2.Tangent, Axis=Z, Angle="Rad(90)")
amp = Amplitude(Vector=vrot, Amplitude=division_3)
move = Move(Geometry=eval_2.Point, Motion=amp)  # -> Geometry, Transform
srf_3 = Surface(srf)
weave = Weave(Pattern=[0, 1], Stream0=eval.Point, Stream1=move.Geometry, NullGaps=False)
srf_4 = Surface(srf_3)
intcrv = Interpolate(Vertices=weave, Degree=3, Periodic=False, KnotStyle=1)  # -> simplify(Curve), Length, Domain
graft = GraftTree(Tree=srf_4, IncludeEmptyLists=True, IncludeNullItems=True)  # -> simplify(Tree)
srfsplit = SurfaceSplit(Surface=graft, Curves=intcrv.Curve)  # -> flatten(Fragments)
merge = Merge(Data1=flatten(srf_2), Data2=flatten(srfsplit))
number_slider_3 = Slider(100, range=0..100)
pi = Pi(Factor=Slider(3, range=0..10))
loop_end = LoopEnd(port=loop_start.port, Exit=False, Data=merge, pausedState=False, state="Constant output", TimeOutVal=0)
range = Range(Domain=pi, Steps=number_slider_3)
range_2 = Range(Domain=number_slider_2, Steps=number_slider_3)
crv = Curve(simplify(graft(loop_end)))
sin = Sine(Value=range)
popgeo = PopulateGeometry(Geometry=loop_end, Count=1, Seed=1)  # -> simplify(Population)
bnd = Bounds(Numbers=sin)
remap = RemapNumbers(Value=sin, Source=bnd, Target=Slider(41, range=0..100))  # -> Mapped, Clipped
offsetcrv = OffsetCurve(crv=crv, pt=popgeo, dist=Slider(0.75, range=0..1))  # -> out, a; inputs crv: Curve, pt: Point3d
# ---------- offsetcrv: Python ----------
import math
import rhinoscriptsyntax as rs

a = rs.OffsetCurve(crv,pt,dist)
# ---------- end offsetcrv ----------
number_slider_4 = Slider(3, range=0..10)
pt = ConstructPoint(XCoordinate=range_2, YCoordinate=remap.Mapped, ZCoordinate=0)
boundary_2 = BoundarySurfaces(Edges=offsetcrv.a)
intcrv_2 = Interpolate(Vertices=pt, Degree=3, Periodic=False, KnotStyle=1)  # -> Curve, Length, Domain
clean = CleanTree(RemoveNulls=True, RemoveInvalid=True, RemoveEmpty=False, Tree=boundary_2)  # -> simplify(Tree)
md_slider = MDSlider(slider_value=Point(0.5, 0.5, 0.5), SliderMode=0, x_domain=Domain(0, 1), y_domain=Domain(0, 1), z_domain=Domain(0, 1))
Z_2 = UnitZ(Factor=number_slider)
prune = PruneTree(Tree=clean, Minimum=1, Maximum=0)
srf_5 = Surface(reparameterize(simplify(prune)))
custom_mesh_settings = SettingsCustom(
    StitchSeams=True,
    SimplePlanes=False,
    Refine=True,
    MinCount=16,
    MaxCount=400,
    AspectRatio=20,
    MaxDistance=0,
    MaxAngle=20,
    MinEdge=number_slider_4,
    MaxEdge=number_slider_4)
evalsrf = EvaluateSurface(Surface=srf_5, Point=md_slider)  # -> Point, Normal, Frame
extr = Extrude(Base=intcrv_2.Curve, Direction=Z_2)
Z_3 = UnitZ(Factor=1)
srf_6 = Surface(reparameterize(extr))
dprod = DotProduct(VectorA=evalsrf.Normal, VectorB=Z_3, Unitize=False)
equals = Equality(FirstNumber=dprod, SecondNumber=1)  # -> Equality, Inequality
dispatch_2 = Dispatch(List=srf_5, DispatchPattern=equals.Equality)  # -> ListA, ListB
panel = Panel(dprod)
flip = Flip(Surface=dispatch_2.ListB)  # -> Surface, Result
weave_2 = Weave(Pattern=equals.Equality, Stream0=flip.Surface, Stream1=dispatch_2.ListA, NullGaps=False)
mesh = MeshBrep(Brep=weave_2, Settings=custom_mesh_settings)  # -> simplify(Mesh)
pi_2 = Pi(Factor=Slider(0.3, range=0..1))
demesh = DeconstructMesh(Mesh=mesh)  # -> simplify(Vertices), Faces, Colours, Normals
srf_7 = Surface(reparameterize(boundary))
srf_cp = SurfaceClosestPoint(Point=demesh.Vertices, Surface=srf_7)  # -> Point, UVPoint, Distance
evalsrf_2 = EvaluateSurface(Surface=srf_6, Point=srf_cp.UVPoint)  # -> simplify(Point), Normal, Frame
conmesh = ConstructMesh(Vertices=evalsrf_2.Point, Faces=demesh.Faces)
wbthicken = WeaverbirdsMeshThicken(MeshCurves=conmesh, Distance=Slider(10, range=0..10), OffsetType=0)
unweld = UnweldMesh(Mesh=wbthicken, Angle=pi_2)
preview = CustomPreview(Geometry=unweld, Shader=ColourSwatch(SwatchColor=RGB(178, 122, 48)))
