# Grasshopper definition Text Pin.ghx (Grasshopper 0.9.76)
# plug-ins: Python Interpreter

pt = ConstructPoint(XCoordinate=0, YCoordinate=0, ZCoordinate=0)
list = ValueList({"Normal": 0, "Bold": 1, "Italic": 2, "Bold and Italic": 3}, selected="Bold")
xy = XYPlane(Origin=pt)
python = PythonScript(pos=xy, txt="ORANGE", font="Century Gothic", size=Slider(100, range=0..100), style=list)  # -> out, a; inputs pos: Plane, style: Int32
# ---------- python: Python ----------
import rhinoscriptsyntax as rs
import scriptcontext as sc
import Rhino

sc.doc = Rhino.RhinoDoc.ActiveDoc

rs.EnableRedraw(False)

txtObj = rs.AddText(txt,pos,size,font,style)
txtCurves = rs.ExplodeText(txtObj)
rs.DeleteObject(txtObj)

list = []
for i in range(len(txtCurves)):
    txtCurve = txtCurves[i]
    txtCurveGH = rs.coercecurve(txtCurve)
    list.append(txtCurveGH)

rs.EnableRedraw(True)

a = list

rs.DeleteObjects(txtCurves)

sc.doc = ghdoc
# ---------- end python ----------
flatten = FlattenTree(Tree=python.a, Path="{0}")
bbox = BoundingBox(Content=flatten, Plane=PlaneXY(0, 0, 0), UnionBox=True)  # -> Box, Box_2
area = Area(Geometry=bbox.Box)  # -> Area, Centroid
number_slider = Slider(30, range=0..100)
debrep = DeconstructBrep(Brep=bbox.Box)  # -> Faces, Edges, Vertices
dim = Dimensions(Surface=debrep.Faces)  # -> UDimension, VDimension
addition = Addition(A=number_slider, B=dim.UDimension)
addition_2 = Addition(A=number_slider, B=dim.VDimension)
division = Division(A=addition_2, B=addition_2)
division_2 = Division(A=addition, B=addition_2)
division_3 = Division(A=addition, B=dim.UDimension)
division_4 = Division(A=addition_2, B=dim.VDimension)
number_slider_2 = Slider(40, range=0..100)
scale_nu = ScaleNU(Geometry=debrep.Faces, Plane=area.Centroid, ScaleX=division_3, ScaleY=division_4, ScaleZ=1)  # -> Geometry, Transform
multiplication = Multiplication(A=division_2, B=number_slider_2)
multiplication_2 = Multiplication(A=division, B=number_slider_2)
sdivide = DivideSurface(Surface=scale_nu.Geometry, UCount=multiplication, VCount=multiplication_2)  # -> simplify(Points), Normals, Parameters
flatten_2 = FlattenTree(Tree=sdivide.Points, Path="{0}")
boundary = BoundarySurfaces(Edges=flatten)
pull = PullPoint(Point=flatten_2, Geometry=flatten, ClosestOnly=True)  # -> ClosestPoint, Distance
pull_2 = PullPoint(Point=flatten_2, Geometry=boundary, ClosestOnly=True)  # -> ClosestPoint, Distance
smaller = SmallerThan(FirstNumber=pull_2.Distance, SecondNumber=Slider(0.01, range=0..0.01))  # -> SmallerThan, OrEqualTo
not = GateNot(A=smaller.SmallerThan)
multiplication_3 = Multiplication(A=smaller.SmallerThan, B=pull.Distance)
equals = Equality(FirstNumber=multiplication_3, SecondNumber="0")  # -> Equality, Inequality
cull = CullPattern(List=multiplication_3, CullPattern=equals.Inequality)
sort = SortList(Keys=cull)  # -> Keys, ValuesA
dom = ConstructDomain(DomainStart=Slider(40, range=0..100), DomainEnd=Slider(60, range=0..100))
item = ListItem(List=reverse(sort.Keys), Index=0, Wrap=True)
item_2 = ListItem(List=sort.Keys, Index=0, Wrap=True)
dom_2 = ConstructDomain(DomainStart=item_2, DomainEnd=item)
remap = RemapNumbers(Value=multiplication_3, Source=dom_2, Target=dom)  # -> Mapped, Clipped
multiplication_4 = Multiplication(A=not, B=Slider(10, range=0..10))
multiplication_5 = Multiplication(A=remap.Mapped, B=smaller.SmallerThan)
addition_3 = Addition(A=multiplication_5, B=multiplication_4)
Z = UnitZ(Factor=1)
pt_2 = Point(flatten_2)
bnd = Bounds(Numbers=addition_3)
line = LineSDL(Start=pt_2, Direction=Z, Length=addition_3)
remap_2 = RemapNumbers(Value=addition_3, Source=bnd, Target=Domain(0, 1))  # -> Mapped, Clipped
pipe = Pipe(Curve=line, Radius=1, Caps=0)  # -> flatten(Pipe)
gradient = Gradient(LowerLimit=0, UpperLimit=1, Parameter=remap_2.Mapped, stops=[0: RGB(52, 128, 194), 1: RGB(255, 255, 255)])
preview = CustomPreview(Geometry=pipe, Shader=gradient)
