# Grasshopper definition Accordion Curtain.ghx (Grasshopper 0.9.76)

number_slider = Slider(100, range=0..100)
Z = UnitZ(Factor=1)
pt = ConstructPoint(XCoordinate=0, YCoordinate=0, ZCoordinate=0)
line = LineSDL(Start=pt, Direction=Z, Length=number_slider)
range = Range(Domain=number_slider, Steps=Slider(40, range=0..100))
X = UnitX(Factor=range)
move = Move(Geometry=line, Motion=X)  # -> Geometry, Transform
end = EndPoints(Curve=move.Geometry)  # -> Start, End
pline = PolyLine(Vertices=end.Start, Closed=False)
explode = Explode(Curve=pline, Recursive=True)  # -> Segments, Vertices
eval = EvaluateLength(Curve=explode.Segments, Length="0.5", Normalized=True)  # -> Point, Tangent, Parameter
pt_2 = Point(eval.Point)
lng = ListLength(List=pt_2)
random = Random(Range=lng, Number=1, Seed=Slider(421, range=0..1000), Integers=True)
item = ListItem(List=pt_2, Index=random, Wrap=True)
pt_3 = Point(end.Start)
pdecon = Deconstruct(Point=pt_3)  # -> XComponent, YComponent, ZComponent
pdecon_2 = Deconstruct(Point=item)  # -> XComponent, YComponent, ZComponent
smaller = SmallerThan(FirstNumber=pdecon.XComponent, SecondNumber=pdecon_2.XComponent)  # -> SmallerThan, OrEqualTo
dispatch = Dispatch(List=move.Geometry, DispatchPattern=smaller.SmallerThan)  # -> ListA, ListB
crv = Curve(reverse(dispatch.ListA))
item_2 = ListItem(List=crv, Index=0, Wrap=True)
crv_2 = Curve(dispatch.ListB)
merge = Merge(Data1=item_2, Data2=crv_2)
split = SplitList(List=crv, Index=Slider(19, range=0..100))  # -> ListA, ListB
split_2 = SplitList(List=merge, Index=Slider(13, range=0..100))  # -> ListA, ListB
crv_3 = Curve(split.ListA)
crv_4 = Curve(split_2.ListA)
crv_5 = Curve(split.ListB)
crv_6 = Curve(split_2.ListB)
group = Group(Objects=crv_3)
group_2 = Group(Objects=crv_4)
group_3 = Group(Objects=crv_5)
group_4 = Group(Objects=crv_6)
merge_2 = Merge(Data1=group_3, Data2=group_4)
merge_3 = Merge(Data1=group, Data2=group_2)
ungroup = Ungroup(Group=merge_3)  # -> simplify(Objects)
divide = DivideCurve(Curve=reparameterize(ungroup), Count=10, Kinks=False)  # -> simplify(Points), Tangents, Parameters
min = Minimum(A=divide.Parameters, B=Slider(0.7, range=0..1))
bnd = Bounds(Numbers=flatten(min))
remap = RemapNumbers(Value=min, Source=bnd, Target=Domain(0, 1))  # -> Mapped, Clipped
ungroup_2 = Ungroup(Group=merge_2)  # -> simplify(Objects)
graph = GraphMapper(
    remap.Mapped,
    x0=0,
    x1=1,
    y0=0,
    y1=1,
    container_name="Bezier",
    cpx=[0, 0.4129703343, 0.5984848738, 1],
    cpy=[0, 0, 0.8550724983, 1])
end_2 = EndPoints(Curve=ungroup)  # -> Start, End
pshift = ShiftPaths(Data=divide.Points, Offset=-1)
pt_4 = Point(reverse(simplify(end_2.Start)))
item_3 = ListItem(List=pt_4, Index=0, Wrap=True)
dom = ConstructDomain(DomainStart=Slider(0.17, range=0..1), DomainEnd=Slider(1, range=0..1))
remap_2 = RemapNumbers(Value=graph, Source=Domain(0, 1), Target=dom)  # -> Mapped, Clipped
pshift_2 = ShiftPaths(Data=remap_2.Mapped, Offset=-1)
scale_nu = ScaleNU(Geometry=pshift, Plane=item_3, ScaleX=pshift_2, ScaleY=1, ScaleZ=1)  # -> Geometry, Transform
unflatten = UnflattenTree(Tree=scale_nu.Geometry, Guide=divide.Points)
intcrv = Interpolate(Vertices=unflatten, Degree=3, Periodic=False, KnotStyle=1)  # -> Curve, Length, Domain
pshift_3 = ShiftPaths(Data=intcrv.Curve, Offset=-1)
merge_4 = Merge(Data1=pshift_3, Data2=ungroup_2)
Y = UnitY(Factor=Slider(5, range=0..10))
dispatch_2 = Dispatch(List=merge_4, DispatchPattern=[True, False])  # -> ListA, ListB
extr = Extrude(Base=merge_4, Direction=Y)
move_2 = Move(Geometry=dispatch_2.ListB, Motion=Y)  # -> Geometry, Transform
weave = Weave(Pattern=[0, 1], Stream0=dispatch_2.ListA, Stream1=move_2.Geometry, NullGaps=False)
loft = Loft(Curves=weave, Options={Adjust=False, Closed=False, LoftEnds=0, LoftSimp=0, LoftType=3, Rebuild=10, Refit=0.01})
preview = CustomPreview(Geometry=loft, Shader=ColourSwatch(SwatchColor=RGB(20, 126, 255)))
