# Grasshopper definition Triangle City.ghx (Grasshopper 0.9.76)
# plug-ins: MeshEdit Components

number_slider = Slider(100, range=0..100)
rectangle = Rectangle(Plane=PlaneXY(0, 0, 0), XSize=number_slider, YSize=number_slider, Radius=0)  # -> Rectangle, Length
area = Area(Geometry=rectangle.Rectangle)  # -> Area, Centroid
scale = Scale(Geometry=rectangle.Rectangle, Center=area.Centroid, Factor="1.5")  # -> Geometry, Transform
pop2d = Populate2D(Region=scale.Geometry, Count=Slider(50, range=0..100), Seed=1)
del = DelaunayMesh(Points=pop2d, Plane=PlaneXY(0, 0, 0))
explode = MeshExplode(Mesh=del, Interpolate=False)
medges = MeshEdges(Mesh=explode)  # -> NakedEdges, InteriorEdges, NonManifoldEdges
join = JoinCurves(Curves=medges.NakedEdges, Preserve=False)  # -> simplify(Curves)
cp = ControlPoints(Curve=join)  # -> simplify(Points), Weights, Knots
ccx = CurveCurve(CurveA=rectangle.Rectangle, CurveB=join)  # -> Points, ParamsA, ParamsB
lng = ListLength(List=ccx.Points)
incurve = PointInCurve(Point=cp.Points, Curve=rectangle.Rectangle)  # -> Relationship, Point
larger = LargerThan(FirstNumber=lng, SecondNumber="0")  # -> LargerThan, OrEqualTo
equals = Equality(FirstNumber=incurve.Relationship, SecondNumber="2")  # -> Equality, Inequality
mm = MassMultiplication(Input=equals.Equality)  # -> Result, PartialResults
equals_2 = Equality(FirstNumber=mm.Result, SecondNumber="1")  # -> Equality, Inequality
or = GateOr(A=larger.LargerThan, B=equals_2.Equality)
cull = CullPattern(List=join, CullPattern=or)  # -> flatten(List)
boundary = BoundarySurfaces(Edges=cull)
crv = Curve(boundary)
offset = Offset(Curve=crv, Distance=Slider(2.2, range=0..10), Plane=PlaneXY(0, 0, 0), Corners=1)  # -> simplify(Curve)
explode_2 = Explode(Curve=offset, Recursive=True)  # -> simplify(Segments), Vertices
area_2 = Area(Geometry=offset)  # -> Area, simplify(Centroid)
len = Length(Curve=explode_2.Segments)
division = Division(A=len, B=Slider(4, range=0..10))
max = Maximum(A=division, B="2")
int = Integer(max)
number_slider_2 = Slider(1, range=0..1)
extr = ExtrudePoint(Base=explode_2.Segments, Point=area_2.Centroid)
divide = DivideCurve(Curve=explode_2.Segments, Count=int, Kinks=False)  # -> simplify(Points), Tangents, Parameters
graft = GraftTree(Tree=explode_2.Segments, IncludeEmptyLists=True, IncludeNullItems=True)
Z = UnitZ(Factor=1)
graft_2 = GraftTree(Tree=extr, IncludeEmptyLists=True, IncludeNullItems=True)
vrot = Rotate(Vector=divide.Tangents, Axis=Z, Angle="Rad(90)")
srf = Surface(extr)
neg = Negative(Value=number_slider_2)
line = LineSDL(Start=divide.Points, Direction=vrot, Length=1)
blx = BrepLine(Brep=graft_2, Line=line, LimitToFirst=False)  # -> Curves, Points
Z_2 = UnitZ(Factor=Slider(0.6, range=0..1))
crv_2 = Curve(offset)
graft_3 = GraftTree(Tree=srf, IncludeEmptyLists=True, IncludeNullItems=True)
pshift = ShiftPaths(Data=blx.Curves, Offset=-1)
crv_3 = Curve(simplify(blx.Curves))
crv_4 = Curve(explode_2.Segments)
move = Move(Geometry=crv_2, Motion=Z_2)  # -> simplify(Geometry), Transform
offset_2 = Offset(Curve=offset, Distance=neg, Plane=PlaneXY(0, 0, 0), Corners=1)  # -> simplify(Curve)
srfsplit = SurfaceSplit(Surface=graft_3, Curves=pshift)  # -> simplify(Fragments)
crv_5 = Curve(srfsplit)
merge = Merge(Data1=number_slider_2, Data2=neg)
merge_2 = Merge(Data1=move.Geometry, Data2=offset_2)
offset_3 = Offset(Curve=crv_3, Distance=merge, Plane=PlaneXY(0, 0, 0), Corners=1)
graft_4 = GraftTree(Tree=crv_5, IncludeEmptyLists=True, IncludeNullItems=True)
offset_l = OffsetLoose(Curve=graft_4, Distance=neg)
move_2 = Move(Geometry=graft_4, Motion=Z_2)  # -> Geometry, Transform
pshift_2 = ShiftPaths(Data=offset_l, Offset=-2)
merge_3 = Merge(Data1=move_2.Geometry, Data2=offset_l)
loft = Loft(Curves=merge_2, Options={Adjust=False, Closed=False, LoftEnds=0, LoftSimp=0, LoftType=0, Rebuild=10, Refit=0.01})
loft_2 = Loft(Curves=merge_3, Options={Adjust=False, Closed=False, LoftEnds=0, LoftSimp=0, LoftType=0, Rebuild=10, Refit=0.01})
merge_4 = Merge(Data1=offset_2, Data2=pshift_2)
Z_3 = UnitZ(Factor=Slider(8, range=0..10))
pshift_3 = ShiftPaths(Data=loft_2, Offset=-2)
merge_5 = Merge(Data1=loft, Data2=pshift_3)
move_3 = Move(Geometry=merge_5, Motion=Z_3)  # -> Geometry, Transform
extr_2 = Extrude(Base=merge_4, Direction=Z_3)
merge_6 = Merge(Data1=move_3.Geometry, Data2=extr_2)
join_2 = BrepJoin(Breps=merge_6)  # -> Breps, Closed
preview = CustomPreview(Geometry=join_2.Breps, Shader=ColourSwatch(SwatchColor=RGB(0, 208, 255)))
