# Grasshopper definition Rocking Chair.ghx (Grasshopper 0.9.76)

number_slider = Slider(25, range=0..100)
subtraction = Subtraction(A="360", B=number_slider)
pt = ConstructPoint(XCoordinate=0, YCoordinate=0, ZCoordinate=0)
rad = Radians(Degrees=number_slider)
rad_2 = Radians(Degrees=subtraction)
xz = XZPlane(Origin=pt)
dom = ConstructDomain(DomainStart=rad, DomainEnd=rad_2)
arc = Arc(Plane=xz, Radius=Slider(305, range=0..1000), Angle=dom)  # -> Arc, Length
scale_nu = ScaleNU(Geometry=arc.Arc, Plane=xz, ScaleX=1, ScaleY=Slider(0.75, range=0..1), ScaleZ=1)  # -> Geometry, Transform
end = EndPoints(Curve=scale_nu.Geometry)  # -> Start, End
Z = UnitZ(Factor=1)
pt_2 = Point(end.Start)
vec = VectorXYZ(XComponent=Slider(0.37, range=0..1), YComponent=0, ZComponent=Slider(1, range=0..1))  # -> Vector, Length
line = LineSDL(Start=pt_2, Direction=vec.Vector, Length=Slider(660, range=0..1000))
divide = DivideCurve(Curve=reparameterize(line), Count=10, Kinks=False)  # -> Points, Tangents, Parameters
Y = UnitY(Factor=1)
graph = GraphMapper(
    divide.Parameters,
    x0=0,
    x1=1,
    y0=0,
    y1=1,
    container_name="Bezier",
    cpx=[0, 0.1514282227, 0.7091426253, 1],
    cpy=[0, 0.6173911691, 0.7194200754, 0.3484057188])
vrot = Rotate(Vector=divide.Tangents, Axis=Y, Angle="Rad(90)")
number_slider_2 = Slider(30, range=0..100)
remap = RemapNumbers(Value=graph, Source=Domain(0, 1), Target=Slider(100, range=0..100))  # -> Mapped, Clipped
Y_2 = UnitY(Factor=Slider(305, range=0..1000))
neg = Negative(Value=remap.Mapped)
amp = Amplitude(Vector=vrot, Amplitude=neg)
pt_3 = Point(pt)
move = Move(Geometry=divide.Points, Motion=amp)  # -> Geometry, Transform
intcrv = Interpolate(Vertices=move.Geometry, Degree=3, Periodic=False, KnotStyle=1)  # -> Curve, Length, Domain
merge = Merge(Data1=scale_nu.Geometry, Data2=intcrv.Curve)  # -> flatten(Result)
join = JoinCurves(Curves=merge, Preserve=False)
fillet = Fillet(Curve=join, Radius=Slider(136, range=0..1000))
move_2 = Move(Geometry=fillet, Motion=Y_2)  # -> Geometry, Transform
divide_2 = DivideCurve(Curve=fillet, Count=number_slider_2, Kinks=False)  # -> Points, Tangents, Parameters
divide_3 = DivideCurve(Curve=reparameterize(move_2.Geometry), Count=number_slider_2, Kinks=False)  # -> Points, Tangents, Parameters
lng = ListLength(List=divide_3.Points)
series = Series(Start=0, Step=1, Count=lng)
dist = Distance(PointA=pt_3, PointB=divide_2.Points)
bnd = Bounds(Numbers=series)
bnd_2 = Bounds(Numbers=dist)
remap_2 = RemapNumbers(Value=series, Source=bnd, Target=Domain(0, 1))  # -> Mapped, Clipped
dom_2 = ConstructDomain(DomainStart=Slider(0.75, range=0..1), DomainEnd=Slider(1.05, range=0..1.2))
remap_3 = RemapNumbers(Value=dist, Source=bnd_2, Target=dom_2)  # -> Mapped, Clipped
graph_2 = GraphMapper(
    remap_2.Mapped,
    x0=0,
    x1=1,
    y0=0,
    y1=1,
    container_name="Bezier",
    cpx=[0, 0.1666666716, 0.8597952127, 1],
    cpy=[1, 0.258666575, 0.1458131671, 1])
scale = Scale(Geometry=divide_2.Points, Center=pt_3, Factor=remap_3.Mapped)  # -> Geometry, Transform
bnd_3 = Bounds(Numbers=graph_2)
neg_2 = Negative(Value=Slider(25, range=0..100))
intcrv_2 = Interpolate(Vertices=scale.Geometry, Degree=3, Periodic=False, KnotStyle=1)  # -> Curve, Length, Domain
remap_4 = RemapNumbers(Value=graph_2, Source=bnd_3, Target=Slider(155, range=0..1000))  # -> Mapped, Clipped
vec_2 = VectorXYZ(XComponent=Slider(25, range=0..100), YComponent=0, ZComponent=neg_2)  # -> Vector, Length
Y_3 = UnitY(Factor=1)
neg_3 = Negative(Value=remap_4.Mapped)
move_3 = Move(Geometry=intcrv_2.Curve, Motion=vec_2.Vector)  # -> Geometry, Transform
amp_2 = Amplitude(Vector=Y_3, Amplitude=neg_3)
move_4 = Move(Geometry=divide_3.Points, Motion=amp_2)  # -> Geometry, Transform
intcrv_3 = Interpolate(Vertices=move_4.Geometry, Degree=3, Periodic=False, KnotStyle=1)  # -> Curve, Length, Domain
xz_2 = XZPlane(Origin=pt_3)
mirror = Mirror(Geometry=intcrv_3.Curve, Plane=xz_2)  # -> Geometry, Transform
merge_2 = Merge(Data1=flatten(intcrv_3.Curve), Data2=flatten(move_3.Geometry), Data3=flatten(mirror.Geometry))
loft = Loft(Curves=merge_2, Options={Adjust=False, Closed=False, LoftEnds=0, LoftSimp=0, LoftType=0, Rebuild=10, Refit=0.01})
offset = Offset(Surface=loft, Distance=Slider(10, range=0..100), Retrim=True)
crv = Curve(loft)
crv_2 = Curve(offset)
merge_3 = Merge(Data1=crv, Data2=crv_2)
loft_2 = Loft(Curves=merge_3, Options={Adjust=False, Closed=False, LoftEnds=0, LoftSimp=0, LoftType=0, Rebuild=10, Refit=0.01})
merge_4 = Merge(Data1=loft, Data2=offset, Data3=loft_2)  # -> flatten(Result)
join_2 = BrepJoin(Breps=merge_4)  # -> Breps, Closed
preview = CustomPreview(Geometry=join_2.Breps, Shader=ColourSwatch(SwatchColor=RGB(237, 154, 0)))
