# Grasshopper definition Polygonal Shelf.ghx (Grasshopper 0.9.76)

number_slider = Slider(459, range=0..1000)
number_slider_2 = Slider(30, range=0..100)
number_slider_3 = Slider(7, range=0..10)
mod = Modulus(A=number_slider_3, B="2")
pt = ConstructPoint(XCoordinate=0, YCoordinate=0, ZCoordinate=0)
num = Number(number_slider)
addition = Addition(A=number_slider_3, B=mod)
number_slider_4 = Slider(2000, range=0..10000)
subtraction = Subtraction(A=num, B=number_slider_2)
polygon = Polygon(Plane=pt, Radius=number_slider, Segments=addition, FilletRadius=0)  # -> Polygon, Length
explode = Explode(Curve=polygon.Polygon, Recursive=True)  # -> Segments, Vertices
division = Division(A=subtraction, B=num)
Z = UnitZ(Factor=number_slider_4)
move = Move(Geometry=polygon.Polygon, Motion=Z)  # -> Geometry, Transform
partition = PartitionList(List=explode.Segments, Size="2")  # -> simplify(Chunks)
panel = Panel("""1
-1""")
multiplication = Multiplication(A=panel, B=number_slider_2)  # -> reverse(Result)
move_2 = Move(Geometry=partition, Motion=Z)  # -> Geometry, Transform
Z_2 = UnitZ(Factor=multiplication)
dispatch = Dispatch(List=partition, DispatchPattern=[True, False])  # -> ListA, ListB
dispatch_2 = Dispatch(List=move_2.Geometry, DispatchPattern=[True, False])  # -> ListA, ListB
end = EndPoints(Curve=dispatch.ListA)  # -> Start, End
end_2 = EndPoints(Curve=dispatch.ListB)  # -> Start, End
end_3 = EndPoints(Curve=dispatch_2.ListA)  # -> Start, End
end_4 = EndPoints(Curve=dispatch_2.ListB)  # -> Start, End
ln = Line(StartPoint=end_2.End, EndPoint=end_4.End)
ln_2 = Line(StartPoint=end.End, EndPoint=end_4.Start)
ln_3 = Line(StartPoint=end_3.End, EndPoint=end_2.Start)
ln_4 = Line(StartPoint=end_3.Start, EndPoint=end.Start)
graft = GraftTree(Tree=partition, IncludeEmptyLists=True, IncludeNullItems=True)
graft_2 = GraftTree(Tree=move_2.Geometry, IncludeEmptyLists=True, IncludeNullItems=True)
number_slider_5 = Slider(20, range=0..100)
merge = Merge(Data1=ln_2, Data2=ln_3)
merge_2 = Merge(Data1=ln_4, Data2=ln)
tstat = TreeStatistics(Tree=merge_2)  # -> Paths, Length, Count
lng = ListLength(List=tstat.Paths)
merge_3 = Merge(Data1=graft, Data2=graft_2)
dup = DuplicateData(Data=panel, Number=lng, Order=True)
lng_2 = ListLength(List=panel)
loft = Loft(Curves=merge_3, Options={Adjust=False, Closed=False, LoftEnds=0, LoftSimp=0, LoftType=0, Rebuild=10, Refit=0.01})  # -> simplify(Loft)
divide = DivideCurve(Curve=reparameterize(merge), Count=number_slider_5, Kinks=False)  # -> simplify(Points), Tangents, Parameters
divide_2 = DivideCurve(Curve=reparameterize(merge_2), Count=number_slider_5, Kinks=False)  # -> simplify(Points), Tangents, Parameters
partition_2 = PartitionList(List=dup, Size=lng_2)  # -> simplify(Chunks)
srf = Surface(reparameterize(loft))
graft_3 = GraftTree(Tree=partition_2, IncludeEmptyLists=True, IncludeNullItems=True)
rad = Radians(Degrees=Slider(90, range=0..180))
srf_cp = SurfaceClosestPoint(Point=divide_2.Points, Surface=srf)  # -> Point, UVPoint, Distance
neg = Negative(Value=rad)
evalsrf = EvaluateSurface(Surface=srf, Point=srf_cp.UVPoint)  # -> Point, Normal, Frame
dom = ConstructDomain(DomainStart=neg, DomainEnd=rad)
remap = RemapNumbers(Value=divide_2.Parameters, Source=Domain(0, 1), Target=dom)  # -> Mapped, Clipped
num_2 = Number(number_slider)
sin = Sine(Value=remap.Mapped)
Z_3 = UnitZ(Factor=1)
multiplication_2 = Multiplication(A=num_2, B=Slider(0.727, range=0..2))
bnd = Bounds(Numbers=flatten(sin))
vrot = Rotate(Vector=evalsrf.Normal, Axis=Z_3, Angle="Rad(90)")
multiplication_3 = Multiplication(A=vrot, B=graft_3)
remap_2 = RemapNumbers(Value=sin, Source=bnd, Target=multiplication_2)  # -> Mapped, Clipped
neg_2 = Negative(Value=multiplication_3)
amp = Amplitude(Vector=neg_2, Amplitude=remap_2.Mapped)
end_5 = EndPoints(Curve=merge)  # -> Start, End
merge_4 = Merge(Data1=polygon.Polygon, Data2=move.Geometry)
move_3 = Move(Geometry=divide_2.Points, Motion=amp)  # -> Geometry, Transform
crv = Curve(dispatch.ListB)
boundary = BoundarySurfaces(Edges=merge_4)
crv_2 = Curve(dispatch_2.ListA)
pt_2 = Point(end_5.Start)
item = ListItem(List=reverse(move_3.Geometry), Index=0, Wrap=True)
nurbs = NurbsCurve(Vertices=move_3.Geometry, Degree=3, Periodic=False)  # -> Curve, Length, Domain
merge_5 = Merge(Data1=crv, Data2=ln_3)
merge_6 = Merge(Data1=crv_2, Data2=ln_2)
graft_4 = GraftTree(Tree=pt_2, IncludeEmptyLists=True, IncludeNullItems=True)  # -> simplify(Tree)
extr = Extrude(Base=boundary, Direction=Z_2)
group = Group(Objects=merge_5)
ln_5 = Line(StartPoint=graft_4, EndPoint=item)
group_2 = Group(Objects=merge_6)
merge_7 = Merge(Data1=group_2, Data2=group)
merge_8 = Merge(Data1=ln_5, Data2=nurbs.Curve)
ungroup = Ungroup(Group=merge_7)
merge_9 = Merge(Data1=merge_8, Data2=ungroup)
join = JoinCurves(Curves=merge_9, Preserve=False)  # -> simplify(Curves)
num_3 = Number(number_slider_2)
num_4 = Number(division)
pt_3 = Point(pt)
neg_3 = Negative(Value=num_3)
crv_3 = Curve(polygon.Polygon)
division_2 = Division(A=num_3, B=2)
scale_nu = ScaleNU(Geometry=join, Plane=pt_3, ScaleX=num_4, ScaleY=num_4, ScaleZ=1)  # -> Geometry, Transform
Z_4 = UnitZ(Factor=neg_3)
line = LineSDL(Start=pt, Direction=Z, Length=number_slider_4)
scale_nu_2 = ScaleNU(Geometry=crv_3, Plane=pt_3, ScaleX=num_4, ScaleY=num_4, ScaleZ=1)  # -> Geometry, Transform
Z_5 = UnitZ(Factor=division_2)
merge_10 = Merge(Data1=scale_nu.Geometry, Data2=join)
divide_3 = DivideCurve(Curve=line, Count=Slider(10, range=0..10), Kinks=False)  # -> Points, Tangents, Parameters
fillet = Fillet(Curve=scale_nu_2.Geometry, Radius=Slider(72, range=0..200))
loft_2 = Loft(Curves=merge_10, Options={Adjust=False, Closed=False, LoftEnds=0, LoftSimp=0, LoftType=0, Rebuild=10, Refit=0.01})
boundary_2 = BoundarySurfaces(Edges=join)
boundary_3 = BoundarySurfaces(Edges=scale_nu.Geometry)
firstlastitem = FirstLastItem(list=divide_3.Points)  # -> first_item, rest_item, last_item
boundary_4 = BoundarySurfaces(Edges=fillet)
merge_11 = Merge(Data1=boundary_3, Data2=loft_2, Data3=boundary_2)
extr_2 = Extrude(Base=boundary_4, Direction=Z_4)
move_4 = Move(Geometry=extr_2, Motion=Z_5)  # -> Geometry, Transform
orient = Orient(Geometry=move_4.Geometry, Source=PlaneXY(0, 0, 0), Target=firstlastitem.rest_item)  # -> Geometry, Transform
join_2 = BrepJoin(Breps=merge_11)  # -> Breps, Closed
merge_12 = Merge(Data1=orient.Geometry, Data2=extr)
merge_13 = Merge(Data1=join_2.Breps)
preview = CustomPreview(Geometry=merge_13, Shader=ColourSwatch(SwatchColor=RGB(200, 140, 255)))
preview_2 = CustomPreview(Geometry=merge_12, Shader=ColourSwatch(SwatchColor=RGB(223, 195, 250)))

# ==== cluster FirstLastItem
list = ClusterInput()
lng = ListLength(List=list)  # -> expr("x-1", Length)
cull_i = CullIndex(List=list, Indices=lng, Wrap=False)
item = ListItem(List=list, Index=lng, Wrap=False)  # -> simplify(Element)
item_2 = ListItem(List=list, Index=0, Wrap=False)  # -> simplify(Element)
cull_i_2 = CullIndex(List=cull_i, Indices=0, Wrap=False)  # -> simplify(List)
rest_item = ClusterOutput(cull_i_2)
last_item = ClusterOutput(item)
first_item = ClusterOutput(item_2)
