# Grasshopper definition Impossible Object.ghx (Grasshopper 0.9.76)

number_slider = Slider(17, range=0..100)
number_slider_2 = Slider(126, range=0..200)
number_slider_3 = Slider(90, range=0..100)
number_slider_4 = Slider(32, range=0..100)
pt = ConstructPoint(XCoordinate=0, YCoordinate=0, ZCoordinate=0)
rectangle = Rectangle(Plane=pt, XSize=number_slider_3, YSize=number_slider_4, Radius=0)  # -> Rectangle, Length
rectangle_2 = Rectangle(Plane=pt, XSize=number_slider, YSize=number_slider_4, Radius=0)  # -> Rectangle, Length
Z = UnitZ(Factor=number_slider)
boundary = BoundarySurfaces(Edges=rectangle.Rectangle)
subtraction = Subtraction(A=number_slider_2, B=number_slider)
move = Move(Geometry=rectangle_2.Rectangle, Motion=Z)  # -> Geometry, Transform
neg = Negative(Value="2")
boundary_2 = BoundarySurfaces(Edges=move.Geometry)
extr = Extrude(Base=boundary, Direction=Z)
Z_2 = UnitZ(Factor=number_slider_2)
division = Division(A=subtraction, B=neg)
division_2 = Division(A=subtraction, B="2")
Z_3 = UnitZ(Factor=number_slider)
area = Area(Geometry=extr)  # -> Area, Centroid
extr_2 = Extrude(Base=boundary_2, Direction=Z_2)
dom = ConstructDomain(DomainStart=division, DomainEnd=division_2)
addition = Addition(A=Z_2, B=Z_3)
remap = RemapNumbers(Value=Slider(0.931, range=0..1), Source=Domain(0, 1), Target=dom)  # -> Mapped, Clipped
area_2 = Area(Geometry=extr_2)  # -> Area, Centroid
rotate = Rotate(Geometry=extr_2, Angle="Rad(180)", Plane=area.Centroid)  # -> Geometry, Transform
move_2 = Move(Geometry=extr, Motion=addition)  # -> Geometry, Transform
xy = XYPlane(Origin=area_2.Centroid)
Z_4 = UnitZ(Factor=remap.Mapped)
num = Number(number_slider_4)
merge = Merge(Data1=extr, Data2=move_2.Geometry, Data3=extr_2, Data4=rotate.Geometry)
move_3 = Move(Geometry=xy, Motion=Z_4)  # -> Geometry, Transform
swatch = ColourSwatch(SwatchColor=RGB(112, 172, 255))
division_3 = Division(A=num, B="2")
neg_2 = Negative(Value=division_3)
preview = CustomPreview(Geometry=merge, Shader=swatch)
neg_3 = Negative(Value=number_slider_2)
dom_2 = ConstructDomain(DomainStart=neg_2, DomainEnd=division_3)
rectangle_3 = Rectangle(Plane=move_3.Geometry, XSize=dom_2, YSize=neg_3, Radius=0)  # -> Rectangle, Length
num_2 = Number(number_slider)
division_4 = Division(A=num_2, B=-2)
Z_5 = UnitZ(Factor=num_2)
boundary_3 = BoundarySurfaces(Edges=rectangle_3.Rectangle)
extr_3 = Extrude(Base=boundary_3, Direction=Z_5)
Z_6 = UnitZ(Factor=division_4)
move_4 = Move(Geometry=extr_3, Motion=Z_6)  # -> Geometry, Transform
Y = UnitY(Factor=number_slider_4)
move_5 = Move(Geometry=move_4.Geometry, Motion=Y)  # -> Geometry, Transform
area_3 = Area(Geometry=move_5.Geometry)  # -> Area, Centroid
scale_nu = ScaleNU(Geometry=move_5.Geometry, Plane=area_3.Centroid, ScaleX=1, ScaleY=Slider(1.5, range=0..10), ScaleZ=1)  # -> Geometry, Transform
brep = Brep(extr_2)
col = Colour(swatch)
sdiff = SolidDifference(BrepsA=brep, BrepsB=scale_nu.Geometry)
preview_2 = CustomPreview(Geometry=scale_nu.Geometry, Shader=col)
area_4 = Area(Geometry=sdiff)  # -> Area, Centroid
pdecon = Deconstruct(Point=area_4.Centroid)  # -> XComponent, YComponent, ZComponent
subtraction_2 = Subtraction(A=number_slider_3, B=number_slider)
sort = SortList(Keys=pdecon.ZComponent, ValuesA=sdiff)  # -> Keys, reverse(ValuesA)
Y_2 = UnitY(Factor=subtraction_2)
item = ListItem(List=sort.ValuesA, Index=0, Wrap=True)
neg_4 = Negative(Value=Y_2)
move_6 = Move(Geometry=item, Motion=neg_4)  # -> Geometry, Transform
debrep = DeconstructBrep(Brep=move_6.Geometry)  # -> Faces, Edges, Vertices
area_5 = Area(Geometry=debrep.Faces)  # -> Area, Centroid
pdecon_2 = Deconstruct(Point=area_5.Centroid)  # -> XComponent, YComponent, ZComponent
sort_2 = SortList(Keys=pdecon_2.XComponent, ValuesA=debrep.Faces)  # -> Keys, ValuesA
sort_3 = SortList(Keys=pdecon_2.YComponent, ValuesA=debrep.Faces)  # -> Keys, ValuesA
item_2 = ListItem(List=sort_2.ValuesA, Index=0, Wrap=True)
item_3 = ListItem(List=sort_3.ValuesA, Index=0, Wrap=True)
merge_2 = Merge(Data1=item_3, Data2=item_2)
sin = Sine(Value="Rad(30)")
join = BrepJoin(Breps=merge_2)  # -> Breps, Closed
multiplication = Multiplication(A=subtraction_2, B=sin)
box_corners = BoxCorners(Box=join.Breps)  # -> CornerA, CornerB, CornerC, CornerD, CornerE, CornerF, CornerG, CornerH
multiplication_2 = Multiplication(A=multiplication, B="2")
dist = Distance(PointA=box_corners.CornerA, PointB=box_corners.CornerE)
addition_2 = Addition(A=dist, B=multiplication_2)
division_5 = Division(A=addition_2, B=dist)
scale_nu_2 = ScaleNU(Geometry=merge_2, Plane=box_corners.CornerA, ScaleX=1, ScaleY=1, ScaleZ=division_5)  # -> Geometry, Transform
item_4 = ListItem(List=scale_nu_2.Geometry, Index=0, Wrap=True)
item_5 = ListItem(List=scale_nu_2.Geometry, Index=1, Wrap=True)
debrep_2 = DeconstructBrep(Brep=item_5)  # -> Faces, Edges, Vertices
rad = Radians(Degrees=Slider(45, range=0..100))
item_6 = ListItem(List=debrep_2.Vertices, Index=0, Wrap=True)
X = UnitX(Factor=1)
Y_3 = UnitY(Factor=1)
neg_5 = Negative(Value=rad)
vrot = Rotate(Vector=Y_3, Axis=X, Angle=neg_5)
pl = ConstructPlane(Origin=item_6, XAxis=X, YAxis=vrot)
sec = BrepPlane(Brep=item_5, Plane=pl)  # -> Curves, Points
srfsplit = SurfaceSplit(Surface=item_5, Curves=sec.Curves)
area_6 = Area(Geometry=srfsplit)  # -> Area, Centroid
pdecon_3 = Deconstruct(Point=area_6.Centroid)  # -> XComponent, YComponent, ZComponent
sort_4 = SortList(Keys=pdecon_3.ZComponent, ValuesA=srfsplit)  # -> Keys, ValuesA
item_7 = ListItem(List=sort_4.ValuesA, Index=0, Wrap=True)
merge_3 = Merge(Data1=item_4, Data2=item_7)
col_2 = Colour(col)
preview_3 = CustomPreview(Geometry=merge_3, Shader=col_2)
