# Grasshopper definition Puzzle Ring.ghx (Grasshopper 0.9.76)

pt = ConstructPoint(XCoordinate=0, YCoordinate=0, ZCoordinate=0)
polygon = Polygon(Plane=pt, Radius=Slider(100, range=0..100), Segments=Slider(3, range=3..6), FilletRadius=0)  # -> Polygon, Length
explode = Explode(Curve=polygon.Polygon, Recursive=True)  # -> Segments, Vertices
divide = DivideCurve(Curve=reparameterize(explode.Segments), Count=Slider(20, range=0..100), Kinks=False)  # -> Points, Tangents, Parameters
Z = UnitZ(Factor=1)
vrot = Rotate(Vector=divide.Tangents, Axis=Z, Angle="Rad(90)")
remap = RemapNumbers(Value=divide.Parameters, Source=Domain(0, 1), Target="Rad(360)")  # -> Mapped, Clipped
sin = Sine(Value=remap.Mapped)
multiplication = Multiplication(A=sin, B=Slider(23.6, range=0..100))
amp = Amplitude(Vector=vrot, Amplitude=multiplication)
move = Move(Geometry=divide.Points, Motion=amp)  # -> Geometry, Transform
nurbs = NurbsCurve(Vertices=move.Geometry, Degree=3, Periodic=False)  # -> flatten(Curve), Length, Domain
join = JoinCurves(Curves=nurbs.Curve, Preserve=False)
number_slider = Slider(32, range=0..100)
neg = Negative(Value=Slider(5, range=0..10))
offset = Offset(Curve=join, Distance=neg, Plane=PlaneXY(0, 0, 0), Corners=1)
merge = Merge(Data1=join, Data2=offset)  # -> flatten(Result)
loft = Loft(Curves=merge, Options={Adjust=False, Closed=False, LoftEnds=0, LoftSimp=0, LoftType=0, Rebuild=10, Refit=0.01})
vec = VectorXYZ(XComponent=number_slider, YComponent=number_slider, ZComponent=0)  # -> Vector, Length
neg_2 = Negative(Value=Slider(40.7, range=0..100))
number_slider_2 = Slider(10, range=0..20)
move_2 = Move(Geometry=loft, Motion=vec.Vector)  # -> Geometry, Transform
Z_2 = UnitZ(Factor=Slider(9.92, range=0..10))
rad = Radians(Degrees=Slider(90, range=-90..90))
rad_2 = Radians(Degrees=neg_2)
extr = Extrude(Base=move_2.Geometry, Direction=Z_2)
yz = YZPlane(Origin=Point(0, 0, 0))
num = Number("Rad(360)")
rotate = Rotate(Geometry=extr, Angle=rad, Plane=pt)  # -> Geometry, Transform
range = Range(Domain=num, Steps=number_slider_2)
range_2 = Range(Domain=Domain(0, 1), Steps=number_slider_2)
rotate_2 = Rotate(Geometry=rotate.Geometry, Angle=rad_2, Plane=yz)  # -> Geometry, Transform
cull_i = CullIndex(List=reverse(range_2), Indices=0, Wrap=True)  # -> reverse(List)
cull_i_2 = CullIndex(List=reverse(range), Indices=0, Wrap=True)  # -> reverse(List)
rotate_3 = Rotate(Geometry=rotate_2.Geometry, Angle=cull_i_2, Plane=PlaneXY(0, 0, 0))  # -> Geometry, Transform
gradient = Gradient(
    LowerLimit=0,
    UpperLimit=1,
    Parameter=cull_i,
    stops=[0: RGB(0, 98, 0), 0.25: RGB(18, 144, 176), 0.47: RGB(236, 255, 64), 0.75: RGB(40, 218, 235), 1: RGB(3, 76, 0)])
preview = CustomPreview(Geometry=rotate_3.Geometry, Shader=gradient)
