# Grasshopper definition Contour Chair Cut.ghx (Grasshopper 0.9.76)
# plug-ins: Weaverbird

number_slider = Slider(280, range=0..1000)
xz = XZPlane(Origin=Point(0, 0, 0))
recgrid = Rectangular(Plane=xz, SizeX=Slider(808, range=0..1000), SizeY=number_slider, ExtentX="1", ExtentY="2")  # -> Cells, Points
explode = Explode(Curve=recgrid.Cells, Recursive=True)  # -> simplify(Segments), Vertices
eval = EvaluateLength(Curve=explode.Segments, Length="0.5", Normalized=True)  # -> Point, Tangent, Parameter
pdecon = Deconstruct(Point=eval.Point)  # -> XComponent, YComponent, ZComponent
sort = SortList(Keys=pdecon.XComponent, ValuesA=explode.Segments)  # -> Keys, ValuesA
subtraction = Subtraction(A=Slider(800, range=0..1000), B=number_slider)
bang = ExplodeTree(Data=reverse(sort.ValuesA))  # -> Branch0, Branch1
item = ListItem(List=bang.Branch1, Index="0", Wrap=True)
len = Length(Curve=item)
end = EndPoints(Curve=item)  # -> Start, End
division = Division(A=subtraction, B=len)
pt = Point(end.Start)
cull_i = CullIndex(List=bang.Branch0, Indices="0", Wrap=True)
scale = Scale(Geometry=item, Center=pt, Factor=division)  # -> Geometry, Transform
merge = Merge(Data1=flatten(cull_i), Data2=flatten(scale.Geometry))
panel = Panel("0")
join = JoinCurves(Curves=merge, Preserve=False)  # -> reparameterize(Curves)
divide = DivideCurve(Curve=join, Count=Slider(7, range=0..20), Kinks=False)  # -> Points, Tangents, Parameters
neg = Negative(Value="1")
Y = UnitY(Factor=1)
eval_2 = EvaluateCurve(Curve=join, Parameter=divide.Parameters)  # -> Point, Tangent, Angle
xz_2 = XZPlane(Origin=Point(0, 0, 0))
vrot = Rotate(Vector=eval_2.Tangent, Axis=Y, Angle="Rad(90)")
graph = GraphMapper(
    divide.Parameters,
    x0=0,
    x1=1,
    y0=0,
    y1=1,
    container_name="Bezier",
    cpx=[0, 0.5201182365, 0.3170614839, 1],
    cpy=[0, 0.2844638824, 0, 0])
graph_2 = GraphMapper(
    divide.Parameters,
    x0=0,
    x1=1,
    y0=0,
    y1=1,
    container_name="Bezier",
    cpx=[0, 0.3073883057, 0.6238681674, 1],
    cpy=[0, 0.2308986783, 0.08911752701, 0])
xy = XYPlane(Origin=Point(0, 0, 0))
dom = ConstructDomain(DomainStart=Slider(110, range=0..400), DomainEnd=Slider(410, range=0..600))
dom_2 = ConstructDomain(DomainStart=Slider(106, range=0..400), DomainEnd=Slider(368, range=0..400))
bnd = Bounds(Numbers=graph)
bnd_2 = Bounds(Numbers=graph_2)
remap = RemapNumbers(Value=graph, Source=bnd, Target=dom)  # -> Mapped, Clipped
remap_2 = RemapNumbers(Value=graph_2, Source=bnd_2, Target=dom_2)  # -> Mapped, Clipped
multiplication = Multiplication(A=Y, B=Slider(0.27, range=0..1))
multiplication_2 = Multiplication(A=vrot, B=Slider(1, range=0..1))
amp = Amplitude(Vector=vrot, Amplitude=Slider(100, range=0..200))
line = LineSDL(Start=eval_2.Point, Direction=Y, Length=remap_2.Mapped)
addition = Addition(A=multiplication, B=multiplication_2)
end_2 = EndPoints(Curve=line)  # -> Start, End
move = Move(Geometry=line, Motion=amp)  # -> Geometry, Transform
amp_2 = Amplitude(Vector=addition, Amplitude=remap.Mapped)
pt_2 = Point(end_2.End)
end_3 = EndPoints(Curve=move.Geometry)  # -> Start, End
line_2 = LineSDL(Start=pt_2, Direction=amp_2, Length=remap.Mapped)
end_4 = EndPoints(Curve=line_2)  # -> Start, End
ln = Line(StartPoint=end_3.End, EndPoint=end_4.End)
firstlastitem = FirstLastItem(list=line_2)  # -> first_item, rest_item, last_item
firstlastitem_2 = FirstLastItem(list=line)  # -> first_item, rest_item, last_item
firstlastitem_3 = FirstLastItem(list=ln)  # -> first_item, rest_item, last_item
firstlastitem_4 = FirstLastItem(list=move.Geometry)  # -> first_item, rest_item, last_item
graft = GraftTree(Tree=move.Geometry, IncludeEmptyLists=True, IncludeNullItems=True)  # -> simplify(Tree)
graft_2 = GraftTree(Tree=line, IncludeEmptyLists=True, IncludeNullItems=True)  # -> simplify(Tree)
graft_3 = GraftTree(Tree=ln, IncludeEmptyLists=True, IncludeNullItems=True)  # -> simplify(Tree)
graft_4 = GraftTree(Tree=line_2, IncludeEmptyLists=True, IncludeNullItems=True)  # -> simplify(Tree)
Y_2 = UnitY(Factor=1)
simplenull = SimpleNull()  # -> out, A
# ---------- simplenull: C# ----------
    A = null;
# ---------- end simplenull ----------
merge_2 = Merge(Data1=firstlastitem_3.last_item, Data2=firstlastitem.last_item)
merge_3 = Merge(Data1=firstlastitem_4.first_item, Data2=firstlastitem_2.first_item)
merge_4 = Merge(Data1=firstlastitem_4.last_item, Data2=firstlastitem_2.last_item)
merge_5 = Merge(Data1=firstlastitem_3.first_item, Data2=firstlastitem.first_item)
group = Group(Objects=simplenull.A)
merge_6 = Merge(Data1=graft, Data2=graft_3, Data3=graft_2, Data4=graft_4)
graft_5 = GraftTree(Tree=merge_4, IncludeEmptyLists=True, IncludeNullItems=True)  # -> simplify(Tree)
graft_6 = GraftTree(Tree=merge_5, IncludeEmptyLists=True, IncludeNullItems=True)  # -> simplify(Tree)
graft_7 = GraftTree(Tree=merge_3, IncludeEmptyLists=True, IncludeNullItems=True)  # -> simplify(Tree)
graft_8 = GraftTree(Tree=merge_2, IncludeEmptyLists=True, IncludeNullItems=True)  # -> simplify(Tree)
join_2 = JoinCurves(Curves=merge_6, Preserve=False)  # -> flatten(Curves)
merge_7 = Merge(Data1=graft_7, Data2=graft_5, Data3=graft_6, Data4=graft_8)
flip = FlipMatrix(Data=merge_7)
loft = Loft(Curves=flip, Options={Adjust=False, Closed=False, LoftEnds=0, LoftSimp=0, LoftType=0, Rebuild=10, Refit=0.01})
loft_2 = Loft(Curves=join_2, Options={Adjust=False, Closed=False, LoftEnds=0, LoftSimp=0, LoftType=3, Rebuild=10, Refit=0.01})
merge_8 = Merge(Data1=flatten(loft), Data2=flatten(loft_2))
xz_3 = XZPlane(Origin=Point(0, 0, 0))
join_3 = BrepJoin(Breps=merge_8)  # -> Breps, Closed
mirror = Mirror(Geometry=join_3.Breps, Plane=xz_3)  # -> Geometry, Transform
merge_9 = Merge(Data1=join_3.Breps, Data2=mirror.Geometry)
join_4 = BrepJoin(Breps=merge_9)  # -> Breps, Closed
number_slider_2 = Slider(10, range=0..100)
area = Area(Geometry=join_4.Breps)  # -> Area, Centroid
smesh = SimpleMesh(Brep=join_4.Breps)
wbcatmullclark = WeaverbirdsCatmullClarkSubdivision(MeshCurves=smesh, Level=Slider(3, range=0..10), SmoothNakedEdges=1)
Y_3 = UnitY(Factor=1)
contour = Contour(Shape=wbcatmullclark, Point=area.Centroid, Direction=Y_3, Distance=number_slider_2)  # -> simplify(Contours)
reb = RebuildCurve(Curve=contour, Degree="3", Count=Slider(80, range=0..100), Tangents=False)
crv = Curve(flatten(reb))
graft_9 = GraftTree(Tree=crv, IncludeEmptyLists=True, IncludeNullItems=True)  # -> simplify(Tree)
bbox = BoundingBox(Content=crv, Plane=PlaneXY(0, 0, 0))  # -> Box, Box_2
group_2 = Group(Objects=graft_9)
debrep = DeconstructBrep(Brep=bbox.Box)  # -> Faces, Edges, Vertices
item_2 = ListItem(List=debrep.Faces, Index=0, Wrap=True)
area_2 = Area(Geometry=item_2)  # -> Area, Centroid
srf_cp = SurfaceClosestPoint(Point=area_2.Centroid, Surface=reparameterize(item_2))  # -> Point, UVPoint, Distance
shift = ShiftList(List=crv, Shift=1, Wrap=False)
shift_2 = ShiftList(List=crv, Shift=neg, Wrap=False)
dim = Dimensions(Surface=simplify(item_2))  # -> UDimension, VDimension
evalsrf = EvaluateSurface(Surface=reparameterize(item_2), Point=srf_cp.UVPoint)  # -> Point, Normal, graft(Frame)
project = Project(Geometry=shift_2, Plane=xz_2)  # -> Geometry, Transform
project_2 = Project(Geometry=shift, Plane=xz_2)  # -> Geometry, Transform
bbox_2 = BoundingBox(Content=shift, Plane=PlaneXY(0, 0, 0))  # -> Box, Box_2
flatten = FlattenTree(Tree=dim.UDimension, Path="{0}")
panel_2 = Panel(dim.UDimension)
graft_10 = GraftTree(Tree=project.Geometry, IncludeEmptyLists=True, IncludeNullItems=True)
graft_11 = GraftTree(Tree=project_2.Geometry, IncludeEmptyLists=True, IncludeNullItems=True)
area_3 = Area(Geometry=bbox_2.Box)  # -> Area, Centroid
consec = ConsecutiveDomains(Numbers=flatten, Additive=True)
trim = TrimWithRegion(Curve=graft_10, Region=graft_11)  # -> simplify(Inside), Outside
dedomain = DeconstructDomain(Domain=consec)  # -> Start, End
merge_10 = Merge(Data1=flatten("0"), Data2=flatten(dedomain.Start))
crv_2 = Curve(simplify(trim.Inside))
bbox_3 = BoundingBox(Content=crv_2, Plane=PlaneXY(0, 0, 0), UnionBox=True)  # -> Box, Box_2
X = UnitX(Factor=merge_10)  # -> graft(UnitVector)
area_4 = Area(Geometry=bbox_3.Box)  # -> Area, Centroid
pdecon_2 = Deconstruct(Point=area_3.Centroid)  # -> XComponent, YComponent, ZComponent
pdecon_3 = Deconstruct(Point=area_4.Centroid)  # -> XComponent, YComponent, ZComponent
lng = ListLength(List=crv)
pt_3 = ConstructPoint(XCoordinate=0, YCoordinate=pdecon_2.YComponent, ZCoordinate=0)  # -> simplify(graft(Point))
pt_4 = ConstructPoint(XCoordinate=0, YCoordinate=pdecon_3.YComponent, ZCoordinate=0)  # -> simplify(Point)
series = Series(Start="1", Step=1, Count=lng)
vec2pt = Vector2Pt(PointA=pt_4, PointB=pt_3, Unitize=False)  # -> Vector, Length
int = Integer(series)
move_2 = Move(Geometry=crv_2, Motion=vec2pt.Vector)  # -> Geometry, Transform
singlestroketext = SingleStrokeText(txt=int, size=Slider(8, range=0..100))  # -> simplify(txtcrvs)
group_3 = Group(Objects=move_2.Geometry)
bbox_4 = BoundingBox(Content=singlestroketext, Plane=PlaneXY(0, 0, 0), UnionBox=True)  # -> Box, Box_2
flatten_2 = FlattenTree(Tree=group_3, Path="{0}")
area_5 = Area(Geometry=bbox_4.Box)  # -> Area, simplify(Centroid)
merge_11 = Merge(Data1=group, Data2=flatten_2)
merge_12 = Merge(Data1=group_2, Data2=simplify(graft(merge_11)))
orient = Orient(Geometry=merge_12, Source=evalsrf.Frame, Target=xy)  # -> simplify(Geometry), Transform
move_3 = Move(Geometry=orient.Geometry, Motion=X)  # -> simplify(Geometry), Transform
item_3 = ListItem(List=move_3.Geometry, Index=0, Wrap=True)
ungroup = Ungroup(Group=item_3)  # -> simplify(Objects)
area_6 = Area(Geometry=ungroup)  # -> Area, Centroid
contour_2 = Contour(Shape=ungroup, Point=area_6.Centroid, Direction=Y_2, Distance=Slider(500, range=0..500))
pshift = ShiftPaths(Data=contour_2, Offset=-1)
len_2 = Length(Curve=pshift)
sort_2 = SortList(Keys=len_2, ValuesA=pshift)  # -> Keys, reverse(ValuesA)
item_4 = ListItem(List=sort_2.ValuesA, Index=0, Wrap=True)
ungroup_2 = Ungroup(Group=merge_11)  # -> simplify(Objects)
midpoint = MidPoint(crv=item_4)  # -> simplify(pt)
vec2pt_2 = Vector2Pt(PointA=area_5.Centroid, PointB=midpoint, Unitize=False)  # -> Vector, Length
geo = Geometry(item_3)
item_5 = ListItem(List=move_3.Geometry, Index=1, Wrap=True)
move_4 = Move(Geometry=singlestroketext, Motion=vec2pt_2.Vector)  # -> Geometry, Transform
ungroup_3 = Ungroup(Group=item_5)  # -> simplify(Objects)
ungroup_4 = Ungroup(Group=geo)  # -> simplify(Objects)
join_5 = JoinCurves(Curves=move_4.Geometry, Preserve=False)  # -> simplify(Curves)
merge_13 = Merge(Data1=ungroup_4, Data2=ungroup_3, Data3=join_5)
scale_2 = Scale(Geometry=merge_13, Center=Point(0, 0, 0), Factor=Slider(0.2, range=0..1))  # -> Geometry, Transform
Y_4 = UnitY(Factor=number_slider_2)
boundary = BoundarySurfaces(Edges=reb)
division_2 = Division(A=Y_4, B=-2)
extr = Extrude(Base=boundary, Direction=Y_4)
move_5 = Move(Geometry=extr, Motion=division_2)  # -> Geometry, Transform
flatten_3 = FlattenTree(Tree=move_5.Geometry, Path="{0}")
lng_2 = ListLength(List=flatten_3)  # -> expr("x-1", Length)
range = Range(Domain=Domain(0, 1), Steps=lng_2)
gradient = Gradient(
    LowerLimit=0,
    UpperLimit=1,
    Parameter=range,
    stops=[0: RGB(255, 228, 189), 0.532: RGB(201, 147, 60), 1: RGB(255, 228, 189)])
preview = CustomPreview(Geometry=flatten_3, Shader=gradient)

# ==== cluster FirstLastItem
list = ClusterInput()
lng = ListLength(List=list)  # -> expr("x-1", Length)
cull_i = CullIndex(List=list, Indices=lng, Wrap=False)
item = ListItem(List=list, Index=lng, Wrap=False)  # -> simplify(Element)
item_2 = ListItem(List=list, Index=0, Wrap=False)  # -> simplify(Element)
cull_i_2 = CullIndex(List=cull_i, Indices=0, Wrap=False)  # -> simplify(List)
rest_item = ClusterOutput(cull_i_2)
last_item = ClusterOutput(item)
first_item = ClusterOutput(item_2)

# ==== cluster SingleStrokeText: Single Stroke Text using Machine Tool Gothic font
size = ClusterInput()
txt = ClusterInput()
P = ClusterInput()
text_doc = CSharpScript(txt=txt, face="Machine Tool Gothic", size=size, P=P)  # -> out, A; inputs txt: String, face: String, size: Double, P: Point3d
# ---------- text_doc: C# ----------
    System.Globalization.CultureInfo invariant = System.Globalization.CultureInfo.InvariantCulture;
    if(size == 0)
      size = 1;

    string command = string.Format("_-TextObject _GroupOutput=No _FontName=\"{0}\" _Italic=No _Bold=No _Height={1} _Output=Curves _AllowOpenCurves=Yes \"{2}\" w{3},{4},{5}",
      face, size.ToString(invariant), txt, P.X.ToString(invariant), P.Y.ToString(invariant), P.Z.ToString(invariant));
    
    RhinoApp.RunScript(command, false);
    RhinoApp.RunScript("_SelLast", false);

    Rhino.Input.Custom.GetObject go = new Rhino.Input.Custom.GetObject();
    go.EnablePreSelect(true, true);

    go.GetMultiple(0, -1);

    if(go.ObjectCount == 0)
      return;

    List<Curve> results = new List<Curve>(go.ObjectCount);
    foreach(Rhino.DocObjects.ObjRef reference in go.Objects())
    {

      Curve c = reference.Curve();
      if(c != null)
        results.Add(c);

      RhinoDoc.ActiveDoc.Objects.Delete(reference, false);
    }

    A = results;
# ---------- end text_doc ----------
txtcrvs = ClusterOutput(text_doc.A)

# ==== cluster MidPoint: Middle Point of Curve
crv = ClusterInput()
num = Number(0.5)
eval = EvaluateLength(Curve=crv, Length=num, Normalized=True)  # -> Point, Tangent, Parameter
pt = ClusterOutput(eval.Point)
