# Grasshopper definition Contour Chair.ghx (Grasshopper 0.9.76)
# plug-ins: Weaverbird

xz = XZPlane(Origin=Point(0, 0, 0))
recgrid = Rectangular(Plane=xz, SizeX=Slider(808, range=0..1000), SizeY=Slider(370, range=0..1000), ExtentX="1", ExtentY="2")  # -> Cells, Points
explode = Explode(Curve=recgrid.Cells, Recursive=True)  # -> simplify(Segments), Vertices
eval = EvaluateLength(Curve=explode.Segments, Length="0.5", Normalized=True)  # -> Point, Tangent, Parameter
pdecon = Deconstruct(Point=eval.Point)  # -> XComponent, YComponent, ZComponent
sort = SortList(Keys=pdecon.XComponent, ValuesA=explode.Segments)  # -> Keys, ValuesA
bang = ExplodeTree(Data=reverse(sort.ValuesA))  # -> Branch0, Branch1
cull_i = CullIndex(List=bang.Branch0, Indices="0", Wrap=True)
item = ListItem(List=bang.Branch1, Index="0", Wrap=True)
merge = Merge(Data1=flatten(cull_i), Data2=flatten(item))
panel = Panel("0")
join = JoinCurves(Curves=merge, Preserve=False)  # -> reparameterize(Curves)
divide = DivideCurve(Curve=join, Count=Slider(7, range=0..20), Kinks=False)  # -> Points, Tangents, Parameters
Y = UnitY(Factor=1)
eval_2 = EvaluateCurve(Curve=join, Parameter=divide.Parameters)  # -> Point, Tangent, Angle
vrot = Rotate(Vector=eval_2.Tangent, Axis=Y, Angle="Rad(90)")
graph = GraphMapper(
    divide.Parameters,
    x0=0,
    x1=1,
    y0=0,
    y1=1,
    container_name="Bezier",
    cpx=[0, 0.5201182365, 0.3170614839, 1],
    cpy=[0, 0.2844638824, 0, 0])
graph_2 = GraphMapper(
    divide.Parameters,
    x0=0,
    x1=1,
    y0=0,
    y1=1,
    container_name="Bezier",
    cpx=[0, 0.3073883057, 0.6238681674, 1],
    cpy=[0, 0.2308986783, 0.08911752701, 0])
dom = ConstructDomain(DomainStart=Slider(110, range=0..400), DomainEnd=Slider(410, range=0..600))
dom_2 = ConstructDomain(DomainStart=Slider(106, range=0..400), DomainEnd=Slider(368, range=0..400))
bnd = Bounds(Numbers=graph)
bnd_2 = Bounds(Numbers=graph_2)
remap = RemapNumbers(Value=graph, Source=bnd, Target=dom)  # -> Mapped, Clipped
remap_2 = RemapNumbers(Value=graph_2, Source=bnd_2, Target=dom_2)  # -> Mapped, Clipped
multiplication = Multiplication(A=Y, B=Slider(0.27, range=0..1))
multiplication_2 = Multiplication(A=vrot, B=Slider(1, range=0..1))
amp = Amplitude(Vector=vrot, Amplitude=Slider(100, range=0..200))
line = LineSDL(Start=eval_2.Point, Direction=Y, Length=remap_2.Mapped)
addition = Addition(A=multiplication, B=multiplication_2)
end = EndPoints(Curve=line)  # -> Start, End
move = Move(Geometry=line, Motion=amp)  # -> Geometry, Transform
amp_2 = Amplitude(Vector=addition, Amplitude=remap.Mapped)
pt = Point(end.End)
end_2 = EndPoints(Curve=move.Geometry)  # -> Start, End
line_2 = LineSDL(Start=pt, Direction=amp_2, Length=remap.Mapped)
end_3 = EndPoints(Curve=line_2)  # -> Start, End
ln = Line(StartPoint=end_2.End, EndPoint=end_3.End)
firstlastitem = FirstLastItem(list=line_2)  # -> first_item, rest_item, last_item
firstlastitem_2 = FirstLastItem(list=line)  # -> first_item, rest_item, last_item
firstlastitem_3 = FirstLastItem(list=ln)  # -> first_item, rest_item, last_item
firstlastitem_4 = FirstLastItem(list=move.Geometry)  # -> first_item, rest_item, last_item
graft = GraftTree(Tree=move.Geometry, IncludeEmptyLists=True, IncludeNullItems=True)  # -> simplify(Tree)
graft_2 = GraftTree(Tree=line, IncludeEmptyLists=True, IncludeNullItems=True)  # -> simplify(Tree)
graft_3 = GraftTree(Tree=ln, IncludeEmptyLists=True, IncludeNullItems=True)  # -> simplify(Tree)
graft_4 = GraftTree(Tree=line_2, IncludeEmptyLists=True, IncludeNullItems=True)  # -> simplify(Tree)
merge_2 = Merge(Data1=firstlastitem_3.last_item, Data2=firstlastitem.last_item)
merge_3 = Merge(Data1=firstlastitem_4.first_item, Data2=firstlastitem_2.first_item)
merge_4 = Merge(Data1=firstlastitem_4.last_item, Data2=firstlastitem_2.last_item)
merge_5 = Merge(Data1=firstlastitem_3.first_item, Data2=firstlastitem.first_item)
merge_6 = Merge(Data1=graft, Data2=graft_3, Data3=graft_2, Data4=graft_4)
graft_5 = GraftTree(Tree=merge_4, IncludeEmptyLists=True, IncludeNullItems=True)  # -> simplify(Tree)
graft_6 = GraftTree(Tree=merge_5, IncludeEmptyLists=True, IncludeNullItems=True)  # -> simplify(Tree)
graft_7 = GraftTree(Tree=merge_3, IncludeEmptyLists=True, IncludeNullItems=True)  # -> simplify(Tree)
graft_8 = GraftTree(Tree=merge_2, IncludeEmptyLists=True, IncludeNullItems=True)  # -> simplify(Tree)
join_2 = JoinCurves(Curves=merge_6, Preserve=False)  # -> flatten(Curves)
merge_7 = Merge(Data1=graft_7, Data2=graft_5, Data3=graft_6, Data4=graft_8)
flip = FlipMatrix(Data=merge_7)
loft = Loft(Curves=flip, Options={Adjust=False, Closed=False, LoftEnds=0, LoftSimp=0, LoftType=0, Rebuild=10, Refit=0.01})
loft_2 = Loft(Curves=join_2, Options={Adjust=False, Closed=False, LoftEnds=0, LoftSimp=0, LoftType=3, Rebuild=10, Refit=0.01})
merge_8 = Merge(Data1=flatten(loft), Data2=flatten(loft_2))
xz_2 = XZPlane(Origin=Point(0, 0, 0))
join_3 = BrepJoin(Breps=merge_8)  # -> Breps, Closed
mirror = Mirror(Geometry=join_3.Breps, Plane=xz_2)  # -> Geometry, Transform
merge_9 = Merge(Data1=join_3.Breps, Data2=mirror.Geometry)
join_4 = BrepJoin(Breps=merge_9)  # -> Breps, Closed
area = Area(Geometry=join_4.Breps)  # -> Area, Centroid
smesh = SimpleMesh(Brep=join_4.Breps)
number_slider = Slider(20, range=0..100)
wbcatmullclark = WeaverbirdsCatmullClarkSubdivision(MeshCurves=smesh, Level=Slider(3, range=0..10), SmoothNakedEdges=1)
Y_2 = UnitY(Factor=1)
contour = Contour(Shape=wbcatmullclark, Point=area.Centroid, Direction=Y_2, Distance=number_slider)  # -> simplify(Contours)
reb = RebuildCurve(Curve=contour, Degree="3", Count=Slider(80, range=0..100), Tangents=False)
Y_3 = UnitY(Factor=number_slider)
boundary = BoundarySurfaces(Edges=reb)
division = Division(A=Y_3, B=-2)
extr = Extrude(Base=boundary, Direction=Y_3)
move_2 = Move(Geometry=extr, Motion=division)  # -> Geometry, Transform
flatten = FlattenTree(Tree=move_2.Geometry, Path="{0}")
lng = ListLength(List=flatten)  # -> expr("x-1", Length)
range = Range(Domain=Domain(0, 1), Steps=lng)
gradient = Gradient(
    LowerLimit=0,
    UpperLimit=1,
    Parameter=range,
    stops=[0: RGB(255, 228, 189), 0.532: RGB(201, 147, 60), 1: RGB(255, 228, 189)])
preview = CustomPreview(Geometry=flatten, Shader=gradient)

# ==== cluster FirstLastItem
list = ClusterInput()
lng = ListLength(List=list)  # -> expr("x-1", Length)
cull_i = CullIndex(List=list, Indices=lng, Wrap=False)
item = ListItem(List=list, Index=lng, Wrap=False)  # -> simplify(Element)
item_2 = ListItem(List=list, Index=0, Wrap=False)  # -> simplify(Element)
cull_i_2 = CullIndex(List=cull_i, Indices=0, Wrap=False)  # -> simplify(List)
rest_item = ClusterOutput(cull_i_2)
last_item = ClusterOutput(item)
first_item = ClusterOutput(item_2)
