# Grasshopper definition Waffle Pattern.ghx (Grasshopper 0.9.76)

number_slider = Slider(700, range=0..1000)
pt = ConstructPoint(XCoordinate=0, YCoordinate=0, ZCoordinate=0)
polygon = Polygon(Plane=pt, Radius=number_slider, Segments=6, FilletRadius=0)  # -> Polygon, Length
explode = Explode(Curve=polygon.Polygon, Recursive=True)  # -> Segments, Vertices
eval = EvaluateLength(Curve=explode.Segments, Length="0.5", Normalized=True)  # -> Point, Tangent, Parameter
pdecon = Deconstruct(Point=eval.Point)  # -> XComponent, YComponent, ZComponent
sort = SortList(Keys=pdecon.YComponent, ValuesA=explode.Segments)  # -> Keys, ValuesA
lng = ListLength(List=sort.ValuesA)
division = Division(A=lng, B="2")
subtraction = Subtraction(A=division, B="1")
subset = SubList(List=sort.ValuesA, Domain=subtraction, Wrap=True)  # -> List, Index
join = JoinCurves(Curves=subset.List, Preserve=False)
subset_2 = SubList(List=subset.List, Domain="1", Wrap=True)  # -> List, Index
neg = Negative(Value=Slider(150, range=0..200))
end = EndPoints(Curve=join)  # -> Start, End
offset = Offset(Curve=subset_2.List, Distance=neg, Plane=PlaneXY(0, 0, 0), Corners=1)  # -> flatten(Curve)
ln = Line(StartPoint=end.Start, EndPoint=end.End)
merge = Merge(Data1=ln, Data2=subset.List)  # -> flatten(Result)
join_2 = JoinCurves(Curves=merge, Preserve=False)
clx = CurveLine(Curve=join_2, Line=offset)  # -> Points, Params, Count
pline = PolyLine(Vertices=clx.Points, Closed=False)  # -> simplify(Polyline)
graft = GraftTree(Tree=subset_2.List, IncludeEmptyLists=True, IncludeNullItems=True)  # -> simplify(Tree)
vec = Vector(pline)
vec_2 = Vector(graft)
dprod = DotProduct(VectorA=vec_2, VectorB=vec, Unitize=False)
larger = LargerThan(FirstNumber=dprod, SecondNumber=0)  # -> LargerThan, OrEqualTo
dispatch = Dispatch(List=pline, DispatchPattern=larger.LargerThan)  # -> ListA, ListB
flip = FlipCurve(Curve=dispatch.ListB)  # -> Curve, Flag
number_slider_2 = Slider(400, range=0..1000)
weave = Weave(Pattern=larger.LargerThan, Stream0=flip.Curve, Stream1=dispatch.ListA, NullGaps=False)
merge_2 = Merge(Data1=graft, Data2=weave)
loft = Loft(Curves=merge_2, Options={Adjust=True, Closed=False, LoftEnds=0, LoftSimp=0, LoftType=0, Rebuild=10, Refit=0.01})
crv = Curve(flatten(loft))
runion = RegionUnion(Curves=crv)
boundary = BoundarySurfaces(Edges=runion)
boundary_2 = BoundarySurfaces(Edges=join_2)
join_3 = JoinCurves(Curves=subset_2.List, Preserve=False)
Z = UnitZ(Factor=number_slider_2)
move = Move(Geometry=boundary, Motion=Z)  # -> Geometry, Transform
cp = ControlPoints(Curve=join_3)  # -> Points, Weights, Knots
extr = Extrude(Base=boundary_2, Direction=Z)
extr_2 = Extrude(Base=move.Geometry, Direction=Z)
pt_2 = Point(pt)
item = ListItem(List=cp.Points, Index=1, Wrap=True)
merge_3 = Merge(Data1=extr, Data2=extr_2)
sunion = SolidUnion(Breps=merge_3)
vec2pt = Vector2Pt(PointA=item, PointB=pt_2, Unitize=False)  # -> Vector, Length
move_2 = Move(Geometry=sunion, Motion=vec2pt.Vector)  # -> Geometry, Transform
Y = UnitY(Factor=1)
Z_2 = UnitZ(Factor=1)
number_slider_3 = Slider(87, range=0..100)
vrot = Rotate(Vector=Y, Axis=Z_2, Angle="Rad(60)")
Z_3 = UnitZ(Factor=1)
vrot_2 = Rotate(Vector=vrot, Axis=Z_3, Angle="Rad(90)")
pl = ConstructPlane(Origin=Point(0, 0, 0), XAxis=vrot, YAxis=vrot_2)
bbox = BoundingBox(Content=move_2.Geometry, Plane=pl)  # -> Box, Box_2
bbox_2 = BoundingBox(Content=move_2.Geometry, Plane=PlaneXY(0, 0, 0))  # -> Box, Box_2
box_corners = BoxCorners(Box=bbox.Box)  # -> CornerA, CornerB, CornerC, CornerD, CornerE, CornerF, CornerG, CornerH
box_corners_2 = BoxCorners(Box=bbox_2.Box)  # -> CornerA, CornerB, CornerC, CornerD, CornerE, CornerF, CornerG, CornerH
number_slider_4 = Slider(30, range=0..100)
dist = Distance(PointA=box_corners.CornerA, PointB=box_corners.CornerB)
dist_2 = Distance(PointA=box_corners_2.CornerA, PointB=box_corners_2.CornerD)
pt_3 = Point(pt_2)
subtraction_2 = Subtraction(A=dist_2, B=number_slider_4)
subtraction_3 = Subtraction(A=dist, B=number_slider_4)
division_2 = Division(A=subtraction_2, B=Slider(5, range=0..10))
division_3 = Division(A=subtraction_3, B=Slider(8, range=0..15))
division_4 = Division(A=division_3, B=2)
amp = Amplitude(Vector=vrot, Amplitude=division_4)
move_3 = Move(Geometry=pt_3, Motion=amp)  # -> Geometry, Transform
division_5 = Division(A=division_2, B=2)
Y_2 = UnitY(Factor=division_5)
move_4 = Move(Geometry=pt_3, Motion=Y_2)  # -> Geometry, Transform
contour = Contour(Shape=move_2.Geometry, Point=move_3.Geometry, Direction=vrot, Distance=division_3)  # -> simplify(Contours)
contour_2 = Contour(Shape=move_2.Geometry, Point=move_4.Geometry, Direction=Y_2, Distance=division_2)
boundary_3 = BoundarySurfaces(Edges=contour_2)  # -> reparameterize(Surfaces)
boundary_4 = BoundarySurfaces(Edges=contour)  # -> reparameterize(Surfaces)
vec_3 = Vector(vrot)
num = Number(number_slider_2)
Y_3 = UnitY(Factor=number_slider_4)
amp_2 = Amplitude(Vector=vec_3, Amplitude=number_slider_4)
division_6 = Division(A=num, B="2")
extr_3 = Extrude(Base=boundary_3, Direction=Y_3)
extr_4 = Extrude(Base=boundary_4, Direction=amp_2)
Z_4 = UnitZ(Factor=division_6)
neg_2 = Negative(Value=Z_4)
move_5 = Move(Geometry=extr_4, Motion=neg_2)  # -> Geometry, Transform
move_6 = Move(Geometry=extr_3, Motion=Z_4)  # -> Geometry, Transform
sdiff = SolidDifference(BrepsA=extr_4, BrepsB=flatten(move_6.Geometry))  # -> simplify(Result)
sdiff_2 = SolidDifference(BrepsA=extr_3, BrepsB=flatten(move_5.Geometry))  # -> simplify(Result)
flatten = FlattenTree(Tree=sdiff, Path="{0}")
flatten_2 = FlattenTree(Tree=sdiff_2, Path="{0}")
group = Group(Objects=flatten_2)
group_2 = Group(Objects=flatten)
range = Range(Domain="360", Steps="3")
merge_4 = Merge(Data1=group_2, Data2=group)
num_2 = Number(number_slider)
cull_i = CullIndex(List=reverse(range), Indices=0, Wrap=True)  # -> reverse(List)
X = UnitX(Factor=num_2)
group_3 = Group(Objects=merge_4)
pt_4 = Point(pt)
pt_5 = Point(box_corners.CornerA)
rad = Radians(Degrees=cull_i)
move_7 = Move(Geometry=pt_5, Motion=X)  # -> Geometry, Transform
rotate = Rotate(Geometry=group_3, Angle=rad, Plane=pt_2)  # -> Geometry, Transform
number_slider_5 = Slider(4, range=0..10)
cos = Cosine(Value="Rad(30)")
group_4 = Group(Objects=rotate.Geometry)
rotate_2 = Rotate(Geometry=group_4, Angle="Rad(60)", Plane=move_7.Geometry)  # -> Geometry, Transform
num_3 = Number(number_slider)
multiplication = Multiplication(A=num_2, B="3")
multiplication_2 = Multiplication(A=cos, B=num_3)
series = Series(Start=0, Step=multiplication, Count=number_slider_5)
multiplication_3 = Multiplication(A=multiplication_2, B="3")
X_2 = UnitX(Factor=series)
series_2 = Series(Start=0, Step=multiplication_3, Count=number_slider_5)
move_8 = Move(Geometry=rotate_2.Geometry, Motion=X_2)  # -> flatten(Geometry), Transform
move_9 = Move(Geometry=group_4, Motion=X_2)  # -> flatten(Geometry), Transform
merge_5 = Merge(Data1=move_9.Geometry, Data2=move_8.Geometry)  # -> graft(Result)
Y_4 = UnitY(Factor=series_2)
move_10 = Move(Geometry=merge_5, Motion=Y_4)  # -> Geometry, Transform
ungroup = Ungroup(Group=move_10.Geometry)
ungroup_2 = Ungroup(Group=ungroup)  # -> simplify(Objects)
item_2 = ListItem(List=ungroup_2, Index=0, Wrap=True)
item_3 = ListItem(List=ungroup_2, Index=1, Wrap=True)
bbox_3 = BoundingBox(Content=item_2, Plane=PlaneXY(0, 0, 0))  # -> Box, Box_2
bbox_4 = BoundingBox(Content=item_3, Plane=PlaneXY(0, 0, 0))  # -> Box, Box_2
area = Area(Geometry=bbox_3.Box)  # -> Area, Centroid
area_2 = Area(Geometry=bbox_4.Box)  # -> Area, Centroid
pdecon_2 = Deconstruct(Point=area.Centroid)  # -> XComponent, YComponent, ZComponent
pdecon_3 = Deconstruct(Point=area_2.Centroid)  # -> XComponent, YComponent, ZComponent
bnd = Bounds(Numbers=flatten(pdecon_3.YComponent))
bnd_2 = Bounds(Numbers=flatten(pdecon_2.XComponent))
remap = RemapNumbers(Value=pdecon_3.YComponent, Source=bnd, Target=Domain(0, 1))  # -> Mapped, Clipped
remap_2 = RemapNumbers(Value=pdecon_2.XComponent, Source=bnd_2, Target=Domain(0, 1))  # -> Mapped, Clipped
gradient = Gradient(LowerLimit=0, UpperLimit=1, Parameter=remap_2.Mapped, stops=[0: RGB(130, 184, 255), 1: RGB(0, 62, 219)])
gradient_2 = Gradient(LowerLimit=0, UpperLimit=1, Parameter=remap.Mapped, stops=[0: RGB(168, 168, 168), 1: RGB(33, 31, 143)])
preview = CustomPreview(Geometry=item_3, Shader=gradient_2)
preview_2 = CustomPreview(Geometry=item_2, Shader=gradient)
