# Grasshopper definition Orange Peel.ghx (Grasshopper 0.9.76)

neg = Negative(Value="90")
pt = ConstructPoint(XCoordinate=0, YCoordinate=0, ZCoordinate=0)
rad = Radians(Degrees="90")
rad_2 = Radians(Degrees=neg)
xz = XZPlane(Origin=pt)
dom = ConstructDomain(DomainStart=rad_2, DomainEnd=rad)
arc = Arc(Plane=xz, Radius=Slider(100, range=0..100), Angle=dom)  # -> Arc, Length
divide = DivideCurve(Curve=reparameterize(arc.Arc), Count=10, Kinks=False)  # -> Points, Tangents, Parameters
graph = GraphMapper(divide.Parameters, x0=0, x1=1, y0=0, y1=1, container_name="Bezier", cpx=[0, 0, 1, 1], cpy=[0, 1, 1, 0])
vec2pt = Vector2Pt(PointA=pt, PointB=divide.Points, Unitize=False)  # -> Vector, Length
bnd = Bounds(Numbers=graph)
remap = RemapNumbers(Value=graph, Source=bnd, Target=Slider(34, range=0..100))  # -> Mapped, Clipped
amp = Amplitude(Vector=vec2pt.Vector, Amplitude=remap.Mapped)
number_slider = Slider(100, range=0..100)
move = Move(Geometry=divide.Points, Motion=amp)  # -> Geometry, Transform
Z = UnitZ(Factor=1)
nurbs = NurbsCurve(Vertices=move.Geometry, Degree=3, Periodic=False)  # -> Curve, Length, Domain
series = Series(Start=0, Step=Slider(0.078, range=0..0.2), Count=number_slider)
line = LineSDL(Start=pt, Direction=Z, Length=1)
revsrf = Revolution(Curve=nurbs.Curve, Axis=line, Domain=Domain(0, 6.283185307))
range = Range(Domain=Slider(0.546, range=0..1), Steps=Slider(10, range=0..10))
mod = Modulus(A=series, B="1")
range_2 = Range(Domain=Domain(0, 1), Steps=expr("x-1", number_slider))
srf = Surface(reparameterize(simplify(revsrf)))
graft = GraftTree(Tree=range, IncludeEmptyLists=True, IncludeNullItems=True)  # -> simplify(Tree)
addition = Addition(A=mod, B=graft)  # -> simplify(Result)
mod_2 = Modulus(A=addition, B="1")
pt_2 = ConstructPoint(XCoordinate=mod_2, YCoordinate=range_2, ZCoordinate=0)
evalsrf = EvaluateSurface(Surface=srf, Point=pt_2)  # -> Point, Normal, Frame
pt_3 = Point(simplify(evalsrf.Point))
vec2pt_2 = Vector2Pt(PointA=pt, PointB=pt_3, Unitize=False)  # -> Vector, Length
amp_2 = Amplitude(Vector=vec2pt_2.Vector, Amplitude=Slider(4.8, range=0..20))
move_2 = Move(Geometry=pt_3, Motion=amp_2)  # -> Geometry, Transform
intcrv = Interpolate(Vertices=pt_3, Degree=3, Periodic=False, KnotStyle=1)  # -> Curve, Length, Domain
intcrv_2 = Interpolate(Vertices=move_2.Geometry, Degree=3, Periodic=False, KnotStyle=1)  # -> Curve, Length, Domain
flatten = FlattenTree(Tree=intcrv.Curve, Path="{0}")
flatten_2 = FlattenTree(Tree=intcrv_2.Curve, Path="{0}")
loft = Loft(Curves=flatten, Options={Adjust=False, Closed=False, LoftEnds=0, LoftSimp=0, LoftType=0, Rebuild=10, Refit=0.01})
loft_2 = Loft(Curves=flatten_2, Options={Adjust=False, Closed=False, LoftEnds=0, LoftSimp=0, LoftType=0, Rebuild=10, Refit=0.01})
merge = Merge(Data1=loft_2, Data2=loft)
loft_3 = Loft(Curves=merge, Options={Adjust=False, Closed=False, LoftEnds=0, LoftSimp=0, LoftType=0, Rebuild=10, Refit=0.01})
merge_2 = Merge(Data1=loft_2, Data2=loft, Data3=loft_3)  # -> flatten(Result)
join = BrepJoin(Breps=merge_2)  # -> Breps, Closed
preview = CustomPreview(Geometry=join.Breps, Shader=ColourSwatch(SwatchColor=RGB(255, 174, 0)))
