# Grasshopper definition Bulb Connection.ghx (Grasshopper 0.9.76)
# plug-ins: Kangaroo Components, Weaverbird, TSplinesGH

pt = ConstructPoint(XCoordinate=0, YCoordinate=0, ZCoordinate=0)
rad = Radians(Degrees="90")
xz = XZPlane(Origin=pt)
arc = Arc(Plane=xz, Radius=Slider(100, range=0..100), Angle=Domain(0, 3.141592654))  # -> Arc, Length
arc_2 = Arc(Plane=xz, Radius=Slider(50, range=0..100), Angle=rad)  # -> Arc, Length
rotate = Rotate(Geometry=arc_2.Arc, Angle=1.570796327, Plane=xz)  # -> Geometry, Transform
Z = UnitZ(Factor=Slider(151, range=0..200))
move = Move(Geometry=rotate.Geometry, Motion=Z)  # -> Geometry, Transform
rotate_2 = Rotate(Geometry=arc.Arc, Angle=1.570796327, Plane=xz)  # -> Geometry, Transform
end = EndPoints(Curve=move.Geometry)  # -> Start, End
Z_2 = UnitZ(Factor=1)
pt_2 = Point(end.End)
line = LineSDL(Start=pt_2, Direction=Z_2, Length=1)
clx = CurveLine(Curve=reparameterize(rotate_2.Geometry), Line=line)  # -> Points, Params, Count
dist = Distance(PointA=pt_2, PointB=clx.Points)
sort = SortList(Keys=dist, ValuesA=clx.Params)  # -> Keys, ValuesA
sort_2 = SortList(Keys=dist, ValuesA=clx.Points)  # -> Keys, ValuesA
item = ListItem(List=sort.ValuesA, Index=0, Wrap=True)
item_2 = ListItem(List=sort_2.ValuesA, Index=0, Wrap=True)
shatter = Shatter(Curve=reparameterize(rotate_2.Geometry), Parameters=item)
ln = Line(StartPoint=pt_2, EndPoint=item_2)
item_3 = ListItem(List=reverse(shatter), Index=0, Wrap=True)
merge = Merge(Data1=move.Geometry, Data2=ln, Data3=item_3)  # -> flatten(Result)
join = JoinCurves(Curves=merge, Preserve=False)
Z_3 = UnitZ(Factor=1)
fillet = Fillet(Curve=join, Radius=Slider(77, range=0..100))
pt_3 = Point(pt)
line_2 = LineSDL(Start=pt_3, Direction=Z_3, Length=1)
reb = RebuildCurve(Curve=fillet, Degree="3", Count=Slider(30, range=0..100), Tangents=False)
revsrf = Revolution(Curve=reb, Axis=line_2, Domain=Domain(0, 6.283185307))
popgeo = PopulateGeometry(Geometry=revsrf, Count=Slider(120, range=0..200), Seed=1)
srf_cp = SurfaceClosestPoint(Point=popgeo, Surface=reparameterize(revsrf))  # -> Point, UVPoint, Distance
evalsrf = EvaluateSurface(Surface=reparameterize(revsrf), Point=srf_cp.UVPoint)  # -> Point, Normal, Frame
amp = Amplitude(Vector=evalsrf.Normal, Amplitude=Slider(2, range=0..10))
neg = Negative(Value=amp)
move_2 = Move(Geometry=popgeo, Motion=neg)  # -> Geometry, Transform
graft = GraftTree(Tree=move_2.Geometry, IncludeEmptyLists=True, IncludeNullItems=True)
dist_2 = Distance(PointA=graft, PointB=move_2.Geometry)
larger = LargerThan(FirstNumber=dist_2, SecondNumber="0")  # -> LargerThan, OrEqualTo
smaller = SmallerThan(FirstNumber=dist_2, SecondNumber=Slider(75, range=0..100))  # -> SmallerThan, OrEqualTo
and = GateAnd(A=smaller.SmallerThan, B=larger.LargerThan)  # -> simplify(Result)
cull = CullPattern(List=move_2.Geometry, CullPattern=and)
ln_2 = Line(StartPoint=graft, EndPoint=cull)  # -> simplify(Line)
len = Length(Curve=ln_2)
sort_3 = SortList(Keys=len, ValuesA=ln_2)  # -> Keys, ValuesA
subset = SubList(List=sort_3.ValuesA, Domain=Slider(3, range=0..10), Wrap=True)  # -> List, Index
flatten = FlattenTree(Tree=subset.List, Path="{0}")
dupln = RemoveDuplicateLines(Lines=flatten, Tolerance=0.01)
graft_2 = GraftTree(Tree=dupln, IncludeEmptyLists=True, IncludeNullItems=True)  # -> simplify(Tree)
end_2 = EndPoints(Curve=simplify(graft_2))  # -> Start, End
merge_2 = Merge(Data1=end_2.Start, Data2=end_2.End)
scale = Scale(Geometry=graft_2, Center=merge_2, Factor=Slider(0.25, range=0..1))  # -> Geometry, Transform
dupln_2 = RemoveDuplicateLines(Lines=flatten(scale.Geometry), Tolerance=0.01)
number_slider = Slider(2, range=0..10)
tpipe = TsPipe(InCurves=dupln_2, DefaultRadius=Slider(2, range=0..10), CurveSegments=Slider(0, range=0..10))
tpipe_2 = TsPipe(InCurves=dupln, DefaultRadius=Slider(1.5, range=0..3), CurveSegments=Slider(8, range=0..10))
mesh = Mesh(tpipe)
mesh_2 = Mesh(tpipe_2)
wbcatmullclark = WeaverbirdsCatmullClarkSubdivision(MeshCurves=mesh, Level=number_slider, SmoothNakedEdges=1)
wbcatmullclark_2 = WeaverbirdsCatmullClarkSubdivision(MeshCurves=mesh_2, Level=number_slider, SmoothNakedEdges=1)
preview = CustomPreview(Geometry=wbcatmullclark, Shader=ColourSwatch(SwatchColor=RGB(130, 130, 130)))
preview_2 = CustomPreview(Geometry=wbcatmullclark_2, Shader=ColourSwatch(SwatchColor=RGB(58, 222, 205)))
