# Grasshopper definition Japanese Wave.ghx (Grasshopper 0.9.76)

number_slider = Slider(32, range=0..100)
number_slider_2 = Slider(10, range=0..10)
subtraction = Subtraction(A="180", B=number_slider)
rad = Radians(Degrees=number_slider)
rad_2 = Radians(Degrees=subtraction)
pt = ConstructPoint(XCoordinate=0, YCoordinate=0, ZCoordinate=0)
dom = ConstructDomain(DomainStart=rad, DomainEnd=rad_2)
multiplication = Multiplication(A=number_slider_2, B=2)
arc = Arc(Plane=pt, Radius=number_slider_2, Angle=dom)  # -> Arc, Length
X = UnitX(Factor=number_slider_2)
series = Series(Start=0, Step=multiplication, Count=Slider(6, range=0..10))
move = Move(Geometry=arc.Arc, Motion=X)  # -> Geometry, Transform
X_2 = UnitX(Factor=series)
end = EndPoints(Curve=move.Geometry)  # -> Start, End
Y = UnitY(Factor=1)
pt_2 = Point(end.End)
line = LineSDL(Start=pt_2, Direction=Y, Length=1)
clx = CurveLine(Curve=arc.Arc, Line=line)  # -> Points, Params, Count
dist = Distance(PointA=pt_2, PointB=clx.Points)
Y_2 = UnitY(Factor=dist)
crv = Curve(arc.Arc)
addition = Addition(A=Y_2, B=X)
move_2 = Move(Geometry=crv, Motion=addition)  # -> Geometry, Transform
end_2 = EndPoints(Curve=move_2.Geometry)  # -> Start, End
pt_3 = Point(end_2.End)
crv_cp = CurveClosestPoint(Point=pt_3, Curve=crv)  # -> Point, Parameter, Distance
shatter = Shatter(Curve=crv, Parameters=crv_cp.Parameter)
item = ListItem(List=shatter, Index=0, Wrap=True)
darc = DeconstructArc(Arc=move_2.Geometry)  # -> BasePlane, Radius, Angle
yz = YZPlane(Origin=darc.BasePlane)
mirror = Mirror(Geometry=item, Plane=yz)  # -> Geometry, Transform
merge = Merge(Data1=flatten(move_2.Geometry), Data2=flatten(item), Data3=flatten(mirror.Geometry))
multiplication_2 = Multiplication(A=dist, B=2)
group = Group(Objects=merge)
move_3 = Move(Geometry=group, Motion=X_2)  # -> Geometry, Transform
series_2 = Series(Start=0, Step=multiplication_2, Count=Slider(12, range=0..20))
move_4 = Move(Geometry=move_3.Geometry, Motion=addition)  # -> Geometry, Transform
Y_3 = UnitY(Factor=series_2)
merge_2 = Merge(Data1=move_3.Geometry, Data2=move_4.Geometry)
graft = GraftTree(Tree=Y_3, IncludeEmptyLists=True, IncludeNullItems=True)  # -> simplify(Tree)
Y_4 = UnitY(Factor=1)
move_5 = Move(Geometry=merge_2, Motion=graft)  # -> simplify(flatten(Geometry)), Transform
bbox = BoundingBox(Content=move_5.Geometry, Plane=PlaneXY(0, 0, 0), UnionBox=True)  # -> Box, Box_2
area = Area(Geometry=bbox.Box)  # -> Area, Centroid
line_2 = LineSDL(Start=area.Centroid, Direction=Y_4, Length=1)
blx = BrepLine(Brep=bbox.Box, Line=line_2, LimitToFirst=False)  # -> Curves, Points
ungroup = Ungroup(Group=move_5.Geometry)  # -> simplify(Objects)
divide = DivideCurve(Curve=reparameterize(blx.Curves), Count=Slider(20, range=0..100), Kinks=False)  # -> Points, Tangents, Parameters
flip = FlipMatrix(Data=ungroup)
multiplication_3 = Multiplication(A=divide.Parameters, B=Slider(360, range=0..1000))
bang = ExplodeTree(Data=flip)  # -> Branch0, Branch1, Branch2
rad_3 = Radians(Degrees=multiplication_3)
darc_2 = DeconstructArc(Arc=bang.Branch0)  # -> BasePlane, Radius, Angle
sin = Sine(Value=rad_3)
multiplication_4 = Multiplication(A=sin, B=Slider(23.6, range=0..100))
X_3 = UnitX(Factor=multiplication_4)
number_slider_3 = Slider(13, range=0..100)
move_6 = Move(Geometry=divide.Points, Motion=X_3)  # -> Geometry, Transform
intcrv = Interpolate(Vertices=move_6.Geometry, Degree=3, Periodic=False, KnotStyle=1)  # -> Curve, Length, Domain
mod = Modulus(A=number_slider_3, B=2)
addition_2 = Addition(A=number_slider_3, B=mod)
crv_cp_2 = CurveClosestPoint(Point=darc_2.BasePlane, Curve=intcrv.Curve)  # -> Point, Parameter, Distance
subtraction_2 = Subtraction(A=addition_2, B=1)
min = Minimum(A=crv_cp_2.Distance, B=Slider(28, range=0..100))
divide_2 = DivideCurve(Curve=bang.Branch1, Count=subtraction_2, Kinks=False)  # -> simplify(Points), Tangents, Parameters
pt_4 = Point(simplify(graft(darc_2.BasePlane)))
dom_2 = ConstructDomain(DomainStart=Slider(2, range=0..10), DomainEnd=Slider(0, range=0..10))
bnd = Bounds(Numbers=min)
bnd_2 = Bounds(Numbers=crv_cp_2.Distance)
vec2pt = Vector2Pt(PointA=pt_4, PointB=divide_2.Points, Unitize=False)  # -> Vector, Length
remap = RemapNumbers(Value=min, Source=bnd, Target=dom_2)  # -> Mapped, Clipped
Y_5 = UnitY(Factor=1)
remap_2 = RemapNumbers(Value=crv_cp_2.Distance, Source=bnd_2, Target=Domain(0, 1))  # -> Mapped, Clipped
round = Round(Number=remap.Mapped)  # -> Nearest, Floor, Ceiling
graft_2 = GraftTree(Tree=round.Nearest, IncludeEmptyLists=True, IncludeNullItems=True)
lng = ListLength(List=graft_2)  # -> simplify(Length)
angle = Angle(VectorA=vec2pt.Vector, VectorB=Y_5)  # -> Angle, Reflex
gradient = Gradient(LowerLimit=0, UpperLimit=1, Parameter=remap_2.Mapped, stops=[0.123: RGB(0, 153, 209), 0.85: RGB(242, 231, 182)])
dup = DuplicateData(Data=Toggle(True), Number=lng, Order=True)  # -> simplify(Data)
neg = Negative(Value=angle.Angle)
dup_2 = DuplicateData(Data=Toggle(False), Number=round.Nearest, Order=True)  # -> simplify(Data)
addition_3 = Addition(A=neg, B="Rad(90)")
vlen = VectorLength(Vector=vec2pt.Vector)
addition_4 = Addition(A=angle.Angle, B="Rad(90)")
merge_3 = Merge(Data1=dup, Data2=dup_2)
dom_3 = ConstructDomain(DomainStart=addition_3, DomainEnd=addition_4)
arc_2 = Arc(Plane=simplify(pt_4), Radius=vlen, Angle=dom_3)  # -> reverse(Arc), Length
partition = PartitionList(List=arc_2.Arc, Size=2)
group_2 = Group(Objects=partition)
Z = UnitZ(Factor=Slider(2, range=0..10))
pshift = ShiftPaths(Data=group_2, Offset=-1)
dispatch = Dispatch(List=pshift, DispatchPattern=merge_3)  # -> ListA, ListB
ungroup_2 = Ungroup(Group=dispatch.ListA)
loft = Loft(Curves=ungroup_2, Options={Adjust=False, Closed=False, LoftEnds=0, LoftSimp=0, LoftType=0, Rebuild=10, Refit=0.01})
col = Colour(graft(gradient))
extr = Extrude(Base=loft, Direction=Z)
swatch = ColourSwatch(SwatchColor=RGB(139, 178, 84))
pshift_2 = ShiftPaths(Data=extr, Offset=-1)  # -> simplify(Data)
preview = CustomPreview(Geometry=pshift_2, Shader=col)
