# Grasshopper definition Pebble Fit.ghx (Grasshopper 0.9.76)
# plug-ins: MeshEdit Components, Kangaroo Components, PlanktonGh, Weaverbird

number_slider = Slider(100, range=0..100)
rectangle = Rectangle(Plane=PlaneXY(0, 0, 0), XSize=number_slider, YSize=number_slider, Radius=0)  # -> Rectangle, Length
division = Division(A=number_slider, B=2)
X = UnitX(Factor=1)
area = Area(Geometry=rectangle.Rectangle)  # -> Area, Centroid
line = LineSDL(Start=area.Centroid, Direction=X, Length=division)
divide = DivideCurve(Curve=reparameterize(line), Count=Slider(100, range=0..100), Kinks=False)  # -> Points, Tangents, Parameters
pop2d = Populate2D(Region=rectangle.Rectangle, Count=Slider(200, range=0..1000), Seed=1)
pi = Pi(Factor=Slider(4, range=0..10))
multiplication = Multiplication(A=divide.Parameters, B=pi)
rotate = Rotate(Geometry=divide.Points, Angle=multiplication, Plane=area.Centroid)  # -> Geometry, Transform
intcrv = Interpolate(Vertices=rotate.Geometry, Degree=3, Periodic=False, KnotStyle=1)  # -> Curve, Length, Domain
crv_cp = CurveClosestPoint(Point=pop2d, Curve=reparameterize(intcrv.Curve))  # -> Point, Parameter, Distance
sort = SortList(Keys=crv_cp.Parameter, ValuesA=pop2d)  # -> Keys, ValuesA
voronoi = Voronoi(Points=sort.ValuesA, Boundary=rectangle.Rectangle, BruteForceOverride=False)  # -> simplify(Cells)
partition = PartitionList(List=voronoi, Size=Slider(2, range=0..10))  # -> simplify(Chunks)
area_2 = Area(Geometry=partition)  # -> Area, Centroid
number_slider_2 = Slider(2, range=0..10)
extr = ExtrudePoint(Base=partition, Point=area_2.Centroid)
join = BrepJoin(Breps=extr)  # -> Breps, Closed
smesh = SimpleMesh(Brep=join.Breps)
weld = WeldMesh(Mesh=smesh, Angle=3.141592654)  # -> flatten(Result)
area_3 = Area(Geometry=weld)  # -> Area, Centroid
Z = UnitZ(Factor=Slider(5, range=0..10))
scale = Scale(Geometry=weld, Center=area_3.Centroid, Factor=Slider(1.2, range=0..10))  # -> Geometry, Transform
wbcatmullclark = WeaverbirdsCatmullClarkSubdivision(MeshCurves=scale.Geometry, Level=number_slider_2, SmoothNakedEdges=1)  # -> simplify(OutputMeshCurves)
medges = MeshEdges(Mesh=wbcatmullclark)  # -> NakedEdges, InteriorEdges, NonManifoldEdges
extr_2 = Extrude(Base=join.Breps, Direction=Z)
smesh_2 = SimpleMesh(Brep=extr_2)
join_2 = JoinCurves(Curves=medges.NakedEdges, Preserve=False)  # -> simplify(Curves)
cp = ControlPoints(Curve=join_2)  # -> Points, Weights, Knots
wbcatmullclark_2 = WeaverbirdsCatmullClarkSubdivision(MeshCurves=smesh_2, Level=number_slider_2, SmoothNakedEdges=1)
duppt = RemoveDuplicatePts(Points=cp.Points, Tolerance=0.01)  # -> simplify(UniquePoints)
sequence = Sequence(Frames=2)
meshmachine = MeshMachine(
    Geometry=wbcatmullclark,
    Length=Slider(1, range=0..2),
    FixCurves=join_2,
    FixVertices=duppt,
    Flip=1,
    PullStrength=0.8,
    CurvatureAdaptivity=0,
    BoundaryScale=1,
    BoundaryDistance=5,
    Exponent=2,
    Background=0.5,
    Iterations=Slider(2, range=0..10),
    Reset=sequence)
item = ListItem(List=reverse(meshmachine), Index=0, Wrap=True)
pmesh = PlanktonMesh(item)
mesh = Mesh(pmesh)
demesh = DeconstructMesh(Mesh=mesh)  # -> simplify(Vertices), Faces, Colours, Normals
crv_cp_2 = CurveClosestPoint(Point=demesh.Vertices, Curve=join_2)  # -> Point, Parameter, Distance
bnd = Bounds(Numbers=crv_cp_2.Distance)
remap = RemapNumbers(Value=crv_cp_2.Distance, Source=bnd, Target=Domain(0, 1))  # -> Mapped, Clipped
graph = GraphMapper(remap.Mapped, x0=0, x1=1, y0=0, y1=1, container_name="Bezier", cpx=[0, 0, 0.5573907495, 1], cpy=[0, 0.6956521869, 1, 1])
remap_2 = RemapNumbers(Value=graph, Source=Domain(0, 1), Target=Slider(4.7, range=0..10))  # -> Mapped, Clipped
Z_2 = UnitZ(Factor=remap_2.Mapped)
move = Move(Geometry=demesh.Vertices, Motion=Z_2)  # -> Geometry, Transform
conmesh = ConstructMesh(Vertices=move.Geometry, Faces=demesh.Faces)
medges_2 = MeshEdges(Mesh=conmesh)  # -> NakedEdges, InteriorEdges, NonManifoldEdges
xy = XYPlane(Origin=Point(0, 0, 0))
join_3 = JoinCurves(Curves=medges_2.NakedEdges, Preserve=False)
sequence_2 = Sequence(Frames=2)
meshmachine_2 = MeshMachine(
    Geometry=conmesh,
    Length=Slider(1, range=0..1),
    FixCurves=join_3,
    Flip=1,
    PullStrength=0.8,
    CurvatureAdaptivity=0,
    BoundaryScale=1,
    BoundaryDistance=5,
    Exponent=2,
    Background=0.5,
    Iterations=Slider(10, range=0..10),
    Reset=sequence_2)
item_2 = ListItem(List=reverse(meshmachine_2), Index=0, Wrap=True)
pmesh_2 = PlanktonMesh(item_2)
mesh_2 = Mesh(simplify(pmesh_2))
mirror = Mirror(Geometry=mesh_2, Plane=xy)  # -> simplify(Geometry), Transform
flip = MeshFlip(Mesh=mirror.Geometry)  # -> simplify(Mesh)
merge = Merge(Data1=simplify(mesh_2), Data2=flip)
mjoin = MeshJoin(Meshes=merge)
weldvertices = MeshWeldVertices(Mesh=mjoin, Tolerance=Slider(0.1, range=0..0.1))  # -> RuntimeMessage, Mesh
weld_2 = WeldMesh(Mesh=mjoin, Angle=3.141592654)
meshnormalize = MeshNormalize(mesh=weldvertices.Mesh)  # -> out, A; inputs mesh: Mesh
# ---------- meshnormalize: C# ----------
    if(mesh != null){
      mesh.Normals.ComputeNormals();

      A = mesh;
    }
# ---------- end meshnormalize ----------
msmooth = SmoothMesh(Mesh=meshnormalize.A, Strength=0.5, SkipNaked=True, Iterations=Slider(4, range=0..10))
swatch = ColourSwatch(SwatchColor=RGB(66, 136, 189))
wbcatmullclark_3 = WeaverbirdsCatmullClarkSubdivision(MeshCurves=msmooth, Level=1, SmoothNakedEdges=1)  # -> simplify(flatten(OutputMeshCurves))
lng = ListLength(List=wbcatmullclark_3)
random = Random(Range=Domain(0, 1), Number=lng, Seed=2)
gradient = Gradient(LowerLimit=0, UpperLimit=1, Parameter=random, stops=[0: RGB(214, 201, 180), 1: RGB(143, 119, 83)])
preview = CustomPreview(Geometry=flatten(wbcatmullclark_3), Shader=gradient)
