# Grasshopper definition Reaction Diffusion.ghx (Grasshopper 0.9.76)
# plug-ins: Weaverbird

number_slider = Slider(100, range=0..100)
number_slider_2 = Slider(700, range=0..1000)
sph = Sphere(Base=PlaneXY(0, 0, 0), Radius=number_slider)
popgeo = PopulateGeometry(Geometry=sph, Count=number_slider_2, Seed=1)
facet = FacetDome(Points=popgeo)  # -> Pattern, Dome
area = Area(Geometry=facet.Pattern)  # -> Area, Centroid
crv_cp = CurveClosestPoint(Point=area.Centroid, Curve=facet.Pattern)  # -> Point, Parameter, Distance
num = Number(number_slider)
multiplication = Multiplication(A=num, B=Slider(1.34, range=0..1.5))
pt = Point(crv_cp.Point)
num_2 = Number(number_slider_2)
wbicosahedron = WeaverbirdsMeshMeshIcosahedron(Plane=PlaneXY(0, 0, 0), Radius=multiplication)
popgeo_2 = PopulateGeometry(Geometry=sph, Count=num_2, Seed=1, Points=pt)
wbcatmullclark = WeaverbirdsCatmullClarkSubdivision(MeshCurves=wbicosahedron, Level=Slider(3, range=0..10), SmoothNakedEdges=1)
wbcatmullclark_2 = WeaverbirdsCatmullClarkSubdivision(MeshCurves=wbcatmullclark, Level=Slider(3, range=0..3), SmoothNakedEdges=1)
demesh = DeconstructMesh(Mesh=wbcatmullclark_2)  # -> Vertices, Faces, Colours, Normals
pull = PullPoint(Point=demesh.Vertices, Geometry=popgeo_2, ClosestOnly=True)  # -> ClosestPoint, Distance
pull_2 = PullPoint(Point=demesh.Vertices, Geometry=pt, ClosestOnly=True)  # -> ClosestPoint, Distance
smaller = SmallerThan(FirstNumber=pull_2.Distance, SecondNumber=pull.Distance)  # -> SmallerThan, OrEqualTo
frgb = ColourRGBF(Alpha=1, Red=smaller.SmallerThan, Green=smaller.SmallerThan, Blue=smaller.SmallerThan)
mcol = MeshColours(Mesh=wbcatmullclark_2, Colours=frgb)
mblur = BlurMesh(Mesh=mcol, Iterations=Slider(6, range=0..10))
demesh_2 = DeconstructMesh(Mesh=mblur)  # -> Vertices, Faces, Colours, Normals
argb = SplitARGB(Colour=demesh_2.Colours)  # -> Alpha, Red, Green, Blue
remap = RemapNumbers(Value=argb.Red, Source=Domain(0, 1), Target=Slider(14.4, range=0..100))  # -> Mapped, Clipped
amp = Amplitude(Vector=demesh_2.Normals, Amplitude=remap.Mapped)
move = Move(Geometry=demesh_2.Vertices, Motion=amp)  # -> Geometry, Transform
conmesh = ConstructMesh(Vertices=move.Geometry, Faces=demesh_2.Faces, Colours=demesh_2.Colours)
