# Grasshopper definition Starfish Dome.ghx (Grasshopper 0.9.76)
# plug-ins: Kangaroo Components

pt = ConstructPoint(XCoordinate=0, YCoordinate=0, ZCoordinate=0)
polygon = Polygon(Plane=pt, Radius=Slider(100, range=0..100), Segments=Slider(5, range=0..10), FilletRadius=0)  # -> Polygon, Length
explode = Explode(Curve=polygon.Polygon, Recursive=True)  # -> Segments, Vertices
cp = ControlPoints(Curve=polygon.Polygon)  # -> Points, Weights, Knots
divide = DivideCurve(Curve=reparameterize(explode.Segments), Count=10, Kinks=False)  # -> Points, Tangents, simplify(Parameters)
duppt = RemoveDuplicatePts(Points=cp.Points, Tolerance=0.01)
multiplication = Multiplication(A=divide.Parameters, B="180")
ln = Line(StartPoint=duppt, EndPoint=pt)
Z = UnitZ(Factor=1)
rad = Radians(Degrees=multiplication)
divide_2 = DivideCurve(Curve=reparameterize(ln), Count=10, Kinks=False)  # -> Points, Tangents, Parameters
vrot = Rotate(Vector=divide.Tangents, Axis=Z, Angle="Rad(90)")
sin = Sine(Value=rad)
graph = GraphMapper(
    divide_2.Parameters,
    x0=0,
    x1=1,
    y0=0,
    y1=1,
    container_name="Bezier",
    cpx=[0, 0.07101484388, 0.6449275613, 1],
    cpy=[0, 0.4246376753, 0.981159389, 0.3777970672])
multiplication_2 = Multiplication(A=sin, B=Slider(23, range=0..100))
Z_2 = UnitZ(Factor=multiplication_2)
amp = Amplitude(Vector=vrot, Amplitude=multiplication_2)
addition = Addition(A=amp, B=Z_2)
bnd = Bounds(Numbers=graph)
move = Move(Geometry=divide.Points, Motion=addition)  # -> simplify(Geometry), Transform
remap = RemapNumbers(Value=graph, Source=bnd, Target=Slider(70, range=0..100))  # -> Mapped, Clipped
Z_3 = UnitZ(Factor=remap.Mapped)
nurbs = NurbsCurve(Vertices=move.Geometry, Degree=3, Periodic=False)  # -> Curve, Length, Domain
move_2 = Move(Geometry=divide_2.Points, Motion=Z_3)  # -> simplify(Geometry), Transform
midpoint = MidPoint(crv=nurbs.Curve)
item = ListItem(List=reverse(move_2.Geometry), Index=0, Wrap=True)
panel = Panel("0.5")
nurbs_2 = NurbsCurve(Vertices=move_2.Geometry, Degree=3, Periodic=False)  # -> Curve, Length, Domain
ln_2 = Line(StartPoint=midpoint, EndPoint=item)
flatten = FlattenTree(Tree=nurbs_2.Curve, Path="{0}")
eval = EvaluateLength(Curve=nurbs_2.Curve, Length=Slider(0.4, range=0..1), Normalized=True)  # -> Point, Tangent, Parameter
divide_3 = DivideCurve(Curve=reparameterize(ln_2), Count=10, Kinks=False)  # -> Points, Tangents, Parameters
devec = DeconstructVector(Vector=eval.Tangent)  # -> XComponent, YComponent, ZComponent
shift = ShiftList(List=flatten, Shift=1, Wrap=True)
graph_2 = GraphMapper(
    divide_3.Parameters,
    x0=0,
    x1=1,
    y0=0,
    y1=1,
    container_name="Bezier",
    cpx=[0, 0.1616228074, 0.5160842538, 1],
    cpy=[0, 0.3424925804, 0.4018550515, 0])
vec = VectorXYZ(XComponent=devec.XComponent, YComponent=devec.YComponent, ZComponent=0)  # -> Vector, Length
Z_4 = UnitZ(Factor=1)
graft = GraftTree(Tree=shift, IncludeEmptyLists=True, IncludeNullItems=True)  # -> simplify(Tree)
vrot_2 = Rotate(Vector=vec.Vector, Axis=Z_4, Angle="Rad(90)")
bnd_2 = Bounds(Numbers=graph_2)
pl = ConstructPlane(Origin=eval.Point, XAxis=eval.Tangent, YAxis=vrot_2)
remap_2 = RemapNumbers(Value=graph_2, Source=bnd_2, Target=Slider(37, range=0..100))  # -> Mapped, Clipped
deplane = DeconstructPlane(Plane=pl)  # -> Origin, XAxis, YAxis, ZAxis
Z_5 = UnitZ(Factor=remap_2.Mapped)
move_3 = Move(Geometry=divide_3.Points, Motion=Z_5)  # -> Geometry, Transform
nurbs_3 = NurbsCurve(Vertices=move_3.Geometry, Degree=3, Periodic=False)  # -> simplify(Curve), Length, Domain
merge = Merge(Data1=nurbs_2.Curve, Data2=nurbs_3.Curve, Data3=graft)
loft = Loft(Curves=merge, Options={Adjust=False, Closed=False, LoftEnds=0, LoftSimp=0, LoftType=0, Rebuild=10, Refit=0.01})  # -> flatten(Loft)
join = BrepJoin(Breps=loft)  # -> Breps, Closed
contour = Contour(Shape=join.Breps, Point=eval.Point, Direction=deplane.ZAxis, Distance=Slider(2, range=0..10))  # -> simplify(Contours)
group = Group(Objects=contour)
pshift = ShiftPaths(Data=group, Offset=-1)
subset = SubList(List=reverse(pshift), Domain=Slider(18, range=0..30), Wrap=True)  # -> simplify(List), Index
lng = ListLength(List=subset.List)  # -> expr("x-1", simplify(Length))
neg = Negative(Value=Slider(5, range=0..10))
range = Range(Domain=Domain(0, 1), Steps=lng)
ungroup = Ungroup(Group=subset.List)
Z_6 = UnitZ(Factor=neg)
gradient = Gradient(LowerLimit=0, UpperLimit=1, Parameter=range, stops=[0: RGB(130, 190, 255), 0.494: RGB(76, 82, 168), 1: RGB(219, 168, 0)])
extr = Extrude(Base=ungroup, Direction=Z_6)
pshift_2 = ShiftPaths(Data=extr, Offset=-1)
preview = CustomPreview(Geometry=pshift_2, Shader=gradient)

# ==== cluster MidPoint: Middle Point of Curve
crv = ClusterInput()
num = Number(0.5)
eval = EvaluateLength(Curve=crv, Length=num, Normalized=True)  # -> Point, Tangent, Parameter
pt = ClusterOutput(eval.Point)
