# Grasshopper definition Flip-up Dish.ghx (Grasshopper 0.9.76)

number_slider = Slider(100, range=0..100)
number_slider_2 = Slider(25, range=0..30)
num = Number(number_slider)
addition = Addition(A=Slider(9, range=0..25), B=number_slider_2)
multiplication = Multiplication(A=num, B=Slider(1.25, range=0..10))
range = Range(Domain=Domain(0, 1), Steps=addition)
neg = Negative(Value=multiplication)
consec = ConsecutiveDomains(Numbers=range, Additive=Toggle(True))
dom = ConstructDomain(DomainStart=neg, DomainEnd=multiplication)
pt = ConstructPoint(XCoordinate=0, YCoordinate=0, ZCoordinate=0)
X = UnitX(Factor=1)
dedomain = DeconstructDomain(Domain=consec)  # -> Start, End
rectangle = Rectangle(Plane=pt, XSize=dom, YSize=dom, Radius=0)  # -> Rectangle, Length
number_slider_3 = Slider(36, range=0..100)
line = LineSDL(Start=pt, Direction=X, Length=number_slider)
split = SplitList(List=dedomain.Start, Index=number_slider_2)  # -> ListA, ListB
division = Division(A="360", B=number_slider_3)
pi = Pi(Factor="2")
dom_2 = ConstructDomain(DomainStart=Slider(0.2, range=0..1), DomainEnd=1)
bnd = Bounds(Numbers=split.ListB)
multiplication_2 = Multiplication(A=division, B=Slider(0.5, range=0..1))
lng = ListLength(List=split.ListB)
range_2 = Range(Domain=pi, Steps=number_slider_3)
remap = RemapNumbers(Value=split.ListB, Source=bnd, Target=dom_2)  # -> Mapped, Clipped
eval = EvaluateCurve(Curve=reparameterize(line), Parameter=remap.Mapped)  # -> Point, Tangent, Angle
graft = GraftTree(Tree=eval.Point, IncludeEmptyLists=True, IncludeNullItems=True)
series = Series(Start=0, Step=multiplication_2, Count=lng)
rotate = Rotate(Geometry=graft, Angle=range_2, Plane=pt)  # -> simplify(Geometry), Transform
rad = Radians(Degrees=series)  # -> simplify(graft(Radians))
rotate_2 = Rotate(Geometry=rotate.Geometry, Angle=rad, Plane=PlaneXY(0, 0, 0))  # -> Geometry, Transform
pline = PolyLine(Vertices=rotate_2.Geometry, Closed=False)
neg_2 = Negative(Value=Slider(1, range=0..1))
explode = Explode(Curve=pline, Recursive=True)  # -> Segments, Vertices
bnd_2 = Bounds(Numbers=remap.Mapped)
dom_3 = ConstructDomain(DomainStart=Slider(4.3, range=0..10), DomainEnd=Slider(9.3, range=0..20))
ext = ExtendCurve(Curve=explode.Segments, Type=0, Start=neg_2, End=neg_2)
remap_2 = RemapNumbers(Value=remap.Mapped, Source=bnd_2, Target=dom_3)  # -> Mapped, Clipped
Z = UnitZ(Factor=1)
eval_2 = EvaluateLength(Curve=ext, Length="0.5", Normalized=True)  # -> Point, Tangent, Parameter
graft_2 = GraftTree(Tree=remap_2.Mapped, IncludeEmptyLists=True, IncludeNullItems=True)  # -> simplify(Tree)
end = EndPoints(Curve=graft(ext))  # -> Start, End
eval_3 = EvaluateLength(Curve=ext, Length="0.5", Normalized=True)  # -> Point, Tangent, Parameter
vrot = Rotate(Vector=eval_2.Tangent, Axis=Z, Angle="Rad(-90)")
amp = Amplitude(Vector=simplify(vrot), Amplitude=graft_2)
move = Move(Geometry=eval_3.Point, Motion=amp)  # -> Geometry, Transform
merge = Merge(Data1=end.Start, Data2=end.End)  # -> simplify(Result)
graft_3 = GraftTree(Tree=move.Geometry, IncludeEmptyLists=True, IncludeNullItems=True)  # -> simplify(Tree)
ln = Line(StartPoint=merge, EndPoint=graft_3)  # -> simplify(Line)
item = ListItem(List=ln, Index=0, Wrap=True)
item_2 = ListItem(List=ln, Index=1, Wrap=True)
bnd_3 = Bounds(Numbers=remap.Mapped)
dom_4 = ConstructDomain(DomainStart=Slider(0.404, range=0..2), DomainEnd=Slider(1.596, range=0..2))
flip = FlipCurve(Curve=item_2)  # -> Curve, Flag
remap_3 = RemapNumbers(Value=remap.Mapped, Source=bnd_3, Target=dom_4)  # -> Mapped, Clipped
Z_2 = UnitZ(Factor=1)
merge_2 = Merge(Data1=item, Data2=flip.Curve)
divide = DivideCurve(Curve=reparameterize(merge_2), Count=Slider(4, range=0..10), Kinks=False)  # -> Points, Tangents, simplify(Parameters)
pshift = ShiftPaths(Data=divide.Parameters, Offset=-2)
graph = GraphMapper(
    pshift,
    x0=0,
    x1=1,
    y0=0,
    y1=1,
    container_name="Bezier",
    cpx=[0, 0.1623190194, 0.8927532434, 1],
    cpy=[0, 0.8521739244, 0.8231884241, 0])
bnd_4 = Bounds(Numbers=graph)
graft_4 = GraftTree(Tree=remap_3.Mapped, IncludeEmptyLists=True, IncludeNullItems=True)  # -> simplify(Tree)
vrot_2 = Rotate(Vector=divide.Tangents, Axis=Z_2, Angle="Rad(-90)")  # -> simplify(Vector)
remap_4 = RemapNumbers(Value=graph, Source=bnd_4, Target=graft_4)  # -> Mapped, Clipped
unflatten = UnflattenTree(Tree=remap_4.Mapped, Guide=divide.Parameters)
amp_2 = Amplitude(Vector=vrot_2, Amplitude=unflatten)
move_2 = Move(Geometry=divide.Points, Motion=amp_2)  # -> Geometry, Transform
intcrv = Interpolate(Vertices=move_2.Geometry, Degree=3, Periodic=False, KnotStyle=1)  # -> Curve, Length, Domain
pshift_2 = ShiftPaths(Data=intcrv.Curve, Offset=-1)
join = JoinCurves(Curves=pshift_2, Preserve=False)
end_2 = EndPoints(Curve=join)  # -> Start, End
ln_2 = Line(StartPoint=end_2.Start, EndPoint=end_2.End)  # -> simplify(Line)
bnd_5 = Bounds(Numbers=remap.Mapped)
dom_5 = ConstructDomain(DomainStart=Slider(20, range=0..90), DomainEnd=Slider(60.2, range=0..90))
merge_3 = Merge(Data1=simplify(join), Data2=simplify(ln_2))
remap_5 = RemapNumbers(Value=remap.Mapped, Source=bnd_5, Target=dom_5)  # -> Mapped, Clipped
join_2 = JoinCurves(Curves=merge_3, Preserve=False)
lng_2 = ListLength(List=split.ListB)  # -> expr("x-1", Length)
pshift_3 = ShiftPaths(Data=ln_2, Offset=-1)
boundary = BoundarySurfaces(Edges=join_2)  # -> simplify(Surfaces)
rad_2 = Radians(Degrees=remap_5.Mapped)  # -> simplify(graft(Radians))
flatten = FlattenTree(Tree=join_2, Path="{0}")
eval_4 = EvaluateLength(Curve=reparameterize(pshift_3), Length="0.5", Normalized=True)  # -> Point, Tangent, Parameter
range_3 = Range(Domain=Domain(0, 1), Steps=lng_2)
merge_4 = Merge(Data1=flatten, Data2=rectangle.Rectangle)
pshift_4 = ShiftPaths(Data=boundary, Offset=-1)
neg_3 = Negative(Value=rad_2)
gradient = Gradient(LowerLimit=0, UpperLimit=1, Parameter=range_3, stops=[0: RGB(45, 172, 189), 1: RGB(38, 174, 252)])
rot3d = Rotate3D(Geometry=pshift_4, Angle=neg_3, Center=eval_4.Point, Axis=eval_4.Tangent)  # -> Geometry, Transform
boundary_2 = BoundarySurfaces(Edges=merge_4)
graft_5 = GraftTree(Tree=gradient, IncludeEmptyLists=True, IncludeNullItems=True)  # -> simplify(Tree)
preview = CustomPreview(Geometry=boundary_2, Shader=ColourSwatch(SwatchColor=RGB(63, 185, 204)))
preview_2 = CustomPreview(Geometry=rot3d.Geometry, Shader=graft_5)
