# Grasshopper definition Weaving Pot.ghx (Grasshopper 0.9.76)

pt = ConstructPoint(XCoordinate=0, YCoordinate=0, ZCoordinate=0)
Z = UnitZ(Factor=1)
line = LineSDL(Start=pt, Direction=Z, Length=Slider(100, range=0..100))
divide = DivideCurve(Curve=line, Count=Slider(21, range=0..100), Kinks=False)  # -> Points, Tangents, Parameters
lng = ListLength(List=divide.Points)
series = Series(Start=0, Step=1, Count=lng)
bnd = Bounds(Numbers=series)
dom = ConstructDomain(DomainStart=Slider(1, range=0..1), DomainEnd=Slider(0, range=0..1))
dom_2 = ConstructDomain(DomainStart=Slider(33, range=0..100), DomainEnd=Slider(74, range=0..100))
remap = RemapNumbers(Value=series, Source=bnd, Target=Domain(0, 1))  # -> Mapped, Clipped
graph = GraphMapper(
    remap.Mapped,
    x0=0,
    x1=1,
    y0=0,
    y1=1,
    container_name="Sine Summation",
    Equation0_px=[0.0637684688, 0.3605802357],
    Equation0_py=[0.1867824197, 0.7581448555],
    Equation1_px=[0.2900868356, 0.9133920074],
    Equation1_py=[0.05247539282, 0.2275941372])
graph_2 = GraphMapper(
    remap.Mapped,
    x0=0,
    x1=1,
    y0=0,
    y1=1,
    container_name="Sine Summation",
    Equation0_px=[0.2550725639, 0.3872468472],
    Equation0_py=[0.05362290144, 0.3898549676],
    Equation1_px=[0.2722322643, 0.8361741304],
    Equation1_py=[0.6755360365, 0.1264347434])
remap_2 = RemapNumbers(Value=series, Source=bnd, Target=dom)  # -> Mapped, Clipped
bnd_2 = Bounds(Numbers=graph)
bnd_3 = Bounds(Numbers=graph_2)
remap_3 = RemapNumbers(Value=graph_2, Source=bnd_3, Target=dom_2)  # -> Mapped, Clipped
remap_4 = RemapNumbers(Value=graph, Source=bnd_2, Target=dom_2)  # -> Mapped, Clipped
multiplication = Multiplication(A=remap_2.Mapped, B=remap_4.Mapped)
range = Range(Domain="360", Steps=Slider(5, range=0..10))
multiplication_2 = Multiplication(A=remap_2.Mapped, B=remap_3.Mapped)
cull_i = CullIndex(List=reverse(range), Indices=0, Wrap=True)  # -> reverse(List)
number_slider = Slider(37, range=0..100)
X = UnitX(Factor=multiplication_2)
X_2 = UnitX(Factor=multiplication)
item = ListItem(List=cull_i, Index="1", Wrap=True)
number_slider_2 = Slider(27, range=0..100)
move = Move(Geometry=divide.Points, Motion=X_2)  # -> Geometry, Transform
lng_2 = ListLength(List=cull_i)
division = Division(A=item, B="3")
move_2 = Move(Geometry=divide.Points, Motion=X)  # -> Geometry, Transform
mod = Modulus(A=number_slider, B=2)
nurbs = NurbsCurve(Vertices=move.Geometry, Degree=3, Periodic=False)  # -> Curve, Length, Domain
nurbs_2 = NurbsCurve(Vertices=move_2.Geometry, Degree=3, Periodic=False)  # -> Curve, Length, Domain
rad = Radians(Degrees=cull_i)
series_2 = Series(Start=division, Step=item, Count=lng_2)
multiplication_3 = Multiplication(A=number_slider_2, B=number_slider)
rotate = Rotate(Geometry=nurbs.Curve, Angle=rad, Plane=PlaneXY(0, 0, 0))  # -> Geometry, Transform
rad_2 = Radians(Degrees=series_2)
rotate_2 = Rotate(Geometry=nurbs_2.Curve, Angle=rad_2, Plane=PlaneXY(0, 0, 0))  # -> Geometry, Transform
range_2 = Range(Domain=number_slider_2, Steps=multiplication_3)
bnd_4 = Bounds(Numbers=range_2)
range_3 = Range(Domain=Domain(0, 1), Steps=number_slider)
weave = Weave(Pattern=[0, 1], Stream0=rotate.Geometry, Stream1=rotate_2.Geometry, NullGaps=False)
remap_5 = RemapNumbers(Value=range_2, Source=bnd_4, Target=Domain(0, 1))  # -> Mapped, Clipped
mod_2 = Modulus(A=range_2, B="1")
loft = Loft(Curves=weave, Options={Adjust=False, Closed=True, LoftEnds=0, LoftSimp=0, LoftType=0, Rebuild=10, Refit=0.01})
cull_i_2 = CullIndex(List=reverse(range_3), Indices=0, Wrap=True)  # -> reverse(List)
pt_2 = ConstructPoint(XCoordinate=mod_2, YCoordinate=remap_5.Mapped, ZCoordinate=0)
number_slider_3 = Slider(1.75, range=0..10)
pt_3 = ConstructPoint(XCoordinate=simplify(graft(cull_i_2)), YCoordinate=range_3, ZCoordinate=0)
evalsrf = EvaluateSurface(Surface=reparameterize(loft), Point=pt_2)  # -> Point, Normal, Frame
dispatch = Dispatch(List=evalsrf.Normal, DispatchPattern=[True, False])  # -> ListA, ListB
neg = Negative(Value=number_slider_3)
evalsrf_2 = EvaluateSurface(Surface=reparameterize(loft), Point=pt_3)  # -> Point, Normal, Frame
amp = Amplitude(Vector=dispatch.ListB, Amplitude=number_slider_3)
amp_2 = Amplitude(Vector=dispatch.ListA, Amplitude=neg)
intcrv = Interpolate(Vertices=evalsrf_2.Point, Degree=3, Periodic=False, KnotStyle=1)  # -> Curve, Length, Domain
number_slider_4 = Slider(10, range=0..100)
weave_2 = Weave(Pattern=[0, 1], Stream0=amp_2, Stream1=amp, NullGaps=False)
move_3 = Move(Geometry=evalsrf.Point, Motion=weave_2)  # -> Geometry, Transform
crv = Curve(reparameterize(simplify(intcrv.Curve)))
dom_3 = ConstructDomain(DomainStart=Slider(3, range=0..10), DomainEnd=Slider(0.5, range=0..10))
intcrv_2 = Interpolate(Vertices=move_3.Geometry, Degree=3, Periodic=False, KnotStyle=1)  # -> Curve, Length, Domain
range_4 = Range(Domain=dom_3, Steps=number_slider_4)
range_5 = Range(Domain=Domain(0, 1), Steps=number_slider_4)
crv_2 = Curve(reparameterize(intcrv_2.Curve))
vpipe = PipeVariable(Curve=crv, Parameters=range_5, Radii=range_4, Caps=0)
vpipe_2 = PipeVariable(Curve=crv_2, Parameters=range_5, Radii=range_4, Caps=0)
number_slider_5 = Slider(1, range=0..10)
preview = CustomPreview(Geometry=vpipe, Shader=ColourSwatch(SwatchColor=RGB(74, 204, 240)))
preview_2 = CustomPreview(Geometry=vpipe_2, Shader=ColourSwatch(SwatchColor=RGB(221, 255, 48)))
