# Grasshopper definition Church Frame.ghx (Grasshopper 0.9.76)
# plug-ins: Python Interpreter

number_slider = Slider(100, range=0..100)
pt = ConstructPoint(XCoordinate=0, YCoordinate=0, ZCoordinate=0)
Z = UnitZ(Factor=1)
X = UnitX(Factor=1)
vrot = Rotate(Vector=X, Axis=Z, Angle="-Rad(60)")
line = LineSDL(Start=pt, Direction=vrot, Length=number_slider)
mirror = Mirror(Geometry=line, Plane=PlaneYZ(0, 0, 0))  # -> Geometry, Transform
merge = Merge(Data1=line, Data2=mirror.Geometry)
cir = Circle(Plane=pt, Radius=number_slider)
join = JoinCurves(Curves=merge, Preserve=False)
ccx = CurveCurve(CurveA=cir, CurveB=join)  # -> Points, ParamsA, ParamsB
shatter = Shatter(Curve=cir, Parameters=ccx.ParamsA)
len = Length(Curve=shatter)
end = EndPoints(Curve=join)  # -> Start, End
panel = Panel("""-1
1""")
sort = SortList(Keys=len, ValuesA=shatter)  # -> Keys, ValuesA
merge_2 = Merge(Data1=end.Start, Data2=end.End)
item = ListItem(List=sort.ValuesA, Index=0, Wrap=True)
multiplication = Multiplication(A=panel, B="60")
rad = Radians(Degrees=multiplication)
rotate = Rotate(Geometry=item, Angle=rad, Plane=merge_2)  # -> Geometry, Transform
end_2 = EndPoints(Curve=rotate.Geometry)  # -> Start, End
Z_2 = UnitZ(Factor=1)
vec2pt = Vector2Pt(PointA=end_2.Start, PointB=end_2.End, Unitize=False)  # -> Vector, Length
pl = ConstructPlane(Origin=end_2.Start, XAxis=vec2pt.Vector, YAxis=Z_2)
mirror_2 = Mirror(Geometry=rotate.Geometry, Plane=pl)  # -> simplify(graft(Geometry)), Transform
yz = YZPlane(Origin=merge_2)  # -> graft(Plane)
mirror_3 = Mirror(Geometry=mirror_2.Geometry, Plane=yz)  # -> simplify(Geometry), Transform
merge_3 = Merge(Data1=mirror_2.Geometry, Data2=mirror_3.Geometry)
join_2 = JoinCurves(Curves=merge_3, Preserve=False)  # -> simplify(Curves)
item_2 = ListItem(List=flatten(join_2), Index=0, Wrap=True)
end_3 = EndPoints(Curve=item_2)  # -> Start, End
end_4 = EndPoints(Curve=simplify(join_2))  # -> Start, End
Y = UnitY(Factor=1)
pt_2 = Point(end_3.Start)
pdecon = Deconstruct(Point=pt_2)  # -> XComponent, YComponent, ZComponent
neg = Negative(Value=Y)
merge_4 = Merge(Data1=end_4.Start, Data2=end_4.End)
scale = Scale(Geometry=item_2, Center=pt_2, Factor="2")  # -> Geometry, Transform
neg_2 = Negative(Value=pdecon.YComponent)
abs = Absolute(Value=neg_2)
Y_2 = UnitY(Factor=neg_2)
line_2 = LineSDL(Start=merge_4, Direction=neg, Length=abs)
move = Move(Geometry=scale.Geometry, Motion=Y_2)  # -> Geometry, Transform
merge_5 = Merge(Data1=join_2, Data2=line_2)
end_5 = EndPoints(Curve=move.Geometry)  # -> Start, End
join_3 = JoinCurves(Curves=merge_5, Preserve=False)  # -> simplify(Curves)
merge_6 = Merge(Data1=end_5.Start, Data2=end_5.End)
end_6 = EndPoints(Curve=join_3)  # -> Start, End
line_3 = LineSDL(Start=merge_6, Direction=neg, Length=abs)
ln = Line(StartPoint=end_6.Start, EndPoint=end_6.End)
merge_7 = Merge(Data1=join_3, Data2=ln)
scale_2 = Scale(Geometry=line_3, Center=merge_6, Factor="2")  # -> Geometry, Transform
end_7 = EndPoints(Curve=scale_2.Geometry)  # -> Start, End
pline = PolyLine(Vertices=end_7.End, Closed=False)
merge_8 = Merge(Data1=move.Geometry, Data2=scale_2.Geometry, Data3=pline)  # -> flatten(Result)
join_4 = JoinCurves(Curves=merge_8, Preserve=False)
number_slider_2 = Slider(8.5, range=0..100)
join_5 = JoinCurves(Curves=merge_7, Preserve=False)
crv = Curve(cir)
rdiff = RegionDifference(CurvesA=join_4, CurvesB=crv)
range = Range(Domain=number_slider_2, Steps=Slider(10, range=0..10))
item_3 = ListItem(List=rdiff, Index=1, Wrap=True)
flatten = FlattenTree(Tree=join_5, Path="{0}")
item_4 = ListItem(List=rdiff, Index=0, Wrap=True)
cull_i = CullIndex(List=range, Indices=0, Wrap=True)
area = Area(Geometry=join_5)  # -> Area, Centroid
neg_3 = Negative(Value=number_slider_2)
rdiff_2 = RegionDifference(CurvesA=item_4, CurvesB=flatten)
area_2 = Area(Geometry=item_3)  # -> Area, Centroid
area_3 = Area(Geometry=crv)  # -> Area, Centroid
area_4 = Area(Geometry=rdiff_2)  # -> Area, Centroid
graft = GraftTree(Tree=cull_i, IncludeEmptyLists=True, IncludeNullItems=True)  # -> simplify(Tree)
scale_3 = Scale(Geometry=join_5, Center=area.Centroid, Factor=Slider(0.9, range=0..1))  # -> Geometry, Transform
offsetcrv = OffsetCurve(crv=simplify(flatten(rdiff_2)), pt=simplify(flatten(area_4.Centroid)), dist=graft)  # -> out, simplify(a); inputs crv: Curve, pt: Point3d
# ---------- offsetcrv: Python ----------
import math
import rhinoscriptsyntax as rs

a = rs.OffsetCurve(crv,pt,dist)
# ---------- end offsetcrv ----------
offsetcrv_2 = OffsetCurve(crv=simplify(flatten(join_5)), pt=simplify(flatten(area.Centroid)), dist=graft)  # -> out, simplify(a); inputs crv: Curve, pt: Point3d; same code as offsetcrv
merge_9 = Merge(Data1=flatten(item_3), Data2=flatten(crv), Data3=flatten(rdiff_2), Data4=flatten(join_5))
offsetcrv_3 = OffsetCurve(crv=item_3, pt=area_2.Centroid, dist=graft)  # -> out, simplify(a); inputs crv: Curve, pt: Point3d; same code as offsetcrv
offsetcrv_4 = OffsetCurve(crv=crv, pt=area_3.Centroid, dist=graft)  # -> out, simplify(a); inputs crv: Curve, pt: Point3d; same code as offsetcrv
pshift = ShiftPaths(Data=offsetcrv.a, Offset=-1)
pshift_2 = ShiftPaths(Data=offsetcrv_2.a, Offset=-1)
graft_2 = GraftTree(Tree=merge_9, IncludeEmptyLists=True, IncludeNullItems=True)  # -> simplify(Tree)
merge_10 = Merge(Data1=offsetcrv_3.a, Data2=offsetcrv_4.a, Data3=pshift, Data4=pshift_2)
flip = FlipMatrix(Data=merge_10)
merge_11 = Merge(Data1=graft_2, Data2=flip)
lng = ListLength(List=merge_11)  # -> expr("x-1", Length)
range_2 = Range(Domain=Domain(0, 1), Steps=lng)
graph = GraphMapper(
    range_2,
    x0=0,
    x1=1,
    y0=0,
    y1=1,
    container_name="Bezier",
    cpx=[0, 0.3231891096, 0.8182603121, 1],
    cpy=[0, 0, 0.5308197737, 1])
crv_2 = Curve(join_4)
remap = RemapNumbers(Value=graph, Source=Domain(0, 1), Target=Slider(10, range=0..10))  # -> Mapped, Clipped
graft_3 = GraftTree(Tree=merge_9, IncludeEmptyLists=True, IncludeNullItems=True)  # -> simplify(Tree)
Z_3 = UnitZ(Factor=remap.Mapped)
neg_4 = Negative(Value=Z_3)
move_2 = Move(Geometry=merge_11, Motion=neg_4)  # -> simplify(Geometry), Transform
item_5 = ListItem(List=reverse(move_2.Geometry), Index=0, Wrap=True)  # -> flatten(Item)
explode = Explode(Curve=move_2.Geometry, Recursive=True)  # -> Segments, Vertices
explode_2 = Explode(Curve=graft_3, Recursive=True)  # -> simplify(graft(Segments)), Vertices
area_5 = Area(Geometry=item_5)  # -> Area, Centroid
path_mapper = PathMapper(explode.Segments, source="{A;B}(i)", target="{A;i}(B)")
pdecon_2 = Deconstruct(Point=area_5.Centroid)  # -> XComponent, YComponent, ZComponent
merge_12 = Merge(Data1=explode_2.Segments)
sort_2 = SortList(Keys=pdecon_2.YComponent, ValuesA=item_5)  # -> Keys, ValuesA
loft = Loft(Curves=path_mapper, Options={Adjust=False, Closed=False, LoftEnds=0, LoftSimp=0, LoftType=0, Rebuild=10, Refit=0.01})
subset = SubList(List=sort_2.ValuesA, Domain=Domain(0, 1), Wrap=True)  # -> List, Index
flatten_2 = FlattenTree(Tree=loft, Path="{0}")
cp = ControlPoints(Curve=crv_2)  # -> Points, Weights, Knots
cp_2 = ControlPoints(Curve=subset.List)  # -> Points, Weights, Knots
box_corners = BoxCorners(Box=crv_2)  # -> CornerA, CornerB, CornerC, CornerD, CornerE, CornerF, CornerG, CornerH
box_corners_2 = BoxCorners(Box=subset.List)  # -> CornerA, CornerB, CornerC, CornerD, CornerE, CornerF, CornerG, CornerH
pdecon_3 = Deconstruct(Point=cp.Points)  # -> XComponent, YComponent, ZComponent
pdecon_4 = Deconstruct(Point=cp_2.Points)  # -> XComponent, YComponent, ZComponent
join_6 = BrepJoin(Breps=flatten_2)  # -> Breps, Closed
dist = Distance(PointA=box_corners.CornerA, PointB=box_corners.CornerD)
dist_2 = Distance(PointA=box_corners.CornerA, PointB=box_corners.CornerB)
dist_3 = Distance(PointA=box_corners_2.CornerA, PointB=box_corners_2.CornerB)
dist_4 = Distance(PointA=box_corners_2.CornerA, PointB=box_corners_2.CornerD)
sort_3 = SortList(Keys=pdecon_3.YComponent, ValuesA=cp.Points)  # -> Keys, reverse(ValuesA)
sort_4 = SortList(Keys=pdecon_4.YComponent, ValuesA=cp_2.Points)  # -> Keys, reverse(ValuesA)
group = Group(Objects=join_6.Breps)
item_6 = ListItem(List=sort_4.ValuesA, Index=0, Wrap=True)
item_7 = ListItem(List=sort_3.ValuesA, Index=0, Wrap=True)
vec2pt_2 = Vector2Pt(PointA=item_7, PointB=item_6, Unitize=False)  # -> Vector, Length
move_3 = Move(Geometry=group, Motion=vec2pt_2.Vector)  # -> Geometry, Transform
division = Division(A=dist_4, B=dist)
division_2 = Division(A=dist_3, B=dist_2)
graft_4 = GraftTree(Tree=division, IncludeEmptyLists=True, IncludeNullItems=True)
graft_5 = GraftTree(Tree=division_2, IncludeEmptyLists=True, IncludeNullItems=True)
scale_nu = ScaleNU(Geometry=move_3.Geometry, Plane=item_6, ScaleX=graft_5, ScaleY=graft_4, ScaleZ=1)  # -> Geometry, Transform
merge_13 = Merge(Data1=group, Data2=scale_nu.Geometry)
preview = CustomPreview(Geometry=merge_13, Shader=ColourSwatch(SwatchColor=RGB(130, 130, 130)))
