# Grasshopper definition Spider Dome.ghx (Grasshopper 0.9.76)
# plug-ins: MeshEdit Components, Kangaroo Components, Weaverbird, Kangaroo2 Components

number_slider = Slider(10, range=0..10)
number_slider_2 = Slider(40, range=0..100)
planesrf = PlaneSurface(Plane=PlaneXY(0, 0, 0), XSize=number_slider, YSize=number_slider)
debrep = DeconstructBrep(Brep=planesrf)  # -> Faces, Edges, Vertices
sdivide = DivideSurface(Surface=planesrf, UCount=number_slider_2, VCount=number_slider_2)  # -> simplify(Points), Normals, Parameters
flatten = FlattenTree(Tree=sdivide.Points, Path="{0}")
pt = Point(debrep.Vertices)
popgeo = PopulateGeometry(Geometry=planesrf, Count=Slider(15, range=0..100), Seed=Slider(441, range=0..1000), Points=pt)
area = Area(Geometry=planesrf)  # -> Area, Centroid
cp = ClosestPoint(Point=popgeo, Cloud=flatten)  # -> ClosestPoint, CPIndex, Distance
item = ListItem(List=pt, Index=0, Wrap=True)
dist = Distance(PointA=cp.ClosestPoint, PointB=area.Centroid)
dist_2 = Distance(PointA=item, PointB=area.Centroid)
toggle = BooleanToggle(False)
remap = RemapNumbers(Value=dist, Source=dist_2, Target=Domain(0, 1))  # -> Mapped, Clipped
graph = GraphMapper(remap.Mapped, x0=0, x1=1, y0=0, y1=1, container_name="Bezier", cpx=[0, 0.4021606445, 0.608741641, 1], cpy=[0, 0, 1, 1])
addition = Addition(A=number_slider_2, B="1")
frompoints = MeshFromPoints(Points=flatten, UDirection=addition, VDirection=addition)
explode = MeshExplode(Mesh=frompoints, Interpolate=False)
dom = ConstructDomain(DomainStart=Slider(5.3, range=0..15), DomainEnd=Slider(0, range=0..100))
demesh = DeconstructMesh(Mesh=frompoints)  # -> simplify(Vertices), Faces, Colours, Normals
demesh_2 = DeconstructMesh(Mesh=explode)  # -> simplify(Vertices), Faces, Colours, Normals
remap_2 = RemapNumbers(Value=graph, Source=Domain(0, 1), Target=dom)  # -> Mapped, Clipped
medges = MeshEdges(Mesh=frompoints)  # -> NakedEdges, InteriorEdges, NonManifoldEdges
dispatch = Dispatch(List=demesh_2.Vertices, DispatchPattern=[True, False])  # -> ListA, ListB
not = GateNot(A=toggle)
Z = UnitZ(Factor=remap_2.Mapped)
merge = Merge(Data1=medges.NakedEdges, Data2=medges.InteriorEdges)
pline = PolyLine(Vertices=dispatch.ListB, Closed=False)
pline_2 = PolyLine(Vertices=dispatch.ListA, Closed=False)
number_slider_3 = Slider(1, range=0..1)
multiplication = Multiplication(A=Z, B=not)
move = Move(Geometry=cp.ClosestPoint, Motion=multiplication)  # -> simplify(Geometry), Transform
merge_2 = Merge(Data1=pline_2, Data2=pline, Data3=merge)  # -> flatten(Result)
pt_2 = Point(pt)
neg = Negative(Value=number_slider_3)
merge_3 = Merge(Data1=pt_2, Data2=move.Geometry)  # -> flatten(Result)
cp_2 = ClosestPoint(Point=merge_3, Cloud=demesh.Vertices)  # -> ClosestPoint, CPIndex, Distance
graft = GraftTree(Tree=cp_2.ClosestPoint, IncludeEmptyLists=True, IncludeNullItems=True)
dist_3 = Distance(PointA=graft, PointB=demesh.Vertices)  # -> simplify(Distance)
min = Minimum(A=dist_3, B=Slider(2, range=0..2))
dom_2 = ConstructDomain(DomainStart=Slider(1, range=0..1), DomainEnd=Slider(0, range=0..100))
bnd = Bounds(Numbers=min)
dupln = RemoveDuplicateLines(Lines=merge_2, Tolerance=0.01)
Z_2 = UnitZ(Factor=number_slider_3)
pt_3 = Point(flatten)
remap_3 = RemapNumbers(Value=min, Source=bnd, Target=dom_2)  # -> Mapped, Clipped
length_line = LengthLine(Line=dupln, Length=dupln, Strength=10)
anchor = Anchor(Point=merge_3, Strength=1000)
del = DelaunayMesh(Points=merge_3, Plane=PlaneXY(0, 0, 0))
load = Load(Point=pt_3, ForceVector=Z_2)
show = Show(G=frompoints)
graph_2 = GraphMapper(remap_3.Mapped, x0=0, x1=1, y0=0, y1=1, container_name="Bezier", cpx=[0, 0.25, 0.75, 1], cpy=[0, 0.25, 0.75, 1])
wbtriangles = WeaverbirdsSplitTrianglesSubdivision(MeshCurves=del, Level=Slider(3, range=0..10))
merge_4 = Merge(Data1=flatten(show), Data2=flatten(anchor), Data3=flatten(length_line), Data4=flatten(load))
preview = CustomPreview(Geometry=wbtriangles, Shader=ColourSwatch(SwatchColor=RGB(115, 115, 115)))
flip = FlipMatrix(Data=graph_2)
solver = Solver(GoalObjects=merge_4, Reset=toggle, Threshold=1e-15, Tolerance=0.01, On=True)  # -> I, V, O
ma = MassAddition(Input=flip)  # -> Result, PartialResults
item_2 = ListItem(List=solver.O, Index=0, Wrap=True)
flatten_2 = FlattenTree(Tree=ma.Result, Path="{0}")
bnd_2 = Bounds(Numbers=flatten_2)
remap_4 = RemapNumbers(Value=flatten_2, Source=bnd_2, Target=Domain(0, 1))  # -> Mapped, Clipped
gradient = Gradient(
    LowerLimit=0,
    UpperLimit=1,
    Parameter=remap_4.Mapped,
    stops=[0: RGB(238, 255, 0), 0.535: RGB(255, 192, 20), 1: RGB(87, 87, 87)])
mcol = MeshColours(Mesh=item_2, Colours=gradient)
