# Grasshopper definition Voxel Bunny.ghx (Grasshopper 0.9.76)
# plug-ins: Weaverbird

mesh = Mesh(<mesh referenced from the Rhino model>)
bbox = BoundingBox(Content=mesh, Plane=PlaneXY(0, 0, 0))  # -> Box, Box_2
box_corners = BoxCorners(Box=bbox.Box)  # -> CornerA, CornerB, CornerC, CornerD, CornerE, CornerF, CornerG, CornerH
area = Area(Geometry=bbox.Box)  # -> Area, Centroid
number_slider = Slider(0.3, range=0.01..2)
dist = Distance(PointA=box_corners.CornerA, PointB=box_corners.CornerD)
dist_2 = Distance(PointA=box_corners.CornerA, PointB=box_corners.CornerE)
dist_3 = Distance(PointA=box_corners.CornerA, PointB=box_corners.CornerB)
merge = Merge(Data1=dist_3, Data2=dist, Data3=dist_2)
division = Division(A=merge, B=number_slider)
round = Round(Number=division)  # -> Nearest, Floor, Ceiling
multiplication = Multiplication(A=number_slider, B=round.Nearest)
division_2 = Division(A=multiplication, B=merge)  # -> simplify(graft(Result))
bang = ExplodeTree(Data=simplify(graft(round.Nearest)))  # -> Branch0, Branch1, Branch2
bang_2 = ExplodeTree(Data=division_2)  # -> Branch0, Branch1, Branch2
scale_nu = ScaleNU(Geometry=bbox.Box, Plane=area.Centroid, ScaleX=bang_2.Branch0, ScaleY=bang_2.Branch1, ScaleZ=bang_2.Branch2)  # -> Geometry, Transform
box_corners_2 = BoxCorners(Box=scale_nu.Geometry)  # -> CornerA, CornerB, CornerC, CornerD, CornerE, CornerF, CornerG, CornerH
sqgrid = Square(Plane=box_corners_2.CornerA, Size=number_slider, ExtentX=bang.Branch0, ExtentY=bang.Branch1)  # -> simplify(Cells), simplify(Points)
flatten = FlattenTree(Tree=sqgrid.Cells, Path="{0}")
explode = Explode(Curve=flatten, Recursive=True)  # -> Segments, simplify(Vertices)
num = Number(number_slider)
wbweave = WeaverbirdsMeshFromLinesWeaveBack(Lines=explode.Segments, MaximumValence=4)
series = Series(Start=0, Step=number_slider, Count=bang.Branch2)
neg = Negative(Value=num)
Z = UnitZ(Factor=series)  # -> simplify(graft(UnitVector))
wbthicken = WeaverbirdsMeshThicken(MeshCurves=wbweave, Distance=neg, OffsetType=0)  # -> simplify(flatten(OutputMeshCurves))
move = Move(Geometry=wbthicken, Motion=Z)  # -> flatten(Geometry), Transform
mesh_2 = Mesh(mesh)
mesh_3 = Mesh(mesh_2)
mmx = MeshMesh(MeshA=mesh_3, MeshB=move.Geometry, UseMeshMeshFast=True)  # -> simplify(Intersections)
lng = ListLength(List=mmx)  # -> flatten(Length)
cull = CullPattern(List=move.Geometry, CullPattern=lng)
area_2 = Area(Geometry=cull)  # -> Area, Centroid
meshcp = MeshClosestPoint(Point=area_2.Centroid, Mesh=mesh_2)  # -> Point, Index, Parameter
unweld = UnweldMesh(Mesh=cull, Angle=1.570796327)
meval = MeshEval(Mesh=mesh_2, Parameter=meshcp.Parameter)  # -> Point, Normal, Colour
meshnormalize = MeshNormalize(mesh=unweld)  # -> out, A; inputs mesh: Mesh
# ---------- meshnormalize: C# ----------
    if(mesh != null){
      mesh.Normals.ComputeNormals();

      A = mesh;
    }
# ---------- end meshnormalize ----------
Z_2 = UnitZ(Factor=1)
dprod = DotProduct(VectorA=meval.Normal, VectorB=Z_2, Unitize=False)
bnd = Bounds(Numbers=dprod)
remap = RemapNumbers(Value=dprod, Source=bnd, Target=Domain(0, 1))  # -> Mapped, Clipped
gradient = Gradient(LowerLimit=0, UpperLimit=1, Parameter=remap.Mapped, stops=[0.229: RGB(255, 130, 160), 1: RGB(220, 0, 40)])
preview = CustomPreview(Geometry=meshnormalize.A, Shader=gradient)
