# Grasshopper definition Nouveau Tile.ghx (Grasshopper 0.9.76)

pt = ConstructPoint(XCoordinate=0, YCoordinate=0, ZCoordinate=0)
Y = UnitY(Factor=1)
number_slider = Slider(36, range=0..100)
line = LineSDL(Start=pt, Direction=Y, Length=Slider(1000, range=0..1000))
pi = Pi(Factor=Slider(4, range=0..10))
range = Range(Domain=Domain(0, 1), Steps=number_slider)
graph = GraphMapper(
    range,
    x0=0,
    x1=1,
    y0=0,
    y1=1,
    container_name="Bezier",
    cpx=[0, 0.1865456253, 0.8430300355, 1],
    cpy=[0, 0.5595362186, 0.8034783006, 0.2033624053])
range_2 = Range(Domain=pi, Steps=number_slider)
divide = DivideCurve(Curve=line, Count=number_slider, Kinks=False)  # -> Points, Tangents, Parameters
graph_2 = GraphMapper(range, x0=0, x1=1, y0=0, y1=1, container_name="Bezier", cpx=[0, 0.447879225, 1, 1], cpy=[0, 0, 0.4208115339, 1])
dom = ConstructDomain(DomainStart=Slider(0, range=0..1), DomainEnd=Slider(450, range=0..500))
dom_2 = ConstructDomain(DomainStart=Slider(1, range=0..1), DomainEnd=Slider(2.13, range=0..10))
bnd = Bounds(Numbers=graph)
rotate = Rotate(Geometry=divide.Points, Angle=range_2, Plane=pt)  # -> Geometry, Transform
remap = RemapNumbers(Value=graph_2, Source=Domain(0, 1), Target=dom_2)  # -> Mapped, Clipped
remap_2 = RemapNumbers(Value=graph, Source=bnd, Target=dom)  # -> Mapped, Clipped
scale = Scale(Geometry=rotate.Geometry, Center=pt, Factor=remap.Mapped)  # -> Geometry, Transform
intcrv = Interpolate(Vertices=scale.Geometry, Degree=3, Periodic=False, KnotStyle=1)  # -> reparameterize(Curve), Length, Domain
crv_cp = CurveClosestPoint(Point=scale.Geometry, Curve=intcrv.Curve)  # -> Point, Parameter, Distance
eval = EvaluateCurve(Curve=intcrv.Curve, Parameter=crv_cp.Parameter)  # -> Point, Tangent, Angle
pi_2 = Pi(Factor="-0.5")
Z = UnitZ(Factor=1)
vrot = Rotate(Vector=eval.Tangent, Axis=Z, Angle=pi_2)
amp = Amplitude(Vector=vrot, Amplitude=remap_2.Mapped)
move = Move(Geometry=eval.Point, Motion=amp)  # -> Geometry, Transform
intcrv_2 = Interpolate(Vertices=move.Geometry, Degree=3, Periodic=False, KnotStyle=1)  # -> Curve, Length, Domain
merge = Merge(Data1=intcrv.Curve, Data2=intcrv_2.Curve)
bbox = BoundingBox(Content=merge, Plane=PlaneXY(0, 0, 0), UnionBox=True)  # -> Box, Box_2
item = ListItem(List=merge, Index=0, Wrap=True)
area = Area(Geometry=bbox.Box)  # -> Area, Centroid
vec = VectorXYZ(XComponent="1", YComponent="1", ZComponent=0)  # -> Vector, Length
end = EndPoints(Curve=item)  # -> Start, End
Z_2 = UnitZ(Factor=1)
yz = YZPlane(Origin=area.Centroid)
pcx = CurvePlane(Curve=reparameterize(merge), Plane=yz)  # -> reverse(simplify(Points)), simplify(ParamsC), ParamsP
item_2 = ListItem(List=pcx.Points, Index=0, Wrap=True)  # -> flatten(Item)
pi_3 = Pi(Factor=1)
avr = Average(Input=item_2)
pl = ConstructPlane(Origin=avr, XAxis=vec.Vector, YAxis=Z_2)
pcx_2 = CurvePlane(Curve=reparameterize(merge), Plane=pl)  # -> Points, simplify(ParamsC), ParamsP
shatter = Shatter(Curve=reparameterize(merge), Parameters=flatten(pcx_2.ParamsC))  # -> simplify(Segments)
len = Length(Curve=shatter)
sort = SortList(Keys=len, ValuesA=shatter)  # -> Keys, reverse(ValuesA)
item_3 = ListItem(List=sort.ValuesA, Index=0, Wrap=True)  # -> flatten(Item)
crv = Curve(item_3)
bbox_2 = BoundingBox(Content=crv, Plane=PlaneXY(0, 0, 0), UnionBox=True)  # -> Box, Box_2
rotate_2 = Rotate(Geometry=crv, Angle=pi_3, Plane=avr)  # -> reverse(Geometry), Transform
flip = FlipCurve(Curve=rotate_2.Geometry)  # -> Curve, Flag
merge_2 = Merge(Data1=simplify(graft(crv)), Data2=simplify(graft(flip.Curve)))
connect = ConnectCurves(Curves=merge_2, Continuity=2, Close=False, Bulge=1)
cp = ControlPoints(Curve=connect)  # -> Points, Weights, Knots
lng = ListLength(List=cp.Points)
division = Division(A=lng, B=Slider(2, range=0..10))
reb = RebuildCurve(Curve=connect, Degree=Slider(3, range=0..10), Count=division, Tangents=False)
join = JoinCurves(Curves=flatten(reb), Preserve=False)
boundary = BoundarySurfaces(Edges=join)
Z_3 = UnitZ(Factor=Slider(300, range=0..500))
box_corners = BoxCorners(Box=boundary)  # -> CornerA, CornerB, CornerC, CornerD, CornerE, CornerF, CornerG, CornerH
extr = Extrude(Base=boundary, Direction=Z_3)
yz_2 = YZPlane(Origin=box_corners.CornerA)
mirror = Mirror(Geometry=extr, Plane=yz_2)  # -> Geometry, Transform
merge_3 = Merge(Data1=extr, Data2=mirror.Geometry)
bbox_3 = BoundingBox(Content=merge_3, Plane=PlaneXY(0, 0, 0), UnionBox=True)  # -> Box, Box_2
group = Group(Objects=merge_3)
box_corners_2 = BoxCorners(Box=bbox_3.Box)  # -> CornerA, CornerB, CornerC, CornerD, CornerE, CornerF, CornerG, CornerH
number_slider_2 = Slider(10, range=0..10)
dist = Distance(PointA=box_corners_2.CornerA, PointB=box_corners_2.CornerD)
dist_2 = Distance(PointA=box_corners_2.CornerA, PointB=box_corners_2.CornerB)
series = Series(Start=0, Step=dist_2, Count=number_slider_2)
series_2 = Series(Start=0, Step=dist, Count=number_slider_2)
X = UnitX(Factor=series)  # -> graft(UnitVector)
Y_2 = UnitY(Factor=series_2)
addition = Addition(A=X, B=Y_2)
move_2 = Move(Geometry=group, Motion=addition)  # -> simplify(Geometry), Transform
ungroup = Ungroup(Group=move_2.Geometry)
flatten = FlattenTree(Tree=ungroup, Path="{0}")
bbox_4 = BoundingBox(Content=flatten, Plane=PlaneXY(0, 0, 0))  # -> Box, Box_2
area_2 = Area(Geometry=bbox_4.Box)  # -> Area, simplify(Centroid)
number_slider_3 = Slider(0.5, range=0..1)
pdecon = Deconstruct(Point=area_2.Centroid)  # -> XComponent, YComponent, ZComponent
bnd_2 = Bounds(Numbers=pdecon.XComponent)
bnd_3 = Bounds(Numbers=pdecon.YComponent)
number_slider_4 = Slider(0.19, range=0..1)
remap_3 = RemapNumbers(Value=pdecon.XComponent, Source=bnd_2, Target=number_slider_3)  # -> Mapped, Clipped
remap_4 = RemapNumbers(Value=pdecon.YComponent, Source=bnd_3, Target=number_slider_3)  # -> Mapped, Clipped
hsl = ColourHSL(Alpha=1, Hue=remap_3.Mapped, Saturation=1, Luminance=number_slider_4)
hsl_2 = ColourHSL(Alpha=1, Hue=remap_4.Mapped, Saturation=1, Luminance=number_slider_4)
addition_2 = Addition(A=hsl, B=hsl_2)
preview = CustomPreview(Geometry=flatten, Shader=addition_2)
