# Grasshopper definition Magic Hands.ghx (Grasshopper 0.9.76)
# plug-ins: Anemone

number_slider = Slider(200, range=0..200)
rectangle = Rectangle(Plane=PlaneXY(0, 0, 0), XSize=number_slider, YSize=Slider(100, range=0..100), Radius=0)  # -> Rectangle, Length
explode = Explode(Curve=rectangle.Rectangle, Recursive=True)  # -> Segments, Vertices
cull_i = CullIndex(List=reverse(explode.Vertices), Indices=0, Wrap=True)  # -> reverse(List)
area = Area(Geometry=rectangle.Rectangle)  # -> Area, Centroid
dispatch = Dispatch(List=cull_i, DispatchPattern=[True, False])  # -> ListA, ListB
rotate = Rotate(Angle=1.570796327, Plane=PlaneXY(0, 0, 0))  # -> Geometry, Transform
pline = PolyLine(Vertices=dispatch.ListA, Closed=False)
pline_2 = PolyLine(Vertices=dispatch.ListB, Closed=False)
rad = Radians(Degrees=Slider(14, range=-45..45))
neg = Negative(Value=rad)
rotate_2 = Rotate(Geometry=pline_2, Angle=neg, Plane=area.Centroid)  # -> Geometry, Transform
rotate_3 = Rotate(Geometry=pline, Angle=rad, Plane=area.Centroid)  # -> Geometry, Transform
merge = Merge(Data1=rotate_3.Geometry, Data2=rotate_2.Geometry)
fastloopstart = FastLoopStart(Iterations=Slider(7, range=0..10), Data=merge)  # -> port, Counter, Data
crv = Curve(fastloopstart.Data)
end = EndPoints(Curve=crv)  # -> Start, End
pline_3 = PolyLine(Vertices=end.End, Closed=False)
pline_4 = PolyLine(Vertices=end.Start, Closed=False)
eval = EvaluateLength(Curve=pline_4, Length="0.5", Normalized=True)  # -> Point, Tangent, Parameter
eval_2 = EvaluateLength(Curve=pline_3, Length="0.5", Normalized=True)  # -> Point, Tangent, Parameter
vec2pt = Vector2Pt(PointA=eval.Point, PointB=eval_2.Point, Unitize=False)  # -> Vector, Length
neg_2 = Negative(Value=Slider(14.21, range=0..15))
move = Move(Geometry=crv, Motion=vec2pt.Vector)  # -> Geometry, Transform
yz = YZPlane(Origin=eval_2.Point)
rad_2 = Radians(Degrees=neg_2)
rotate_4 = Rotate(Geometry=move.Geometry, Angle=rad_2, Plane=yz)  # -> Geometry, Transform
fastloopend = FastLoopEnd(port=fastloopstart.port, Exit=False, Data=rotate_4.Geometry, RecordData=True, TimeOutVal=0)  # -> simplify(Data)
group = Group(Objects=fastloopend)  # -> flatten(Group)
group_2 = Group(Objects=crv)  # -> flatten(Group)
merge_2 = Merge(Data1=group_2, Data2=group)
item = ListItem(List=reverse(merge_2), Index=0, Wrap=True)
ungroup = Ungroup(Group=merge_2)
item_2 = ListItem(List=merge_2, Index=0, Wrap=True)
ungroup_2 = Ungroup(Group=item_2)
ungroup_3 = Ungroup(Group=item)
end_2 = EndPoints(Curve=ungroup_2)  # -> Start, End
end_3 = EndPoints(Curve=ungroup_3)  # -> Start, End
pline_5 = PolyLine(Vertices=end_3.End, Closed=False)
pline_6 = PolyLine(Vertices=end_2.Start, Closed=False)
eval_3 = EvaluateLength(Curve=pline_6, Length="0.5", Normalized=True)  # -> Point, Tangent, Parameter
eval_4 = EvaluateLength(Curve=pline_5, Length="0.5", Normalized=True)  # -> Point, Tangent, Parameter
Y = UnitY(Factor=1)
vec2pt_2 = Vector2Pt(PointA=eval_3.Point, PointB=eval_4.Point, Unitize=False)  # -> Vector, Length
yz_2 = YZPlane(Origin=eval_3.Point)
angle = Angle(VectorA=vec2pt_2.Vector, VectorB=Y)  # -> Angle, Reflex
rad_3 = Radians(Degrees=Slider(14, range=0..100))
addition = Addition(A=angle.Angle, B=rad_3)
rotate_5 = Rotate(Geometry=ungroup, Angle=addition, Plane=yz_2)  # -> simplify(Geometry), Transform
flip = FlipMatrix(Data=rotate_5.Geometry)
bang = ExplodeTree(Data=flip)  # -> Branch0, Branch1
item_3 = ListItem(List=reverse(flip), Index=0, Wrap=True)
dispatch_2 = Dispatch(List=bang.Branch0, DispatchPattern=[True, False])  # -> ListA, ListB
dispatch_3 = Dispatch(List=bang.Branch1, DispatchPattern=[True, False])  # -> ListA, ListB
end_4 = EndPoints(Curve=item_3)  # -> Start, End
flatten = FlattenTree(Tree=end_4.Start, Path="{0}")
flatten_2 = FlattenTree(Tree=end_4.End, Path="{0}")
weave = Weave(Pattern=[0, 1], Stream0=dispatch_2.ListA, Stream1=dispatch_3.ListB, NullGaps=False)  # -> simplify(Weave)
weave_2 = Weave(Pattern=[0, 1], Stream0=dispatch_3.ListA, Stream1=dispatch_2.ListB, NullGaps=False)  # -> simplify(Weave)
pline_7 = PolyLine(Vertices=flatten_2, Closed=False)
pline_8 = PolyLine(Vertices=flatten, Closed=False)
vec2pt_3 = Vector2Pt(PointA=end_4.Start, PointB=end_4.End, Unitize=False)  # -> Vector, Length
group_3 = Group(Objects=weave)
group_4 = Group(Objects=weave_2)
eval_5 = EvaluateLength(Curve=pline_7, Length="0.5", Normalized=True)  # -> Point, Tangent, Parameter
eval_6 = EvaluateLength(Curve=pline_8, Length="0.5", Normalized=True)  # -> Point, Tangent, Parameter
merge_3 = Merge(Data1=group_3, Data2=group_4)
number_slider_2 = Slider(34.1, range=0..50)
vec2pt_4 = Vector2Pt(PointA=eval_6.Point, PointB=eval_5.Point, Unitize=False)  # -> Vector, Length
move_2 = Move(Geometry=end_4.End, Motion=vec2pt_4.Vector)  # -> Geometry, Transform
ungroup_4 = Ungroup(Group=merge_3)  # -> simplify(Objects)
arc = ArcSED(Start=end_4.End, End=move_2.Geometry, Direction=vec2pt_3.Vector)  # -> Arc, Plane, Radius
join = JoinCurves(Curves=ungroup_4, Preserve=False)  # -> simplify(graft(Curves))
num = Number(number_slider_2)
division = Division(A=num, B="2")
neg_3 = Negative(Value=division)
merge_4 = Merge(Data1=neg_3, Data2=division)
X = UnitX(Factor=merge_4)
move_3 = Move(Geometry=join, Motion=X)  # -> Geometry, Transform
loft = Loft(Curves=move_3.Geometry, Options={Adjust=False, Closed=False, LoftEnds=0, LoftSimp=0, LoftType=0, Rebuild=10, Refit=0.01})
md_slider = MDSlider(slider_value=Point(0.5, 0.5, 0.5), SliderMode=0, x_domain=Domain(0, 1), y_domain=Domain(0, 1), z_domain=Domain(0, 1))
debrep = DeconstructBrep(Brep=loft)  # -> Faces, Edges, Vertices
division_2 = Division(A=division, B="2")
evalsrf = EvaluateSurface(Surface=reparameterize(debrep.Faces), Point=md_slider)  # -> Point, Normal, Frame
neg_4 = Negative(Value=division)
amp = Amplitude(Vector=evalsrf.Normal, Amplitude=division_2)
amp_2 = Amplitude(Vector=evalsrf.Normal, Amplitude=neg_4)
extr = Extrude(Base=debrep.Faces, Direction=amp_2)
move_4 = Move(Geometry=extr, Motion=amp)  # -> Geometry, Transform
pipe = Pipe(Curve=arc.Arc, Radius=number_slider_2, Caps=2)
flatten_3 = FlattenTree(Tree=move_4.Geometry, Path="{0}")
flatten_4 = FlattenTree(Tree=pipe, Path="{0}")
group_5 = Group(Objects=flatten_4)
group_6 = Group(Objects=flatten_3)
num_2 = Number(number_slider)
X_2 = UnitX(Factor=num_2)
merge_5 = Merge(Data1=group_6, Data2=group_5)
Y_2 = UnitY(Factor=num_2)
division_3 = Division(A=X_2, B=2)
range = Range(Domain="360", Steps=Slider(10, range=0..10))
neg_5 = Negative(Value=division_3)
rad_4 = Radians(Degrees=range)  # -> graft(Radians)
addition_2 = Addition(A=Y_2, B=neg_5)
move_5 = Move(Geometry=merge_5, Motion=addition_2)  # -> Geometry, Transform
rotate_6 = Rotate(Geometry=move_5.Geometry, Angle=rad_4, Plane=PlaneXY(0, 0, 0))  # -> Geometry, Transform
item_4 = ListItem(List=rotate_6.Geometry, Index=0, Wrap=True)
item_5 = ListItem(List=rotate_6.Geometry, Index=1, Wrap=True)
preview = CustomPreview(Geometry=item_4, Shader=ColourSwatch(SwatchColor=RGB(255, 106, 61)))
preview_2 = CustomPreview(Geometry=item_5, Shader=ColourSwatch(SwatchColor=RGB(255, 182, 10)))
