# Grasshopper definition Dumbbell Pattern.ghx (Grasshopper 0.9.76)

number_slider = Slider(100, range=0..100)
number_slider_2 = Slider(13, range=0..20)
planesrf = PlaneSurface(Plane=PlaneXY(0, 0, 0), XSize=number_slider, YSize=number_slider)
sdivide = DivideSurface(Surface=planesrf, UCount=number_slider_2, VCount=number_slider_2)  # -> simplify(Points), Normals, Parameters
popgeo = PopulateGeometry(Geometry=planesrf, Count=Slider(3, range=0..10), Seed=Slider(35, range=0..100))
flatten = FlattenTree(Tree=sdivide.Points, Path="{0}")
graft = GraftTree(Tree=popgeo, IncludeEmptyLists=True, IncludeNullItems=True)
dist = Distance(PointA=graft, PointB=flatten)  # -> simplify(Distance)
min = Minimum(A=dist, B=Slider(63, range=0..100))
flip = FlipMatrix(Data=min)
ma = MassAddition(Input=flip)  # -> Result, PartialResults
bnd = Bounds(Numbers=flatten(ma.Result))
remap = RemapNumbers(Value=ma.Result, Source=bnd, Target=Domain(0, 1))  # -> Mapped, Clipped
graph = GraphMapper(remap.Mapped, x0=0, x1=1, y0=0, y1=1, container_name="Bezier", cpx=[0, 0.4289860427, 0.4985510707, 1], cpy=[0, 0, 1, 1])
dom = ConstructDomain(DomainStart=Slider(36, range=0..100), DomainEnd=0)
remap_2 = RemapNumbers(Value=graph, Source=Domain(0, 1), Target=dom)  # -> Mapped, Clipped
Z = UnitZ(Factor=remap_2.Mapped)
num = Number(number_slider_2)
move = Move(Geometry=flatten, Motion=flatten(Z))  # -> Geometry, Transform
addition = Addition(A=num, B=1)
srfgrid = SurfaceFromPoints(Points=move.Geometry, UCount=addition, Interpolate=False)
unflatten = UnflattenTree(Tree=move.Geometry, Guide=sdivide.Points)
flip_2 = FlipMatrix(Data=unflatten)
intcrv = Interpolate(Vertices=unflatten, Degree=3, Periodic=False, KnotStyle=1)  # -> Curve, Length, Domain
flatten_2 = FlattenTree(Tree=intcrv.Curve, Path="{0}")
intcrv_2 = Interpolate(Vertices=flip_2, Degree=3, Periodic=False, KnotStyle=1)  # -> Curve, Length, Domain
loft = Loft(Curves=flatten_2, Options={Adjust=False, Closed=False, LoftEnds=0, LoftSimp=0, LoftType=0, Rebuild=10, Refit=0.01})
crv = Curve(reparameterize(intcrv_2.Curve))
crv_2 = Curve(reparameterize(intcrv.Curve))
flatten_3 = FlattenTree(Tree=crv, Path="{0}")
flatten_4 = FlattenTree(Tree=crv_2, Path="{0}")
dispatch = Dispatch(List=flatten_4, DispatchPattern=[True, False])  # -> ListA, ListB
dispatch_2 = Dispatch(List=flatten_3, DispatchPattern=[True, False])  # -> ListA, ListB
graft_2 = GraftTree(Tree=dispatch.ListA, IncludeEmptyLists=True, IncludeNullItems=True)  # -> simplify(Tree)
graft_3 = GraftTree(Tree=dispatch.ListB, IncludeEmptyLists=True, IncludeNullItems=True)  # -> simplify(Tree)
graft_4 = GraftTree(Tree=dispatch_2.ListB, IncludeEmptyLists=True, IncludeNullItems=True)  # -> simplify(Tree)
graft_5 = GraftTree(Tree=dispatch_2.ListA, IncludeEmptyLists=True, IncludeNullItems=True)  # -> simplify(Tree)
ccx = CurveCurve(CurveA=graft_3, CurveB=dispatch_2.ListB)  # -> Points, ParamsA, ParamsB
ccx_2 = CurveCurve(CurveA=graft_2, CurveB=dispatch_2.ListA)  # -> Points, ParamsA, ParamsB
ccx_3 = CurveCurve(CurveA=graft_5, CurveB=dispatch.ListB)  # -> Points, ParamsA, ParamsB
ccx_4 = CurveCurve(CurveA=graft_4, CurveB=dispatch.ListA)  # -> Points, ParamsA, ParamsB
pshift = ShiftPaths(Data=ccx.ParamsA, Offset=-1)
pshift_2 = ShiftPaths(Data=ccx_2.ParamsA, Offset=-1)
pshift_3 = ShiftPaths(Data=ccx_3.ParamsA, Offset=-1)
pshift_4 = ShiftPaths(Data=ccx_4.ParamsA, Offset=-1)
shatter = Shatter(Curve=graft_2, Parameters=pshift_2)  # -> simplify(Segments)
shatter_2 = Shatter(Curve=graft_3, Parameters=pshift)  # -> simplify(Segments)
shatter_3 = Shatter(Curve=graft_4, Parameters=pshift_4)  # -> simplify(Segments)
shatter_4 = Shatter(Curve=graft_5, Parameters=pshift_3)  # -> simplify(Segments)
merge = Merge(Data1=shatter, Data2=shatter_2, Data3=shatter_3, Data4=shatter_4)  # -> flatten(Result)
len = Length(Curve=merge)
bnd_2 = Bounds(Numbers=len)
dedomain = DeconstructDomain(Domain=bnd_2)  # -> Start, End
division = Division(A=dedomain.Start, B=2)
subtraction = Subtraction(A=division, B=Slider(0.01, range=0..1))
min_2 = Minimum(A=Slider(4.9, range=0..10), B=subtraction)
neg = Negative(Value=min_2)
ext = ExtendCurve(Curve=merge, Type=0, Start=neg, End=neg)  # -> graft(Curve)
number_slider_3 = Slider(0.58, range=0..1)
srf = Surface(reparameterize(loft))
eval = EvaluateLength(Curve=ext, Length=0.5, Normalized=True)  # -> Point, Tangent, Parameter
end = EndPoints(Curve=simplify(ext))  # -> Start, End
xy = XYPlane(Origin=Point(0, 0, 0))
neg_2 = Negative(Value=number_slider_3)
merge_2 = Merge(Data1=end.Start, Data2=end.End)
srf_cp = SurfaceClosestPoint(Point=eval.Point, Surface=reparameterize(srf))  # -> Point, UVPoint, Distance
merge_3 = Merge(Data1=neg_2, Data2=number_slider_3)
srf_cp_2 = SurfaceClosestPoint(Point=merge_2, Surface=reparameterize(srf))  # -> Point, UVPoint, Distance
evalsrf = EvaluateSurface(Surface=srf, Point=srf_cp.UVPoint)  # -> Point, Normal, Frame
offset_l = OffsetLoose(Curve=ext, Distance=merge_3, Plane=evalsrf.Frame)
loft_2 = Loft(Curves=offset_l, Options={Adjust=False, Closed=False, LoftEnds=0, LoftSimp=0, LoftType=0, Rebuild=10, Refit=0.01})
evalsrf_2 = EvaluateSurface(Surface=srf, Point=srf_cp_2.UVPoint)  # -> Point, Normal, Frame
panel = Panel(subtraction)
crv_3 = Curve(simplify(loft_2))
cir = Circle(Plane=evalsrf_2.Frame, Radius=Slider(2.23, range=0..10))
merge_4 = Merge(Data1=crv_3, Data2=cir)
project = Project(Geometry=merge_4, Plane=PlaneXY(0, 0, 0))  # -> Geometry, Transform
runion = RegionUnion(Curves=project.Geometry)
fillet = Fillet(Curve=runion, Radius=Slider(2, range=0..10))
Z_2 = UnitZ(Factor=Slider(1000, range=0..1000))
boundary = BoundarySurfaces(Edges=fillet)
division_2 = Division(A=Z_2, B=-2)
extr = Extrude(Base=boundary, Direction=Z_2)  # -> flatten(Extrusion)
srf_2 = Surface(reparameterize(srf))
move_2 = Move(Geometry=extr, Motion=division_2)  # -> Geometry, Transform
trim = TrimSolid(Shape=srf_2, Cutters=move_2.Geometry)
Z_3 = UnitZ(Factor=Slider(1, range=0..10))
extr_2 = Extrude(Base=trim, Direction=Z_3)
preview = CustomPreview(Geometry=extr_2, Shader=ColourSwatch(SwatchColor=RGB(87, 169, 250)))
