# Grasshopper definition Spider Cage.ghx (Grasshopper 0.9.76)

sph = Sphere(Base=PlaneXY(0, 0, 0), Radius=Slider(100, range=0..100))
popgeo = PopulateGeometry(Geometry=sph, Count=Slider(17, range=0..100), Seed=1)
facet = FacetDome(Points=popgeo)  # -> Pattern, Dome
explode = Explode(Curve=facet.Pattern, Recursive=True)  # -> simplify(Segments), Vertices
len = Length(Curve=explode.Segments)
division = Division(A=len, B=Slider(23.14, range=0..30))
max = Maximum(A=division, B=Slider(1, range=0..10))
area = Area(Geometry=facet.Pattern)  # -> Area, Centroid
round = Round(Number=max)  # -> Nearest, Floor, Ceiling
graft = GraftTree(Tree=area.Centroid, IncludeEmptyLists=True, IncludeNullItems=True)  # -> simplify(Tree)
divide = DivideCurve(Curve=explode.Segments, Count=round.Nearest, Kinks=False)  # -> simplify(Points), Tangents, Parameters
cull_i = CullIndex(List=divide.Points, Indices="0", Wrap=True)  # -> simplify(List)
panel = Panel(round.Nearest)
pshift = ShiftPaths(Data=cull_i, Offset=-1)
ln = Line(StartPoint=graft, EndPoint=pshift)
shift = ShiftList(List=ln, Shift=1, Wrap=True)
graft_2 = GraftTree(Tree=ln, IncludeEmptyLists=True, IncludeNullItems=True)  # -> simplify(Tree)
graft_3 = GraftTree(Tree=shift, IncludeEmptyLists=True, IncludeNullItems=True)  # -> simplify(Tree)
merge = Merge(Data1=graft_2, Data2=graft_3)
number_slider = Slider(9, range=0..10)
item = ListItem(List=merge, Index=0, Wrap=True)
item_2 = ListItem(List=merge, Index="1", Wrap=True)
popgeo_2 = PopulateGeometry(Geometry=item, Count=number_slider, Seed=1)  # -> simplify(Population)
popgeo_3 = PopulateGeometry(Geometry=item_2, Count=number_slider, Seed=Slider(34, range=0..100))  # -> simplify(Population)
crv_cp = CurveClosestPoint(Point=popgeo_3, Curve=reparameterize(item_2))  # -> Point, Parameter, Distance
crv_cp_2 = CurveClosestPoint(Point=popgeo_2, Curve=reparameterize(item))  # -> Point, Parameter, Distance
sort = SortList(Keys=crv_cp.Parameter, ValuesA=crv_cp.Point)  # -> Keys, ValuesA
sort_2 = SortList(Keys=crv_cp_2.Parameter, ValuesA=crv_cp_2.Point)  # -> Keys, ValuesA
ln_2 = Line(StartPoint=sort_2.ValuesA, EndPoint=sort.ValuesA)
range = Range(Domain=Domain(0, 1), Steps=expr("x-1", number_slider))
dom = ConstructDomain(DomainStart=Slider(0.5, range=0..1), DomainEnd=Slider(2, range=0..10))
group = Group(Objects=ln_2)
divide_2 = DivideCurve(Curve=reparameterize(ln_2), Count=Slider(3, range=0..10), Kinks=False)  # -> simplify(Points), Tangents, Parameters
pshift_2 = ShiftPaths(Data=divide_2.Points, Offset="-2")
remap = RemapNumbers(Value=range, Source=Domain(0, 1), Target=dom)  # -> Mapped, Clipped
flatten = FlattenTree(Tree=group, Path="{0}")
pt = ConstructPoint(XCoordinate=remap.Mapped, YCoordinate=0, ZCoordinate=0)
vec2pt = Vector2Pt(PointA=graft, PointB=pshift_2, Unitize=False)  # -> Vector, Length
lng = ListLength(List=flatten)
graph = GraphMapper(
    divide_2.Parameters,
    x0=0,
    x1=1,
    y0=0,
    y1=1,
    container_name="Bezier",
    cpx=[0, 0.2177398205, 0.7482910156, 1],
    cpy=[0, 0.8407536745, 0.8741449714, 0])
group_2 = Group(Objects=pt)
dup = DuplicateData(Data=group_2, Number=lng, Order=True)
unflatten = UnflattenTree(Tree=dup, Guide=group)
bnd = Bounds(Numbers=graph)
ungroup = Ungroup(Group=unflatten)  # -> simplify(Objects)
unflatten_2 = UnflattenTree(Tree=vec2pt.Vector, Guide=divide_2.Points)
graft_4 = GraftTree(Tree=ungroup, IncludeEmptyLists=True, IncludeNullItems=True)  # -> simplify(Tree)
remap_2 = RemapNumbers(Value=graph, Source=bnd, Target=graft_4)  # -> Mapped, Clipped
amp = Amplitude(Vector=unflatten_2, Amplitude=remap_2.Mapped)
move = Move(Geometry=divide_2.Points, Motion=amp)  # -> Geometry, Transform
nurbs = NurbsCurve(Vertices=move.Geometry, Degree=3, Periodic=False)  # -> Curve, Length, Domain
pshift_3 = ShiftPaths(Data=nurbs.Curve, Offset=-1)
toggle = BooleanToggle(False)
shift_2 = ShiftList(List=pshift_3, Shift=1, Wrap=toggle)
shift_3 = ShiftList(List=pshift_3, Shift=-1, Wrap=toggle)
graft_5 = GraftTree(Tree=shift_2, IncludeEmptyLists=True, IncludeNullItems=True)  # -> simplify(Tree)
graft_6 = GraftTree(Tree=shift_3, IncludeEmptyLists=True, IncludeNullItems=True)  # -> simplify(Tree)
merge_2 = Merge(Data1=graft_5, Data2=graft_6)
loft = Loft(Curves=merge_2, Options={Adjust=False, Closed=False, LoftEnds=0, LoftSimp=0, LoftType=0, Rebuild=10, Refit=0.01})
crv = Curve(loft)
area_2 = Area(Geometry=crv)  # -> Area, Centroid
scale = Scale(Geometry=crv, Center=area_2.Centroid, Factor=Slider(0.7, range=0..1))  # -> Geometry, Transform
merge_3 = Merge(Data1=crv, Data2=scale.Geometry)
loft_2 = Loft(Curves=merge_3, Options={Adjust=False, Closed=False, LoftEnds=0, LoftSimp=0, LoftType=0, Rebuild=10, Refit=0.01})
swatch = ColourSwatch(SwatchColor=RGB(255, 255, 255))
pshift_4 = ShiftPaths(Data=loft_2, Offset=-1)
preview = CustomPreview(
    Geometry=loft_2,
    Shader={ambient=RGB(0, 0, 0), diffuse=RGB(255, 105, 180), emission=RGB(76, 32, 54), shine=0.5, specular=RGB(255, 255, 255), transparency=0})
path_mapper = PathMapper(pshift_4, source="{A;B}(i)", target="{A;i}(B)")
tstat = TreeStatistics(Tree=path_mapper)  # -> Paths, Length, Count
dpath = DeconstructPath(Branch=tstat.Paths)
item_3 = ListItem(List=dpath, Index=1, Wrap=True)  # -> simplify(Item)
item_4 = ListItem(List=dpath, Index=0, Wrap=True)  # -> simplify(Item)
flatten_2 = FlattenTree(Tree=item_4, Path="{0}")
flatten_3 = FlattenTree(Tree=item_3, Path="{0}")
dom_2 = ConstructDomain(DomainStart=Slider(0, range=0..1), DomainEnd=Slider(0.19, range=0..1))
bnd_2 = Bounds(Numbers=flatten_2)
bnd_3 = Bounds(Numbers=flatten_3)
remap_3 = RemapNumbers(Value=flatten_2, Source=bnd_2, Target=dom_2)  # -> Mapped, Clipped
remap_4 = RemapNumbers(Value=flatten_3, Source=bnd_3, Target=Domain(0, 1))  # -> Mapped, Clipped
hsl = ColourHSL(Alpha=1, Hue=remap_3.Mapped, Saturation=1, Luminance=reverse(remap_4.Mapped))
brep = Brep(path_mapper)
group_3 = Group(Objects=brep)
flatten_4 = FlattenTree(Tree=group_3, Path="{0}")
preview_2 = CustomPreview(Geometry=flatten_4, Shader=hsl)
