# Grasshopper definition Needle Ball.ghx (Grasshopper 0.9.76)
# plug-ins: Weaverbird, Kangaroo2 Components

pt = ConstructPoint(XCoordinate=0, YCoordinate=0, ZCoordinate=0)
wbicosahedron = WeaverbirdsMeshMeshIcosahedron(Plane=pt, Radius=Slider(10, range=0..10))
mesh = Mesh(wbicosahedron)
wbcatmullclark = WeaverbirdsCatmullClarkSubdivision(MeshCurves=mesh, Level=Slider(1, range=0..1), SmoothNakedEdges=1)
demesh = DeconstructMesh(Mesh=wbcatmullclark)  # -> Vertices, Faces, Colours, Normals
wbcatmullclark_2 = WeaverbirdsCatmullClarkSubdivision(MeshCurves=wbcatmullclark, Level=Slider(3, range=0..10), SmoothNakedEdges=1)
medges = MeshEdges(Mesh=wbcatmullclark_2)  # -> NakedEdges, InteriorEdges, NonManifoldEdges
demesh_2 = DeconstructMesh(Mesh=wbcatmullclark_2)  # -> Vertices, Faces, Colours, Normals
merge = Merge(Data1=medges.NakedEdges, Data2=medges.InteriorEdges)
cp = ClosestPoint(Point=demesh.Vertices, Cloud=demesh_2.Vertices)  # -> ClosestPoint, CPIndex, Distance
vec2pt = Vector2Pt(PointA=demesh_2.Vertices, PointB=pt, Unitize=False)  # -> Vector, Length
len = Length(Curve=merge)
amp = Amplitude(Vector=vec2pt.Vector, Amplitude=Slider(0.3619, range=-1..1))
multiplication = Multiplication(A=len, B=Slider(0.8, range=0..1))
length_line = LengthLine(Line=merge, Length=multiplication, Strength=10)
anchor = Anchor(Point=cp.ClosestPoint, Strength=1000)
show = Show(G=wbcatmullclark_2)
load = Load(Point=demesh_2.Vertices, ForceVector=amp)
merge_2 = Merge(Data1=flatten(show), Data2=flatten(anchor), Data3=flatten(length_line), Data4=flatten(load))
solver = Solver(
    GoalObjects=merge_2,
    Reset=Button(),
    Restart=False,
    Parallel=True,
    Threshold=1e-15,
    Tolerance=0.01,
    AddCurrent=False,
    On=True)  # -> V, O
item = ListItem(List=solver.O, Index=0, Wrap=True)
demesh_3 = DeconstructMesh(Mesh=item)  # -> Vertices, Faces, Colours, Normals
dist = Distance(PointA=pt, PointB=demesh_3.Vertices)
bnd = Bounds(Numbers=dist)
remap = RemapNumbers(Value=dist, Source=bnd, Target=Domain(0, 1))  # -> Mapped, Clipped
gradient = Gradient(
    LowerLimit=0,
    UpperLimit=1,
    Parameter=remap.Mapped,
    stops=[0: RGB(0, 115, 0), 0.25: RGB(81, 175, 17), 0.5: RGB(159, 198, 146), 0.75: RGB(170, 235, 41), 1: RGB(221, 255, 53)])
mcol = MeshColours(Mesh=item, Colours=gradient)
