# Grasshopper definition Simple Tent.ghx (Grasshopper 0.9.76)
# plug-ins: Kangaroo2 Components

number_slider = Slider(100, range=0..100)
number_slider_2 = Slider(30, range=0..100)
rectangle = Rectangle(Plane=PlaneXY(0, 0, 0), XSize=number_slider, YSize=number_slider, Radius=0)  # -> Rectangle, Length
md_slider = MDSlider(
    slider_value=Point(0.4562072754, 0.5922805042, 0.5),
    SliderMode=0,
    x_domain=Domain(0, 1),
    y_domain=Domain(0, 1),
    z_domain=Domain(0, 1))
boundary = BoundarySurfaces(Edges=rectangle.Rectangle)
explode = Explode(Curve=rectangle.Rectangle, Recursive=True)  # -> Segments, Vertices
mplane = MeshPlane(Boundary=rectangle.Rectangle, WidthCount=number_slider_2, HeightCount=number_slider_2)  # -> Mesh, Area
srf = Surface(reparameterize(boundary))
cull_i = CullIndex(List=explode.Vertices, Indices="0", Wrap=True)
genes = GenePool(Decimals=2, Maximum=50, Minimum=0, Value=[20.23333333, 33.01, 26.76, 50, 50])
demesh = DeconstructMesh(Mesh=mplane.Mesh)  # -> Vertices, Faces, Colours, Normals
evalsrf = EvaluateSurface(Surface=srf, Point=md_slider)  # -> Point, Normal, Frame
medges = MeshEdges(Mesh=mplane.Mesh)  # -> NakedEdges, InteriorEdges, NonManifoldEdges
cp = ClosestPoint(Point=evalsrf.Point, Cloud=demesh.Vertices)  # -> flatten(ClosestPoint), CPIndex, Distance
pt = Point(flatten(cull_i))
geo = Geometry(mplane.Mesh)
Z = UnitZ(Factor=genes)
merge = Merge(Data1=medges.NakedEdges, Data2=medges.InteriorEdges, Data3=medges.NonManifoldEdges)
neg = Negative(Value=Slider(0.06, range=0..1))
show = Show(G=geo)
merge_2 = Merge(Data1=pt, Data2=cp.ClosestPoint)
move = Move(Geometry=merge_2, Motion=Z)  # -> Geometry, Transform
Z_2 = UnitZ(Factor=neg)
button = Button()
ln = Line(StartPoint=merge_2, EndPoint=move.Geometry)
length_line = LengthLine(Line=merge, Strength=10)
filter = StreamFilter(Gate=button, Stream0=move.Geometry, Stream1=merge_2)
load = Load(Point=demesh.Vertices, ForceVector=Z_2)
anchor = Anchor(Point=filter, Strength=1000)
pipe = Pipe(Curve=ln, Radius=Slider(1, range=0..10), Caps=0)
preview = CustomPreview(Geometry=pipe, Shader=ColourSwatch(SwatchColor=RGB(240, 70, 70)))
merge_3 = Merge(Data1=flatten(show), Data2=flatten(anchor), Data3=flatten(length_line), Data4=flatten(load))
solver = Solver(
    GoalObjects=merge_3,
    Reset=button,
    Restart=False,
    Parallel=True,
    Threshold=1e-15,
    Tolerance=0.01,
    AddCurrent=False,
    On=True)  # -> V, O
item = ListItem(List=solver.O, Index=0, Wrap=True)
preview_2 = CustomPreview(Geometry=item, Shader=ColourSwatch(SwatchColor=RGBA(107, 235, 255, 200)))
