# Grasshopper definition 2D Gradation.ghx (Grasshopper 0.9.76)
# plug-ins: Owl.Accord.GH, Owl.GH

number_slider = Slider(50, range=0..100)
number_slider_2 = Slider(30, range=0..100)
sqgrid = Square(Plane=PlaneXY(0, 0, 0), Size=1, ExtentX=number_slider, ExtentY=number_slider_2)  # -> Cells, simplify(Points)
max = Maximum(A=number_slider, B=number_slider_2)
flatten = FlattenTree(Tree=sqgrid.Cells, Path="{0}")
bbox = BoundingBox(Content=flatten, Plane=PlaneXY(0, 0, 0), UnionBox=True)  # -> Box, Box_2
debrep = DeconstructBrep(Brep=bbox.Box)  # -> Faces, Edges, Vertices
md_slider = MDSlider(
    slider_value=Point(0.6864072929, 0.6382517398, 0.5),
    SliderMode=0,
    x_domain=Domain(0, 1),
    y_domain=Domain(0, 1),
    z_domain=Domain(0, 1))
md_slider_2 = MDSlider(
    slider_value=Point(0.3990300743, 0.4766987921, 0.5),
    SliderMode=0,
    x_domain=Domain(0, 1),
    y_domain=Domain(0, 1),
    z_domain=Domain(0, 1))
md_slider_3 = MDSlider(
    slider_value=Point(0.07530138331, 0.5620579395, 0.5),
    SliderMode=0,
    x_domain=Domain(0, 1),
    y_domain=Domain(0, 1),
    z_domain=Domain(0, 1))
box_corners = BoxCorners(Box=simplify(graft(flatten)))  # -> CornerA, CornerB, CornerC, CornerD, CornerE, CornerF, CornerG, CornerH
item = ListItem(List=debrep.Faces, Index=0, Wrap=True)
srf = Surface(reparameterize(item))
merge = Merge(Data1=box_corners.CornerA, Data2=box_corners.CornerG)
merge_2 = Merge(Data1=md_slider_2, Data2=md_slider, Data3=md_slider_3)
merge_3 = Merge(
    Data1=ColourSwatch(SwatchColor=RGB(255, 38, 38)),
    Data2=ColourSwatch(SwatchColor=RGB(33, 122, 255)),
    Data3=ColourSwatch(SwatchColor=RGB(134, 235, 33)))
avr = Average(Input=merge)
evalsrf = EvaluateSurface(Surface=srf, Point=merge_2)  # -> Point, Normal, Frame
flatten_2 = FlattenTree(Tree=avr, Path="{0}")
pdecon = Deconstruct(Point=flatten(avr))  # -> XComponent, YComponent, ZComponent
sph = Sphere(Base=evalsrf.Point, Radius=Slider(3, range=0..10))
pdecon_2 = Deconstruct(Point=flatten(evalsrf.Point))  # -> XComponent, YComponent, ZComponent
featurets = FeatureTensorSet(Feature0=pdecon.XComponent, Feature1=pdecon.YComponent)
argb = SplitARGB(Colour=merge_3)  # -> Alpha, Red, Green, Blue
number_slider_3 = Slider(300, range=0..1000)
number_slider_4 = Slider(100000, range=0..100000)
preview = CustomPreview(Geometry=sph, Shader=merge_3)
featurets_2 = FeatureTensorSet(Feature0=argb.Red, Feature1=argb.Green, Feature2=argb.Blue)
featurets_3 = FeatureTensorSet(Feature0=pdecon_2.XComponent, Feature1=pdecon_2.YComponent)
num = Number(max)
remap = RemapTSet(TensorSet=featurets, Source=num, Target=Domain(0, 1))
number_slider_5 = Slider(0.02, range=0..0.1)
remap_2 = RemapTSet(TensorSet=featurets_3, Source=num, Target=Domain(0, 1))
random = Random(Range=number_slider_4, Number=number_slider_3, Seed=Slider(342, range=0..1000))
random_2 = Random(Range=number_slider_4, Number=number_slider_3, Seed=Slider(501, range=0..1000))
noise = AddNoise(TensorSet=featurets_2, Amplitude=number_slider_5, Seed=random_2, Constrain=Domain(0, 1))
noise_2 = AddNoise(TensorSet=remap_2, Amplitude=number_slider_5, Seed=random, Constrain=Domain(0, 1))
panel = Panel("""2
15
3""")
mergets = MergeTSet(TensorSets=noise)
mergets_2 = MergeTSet(TensorSets=noise_2)
network = ConstructNetwork(Layers=panel, Activation=0, Alpha=2, Seed=123)
backprop = Backpropagation(
    ActivationNetwork=network,
    Input=mergets_2,
    Output=mergets,
    LearningRate=0.01,
    Momentum=0.001,
    Epoch=10,
    Iterations=Slider(500, range=0..1000))  # -> ActivationNetwork, Error
compute = Compute(ActivationNetwork=backprop.ActivationNetwork, Input=remap)
detset = DeconstructTensorSet(TensorSet=compute)
detensor = DeconstructTensor(Tensor=detset)  # -> simplify(Values)
flip = FlipMatrix(Data=detensor)  # -> simplify(Data)
bang = ExplodeTree(Data=flip)  # -> Branch0, Branch1, Branch2
merge_4 = Merge(Data1=bang.Branch0, Data2=bang.Branch1, Data3=bang.Branch2)
flip_2 = FlipMatrix(Data=merge_4)  # -> simplify(Data)
ma = MassAddition(Input=flip_2)  # -> Result, PartialResults
bnd = Bounds(Numbers=flatten(ma.Result))
remap_3 = RemapNumbers(Value=flatten(ma.Result), Source=bnd, Target=Slider(10, range=0..10))  # -> Mapped, Clipped
frgb = ColourRGBF(Alpha=1, Red=bang.Branch0, Green=bang.Branch1, Blue=bang.Branch2)
pt = Point(flatten_2)
box = CenterBox(Base=pt, X="0.5", Y="0.5", Z=remap_3.Mapped)
preview_2 = CustomPreview(Geometry=box, Shader=frgb)
