# Grasshopper definition Categorized Stool.ghx (Grasshopper 0.9.76)
# plug-ins: Owl.GH

number_slider = Slider(50, range=0..100)
dom = ConstructDomain(DomainStart=Slider(50, range=0..100), DomainEnd=Slider(200, range=0..1000))
dom_2 = ConstructDomain(DomainStart=Slider(30, range=0..100), DomainEnd=Slider(100, range=0..100))
pt = ConstructPoint(XCoordinate=0, YCoordinate=0, ZCoordinate=0)
random = Random(Range=dom_2, Number=number_slider, Seed=Slider(556, range=0..1000))
random_2 = Random(Range=dom, Number=number_slider, Seed=Slider(245, range=0..1000))
cir = Circle(Plane=pt, Radius=random)
cir_2 = Circle(Plane=pt, Radius=Slider(30, range=0..100))
scale = Scale(Geometry=cir_2, Center=pt, Factor=0.5)  # -> Geometry, Transform
Z = UnitZ(Factor=random_2)
division = Division(A=random_2, B="2")
radius_weight = Slider(0.78, range=0..1)
height_weight = Slider(1, range=0..1)
num = Number(random_2)
num_2 = Number(random)
Z_2 = UnitZ(Factor=division)
featurets = FeatureTensorSet(Feature0=num_2)
move = Move(Geometry=scale.Geometry, Motion=Z_2)  # -> Geometry, Transform
move_2 = Move(Geometry=cir, Motion=Z)  # -> Geometry, Transform
featurets_2 = FeatureTensorSet(Feature0=num)
dup = DuplicateData(Data=cir_2, Number=number_slider, Order=True)
remap = RemapTSet(TensorSet=featurets, Source=dom_2, Target=radius_weight)
remap_2 = RemapTSet(TensorSet=featurets_2, Source=dom, Target=height_weight)
merge = Merge(Data1=simplify(graft(dup)), Data2=simplify(graft(move.Geometry)), Data3=simplify(graft(move_2.Geometry)))
detset = DeconstructTensorSet(TensorSet=remap)
detset_2 = DeconstructTensorSet(TensorSet=remap_2)
loft = Loft(Curves=merge, Options={Adjust=False, Closed=False, LoftEnds=0, LoftSimp=0, LoftType=0, Rebuild=10, Refit=0.01})
detensor = DeconstructTensor(Tensor=detset)
detensor_2 = DeconstructTensor(Tensor=detset_2)
cap = CapHoles(Brep=loft)
merge_2 = Merge(Data1=detensor_2, Data2=detensor)  # -> simplify(Result)
flatten = FlattenTree(Tree=cap, Path="{0}")
datatree_to_tensorset = DataTreeToTensorSet(DataTree=merge_2)  # "DT->TS"
kmeans = KMeansClustering(Data=datatree_to_tensorset, Clusters=Slider(7, range=0..10), Iterations=Slider(1000, range=0..1000), Seed=123)  # -> Clusters, Indices
item = ListItem(List=flatten, Index=kmeans.Indices, Wrap=True)
average = AverageTSet(TensorSet=kmeans.Clusters)
detset_3 = DeconstructTensorSet(TensorSet=average)
number_slider_2 = Slider(200, range=0..200)
detensor_3 = DeconstructTensor(Tensor=detset_3)
ma = MassAddition(Input=detensor_3)  # -> simplify(flatten(Result)), PartialResults
group = Group(Objects=item)  # -> flatten(Group)
txt = Text(height_weight)
txt_2 = Text(radius_weight)
neg = Negative(Value=Slider(157, range=0..300))
sort = SortList(Keys=ma.Result, ValuesA=group)  # -> Keys, ValuesA
ungroup = Ungroup(Group=sort.ValuesA)
tstat = TreeStatistics(Tree=ungroup)  # -> Paths, Length, Count
neg_2 = Negative(Value=Slider(300, range=0..300))
pt_2 = ConstructPoint(XCoordinate=neg, YCoordinate=0, ZCoordinate=0)
concat = Concatenate(FragmentA="[WEIGHT]", FragmentB="Height:", FragmentC=txt, FragmentD="Radius:", FragmentE=txt_2)
lng = ListLength(List=tstat.Paths)
lng_2 = ListLength(List=ungroup)
pt_3 = ConstructPoint(XCoordinate=neg_2, YCoordinate=0, ZCoordinate=0)
swatch = ColourSwatch(SwatchColor=RGB(0, 0, 0))
series = Series(Start="1", Step="1", Count=lng)
series_2 = Series(Start=0, Step=number_slider_2, Count=lng)
series_3 = Series(Start=0, Step=number_slider_2, Count=lng_2)
int = Integer(simplify(graft(series)))
Y = UnitY(Factor=series_2)
tag = TextTag3D(Location=pt_3, Text=concat, Size=Slider(66, range=0..100), Colour=swatch, Justification=9)
graft = GraftTree(Tree=Y, IncludeEmptyLists=True, IncludeNullItems=True)
move_3 = Move(Geometry=pt_2, Motion=graft)  # -> simplify(Geometry), Transform
tag_2 = TextTag3D(Location=move_3.Geometry, Text=int, Size=Slider(100, range=0..100), Colour=swatch, Justification=6)
X = UnitX(Factor=series_3)  # -> simplify(UnitVector)
addition = Addition(A=graft, B=X)
range = Range(Domain=Domain(0, 1), Steps=expr("x-1", lng))  # -> graft(Range)
move_4 = Move(Geometry=ungroup, Motion=addition)  # -> simplify(Geometry), Transform
gradient = Gradient(
    LowerLimit=0,
    UpperLimit=1,
    Parameter=range,
    stops=[0: RGB(234, 38, 0), 0.25: RGB(234, 126, 0), 0.5: RGB(254, 244, 84), 0.75: RGB(173, 203, 249), 1: RGB(75, 107, 169)])
preview = CustomPreview(Geometry=move_4.Geometry, Shader=gradient)
