# Grasshopper definition Falling Flowers.ghx (Grasshopper 1.0.4)

number_slider = Slider(7, range=0..10)
pt = ConstructPoint(XCoordinate=0, YCoordinate=0, ZCoordinate=0)
series = Series(Start=Slider(3, range=0..10), Step=1, Count=Slider(5, range=0..10))
polygon = Polygon(Plane=pt, Radius=Slider(100, range=0..100), Segments=series, FilletRadius=0)  # -> Polygon, Length
explode = Explode(Curve=polygon.Polygon, Recursive=True)  # -> simplify(graft(Segments)), Vertices
pt_2 = Point(explode.Vertices)
eval = EvaluateLength(Curve=explode.Segments, Length="0.5", Normalized=True)  # -> Point, Tangent, Parameter
end = EndPoints(Curve=explode.Segments)  # -> Start, End
cull_i = CullIndex(List=reverse(pt_2), Indices=0, Wrap=True)  # -> reverse(List)
ln = Line(StartPoint=pt, EndPoint=eval.Point)
eval_2 = EvaluateLength(Curve=ln, Length=Slider(0.51, range=0..1), Normalized=True)  # -> Point, Tangent, Parameter
merge = Merge(Data1=end.Start, Data2=end.End)
ln_2 = Line(StartPoint=pt, EndPoint=cull_i)
crv = Curve(reparameterize(ln_2))
ln_3 = Line(StartPoint=eval_2.Point, EndPoint=merge)
ln_4 = Line(StartPoint=pt, EndPoint=eval_2.Point)
item = ListItem(List=ln_3, Index=0, Wrap=True)
item_2 = ListItem(List=ln_3, Index=1, Wrap=True)
pshift = ShiftPaths(Data=ln_4, Offset=-1)
pshift_2 = ShiftPaths(Data=item_2, Offset=-1)
shift = ShiftList(List=pshift, Shift=-1, Wrap=True)
divide = DivideCurve(Curve=crv, Count=10, Kinks=False)  # -> Points, Tangents, reverse(simplify(Parameters))
shift_2 = ShiftList(List=pshift_2, Shift=-1, Wrap=True)
graft = GraftTree(Tree=pshift, IncludeEmptyLists=True, IncludeNullItems=True)  # -> simplify(Tree)
graft_2 = GraftTree(Tree=shift, IncludeEmptyLists=True, IncludeNullItems=True)  # -> simplify(Tree)
graft_3 = GraftTree(Tree=item, IncludeEmptyLists=True, IncludeNullItems=True)  # -> simplify(Tree)
graft_4 = GraftTree(Tree=shift_2, IncludeEmptyLists=True, IncludeNullItems=True)  # -> simplify(Tree)
graph = GraphMapper(
    divide.Parameters,
    x0=0,
    x1=1,
    y0=0,
    y1=1,
    container_name="Bezier",
    cpx=[0, 0, 0.4736230969, 1],
    cpy=[0, 0.5579710007, 1, 0.3771015406])
merge_2 = Merge(Data1=graft, Data2=graft_2)
merge_3 = Merge(Data1=graft_3, Data2=graft_4)
vec = Vector(merge_3)
item_3 = ListItem(List=vec, Index=0, Wrap=True)
item_4 = ListItem(List=vec, Index=1, Wrap=True)
neg = Negative(Value=item_4)
divide_2 = DivideCurve(Curve=reparameterize(merge_3), Count=10, Kinks=False)  # -> Points, Tangents, Parameters
multiplication = Multiplication(A=graph, B=Slider(40.7, range=0..100))
merge_4 = Merge(Data1=item_3, Data2=neg)
Z = UnitZ(Factor=multiplication)
Z_2 = UnitZ(Factor=1)
graft_5 = GraftTree(Tree=merge_4, IncludeEmptyLists=True, IncludeNullItems=True)  # -> simplify(Tree)
graph_2 = GraphMapper(
    divide_2.Parameters,
    x0=0,
    x1=1,
    y0=0,
    y1=1,
    container_name="Bezier",
    cpx=[0, 0.2752473354, 0.6685224771, 1],
    cpy=[0, 0.4934493303, 0.7420290709, 0])
vrot = Rotate(Vector=graft_5, Axis=Z_2, Angle="Rad(90)")
move = Move(Geometry=divide.Points, Motion=Z)  # -> simplify(Geometry), Transform
multiplication_2 = Multiplication(A=graph_2, B=Slider(27.07, range=0..100))
crv_2 = Curve(reparameterize(merge_2))
amp = Amplitude(Vector=vrot, Amplitude=multiplication_2)
number_slider_2 = Slider(100, range=0..100)
nurbs = NurbsCurve(Vertices=move.Geometry, Degree=3, Periodic=False)  # -> Curve, Length, Domain
join = JoinCurves(Curves=crv_2, Preserve=False)
move_2 = Move(Geometry=divide_2.Points, Motion=amp)  # -> Geometry, Transform
nurbs_2 = NurbsCurve(Vertices=move_2.Geometry, Degree=3, Periodic=False)  # -> Curve, Length, Domain
crv_3 = Curve(nurbs_2.Curve)
ext = ExtendCurve(Curve=join, Type=0, Start=number_slider_2, End=number_slider_2)
pshift_3 = ShiftPaths(Data=crv_3, Offset=-1)
Z_3 = UnitZ(Factor=Slider(1000, range=0..1000))
extr = Extrude(Base=ext, Direction=Z_3)  # -> simplify(Extrusion)
weave = Weave(Pattern=[0, 1], Stream0=pshift_3, Stream1=nurbs.Curve, NullGaps=False)
division = Division(A=Z_3, B=-2)
loft = Loft(Curves=weave, Options={Adjust=False, Closed=False, LoftEnds=0, LoftSimp=0, LoftType=0, Rebuild=10, Refit=0.01})
move_3 = Move(Geometry=extr, Motion=division)  # -> Geometry, Transform
bbx = BrepBrep(BrepA=loft, BrepB=move_3.Geometry)  # -> Curves, Points
srfsplit = SurfaceSplit(Surface=loft, Curves=bbx.Curves)
bbox = BoundingBox(Content=srfsplit, Plane=PlaneXY(0, 0, 0))  # -> Box, Box_2
area = Area(Geometry=bbox.Box)  # -> Area, Centroid
number_slider_3 = Slider(1713, range=0..10000)
sort = SortList(Keys=area.Area, ValuesA=srfsplit)  # -> Keys, reverse(ValuesA)
item_5 = ListItem(List=sort.ValuesA, Index=0, Wrap=True)  # -> simplify(Item)
rectangle = Rectangle(Plane=PlaneXY(0, 0, 0), XSize=number_slider_3, YSize=number_slider_3, Radius=0)  # -> Rectangle, Length
pshift_4 = ShiftPaths(Data=item_5, Offset=-1)
pop2d = Populate2D(Region=rectangle.Rectangle, Count=Slider(100, range=0..1000), Seed=1)
number_slider_4 = Slider(345, range=0..1000)
join_2 = BrepJoin(Breps=pshift_4)  # -> flatten(Breps), Closed
lng = ListLength(List=join_2.Breps)
subtraction = Subtraction(A=lng, B=1)
lng_2 = ListLength(List=pop2d)
random = Random(Range=subtraction, Number=lng_2, Seed=number_slider_4, Integers=True)
pi = Pi(Factor=2)
item_6 = ListItem(List=join_2.Breps, Index=random, Wrap=True)
random_2 = Random(Range=pi, Number=lng_2, Seed=number_slider_4)
rotate = Rotate(Geometry=item_6, Angle=random_2, Plane=PlaneXY(0, 0, 0))  # -> Geometry, Transform
dom = ConstructDomain(DomainStart=Slider(0.5, range=0..1), DomainEnd=Slider(1, range=0..1))
random_3 = Random(Range=dom, Number=lng_2, Seed=number_slider_4)
scale = Scale(Geometry=rotate.Geometry, Center=Point(0, 0, 0), Factor=random_3)  # -> Geometry, Transform
random_4 = Random(Range=Domain(0, 1), Number=lng_2, Seed=number_slider_4)
gradient = Gradient(LowerLimit=0, UpperLimit=1, Parameter=random_4, stops=[0.0119: RGB(255, 235, 239), 1: RGB(252, 124, 147)])
move_4 = Move(Geometry=scale.Geometry, Motion=pop2d)  # -> Geometry, Transform
preview = CustomPreview(Geometry=move_4.Geometry, Shader=gradient)
