# Grasshopper definition Fake Shadow.ghx (Grasshopper 0.9.76)

number_slider = Slider(60, range=0..100)
number_slider_2 = Slider(150, range=0..200)
number_slider_3 = Slider(7, range=0..10)
number_slider_4 = Slider(36, range=0..100)
rectangle = Rectangle(Plane=PlaneXY(0, 0, 0), XSize=number_slider, YSize=number_slider, Radius=0)  # -> Rectangle, Length
dom = ConstructDomain(DomainStart=Slider(29, range=0..100), DomainEnd=Slider(0, range=0..100))
dom_2 = ConstructDomain(DomainStart=Slider(10, range=0..10), DomainEnd=Slider(27.4, range=0..100))
number_slider_5 = Slider(50, range=0..100)
pop2d = Populate2D(Region=rectangle.Rectangle, Count=number_slider_3, Seed=1)
area = Area(Geometry=rectangle.Rectangle)  # -> Area, Centroid
random = Random(Range=dom_2, Number=number_slider_3, Seed=number_slider_4)
mplane = MeshPlane(Boundary=rectangle.Rectangle, WidthCount=number_slider_2, HeightCount=number_slider_2)  # -> Mesh, Area
random_2 = Random(Range=dom, Number=number_slider_3, Seed=number_slider_4)
msphere = MeshSphere(Base=PlaneXY(0, 0, 0), Radius=random, UCount=number_slider_5, VCount=number_slider_5)
Z = UnitZ(Factor=random_2)
move = Move(Geometry=msphere, Motion=pop2d)  # -> Geometry, Transform
move_2 = Move(Geometry=move.Geometry, Motion=Z)  # -> Geometry, Transform
scale = Scale(Geometry=mplane.Mesh, Center=area.Centroid, Factor=Slider(3, range=0..10))  # -> Geometry, Transform
merge = Merge(Data1=flatten(scale.Geometry), Data2=flatten(move_2.Geometry))
mjoin = MeshJoin(Meshes=merge)
bbox = BoundingBox(Content=mjoin, Plane=PlaneXY(0, 0, 0))  # -> Box, Box_2
vec = VectorXYZ(XComponent=Slider(1, range=-1..1), YComponent=Slider(1, range=-1..1), ZComponent=Slider(-0.01, range=-1..1))  # -> Vector, Length
vec_2 = VectorXYZ(XComponent=Slider(-0.81, range=-1..1), YComponent=Slider(-1, range=-1..1), ZComponent=Slider(-0.65, range=-1..1))  # -> Vector, Length
box_corners = BoxCorners(Box=bbox.Box)  # -> CornerA, CornerB, CornerC, CornerD, CornerE, CornerF, CornerG, CornerH
Z_2 = UnitZ(Factor=1)
toggle = BooleanToggle(True)
amp = Amplitude(Vector=vec_2.Vector, Amplitude=Slider(29.2, range=0..100))
neg = Negative(Value=Z_2)
pt = Point(box_corners.CornerG)
vdis = VectorDisplay(Anchor=pt, Vector=amp)
unit = UnitVector(Vector=vec_2.Vector)
unit_2 = UnitVector(Vector=vec.Vector)
exposure = Exposure(Shape=scale.Geometry, Obstructions=merge, Rays=neg, Lambert=toggle)  # -> Exposure, Range
exposure_2 = Exposure(Shape=merge, Obstructions=merge, Rays=unit, Lambert=toggle)  # -> Exposure, Range
demesh = DeconstructMesh(Mesh=merge)  # -> Vertices, Faces, Colours, Normals
gradient = Gradient(LowerLimit=0, UpperLimit=1, Parameter=exposure.Exposure, stops=[0: RGB(0, 0, 0), 1: RGB(255, 255, 255)])
gradient_2 = Gradient(LowerLimit=0, UpperLimit=1, Parameter=exposure_2.Exposure, stops=[0: RGB(0, 0, 0), 1: RGB(255, 255, 255)])
dprod = DotProduct(VectorA=unit_2, VectorB=demesh.Normals, Unitize=False)
dprod_2 = DotProduct(VectorA=unit, VectorB=demesh.Normals, Unitize=False)
graft = GraftTree(Tree=merge, IncludeEmptyLists=True, IncludeNullItems=True)
neg_2 = Negative(Value="1")
multiplication = Multiplication(A=dprod, B=Slider(0.64, range=0..1))
multiplication_2 = Multiplication(A=dprod_2, B=Slider(0.87, range=0..1))
dom_3 = ConstructDomain(DomainStart=neg_2, DomainEnd="1")
addition = Addition(A=multiplication, B=multiplication_2)
number_slider_6 = Slider(3, range=0..10)
mcol = MeshColours(Mesh=scale.Geometry, Colours=gradient)
mcol_2 = MeshColours(Mesh=graft, Colours=gradient_2)
bnd = Bounds(Numbers=addition)
mblur = BlurMesh(Mesh=mcol_2, Iterations=number_slider_6)  # -> simplify(Mesh)
remap = RemapNumbers(Value=addition, Source=bnd, Target=Domain(0, 1))  # -> Mapped, Clipped
mblur_2 = BlurMesh(Mesh=mcol, Iterations=number_slider_6)
demesh_2 = DeconstructMesh(Mesh=mblur)  # -> Vertices, Faces, Colours, Normals
demesh_3 = DeconstructMesh(Mesh=mblur_2)  # -> Vertices, Faces, Colours, Normals
argb = SplitARGB(Colour=demesh_2.Colours)  # -> Alpha, simplify(Red), Green, Blue
argb_2 = SplitARGB(Colour=demesh_3.Colours)  # -> Alpha, simplify(Red), Green, Blue
num = Number(argb.Red)
subtraction = Subtraction(A="1", B=argb_2.Red)
subtraction_2 = Subtraction(A="1", B=num)
tstat = TreeStatistics(Tree=subtraction_2)  # -> Paths, Length, Count
item = ListItem(List=tstat.Paths, Index=0, Wrap=True)
multiplication_3 = Multiplication(A=subtraction, B=Slider(0.71, range=0..1))
split = SplitTree(Data=subtraction_2, Masks=flatten(item))  # -> Positive, Negative
addition_2 = Addition(A=split.Positive, B=multiplication_3)
flatten = FlattenTree(Tree=addition_2, Path="{0}")
merge_2 = Merge(Data1=flatten, Data2=split.Negative)
multiplication_4 = Multiplication(A=merge_2, B=Slider(0.33, range=0..1))
addition_3 = Addition(A=remap.Mapped, B=multiplication_4)
bnd_2 = Bounds(Numbers=flatten(addition_3))
remap_2 = RemapNumbers(Value=addition_3, Source=bnd_2, Target=Domain(0, 1))  # -> Mapped, Clipped
gradient_3 = Gradient(LowerLimit=0, UpperLimit=1, Parameter=remap_2.Mapped, stops=[0: RGB(255, 255, 255), 1: RGB(0, 0, 0)])
mcol_3 = MeshColours(Mesh=graft, Colours=gradient_3)
