# Grasshopper definition Superformula Tower.ghx (Grasshopper 0.9.76)
# plug-ins: MeshEdit Components

number_of_points = Slider(500, range=0..1000)
n2 = Slider(4, range=0.1..20)
m1 = Slider(1, range=0..10)
a = Slider(3, range=0..10)
n1 = Slider(1, range=0.1..10)
number_slider = Slider(49, range=0..100)
pi = Pi(Factor="2")
series = Series(Start=n2, Step=Slider(1, range=0..1), Count=number_slider)
series_2 = Series(Start=n1, Step=Slider(0.4, range=0..1), Count=number_slider)
division = Division(A=pi, B=number_of_points)
series_3 = Series(Start=m1, Step=Slider(0.16, range=0..1), Count=number_slider)
graft = GraftTree(Tree=series, IncludeEmptyLists=True, IncludeNullItems=True)
graft_2 = GraftTree(Tree=series_3, IncludeEmptyLists=True, IncludeNullItems=True)
graft_3 = GraftTree(Tree=series_2, IncludeEmptyLists=True, IncludeNullItems=True)
series_4 = Series(Start=0, Step=division, Count=number_of_points)
division_2 = Division(A="1", B=graft_3)
num = Number(graft)
neg = Negative(Value=division_2)
multiplication = Multiplication(A=series_4, B=graft_2)
multiplication_2 = Multiplication(A=series_4, B=graft_2)
division_3 = Division(A=multiplication, B="4")
division_4 = Division(A=multiplication_2, B="4")
sin = Sine(Value=division_4)
cos = Cosine(Value=division_3)
division_5 = Division(A=cos, B=a)
division_6 = Division(A=sin, B=a)
abs = Absolute(Value=division_5)
abs_2 = Absolute(Value=division_6)
pow = Power(A=abs_2, B=num)
pow_2 = Power(A=abs, B=num)
addition = Addition(A=pow_2, B=pow)
pow_3 = Power(A=addition, B=neg)  # -> simplify(Result)
sin_2 = Sine(Value=series_4)
cos_2 = Cosine(Value=series_4)
multiplication_3 = Multiplication(A=pow_3, B=cos_2)
multiplication_4 = Multiplication(A=pow_3, B=sin_2)
number_slider_2 = Slider(1, range=0..1)
pt = ConstructPoint(XCoordinate=multiplication_3, YCoordinate=multiplication_4, ZCoordinate=0)
tstat = TreeStatistics(Tree=pt)  # -> Paths, Length, Count
lng = ListLength(List=pt)
lng_2 = ListLength(List=tstat.Paths)
series_5 = Series(Start=0, Step=number_slider_2, Count=lng)
pow_4 = Power()
series_6 = Series(Start=0, Step=number_slider_2, Count=lng_2)  # -> graft(Series)
pt_2 = Point(pt)
multiplication_5 = Multiplication(A=series_6, B=series_5)
sqrt = SquareRoot(Value=multiplication_5)
Z = UnitZ(Factor=sqrt)  # -> simplify(UnitVector)
move = Move(Geometry=pt_2, Motion=Z)  # -> Geometry, Transform
nurbs = NurbsCurve(Vertices=move.Geometry, Degree=3, Periodic=False)  # -> flatten(Curve), Length, Domain
number_slider_3 = Slider(500, range=0..1000)
loft = Loft(Curves=nurbs.Curve, Options={Adjust=False, Closed=False, LoftEnds=0, LoftSimp=0, LoftType=0, Rebuild=10, Refit=0.01})
Z_2 = UnitZ(Factor=1)
X = UnitX(Factor=1)
preview = CustomPreview(
    Geometry=loft,
    Shader={ambient=RGB(0, 0, 0), diffuse=RGB(255, 105, 180), emission=RGB(76, 32, 54), shine=0.5, specular=RGB(255, 255, 255), transparency=0})
sdivide = DivideSurface(Surface=loft, UCount=number_slider_3, VCount=number_slider_3)  # -> Points, Normals, Parameters
neg_2 = Negative(Value=X)
addition_2 = Addition(A=number_slider_3, B=1)
dprod = DotProduct(VectorA=Z_2, VectorB=sdivide.Normals, Unitize=False)  # -> flatten(DotProduct)
dprod_2 = DotProduct(VectorA=neg_2, VectorB=sdivide.Normals, Unitize=False)  # -> flatten(DotProduct)
addition_3 = Addition(A=dprod_2, B=dprod)
bnd = Bounds(Numbers=addition_3)
remap = RemapNumbers(Value=addition_3, Source=bnd, Target=Domain(0, 1))  # -> Mapped, Clipped
gradient = Gradient(LowerLimit=0, UpperLimit=1, Parameter=remap.Mapped, stops=[0: RGB(255, 251, 130), 1: RGB(196, 101, 0)])
frompoints = MeshFromPoints(Points=flatten(sdivide.Points), UDirection=addition_2, VDirection=addition_2, Colour=gradient)
