# Grasshopper definition Hatched Screw.ghx (Grasshopper 0.9.76)
# plug-ins: MeshEdit Components

pt = ConstructPoint(XCoordinate=0, YCoordinate=0, ZCoordinate=0)
polygon = Polygon(Plane=pt, Radius=Slider(100, range=0..100), Segments=6, FilletRadius=0)  # -> Polygon, Length
explode = Explode(Curve=polygon.Polygon, Recursive=True)  # -> Segments, Vertices
eval = EvaluateLength(Curve=explode.Segments, Length="0.5", Normalized=True)  # -> Point, Tangent, Parameter
scale = Scale(Geometry=eval.Point, Center=pt, Factor=Slider(0.55, range=0..1))  # -> Geometry, Transform
weave = Weave(Pattern=[0, 1], Stream0=explode.Vertices, Stream1=scale.Geometry, NullGaps=False)
pline = PolyLine(Vertices=weave, Closed=False)
number_slider = Slider(10, range=0..10)
fillet = FilletDistance(Curve=pline, Distance=Slider(25.9, range=0..100))
pi = Pi(Factor=Slider(1.3, range=0..4))
range = Range(Domain=Domain(0, 1), Steps=number_slider)
range_2 = Range(Domain=pi, Steps=number_slider)
range_3 = Range(Domain=Slider(150, range=0..1000), Steps=number_slider)
reb = RebuildCurve(Curve=fillet, Degree="3", Count=Slider(100, range=0..100), Tangents=False)
graph = GraphMapper(
    range,
    x0=0,
    x1=1,
    y0=0,
    y1=1,
    container_name="Bezier",
    cpx=[0, 0.1775095612, 0.8658736944, 1],
    cpy=[0.3799999952, 0.975700736, 0.8807211518, 0.09476405382])
Z = UnitZ(Factor=range_3)
move = Move(Geometry=reb, Motion=Z)  # -> Geometry, Transform
area = Area(Geometry=move.Geometry)  # -> Area, Centroid
scale_2 = Scale(Geometry=move.Geometry, Center=area.Centroid, Factor=graph)  # -> Geometry, Transform
rotate = Rotate(Geometry=scale_2.Geometry, Angle=range_2, Plane=area.Centroid)  # -> Geometry, Transform
loft = Loft(Curves=rotate.Geometry, Options={Adjust=False, Closed=False, LoftEnds=0, LoftSimp=0, LoftType=0, Rebuild=10, Refit=0.01})
num = Number(Slider(25, range=0..100))
num_2 = Number(Slider(500, range=0..500))
Z_2 = UnitZ(Factor=1)
neg = Negative(Value=Z_2)
sdivide = DivideSurface(Surface=loft, UCount=num, VCount=num_2)  # -> simplify(Points), Normals, Parameters
dprod = DotProduct(VectorA=sdivide.Normals, VectorB=neg, Unitize=False)  # -> simplify(DotProduct)
flatten = FlattenTree(Tree=dprod, Path="{0}")
bnd = Bounds(Numbers=flatten)
remap = RemapNumbers(Value=dprod, Source=bnd, Target=Domain(0, 1))  # -> Mapped, Clipped
flatten_2 = FlattenTree(Tree=remap.Mapped, Path="{0}")
sqrt = SquareRoot(Value=flatten_2)
gradient = Gradient(LowerLimit=0, UpperLimit=1, Parameter=sqrt, stops=[0: RGB(0, 0, 0), 0.811: RGB(140, 140, 140), 1: RGB(255, 255, 255)])
argb = SplitARGB(Colour=gradient)  # -> Alpha, Red, Green, Blue
unflatten = UnflattenTree(Tree=argb.Red, Guide=remap.Mapped)

num_3 = Number(unflatten)
max = Maximum(A=num_3, B=Slider(0, range=0..1))
consec = ConsecutiveDomains(Numbers=max, Additive=True)
dedomain = DeconstructDomain(Domain=consec)  # -> Start, simplify(End)
item = ListItem(List=max, Index=0, Wrap=True)  # -> simplify(Item)
merge = Merge(Data1=item, Data2=dedomain.End)
bnd_2 = Bounds(Numbers=merge)
intcrv = Interpolate(Vertices=sdivide.Points, Degree=3, Periodic=False, KnotStyle=1)  # -> reparameterize(simplify(Curve)), Length, Domain
remap_2 = RemapNumbers(Value=merge, Source=bnd_2, Target=Domain(0, 1))  # -> Mapped, Clipped
eval_2 = EvaluateCurve(Curve=intcrv.Curve, Parameter=remap_2.Mapped)  # -> Point, Tangent, Angle
flip = FlipMatrix(Data=eval_2.Point)
intcrv_2 = Interpolate(Vertices=flip, Degree=3, Periodic=False, KnotStyle=1)  # -> Curve, Length, Domain
preview = CustomPreview(Geometry=intcrv_2.Curve, Shader=ColourSwatch(SwatchColor=RGB(0, 0, 0)))

addition = Addition(A=num, B=1)
flatten_3 = FlattenTree(Tree=sdivide.Points, Path="{0}")
addition_2 = Addition(A=num_2, B=1)
frompoints = MeshFromPoints(Points=flatten_3, UDirection=addition, VDirection=addition_2, Colour=ColourSwatch(SwatchColor=RGB(255, 255, 255)))
frompoints_2 = MeshFromPoints(Points=flatten_3, UDirection=addition, VDirection=addition_2, Colour=gradient)
