# Grasshopper definition Summer Firework.ghx (Grasshopper 0.9.76)
# plug-ins: Python Interpreter

number_slider = Slider(3, range=0..10)
number_slider_2 = Slider(2, range=0..10)
timer = Timer(TimerInterval=100, Target=python_2)  # disabled
sph = Sphere(Base=PlaneXY(0, 0, 0), Radius=number_slider_2)
Z = UnitZ(Factor=number_slider)
srf = Surface(reparameterize(sph))
popgeo = PopulateGeometry(Geometry=sph, Count=Slider(500, range=0..1000), Seed=1)
srf_cp = SurfaceClosestPoint(Point=popgeo, Surface=srf)  # -> Point, UVPoint, Distance
evalsrf = EvaluateSurface(Surface=srf, Point=srf_cp.UVPoint)  # -> Point, Normal, Frame
python = PythonScript(h=Slider(100, range=0..100), r=number_slider_2, v=number_slider, g=Slider(0.02, range=0..1), pls=evalsrf.Frame)  # -> out, firework; inputs pls: list of Plane
# ---------- python: Python ----------
import rhinoscriptsyntax as rs
import Rhino.Geometry as geo
import math
import random
import time
import copy

class FireWork:
    def __init__(self, hei, rad, vel,grav, pls):
        self.height = hei
        self.radius = rad
        self.vel = vel
        self.gravity = geo.Vector3d(0,0,-grav)
        self.initialPlanes = pls
        
        self.pos = geo.Point3d(0,0,0)
        self.positions = []
        self.positions.append(self.pos)
        self.iteration = 0
        self.exploding = False
        self.planes = list(self.initialPlanes)
        self.planeSequences = []
        #self.planeSequences.append(self.planes)
        
    def reset(self):
        self.pos = geo.Point3d(0,0,0)
        self.positions = []
        self.positions.append(self.pos)
        self.iteration = 0
        self.exploding = False
        self.planes = list(self.initialPlanes)
        self.planeSequences = []
        #self.planeSequences.append(self.planes)

    
    def update(self):
        if self.pos[2] > self.height:
            self.exploding = True
        else:
            scale = 0.2
            random.seed(self.iteration)
            x = -scale * self.radius + random.random() * self.radius * scale * 2
            random.seed(self.iteration + 10)
            y = -scale * self.radius + random.random() * self.radius * scale * 2
            
            self.pos = self.pos + geo.Vector3d(x,y,0) + geo.Vector3d(0,0,self.vel)
            
            newPlanes = []
            for i in range(len(self.planes)):
                plane = self.planes[i]
                newPlane = geo.Plane(plane)
                newPlane.Translate(geo.Vector3d(x,y,0) + geo.Vector3d(0,0,self.vel))
                newPlanes.append(newPlane)
            self.planes = newPlanes
            
            
        
        if self.exploding == False:
            self.positions.append(self.pos)
        else:
            newPls = []
            for i in range(len(self.planes)):
                plane = self.planes[i]
                newPos = plane.Origin + plane.ZAxis * self.vel * 0.5
                newNormal = plane.ZAxis + self.gravity
                
                newPl = geo.Plane(newPos,newNormal)
                newPls.append(newPl)
                
            self.planeSequences.append(newPls)
            self.planes = newPls
            
    def drawBall(self):
        geos = []
        if self.exploding == False:
            geo = rs.AddSphere(self.pos, self.radius)
            geos.append(geo)
        return geos
        
    def drawLines(self):
        geos = []
        
        if len(self.positions) > 1:
            geo = rs.AddPolyline(self.positions)
            geos.append(geo)
            
        if self.exploding:
            newPointSequences = []
            for i in range(len(self.planeSequences)):
                planes = self.planeSequences[i]
                newPts = []
                for n in range(len(planes)):
                    plane = planes[n]
                    pt = plane.Origin
                    newPts.append(pt)
                newPointSequences.append(newPts)
                
            forPolys = zip(*newPointSequences)
            
            if(len(forPolys) > 0 and len(forPolys[0]) > 1):
                for i in range(len(forPolys)):
                    pts = forPolys[i]
                    geo = rs.AddPolyline(pts)
                    geos.append(geo)
                
        
        self.iteration += 1
        return geos


firework = FireWork(h,r,v,g,pls)
# ---------- end python ----------
python_2 = PythonScript(firework=python.firework, reset=Button())  # -> out, a, b; inputs reset: Int32
# ---------- python_2: Python ----------
import rhinoscriptsyntax as rs



if reset:
    firework.reset()
else:
    firework.update()
    a = firework.drawLines()
    b = firework.drawBall()
# ---------- end python_2 ----------
crv = Curve(python_2.a)
explode = Explode(Curve=crv, Recursive=True)  # -> Segments, Vertices
preview = CustomPreview(Geometry=python_2.b, Shader=ColourSwatch(SwatchColor=RGB(97, 15, 15)))
lng = ListLength(List=explode.Segments)
series = Series(Start=0, Step=1, Count=lng)
bnd = Bounds(Numbers=series)
remap = RemapNumbers(Value=series, Source=bnd, Target=Domain(0, 1))  # -> Mapped, Clipped
gradient = Gradient(
    LowerLimit=0,
    UpperLimit=1,
    Parameter=remap.Mapped,
    stops=[0.00855: RGB(255, 255, 255), 0.733: RGB(255, 115, 201), 1: RGB(55, 0, 255)])
preview_2 = CustomPreview(Geometry=explode.Segments, Shader=gradient)
