# Grasshopper definition Round Slices.ghx (Grasshopper 0.9.76)
# plug-ins: Anemone

number_slider = Slider(100, range=0..100)
sph = Sphere(Base=PlaneXY(0, 0, 0), Radius=number_slider)
division = Division(A=number_slider, B=Slider(1, range=0..10))
Z = UnitZ(Factor=Slider(15, range=0..50))
area = Area(Geometry=sph)  # -> Area, Centroid

fastloopstart = FastLoopStart(I=Slider(100, range=0..100), D0=sph, D1=sph, D3=area.Centroid)  # -> port, Counter, Data, Data_2, Data_3, Data_4
move = Move(Geometry=fastloopstart.Data, Motion=Z)  # -> Geometry, Transform
sint = SolidIntersection(BrepsA=fastloopstart.Data_2, BrepsB=move.Geometry)
sdiff = SolidDifference(BrepsA=fastloopstart.Data_2, BrepsB=move.Geometry)
lng = ListLength(List=sint)
area_2 = Area(Geometry=move.Geometry)  # -> Area, Centroid
equals = Equality(FirstNumber=lng, SecondNumber=0)  # -> Equality, Inequality
fastloopend = FastLoopEnd(
    port=fastloopstart.port,
    Exit=equals.Equality,
    Data=move.Geometry,
    Data_2=sint,
    Data_3=sdiff,
    Data_4=area_2.Centroid,
    RecordData=True,
    TimeOutVal=0)  # -> D0, D1, D2, D3

flatten = FlattenTree(Tree=fastloopend.D3, Path="{0}")
geo = Geometry(fastloopend.D2)
merge = Merge(Data1=flatten(area.Centroid), Data2=flatten)
flatten_2 = FlattenTree(Tree=geo, Path="{0}")
xz = XZPlane(Origin=merge)
cull_i = CullIndex(List=reverse(xz), Indices=0, Wrap=True)  # -> reverse(List)
lng_2 = ListLength(List=cull_i)
series = Series(Start=0, Step=Slider(0, range=0..100), Count=lng_2)
rad = Radians(Degrees=series)
rotate = Rotate(Geometry=flatten_2, Angle=rad, Plane=cull_i)  # -> Geometry, Transform
lng_3 = ListLength(List=rotate.Geometry)  # -> expr("x-1", Length)

fastloopstart_2 = FastLoopStart(I=lng_3, D0=rotate.Geometry, D1=cull_i)  # -> port, Counter, Data, Data_2
multiplication = Multiplication(A=fastloopstart_2.Counter, B=Slider(1.5, range=0..10))
item = ListItem(List=fastloopstart_2.Data_2, Index=fastloopstart_2.Counter, Wrap=True)
split = SplitList(List=fastloopstart_2.Data, Index=fastloopstart_2.Counter)  # -> ListA, ListB
rad_2 = Radians(Degrees=multiplication)
split_2 = SplitList(List=fastloopstart_2.Data_2, Index=fastloopstart_2.Counter)  # -> ListA, ListB
rotate_2 = Rotate(Geometry=split_2.ListB, Angle=rad_2, Plane=item)  # -> Geometry, Transform
rotate_3 = Rotate(Geometry=split.ListB, Angle=rad_2, Plane=item)  # -> Geometry, Transform
merge_2 = Merge(Data1=split.ListA, Data2=rotate_3.Geometry)

multiplication_2 = Multiplication(A=fastloopstart_2.Counter, B=Slider(1, range=-5..5))
rad_3 = Radians(Degrees=multiplication_2)
yz = YZPlane(Origin=rotate_2.Geometry)
xy = XYPlane(Origin=rotate_2.Geometry)
rotate_4 = Rotate(Geometry=rotate_2.Geometry, Angle=rad_3, Plane=yz)  # -> Geometry, Transform

merge_3 = Merge(Data1=split_2.ListA, Data2=rotate_4.Geometry)
fastloopend_2 = FastLoopEnd(port=fastloopstart_2.port, Exit=False, Data=merge_2, Data_2=merge_3, RecordData=False, TimeOutVal=0)  # -> D0, D1

lng_4 = ListLength(List=fastloopend_2.D0)  # -> expr("x-1", Length)
range = Range(Domain=Domain(0, 1), Steps=lng_4)
gradient = Gradient(LowerLimit=0, UpperLimit=1, Parameter=range, stops=[0: RGB(41, 144, 255), 1: RGB(212, 222, 255)])
preview = CustomPreview(Geometry=fastloopend_2.D0, Shader=gradient)
