# Grasshopper definition Candy Wall.ghx (Grasshopper 0.9.76)
# plug-ins: Weaverbird

cir = Circle(Plane=PlaneXY(0, 0, 0), Radius=Slider(46.7, range=0..100))
pipe = Pipe(Curve=cir, Radius=Slider(45.2, range=0..100), Caps=0)
srf = Surface(reparameterize(pipe))
sdivide = DivideSurface(Surface=srf, UCount=Slider(8, range=0..10), VCount=Slider(8, range=0..10))  # -> simplify(Points), Normals, Parameters
pline = PolyLine(Vertices=sdivide.Points, Closed=True)
flip = FlipMatrix(Data=sdivide.Points)
flatten = FlattenTree(Tree=pline, Path="{0}")
cull_i = CullIndex(List=reverse(flatten), Indices=0, Wrap=True)  # -> reverse(List)
loft = Loft(Curves=cull_i, Options={Adjust=False, Closed=True, LoftEnds=0, LoftSimp=0, LoftType=3, Rebuild=10, Refit=0.01})
debrep = DeconstructBrep(Brep=loft)  # -> Faces, Edges, Vertices
area = Area(Geometry=debrep.Faces)  # -> Area, Centroid
pdecon = Deconstruct(Point=area.Centroid)  # -> XComponent, YComponent, ZComponent
sort = SortList(Keys=pdecon.YComponent, ValuesA=debrep.Faces)  # -> Keys, ValuesA
number_slider = Slider(4, range=0..10)
number_slider_2 = Slider(0.2, range=0..1)
number_slider_3 = Slider(3, range=0..10)
split = SplitList(List=sort.ValuesA, Index=number_slider)  # -> ListA, reverse(ListB)
number_slider_4 = Slider(1, range=0..1)
range = Range(Domain=Domain(0, 1), Steps=number_slider_3)
split_2 = SplitList(List=split.ListB, Index=number_slider)  # -> ListA, reverse(ListB)
multiplication = Multiplication(A=number_slider_2, B=Slider(2.5, range=0..10))
range_2 = Range(Domain=Domain(0, 1), Steps=number_slider_3)
graph = GraphMapper(
    range,
    x0=0,
    x1=1,
    y0=0,
    y1=1,
    container_name="Bezier",
    cpx=[0, 0.003187981201, 0.4694496989, 1],
    cpy=[0, 0.3399999738, 1, 1])
geo = Geometry(flatten(split.ListA))
geo_2 = Geometry(flatten(split_2.ListA))
graft = GraftTree(Tree=range_2, IncludeEmptyLists=True, IncludeNullItems=True)  # -> simplify(Tree)
dom = ConstructDomain(DomainStart=number_slider_4, DomainEnd=number_slider_2)
dom_2 = ConstructDomain(DomainStart=number_slider_4, DomainEnd=multiplication)
dom_3 = ConstructDomain(DomainStart=number_slider_4, DomainEnd=Slider(0, range=0..100))
join = BrepJoin(Breps=geo)  # -> Breps, Closed
join_2 = BrepJoin(Breps=geo_2)  # -> Breps, Closed
multiplication_2 = Multiplication(A=graft, B="-1")
merge = Merge(Data1=join.Breps, Data2=join_2.Breps)  # -> simplify(graft(Result))
remap = RemapNumbers(Value=graph, Source=Domain(0, 1), Target=dom)  # -> Mapped, Clipped
remap_2 = RemapNumbers(Value=graph, Source=Domain(0, 1), Target=dom_2)  # -> Mapped, Clipped
remap_3 = RemapNumbers(Value=graph, Source=Domain(0, 1), Target=dom_3)  # -> Mapped, Clipped
merge_2 = Merge(Data1=multiplication_2, Data2=graft)
area_2 = Area(Geometry=merge)  # -> Area, Centroid
flip_2 = FlipMatrix(Data=merge_2)
scale_nu = ScaleNU(Geometry=merge, Plane=area_2.Centroid, ScaleX=remap.Mapped, ScaleY=remap_3.Mapped, ScaleZ=remap_2.Mapped)  # -> simplify(Geometry), Transform
multiplication_3 = Multiplication(A=flip_2, B=Slider(66.6, range=0..100))
Y = UnitY(Factor=multiplication_3)
move = Move(Geometry=simplify(scale_nu.Geometry), Motion=simplify(Y))  # -> simplify(Geometry), Transform
loft_2 = Loft(Curves=move.Geometry, Options={Adjust=False, Closed=False, LoftEnds=0, LoftSimp=0, LoftType=3, Rebuild=10, Refit=0.01})
brep = Brep(split_2.ListB)
merge_3 = Merge(Data1=flatten(brep), Data2=flatten(loft_2))
join_3 = BrepJoin(Breps=merge_3)  # -> Breps, Closed
smesh = SimpleMesh(Brep=join_3.Breps)
wbcatmullclark = WeaverbirdsCatmullClarkSubdivision(MeshCurves=smesh, Level=Slider(2, range=0..10), SmoothNakedEdges=1)
bbox = BoundingBox(Content=wbcatmullclark, Plane=PlaneXY(0, 0, 0))  # -> Box, Box_2
box_corners = BoxCorners(Box=bbox.Box)  # -> CornerA, CornerB, CornerC, CornerD, CornerE, CornerF, CornerG, CornerH
dist = Distance(PointA=box_corners.CornerA, PointB=box_corners.CornerB)
dist_2 = Distance(PointA=box_corners.CornerA, PointB=box_corners.CornerD)
division = Division(A=dist_2, B=2)
series = Series(Start=0, Step=dist_2, Count=Slider(10, range=0..10))
X = UnitX(Factor=dist)
Y_2 = UnitY(Factor=series)
Y_3 = UnitY(Factor=division)
move_2 = Move(Geometry=wbcatmullclark, Motion=Y_2)  # -> Geometry, Transform
graft_2 = GraftTree(Tree=X, IncludeEmptyLists=True, IncludeNullItems=True)
multiplication_4 = Multiplication(A=dist, B=2)
move_3 = Move(Geometry=move_2.Geometry, Motion=graft_2)  # -> Geometry, Transform
move_4 = Move(Geometry=move_3.Geometry, Motion=Y_3)  # -> Geometry, Transform
series_2 = Series(Start=0, Step=multiplication_4, Count=Slider(10, range=0..10))
demesh = DeconstructMesh(Mesh=wbcatmullclark)  # -> Vertices, Faces, Colours, Normals
merge_4 = Merge(Data1=move_2.Geometry, Data2=move_4.Geometry)
vec = VectorXYZ(XComponent=Slider(1, range=0..1), YComponent=Slider(1, range=0..1), ZComponent=Slider(0.3, range=0..1))  # -> Vector, Length
X_2 = UnitX(Factor=series_2)  # -> graft(UnitVector)
dprod = DotProduct(VectorA=vec.Vector, VectorB=demesh.Normals, Unitize=False)
move_5 = Move(Geometry=merge_4, Motion=X_2)  # -> Geometry, Transform
flatten_2 = FlattenTree(Tree=move_5.Geometry, Path="{0}")
dom_4 = ConstructDomain(DomainStart=Slider(0, range=0..1), DomainEnd=Slider(1, range=0..1))
dom_5 = ConstructDomain(DomainStart=Slider(0.43, range=0..1), DomainEnd=Slider(0.92, range=0..1))
lng = ListLength(List=flatten_2)
number_slider_5 = Slider(0.5, range=0..1)
bnd = Bounds(Numbers=dprod)
random = Random(Range=dom_4, Number=lng, Seed=2)
remap_4 = RemapNumbers(Value=dprod, Source=bnd, Target=dom_5)  # -> Mapped, Clipped
gradient = Gradient(LowerLimit=0, UpperLimit=1, Parameter=remap_4.Mapped, stops=[0: RGB(220, 0, 40), 1: RGB(255, 130, 160)])
hsl = ColourHSL(Alpha=1, Hue=graft(random), Saturation=Slider(1, range=0..1), Luminance=remap_4.Mapped)  # -> simplify(Colour)
mcol = MeshColours(Mesh=wbcatmullclark, Colours=gradient)
graft_3 = GraftTree(Tree=flatten_2, IncludeEmptyLists=True, IncludeNullItems=True)
mcol_2 = MeshColours(Mesh=simplify(graft_3), Colours=simplify(hsl))
