# Grasshopper definition Quattro Morphoggi.ghx (Grasshopper 0.9.76)
# plug-ins: MeshEdit Components

number_slider = Slider(100, range=0..100)
number_slider_2 = Slider(100, range=0..100)
planesrf = PlaneSurface(Plane=PlaneXY(0, 0, 0), XSize=number_slider, YSize=number_slider)
sdivide = DivideSurface(Surface=planesrf, UCount=number_slider_2, VCount=number_slider_2)  # -> simplify(Points), Normals, Parameters
panel = Panel("""A
B
C
D""")
pt = ConstructPoint(XCoordinate=0, YCoordinate=0, ZCoordinate=0)
textlines = TextLines(face="Arial", size=Slider(64, range=0..100), content=panel, pl=pt)  # -> out, A; inputs face: String, bold: Boolean, italics: Boolean, size: Double, content: String, pl: Plane
# ---------- textlines: C# ----------
    if(size == 0)
      size = 1;

    if(!string.IsNullOrEmpty(face) && size > 0 && !string.IsNullOrEmpty(content) &&
      pl.IsValid)
    {

      var te = RhinoDoc.ActiveDoc.Objects.AddText(content, pl, size, face, bold, italics);
      Rhino.DocObjects.TextObject txt = RhinoDoc.ActiveDoc.Objects.Find(te) as Rhino.DocObjects.TextObject;

      if(txt != null)
      {
        var tt = txt.Geometry as Rhino.Geometry.TextEntity;
        A = tt.Explode();
      }
      
      RhinoDoc.ActiveDoc.Objects.Delete(te, true);
    }
# ---------- end textlines ----------
bbox = BoundingBox(Content=textlines.A, Plane=PlaneXY(0, 0, 0), UnionBox=True)  # -> Box, Box_2
area = Area(Geometry=planesrf)  # -> Area, Centroid
area_2 = Area(Geometry=bbox.Box)  # -> Area, Centroid
vec2pt = Vector2Pt(PointA=area_2.Centroid, PointB=area.Centroid, Unitize=False)  # -> Vector, Length
move = Move(Geometry=textlines.A, Motion=vec2pt.Vector)  # -> Geometry, Transform
flatten = FlattenTree(Tree=sdivide.Points, Path="{0}")
pull = PullPoint(Point=flatten, Geometry=move.Geometry, ClosestOnly=True)  # -> ClosestPoint, Distance
min = Minimum(A=pull.Distance, B=Slider(12, range=0..100))
bnd = Bounds(Numbers=flatten(min))
remap = RemapNumbers(Value=min, Source=bnd, Target=Domain(0, 1))  # -> Mapped, Clipped
graph = GraphMapper(remap.Mapped, x0=0, x1=1, y0=0, y1=1, container_name="Bezier", cpx=[0, 0.435959965, 0.5404379964, 1], cpy=[0, 0, 1, 1])
dom = ConstructDomain(DomainStart=Slider(12, range=0..100), DomainEnd=1)
md_slider = MDSlider(
    slider_value=Point(0.494244087, 0.5036098201, 0.5),
    SliderMode=0,
    x_domain=Domain(0, 1),
    y_domain=Domain(0, 1),
    z_domain=Domain(0, 1))
remap_2 = RemapNumbers(Value=graph, Source=Domain(0, 1), Target=dom)  # -> Mapped, Clipped
Z = UnitZ(Factor=remap_2.Mapped)
pdecon = Deconstruct(Point=md_slider)  # -> XComponent, YComponent, ZComponent
move_2 = Move(Geometry=flatten, Motion=Z)  # -> simplify(Geometry), Transform
group = Group(Objects=move_2.Geometry)
num = Number(number_slider_2)
merge = Merge(Data1=pdecon.XComponent, Data2=pdecon.YComponent)
flatten_2 = FlattenTree(Tree=group, Path="{0}")
addition = Addition(A=num, B=1)
partition = PartitionList(List=flatten_2, Size=Slider(2, range=0..10))  # -> simplify(Chunks)
graft = GraftTree(Tree=merge, IncludeEmptyLists=True, IncludeNullItems=True)
srfgrid = SurfaceFromPoints(Points=move_2.Geometry, UCount=addition, Interpolate=False)
item = ListItem(List=partition, Index=0, Wrap=True)
item_2 = ListItem(List=partition, Index=1, Wrap=True)
flatten_3 = FlattenTree(Tree=srfgrid, Path="{0}")
ungroup = Ungroup(Group=item)  # -> simplify(Objects)
ungroup_2 = Ungroup(Group=item_2)  # -> simplify(Objects)
num_2 = Number(pdecon.YComponent)
num_3 = Number(pdecon.XComponent)
pt_2 = Point(ungroup)
vec2pt_2 = Vector2Pt(PointA=ungroup, PointB=ungroup_2, Unitize=False)  # -> simplify(Vector), Length
multiplication = Multiplication(A=vec2pt_2.Vector, B=num_3)
move_3 = Move(Geometry=pt_2, Motion=multiplication)  # -> Geometry, Transform
bang = ExplodeTree(Data=move_3.Geometry)  # -> Branch0, Branch1
vec2pt_3 = Vector2Pt(PointA=bang.Branch0, PointB=bang.Branch1, Unitize=False)  # -> Vector, Length
multiplication_2 = Multiplication(A=vec2pt_3.Vector, B=num_2)
num_4 = Number(addition)
move_4 = Move(Geometry=bang.Branch0, Motion=multiplication_2)  # -> Geometry, Transform
pdecon_2 = Deconstruct(Point=move_4.Geometry)  # -> XComponent, YComponent, ZComponent
bnd_2 = Bounds(Numbers=pdecon_2.ZComponent)
remap_3 = RemapNumbers(Value=pdecon_2.ZComponent, Source=bnd_2, Target=Domain(0, 1))  # -> Mapped, Clipped
srfgrid_2 = SurfaceFromPoints(Points=move_4.Geometry, UCount=num_4, Interpolate=False)
gradient = Gradient(
    LowerLimit=0,
    UpperLimit=1,
    Parameter=remap_3.Mapped,
    stops=[0: RGB(178, 0, 33), 0.472: RGB(214, 54, 54), 1: RGB(255, 161, 183)])
preview = CustomPreview(Geometry=srfgrid_2, Shader=ColourSwatch(SwatchColor=RGB(0, 208, 255)))
frompoints = MeshFromPoints(Points=move_4.Geometry, UDirection=num_4, VDirection=num_4, Colour=gradient)
