# Grasshopper definition Circle Moire.ghx (Grasshopper 0.9.76)
# plug-ins: MeshEdit Components, Kangaroo Components

pt = ConstructPoint(XCoordinate=0, YCoordinate=0, ZCoordinate=0)
multiplication = Multiplication(A="12", B="2")
polygon = Polygon(Plane=pt, Radius=3, Segments="12", FilletRadius=0)  # -> Polygon, Length
number_slider = Slider(3, range=0..10)
polygon_2 = Polygon(Plane=pt, Radius=3, Segments=multiplication, FilletRadius=0)  # -> Polygon, Length
cp = ControlPoints(Curve=polygon.Polygon)  # -> Points, Weights, Knots
cull_i = CullIndex(List=reverse(cp.Points), Indices="0", Wrap=True)  # -> reverse(List)
shift = ShiftList(List=cull_i, Shift=Slider(2, range=0..10), Wrap=True)
partition = PartitionList(List=cull_i, Size=number_slider)  # -> simplify(Chunks)
partition_2 = PartitionList(List=shift, Size=number_slider)  # -> simplify(Chunks)
item = ListItem(List=partition, Index=0, Wrap=True)  # -> flatten(Item)
item_2 = ListItem(List=partition_2, Index=0, Wrap=True)  # -> flatten(Item)
pt_2 = Point(item)
pt_3 = Point(item_2)
pline = PolyLine(Vertices=pt_2, Closed=True)
pline_2 = PolyLine(Vertices=pt_3, Closed=True)
explode = Explode(Curve=pline, Recursive=True)  # -> Segments, Vertices
explode_2 = Explode(Curve=pline_2, Recursive=True)  # -> Segments, Vertices
item_3 = ListItem(List=explode.Segments, Index=0, Wrap=True)
item_4 = ListItem(List=explode_2.Segments, Index=0, Wrap=True)
number_slider_2 = Slider(15, range=0..100)
len = Length(Curve=item_3)
vec = Vector(graft(item_3))
vec_2 = Vector(graft(item_4))
series = Series(Start=0, Step=len, Count=number_slider_2)
series_2 = Series(Start=0, Step=len, Count=number_slider_2)
amp = Amplitude(Vector=vec, Amplitude=series)  # -> simplify(Vector)
amp_2 = Amplitude(Vector=vec_2, Amplitude=series_2)  # -> simplify(Vector)
graft = GraftTree(Tree=amp_2, IncludeEmptyLists=True, IncludeNullItems=True)
addition = Addition(A=amp, B=graft)
move = Move(Geometry=polygon_2.Polygon, Motion=addition)  # -> Geometry, Transform
explode_3 = Explode(Curve=polygon.Polygon, Recursive=True)  # -> Segments, Vertices
explode_4 = Explode(Curve=move.Geometry, Recursive=True)  # -> Segments, Vertices
item_5 = ListItem(List=explode_3.Segments, Index=0, Wrap=True)
area = Area(Geometry=move.Geometry)  # -> Area, Centroid
cp_2 = ControlPoints(Curve=move.Geometry)  # -> Points, Weights, Knots
len_2 = Length(Curve=item_5)
eval = EvaluateLength(Curve=explode_4.Segments, Length="0.5", Normalized=True)  # -> Point, Tangent, Parameter
merge = Merge(Data1=cp_2.Points, Data2=area.Centroid)
division = Division(A=len_2, B="4")
multiplication_2 = Multiplication(A=division, B=Slider(0.9, range=0..1))
flatten = FlattenTree(Tree=merge, Path="{0}")
duppt = RemoveDuplicatePts(Points=flatten, Tolerance=0.01)
num = Number("12")
polygon_3 = Polygon(Plane=duppt, Radius=multiplication_2, Segments=num, FilletRadius=0)  # -> Polygon, Length
cp_3 = ControlPoints(Curve=polygon_3.Polygon)  # -> Points, Weights, Knots
flatten_2 = FlattenTree(Tree=cp_3.Points, Path="{0}")
del = DelaunayMesh(Points=flatten_2, Plane=PlaneXY(0, 0, 0))
bbox = BoundingBox(Content=del, Plane=PlaneXY(0, 0, 0))  # -> Box, Box_2
debrep = DeconstructBrep(Brep=bbox.Box)  # -> Faces, Edges, Vertices
md_slider = MDSlider(
    slider_value=Point(0.5886745223, 0.3704389246, 0.5),
    SliderMode=0,
    x_domain=Domain(0, 1),
    y_domain=Domain(0, 1),
    z_domain=Domain(0, 1))
item_6 = ListItem(List=debrep.Faces, Index=0, Wrap=True)
explode_5 = MeshExplode(Mesh=del, Interpolate=False)
area_2 = Area(Geometry=explode_5)  # -> Area, Centroid
pt_4 = Point(duppt)
evalsrf = EvaluateSurface(Surface=reparameterize(item_6), Point=md_slider)  # -> Point, Normal, Frame
pull = PullPoint(Point=area_2.Centroid, Geometry=pt_4, ClosestOnly=True)  # -> ClosestPoint, Distance
num_2 = Number(multiplication_2)
larger = LargerThan(FirstNumber=pull.Distance, SecondNumber=num_2)  # -> LargerThan, OrEqualTo
cull = CullPattern(List=explode_5, CullPattern=larger.LargerThan)
mjoin = MeshJoin(Meshes=cull)
rad = Radians(Degrees=Slider(5.913, range=0..60))
weld = WeldMesh(Mesh=mjoin, Angle=3.141592654)
rotate = Rotate(Geometry=weld, Angle=rad, Plane=evalsrf.Point)  # -> Geometry, Transform
merge_2 = Merge(Data1=rotate.Geometry, Data2=weld)  # -> flatten(Result)
preview = CustomPreview(Geometry=merge_2, Shader=ColourSwatch(SwatchColor=RGB(0, 0, 0)))
