# Grasshopper definition Islamic Weaving.ghx (Grasshopper 0.9.76)

number_slider = Slider(1, range=0..1)
number_slider_2 = Slider(100, range=0..100)
pt = ConstructPoint(XCoordinate=0, YCoordinate=0, ZCoordinate=0)
hexgrid = Hexagonal(Plane=pt, Size=number_slider_2, ExtentX=number_slider, ExtentY=number_slider)  # -> Cells, Points
crv = Curve(hexgrid.Cells)
rotate = Rotate(Geometry=crv, Angle=1.570796327, Plane=PlaneXY(0, 0, 0))  # -> Geometry, Transform
explode = Explode(Curve=rotate.Geometry, Recursive=True)  # -> Segments, Vertices
offset = Slider(25.6, range=0..100)
eval = EvaluateLength(Curve=explode.Segments, Length="0.5", Normalized=True)  # -> Point, Tangent, Parameter
vec2pt = Vector2Pt(PointA=pt, PointB=eval.Point, Unitize=False)  # -> Vector, Length
amp = Amplitude(Vector=vec2pt.Vector, Amplitude=offset)
end = EndPoints(Curve=explode.Segments)  # -> Start, End
neg = Negative(Value=amp)
move = Move(Geometry=eval.Point, Motion=neg)  # -> simplify(graft(Geometry)), Transform
thickness = Slider(25.5, range=0..100)
merge = Merge(Data1=simplify(graft(end.Start)), Data2=move.Geometry, Data3=simplify(graft(end.End)))
vec2pt_2 = Vector2Pt(PointA=pt, PointB=move.Geometry, Unitize=False)  # -> Vector, Length
pline = PolyLine(Vertices=merge, Closed=False)
neg_2 = Negative(Value=thickness)
dom = ConstructDomain(DomainStart=neg_2, DomainEnd=thickness)
crv_2 = Curve(reparameterize(pline))
range = Range(Domain=dom, Steps="1")
end_2 = EndPoints(Curve=crv_2)  # -> Start, End
amp_2 = Amplitude(Vector=vec2pt_2.Vector, Amplitude=range)
merge_2 = Merge(Data1=end_2.Start, Data2=end_2.End)
move_2 = Move(Geometry=crv_2, Motion=amp_2)  # -> simplify(Geometry), Transform
crv_cp = CurveClosestPoint(Point=merge_2, Curve=reparameterize(crv_2))  # -> Point, Parameter, Distance
eval_2 = EvaluateCurve(Curve=crv_2, Parameter=crv_cp.Parameter)  # -> Point, Tangent, Angle
devec = DeconstructVector(Vector=eval_2.Tangent)  # -> XComponent, YComponent, ZComponent
crv_3 = Curve(move_2.Geometry)
num = Number(number_slider_2)
vec = VectorXYZ(XComponent=devec.XComponent, YComponent=devec.YComponent, ZComponent=0)  # -> Vector, Length
Z = UnitZ(Factor=1)
ext = ExtendCurve(Curve=crv_3, Type=0, Start=num, End=num)  # -> reparameterize(Curve)
vrot = Rotate(Vector=vec.Vector, Axis=Z, Angle="Rad(90)")
Z_2 = UnitZ(Factor=1)
item = ListItem(List=crv_3, Index="1", Wrap=True)
item_2 = ListItem(List=crv_3, Index=0, Wrap=True)
item_3 = ListItem(List=ext, Index=0, Wrap=True)
item_4 = ListItem(List=ext, Index="1", Wrap=True)
pl = ConstructPlane(Origin=eval_2.Point, XAxis=vrot, YAxis=Z_2)
cp = ControlPoints(Curve=item_2)  # -> simplify(Points), Weights, Knots
cp_2 = ControlPoints(Curve=item)  # -> simplify(Points), Weights, Knots
cp_3 = ControlPoints(Curve=rotate.Geometry)  # -> Points, Weights, Knots
pcx = CurvePlane(Curve=item_4, Plane=pl)  # -> Points, ParamsC, ParamsP
pcx_2 = CurvePlane(Curve=item_3, Plane=pl)  # -> Points, ParamsC, ParamsP
item_5 = ListItem(List=cp_2.Points, Index="1", Wrap=True)
item_6 = ListItem(List=cp.Points, Index="1", Wrap=True)
subset = SubList(List=cp_3.Points, Domain=Slider(2, range=0..10), Wrap=True)  # -> List, Index
pshift = ShiftPaths(Data=pcx.Points, Offset=-1)
pshift_2 = ShiftPaths(Data=pcx_2.Points, Offset=-1)
vec2pt_3 = Vector2Pt(PointA=pt, PointB=subset.List, Unitize=False)  # -> Vector, Length
weave = Weave(Pattern=[0, 1], Stream0=pshift_2, Stream1=item_6, NullGaps=False)
weave_2 = Weave(Pattern=[0, 1], Stream0=pshift, Stream1=item_5, NullGaps=False)
depth = Slider(20, range=0..20)
multiplication = Multiplication(A=vec2pt_3.Vector, B="2")
cos = Cosine(Value="Rad(30)")
num_2 = Number(num)
pline_2 = PolyLine(Vertices=weave, Closed=False)
pline_3 = PolyLine(Vertices=weave_2, Closed=False)
pshift_3 = ShiftPaths(Data=pcx.ParamsC, Offset=-1)
multiplication_2 = Multiplication(A=num_2, B=cos)
pshift_4 = ShiftPaths(Data=pcx_2.ParamsC, Offset=-1)
merge_3 = Merge(Data1=pline_2, Data2=pline_3)
shatter = Shatter(Curve=item_3, Parameters=pshift_4)
shatter_2 = Shatter(Curve=item_4, Parameters=pshift_3)
num_3 = Number(multiplication_2)
num_4 = Number(depth)
cp_4 = ControlPoints(Curve=merge_3)  # -> Points, Weights, Knots
item_7 = ListItem(List=shatter, Index="1", Wrap=True)  # -> simplify(Item)
item_8 = ListItem(List=shatter_2, Index="1", Wrap=True)  # -> simplify(Item)
neg_3 = Negative(Value=num_4)
multiplication_3 = Multiplication(A=num_2, B="4")
multiplication_4 = Multiplication(A=num_3, B="4")
dom_2 = ConstructDomain(DomainStart=neg_3, DomainEnd=num_4)
merge_4 = Merge(Data1=item_7, Data2=item_8)
number_slider_3 = Slider(5, range=0..10)
range_2 = Range(Domain=dom_2, Steps="2")
Z_3 = UnitZ(Factor=range_2)
move_3 = Move(Geometry=cp_4.Points, Motion=Z_3)  # -> Geometry, Transform
Z_4 = UnitZ(Factor=depth)
pline_4 = PolyLine(Vertices=move_3.Geometry, Closed=False)
series = Series(Start=0, Step=multiplication_4, Count=number_slider_3)
series_2 = Series(Start=0, Step=multiplication_3, Count=number_slider_3)
pshift_5 = ShiftPaths(Data=pline_4, Offset=-1)
loft = Loft(Curves=pshift_5, Options={Adjust=False, Closed=False, LoftEnds=0, LoftSimp=0, LoftType=0, Rebuild=10, Refit=0.01})
flatten = FlattenTree(Tree=loft, Path="{0}")
extr = Extrude(Base=flatten, Direction=Z_4)
smesh = SimpleMesh(Brep=extr)
group = Group(Objects=smesh)
move_4 = Move(Geometry=group, Motion=multiplication)  # -> simplify(Geometry), Transform
X = UnitX(Factor=series)
Y = UnitY(Factor=series_2)
merge_5 = Merge(Data1=flatten(group), Data2=flatten(move_4.Geometry))
graft = GraftTree(Tree=merge_5, IncludeEmptyLists=True, IncludeNullItems=True)
move_5 = Move(Geometry=graft, Motion=X)  # -> Geometry, Transform
flatten_2 = FlattenTree(Tree=move_5.Geometry, Path="{0}")
graft_2 = GraftTree(Tree=flatten_2, IncludeEmptyLists=True, IncludeNullItems=True)
move_6 = Move(Geometry=graft_2, Motion=Y)  # -> Geometry, Transform
ungroup = Ungroup(Group=move_6.Geometry)
flatten_3 = FlattenTree(Tree=ungroup, Path="{0}")
mjoin = MeshJoin(Meshes=flatten_3)
demesh = DeconstructMesh(Mesh=mjoin)  # -> Vertices, Faces, Colours, Normals
pdecon = Deconstruct(Point=demesh.Vertices)  # -> XComponent, YComponent, ZComponent
preview = CustomPreview(
    Geometry=mjoin,
    Shader={ambient=RGB(0, 0, 0), diffuse=RGB(255, 105, 180), emission=RGB(76, 32, 54), shine=0.5, specular=RGB(255, 255, 255), transparency=0})
bnd = Bounds(Numbers=pdecon.ZComponent)
bnd_2 = Bounds(Numbers=pdecon.YComponent)
bnd_3 = Bounds(Numbers=pdecon.XComponent)
remap = RemapNumbers(Value=pdecon.ZComponent, Source=bnd, Target=Domain(0, 1))  # -> Mapped, Clipped
remap_2 = RemapNumbers(Value=pdecon.YComponent, Source=bnd_2, Target=Domain(0, 1))  # -> Mapped, Clipped
remap_3 = RemapNumbers(Value=pdecon.XComponent, Source=bnd_3, Target=Domain(0, 1))  # -> Mapped, Clipped
frgb = ColourRGBF(Alpha=1, Red=remap_3.Mapped, Green=remap_2.Mapped, Blue=remap.Mapped)
mcol = MeshColours(Mesh=mjoin, Colours=frgb)
