# Grasshopper definition Windup Pattern.ghx (Grasshopper 0.9.76)

number_slider = Slider(30, range=0..100)
rectangle = Rectangle(Plane=PlaneXY(0, 0, 0), XSize=number_slider, YSize=number_slider, Radius=0)  # -> Rectangle, Length
rotate = Rotate(Geometry=rectangle.Rectangle, Angle="Rad(45)", Plane=PlaneXY(0, 0, 0))  # -> Geometry, Transform
scale_nu = ScaleNU(Geometry=rotate.Geometry, Plane=PlaneXY(0, 0, 0), ScaleX=Slider(0.5, range=0..1.5), ScaleY=1, ScaleZ=1)  # -> Geometry, Transform
crv = Curve(scale_nu.Geometry)
dom = ConstructDomain(DomainStart=Slider(1, range=0..1), DomainEnd=Slider(0.25, range=0..1))
bbox = BoundingBox(Content=scale_nu.Geometry, Plane=PlaneXY(0, 0, 0))  # -> Box, Box_2
range = Range(Domain=dom, Steps=Slider(2, range=0..5))
dim = Dimensions(Surface=bbox.Box)  # -> UDimension, VDimension
area = Area(Geometry=crv)  # -> Area, Centroid
division = Division(A=dim.VDimension, B=2)
division_2 = Division(A=dim.UDimension, B=2)
series = Series(Start=0, Step=dim.UDimension, Count=Slider(10, range=0..10))
series_2 = Series(Start=0, Step=dim.VDimension, Count=Slider(6, range=0..10))
scale = Scale(Geometry=crv, Center=area.Centroid, Factor=range)  # -> Geometry, Transform
X = UnitX(Factor=division_2)
Y = UnitY(Factor=division)
explode = Explode(Curve=scale.Geometry, Recursive=True)  # -> Segments, Vertices
X_2 = UnitX(Factor=series)
Y_2 = UnitY(Factor=series_2)
cp = ControlPoints(Curve=scale.Geometry)  # -> Points, Weights, Knots
addition = Addition(A=X, B=Y)
move = Move(Geometry=scale_nu.Geometry, Motion=Y_2)  # -> Geometry, Transform
rev = ReverseList(List=cp.Points)
group = Group(Objects=move.Geometry)
move_2 = Move(Geometry=group, Motion=addition)  # -> Geometry, Transform
cull_i = CullIndex(List=rev, Indices=0, Wrap=True)
merge = Merge(Data1=group, Data2=move_2.Geometry)
eval = EvaluateLength(Curve=explode.Segments, Length=Slider(0.5, range=0..1), Normalized=True)  # -> simplify(Point), Tangent, Parameter
rev_2 = ReverseList(List=cull_i)  # -> simplify(List)
move_3 = Move(Geometry=merge, Motion=graft(X_2))  # -> Geometry, Transform
weave = Weave(Pattern=[0, 1], Stream0=rev_2, Stream1=eval.Point, NullGaps=False)
flatten = FlattenTree(Tree=move_3.Geometry, Path="{0}")
flatten_2 = FlattenTree(Tree=weave, Path="{0}")
subset = SubList(List=flatten_2, Domain=Domain(0, 1), Wrap=True)  # -> List, Index
ungroup = Ungroup(Group=flatten)
pline = PolyLine(Vertices=subset.List, Closed=False)
area_2 = Area(Geometry=ungroup)  # -> Area, Centroid
eval_2 = EvaluateLength(Curve=pline, Length=Slider(0.8, range=0..1), Normalized=True)  # -> Point, Tangent, Parameter
flatten_3 = FlattenTree(Tree=area_2.Centroid, Path="{0}")
replace = ReplaceItems(List=flatten_2, Item=eval_2.Point, Indices="0", Wrap=False)
lng = ListLength(List=flatten_3)
nurbs = NurbsCurve(Vertices=replace, Degree=3, Periodic=False)  # -> Curve, Length, Domain
orient = Orient(Geometry=nurbs.Curve, Source=area.Centroid, Target=flatten_3)  # -> Geometry, Transform
random = Random(Range=Slider(3, range=0..10), Number=lng, Seed=Slider(234, range=0..1000), Integers=True)
larger = LargerThan(FirstNumber=random, SecondNumber="2")  # -> LargerThan, OrEqualTo
rotate_2 = Rotate(Angle=1.570796327, Plane=PlaneXY(0, 0, 0))  # -> Geometry, Transform
dispatch = Dispatch(List=flatten_3, DispatchPattern=larger.OrEqualTo)  # -> ListA, ListB
dispatch_2 = Dispatch(List=orient.Geometry, DispatchPattern=larger.OrEqualTo)  # -> ListA, ListB
mod = Modulus(A=random, B="2")
pi = Pi(Factor=1)
yz = YZPlane(Origin=dispatch.ListA)
multiplication = Multiplication(A=mod, B=pi)
mirror = Mirror(Geometry=dispatch_2.ListA, Plane=yz)  # -> Geometry, Transform
weave_2 = Weave(Pattern=larger.OrEqualTo, Stream0=dispatch_2.ListB, Stream1=mirror.Geometry, NullGaps=False)
number_slider_2 = Slider(0.75, range=0..1)
rotate_3 = Rotate(Geometry=weave_2, Angle=multiplication, Plane=flatten_3)  # -> Geometry, Transform
neg = Negative(Value=number_slider_2)
offset_l = OffsetLoose(Curve=rotate_3.Geometry, Distance=number_slider_2)  # -> simplify(graft(Curve))
offset_l_2 = OffsetLoose(Curve=rotate_3.Geometry, Distance=neg)  # -> simplify(graft(Curve))
merge_2 = Merge(Data1=offset_l, Data2=offset_l_2)  # -> simplify(Result)
pdecon = Deconstruct(Point=flatten_3)  # -> XComponent, YComponent, ZComponent
loft = Loft(Curves=merge_2, Options={Adjust=False, Closed=False, LoftEnds=0, LoftSimp=0, LoftType=0, Rebuild=10, Refit=0.01})
bnd = Bounds(Numbers=pdecon.XComponent)
Z = UnitZ(Factor=Slider(2, range=0..10))
extr = Extrude(Base=loft, Direction=Z)
remap = RemapNumbers(Value=pdecon.XComponent, Source=bnd, Target=Domain(0, 1))  # -> Mapped, Clipped
gradient = Gradient(LowerLimit=0, UpperLimit=1, Parameter=remap.Mapped, stops=[0: RGB(255, 157, 0), 1: RGB(251, 255, 0)])
graft = GraftTree(Tree=gradient, IncludeEmptyLists=True, IncludeNullItems=True)
preview = CustomPreview(Geometry=extr, Shader=graft)
