# Grasshopper definition Origami Fold.ghx (Grasshopper 1.0.4)
# plug-ins: Kangaroo2 Components

number_slider = Slider(10, range=0..15)
number_slider_2 = Slider(1, range=0..1)
multiplication = Multiplication(A=number_slider_2, B=number_slider)
multiplication_2 = Multiplication(A=number_slider_2, B=number_slider)
sqgrid = Square(Plane=PlaneXY(0, 0, 0), Size=number_slider_2, ExtentX=number_slider, ExtentY=number_slider)  # -> Cells, Points
rectangle = Rectangle(Plane=PlaneXY(0, 0, 0), XSize=multiplication_2, YSize=multiplication, Radius=0)  # -> Rectangle, Length
crv = Curve(sqgrid.Cells)
explode = Explode(Curve=crv, Recursive=True)  # -> simplify(Segments), Vertices
crv_2 = Curve(rectangle.Rectangle)
eval = EvaluateLength(Curve=explode.Segments, Length="0.5", Normalized=True)  # -> Point, Tangent, Parameter
pline = PolyLine(Vertices=eval.Point, Closed=True)
dispatch = Dispatch(List=eval.Point, DispatchPattern=[True, False])  # -> ListA, ListB
pshift = ShiftPaths(Data=pline, Offset=-1)
pline_2 = PolyLine(Vertices=dispatch.ListA, Closed=False)
flip = FlipMatrix(Data=pshift)
group = Group(Objects=flip)  # -> flatten(Group)
division = Division(A=number_slider_2, B="2")
dispatch_2 = Dispatch(List=group, DispatchPattern=[True, False])  # -> ListA, ListB
X = UnitX(Factor=division)
ungroup = Ungroup(Group=dispatch_2.ListB)
neg = Negative(Value=X)
move = Move(Geometry=dispatch_2.ListB, Motion=X)  # -> Geometry, Transform
item = ListItem(List=ungroup, Index=0, Wrap=True)
ungroup_2 = Ungroup(Group=move.Geometry)  # -> simplify(Objects)
move_2 = Move(Geometry=item, Motion=neg)  # -> simplify(Geometry), Transform
ungroup_3 = Ungroup(Group=dispatch_2.ListA)
merge = Merge(Data1=move_2.Geometry, Data2=ungroup_2)
merge_2 = Merge(Data1=ungroup_3, Data2=merge)
explode_2 = Explode(Curve=merge_2, Recursive=True)  # -> Segments, Vertices
flatten = FlattenTree(Tree=explode_2.Segments, Path="{0}")
dupln = RemoveDuplicateLines(Lines=flatten, Tolerance=0.01)
eval_2 = EvaluateLength(Curve=dupln, Length="0.5", Normalized=True)  # -> Point, Tangent, Parameter
incurve = PointInCurve(Point=eval_2.Point, Curve=crv_2)  # -> Relationship, Point
equals = Equality(FirstNumber=incurve.Relationship, SecondNumber="2")  # -> Equality, Inequality
crv_3 = Curve(crv_2)
cull = CullPattern(List=dupln, CullPattern=equals.Equality)
merge_3 = Merge(Data1=crv, Data2=pline_2, Data3=cull)
flatten_2 = FlattenTree(Tree=merge_3, Path="{0}")
explode_3 = Explode(Curve=flatten_2, Recursive=True)  # -> flatten(Segments), Vertices
graft = GraftTree(Tree=cull, IncludeEmptyLists=True, IncludeNullItems=True)
boundary = BoundarySurfaces(Edges=crv_3)
dupln_2 = RemoveDuplicateLines(Lines=explode_3.Segments, Tolerance=0.01)
srfsplit = SurfaceSplit(Surface=boundary, Curves=dupln_2)
eval_3 = EvaluateLength(Curve=graft, Length="0.5", Normalized=True)  # -> simplify(Point), Tangent, Parameter
smesh = SimpleMesh(Brep=srfsplit)
geo = Geometry(smesh)
meshcp = MeshClosestPoint(Point=eval_3.Point, Mesh=geo)  # -> simplify(Point), Index, Parameter
dist = Distance(PointA=eval_3.Point, PointB=meshcp.Point)
smaller = SmallerThan(FirstNumber=dist, SecondNumber=Slider(0.001, range=0..0.001))  # -> SmallerThan, OrEqualTo
cull_2 = CullPattern(List=geo, CullPattern=smaller.SmallerThan)  # -> simplify(List)
mjoin = MeshJoin(Meshes=cull_2)
weld = WeldMesh(Mesh=mjoin, Angle=3.141592654)

# ---- group: Updated 20180222
medges = MeshEdges(Mesh=weld)  # -> simplify(NakedEdges), simplify(InteriorEdges), NonManifoldEdges
join = JoinCurves(Curves=medges.NakedEdges, Preserve=False)  # -> simplify(Curves)
offset = OffsetCurve(Curve=join, Distance=Slider(0.01, range=0..0.01), Plane=PlaneXY(0, 0, 0), Corners=1)  # -> simplify(Curve)
area = Area(Geometry=offset)  # -> Area, Centroid
area_2 = Area(Geometry=join)  # -> Area, Centroid
smaller_2 = SmallerThan(FirstNumber=area_2.Area, SecondNumber=area.Area)  # -> SmallerThan, OrEqualTo
dispatch_3 = Dispatch(List=join, DispatchPattern=smaller_2.SmallerThan)  # -> ListA, ListB
flip_2 = FlipCurve(Curve=dispatch_3.ListB)  # -> Curve, Flag
end = EndPoints(Curve=medges.InteriorEdges)  # -> Start, End
merge_4 = Merge(Data1=dispatch_3.ListA, Data2=flip_2.Curve)
cp = ControlPoints(Curve=merge_4)  # -> simplify(Points), Weights, Knots
duppt = RemoveDuplicatePts(Points=cp.Points, Tolerance=0.01)  # -> simplify(UniquePoints)
crv_cp = CurveClosestPoint(Point=end.Start, Curve=reparameterize(merge_4))  # -> Point, Parameter, Distance
crv_cp_2 = CurveClosestPoint(Point=duppt, Curve=reparameterize(merge_4))  # -> Point, Parameter, Distance
lng = ListLength(List=crv_cp_2.Parameter)
equals_2 = Equality(FirstNumber=crv_cp_2.Parameter, SecondNumber=crv_cp.Parameter)  # -> Equality, Inequality
series = Series(Start=0, Step=1, Count=lng)
cull_3 = CullPattern(List=series, CullPattern=equals_2.Equality)  # -> simplify(List)
shift = ShiftList(List=duppt, Shift=cull_3, Wrap=True)  # -> simplify(List)

# ----
dispatch_4 = Dispatch(List=shift, DispatchPattern=[True, False])  # -> ListA, ListB
dispatch_5 = Dispatch(List=dispatch_4.ListA, DispatchPattern=[True, False])  # -> ListA, ListB
mjoin_2 = MeshJoin(Meshes=smesh)
dispatch_6 = Dispatch(List=dispatch_4.ListB, DispatchPattern=[True, False])  # -> ListA, ListB
rad = Radians(Degrees=Slider(106, range=0..120))
hinge = Hinge(
    FoldStart=dispatch_5.ListA,
    FoldEnd=dispatch_5.ListB,
    Tip1=dispatch_6.ListA,
    Tip2=dispatch_6.ListB,
    RestAngle=rad,
    Strength=1)
medges_2 = MeshEdges(Mesh=mjoin_2)  # -> NakedEdges, InteriorEdges, NonManifoldEdges
demesh = DeconstructMesh(Mesh=mjoin_2)  # -> Vertices, Faces, Colours, Normals
neg_2 = Negative(Value=Slider(1, range=0..1))
merge_5 = Merge(Data1=medges_2.NakedEdges, Data2=medges_2.InteriorEdges)
duppt_2 = RemoveDuplicatePts(Points=demesh.Vertices, Tolerance=0.01)
Z = UnitZ(Factor=neg_2)
length_line = LengthLine(Line=merge_5, Length=merge_5, Strength=10)
floor = Floor(Strength=Slider(1, range=0..100))
show = Show(G=mjoin_2)
load = Load(Point=duppt_2, ForceVector=Z)
merge_6 = Merge(Data1=flatten(show), Data2=flatten(length_line), Data3=flatten(floor), Data4=flatten(load), Data5=flatten(hinge))
solver = Solver(GoalObjects=merge_6, Reset=Toggle(False), Threshold=1e-15, Tolerance=0.01, On=Toggle(True))  # -> I, V, O
item_2 = ListItem(List=solver.O, Index=0, Wrap=True)
preview = CustomPreview(Geometry=item_2, Material=ColourSwatch(SwatchColor=RGB(0, 162, 255)))
