# Grasshopper definition Spiral Torus.ghx (Grasshopper 1.0.4)
# plug-ins: Kangaroo Components

R = Slider(100, range=0..100)
r = Slider(56, range=0..100)
timer = Timer(TimerInterval=50, Target=counter)  # disabled
pi = Pi(Factor="2")
number_slider = Slider(10, range=0..100)
range = Range(Domain=pi, Steps=Slider(15, range=0..100))
pi_2 = Pi(Factor="2")
counter = Counter(Reset=Toggle(False))
item = ListItem(List=range, Index=1, Wrap=True)
rad = Radians(Degrees=Slider(2, range=0..10))
range_2 = Range(Domain=pi_2, Steps=number_slider)
range_3 = Range(Domain=item, Steps=number_slider)
multiplication = Multiplication(A=counter, B=rad)
graft = GraftTree(Tree=range_3, IncludeEmptyLists=True, IncludeNullItems=True)  # -> simplify(Tree)
graft_2 = GraftTree(Tree=range_2, IncludeEmptyLists=True, IncludeNullItems=True)  # -> simplify(Tree)
addition = Addition(A=range, B=graft)
addition_2 = Addition(A=multiplication, B=addition)
cos = Cosine(Value=addition_2)
multiplication_2 = Multiplication(A=r, B=cos)
sin = Sine(Value=addition_2)
addition_3 = Addition(A=R, B=multiplication_2)
multiplication_3 = Multiplication(A=r, B=sin)
cos_2 = Cosine(Value=graft_2)
sin_2 = Sine(Value=graft_2)
multiplication_4 = Multiplication(A=addition_3, B=cos_2)
multiplication_5 = Multiplication(A=addition_3, B=sin_2)
pt = ConstructPoint(XCoordinate=multiplication_4, YCoordinate=multiplication_5, ZCoordinate=multiplication_3)  # -> simplify(Point)
flip = FlipMatrix(Data=pt)
flatten = FlattenTree(Tree=flip, Path="{0}")
duppt = RemoveDuplicatePts(Points=flatten, Tolerance=0.01)
nurbs = NurbsCurve(Vertices=duppt, Degree=3, Periodic=True)  # -> Curve, Length, Domain
pipe = Pipe(Curve=nurbs.Curve, Radius=Slider(3.7, range=0..10), Caps=0)
preview = CustomPreview(Geometry=pipe, Material=ColourSwatch(SwatchColor=RGB(0, 178, 255)))
