# Grasshopper definition Wind Sculpture.ghx (Grasshopper 1.0.4)
# plug-ins: Kangaroo Components

number_slider = Slider(1500, range=0..10000)
number_slider_2 = Slider(20, range=0..100)
number_slider_3 = Slider(30, range=0..100)
xz = XZPlane(Origin=Point(0, 0, 0))
cir = Circle(Plane=xz, Radius=number_slider)
pframes = PerpFrames(Curve=cir, Count=number_slider_2, Align=True)  # -> Frames, Parameters
number_slider_4 = Slider(100, range=0..100)
deplane = DeconstructPlane(Plane=pframes.Frames)  # -> Origin, XAxis, YAxis, ZAxis
pipe = Pipe(Curve=cir, Radius=number_slider_3, Caps=0)
addition = Addition(A=number_slider_3, B=Slider(10, range=0..10))
multiplication = Multiplication(A=number_slider, B=Slider(0.656, range=0..1))
amp = Amplitude(Vector=deplane.XAxis, Amplitude=number_slider_4)
amp_2 = Amplitude(Vector=deplane.ZAxis, Amplitude=number_slider_4)
cir_2 = Circle(Plane=pframes.Frames, Radius=addition)
line = LineSDL(Start=deplane.Origin, Direction=deplane.XAxis, Length=multiplication)
vdis = VectorDisplay(Anchor=deplane.Origin, Vector=amp_2)
extr = Extrude(Base=cir_2, Direction=amp_2)
multiplication_2 = Multiplication(A=amp_2, B=-0.5)
Y = UnitY(Factor=Slider(595, range=0..1000))
end = EndPoints(Curve=line)  # -> Start, End
move = Move(Geometry=end.End, Motion=Y)  # -> Geometry, Transform
move_2 = Move(Geometry=extr, Motion=multiplication_2)  # -> Geometry, Transform
merge = Merge(Data1=pipe, Data2=move_2.Geometry)
arc = ArcSED(Start=deplane.Origin, End=move.Geometry, Direction=deplane.XAxis)  # -> Arc, Plane, Radius
preview = CustomPreview(Geometry=merge, Material=ColourSwatch(SwatchColor=RGB(0, 187, 255)))

number_slider_5 = Slider(150, range=0..150)

pframes_2 = PerpFrames(Curve=arc.Arc, Count=Slider(10, range=0..100), Align=True)  # -> simplify(Frames), Parameters
division = Division()
deplane_2 = DeconstructPlane(Plane=pframes_2.Frames)  # -> Origin, XAxis, YAxis, ZAxis
lng = ListLength(List=deplane_2.Origin)  # -> expr("x-1", Length)
dom = ConstructDomain(DomainStart=Slider(30, range=0..100), DomainEnd=number_slider_5)
range = Range(Domain=dom, Steps=lng)  # -> reverse(Range)
remap = RemapNumbers(Value=range, Source=number_slider_5, Target=Domain(0, 1))  # -> Mapped, Clipped
line_2 = LineSDL(Start=deplane_2.Origin, Direction=deplane_2.ZAxis, Length=1)
amp_3 = Amplitude(Vector=deplane_2.XAxis, Amplitude=range)
multiplication_3 = Multiplication(A=Slider(50, range=0..100), B=remap.Mapped)
amp_4 = Amplitude(Vector=deplane_2.ZAxis, Amplitude=multiplication_3)
move_3 = Move(Geometry=deplane_2.Origin, Motion=amp_3)  # -> Geometry, Transform
move_4 = Move(Geometry=move_3.Geometry, Motion=amp_4)  # -> Geometry, Transform
arc_2 = ArcSED(Start=deplane_2.Origin, End=move_4.Geometry, Direction=deplane_2.XAxis)  # -> Arc, Plane, Radius
pi = Pi(Factor=Slider(2, range=0..10))
pi_2 = Pi(Factor=2)
revsrf = Revolution(Curve=arc_2.Arc, Axis=line_2, Domain=Domain(0, 6.283185307))  # -> simplify(Surface)
pipe_2 = Pipe(Curve=arc.Arc, Radius=Slider(15, range=0..100), Caps=0)  # -> simplify(Pipe)
number_slider_6 = Slider(35, range=0..100)
range_2 = Range(Domain=pi, Steps=number_slider_2)
range_3 = Range(Domain=pi_2, Steps=Slider(3, range=0..10))
merge_2 = Merge(Data1=pipe_2, Data2=revsrf)
cull_i = CullIndex(List=reverse(range_3), Indices=0, Wrap=True)  # -> reverse(List)
cull_i_2 = CullIndex(List=reverse(range_2), Indices=0, Wrap=True)  # -> reverse(List)
custom_mesh_settings = SettingsCustom(
    StitchSeams=True,
    SimplePlanes=False,
    Refine=True,
    MinCount=16,
    MaxCount=400,
    AspectRatio=20,
    MaxDistance=0,
    MaxAngle=20,
    MinEdge=number_slider_6,
    MaxEdge=number_slider_6)
graft = GraftTree(Tree=cull_i_2, IncludeEmptyLists=True, IncludeNullItems=True)  # -> simplify(Tree)
addition_2 = Addition(A=graft, B=cull_i)  # -> simplify(Result)
mesh = MeshBrep(Brep=merge_2, Settings=custom_mesh_settings)
group = Group(Objects=mesh)
rotate = Rotate(Geometry=group, Angle=addition_2, Plane=simplify(graft(pframes.Frames)))  # -> Geometry, Transform
timer = Timer(TimerInterval=50, Target=counter)  # disabled
counter = Counter(Reset=Toggle(False))
multiplication_4 = Multiplication(A=counter, B=Slider(-10, range=-10..10))
rad = Radians(Degrees=multiplication_4)
rotate_2 = Rotate(Geometry=rotate.Geometry, Angle=rad, Plane=simplify(graft(pframes.Frames)))  # -> Geometry, Transform
preview_2 = CustomPreview(Geometry=rotate_2.Geometry, Material=ColourSwatch(SwatchColor=RGB(255, 162, 0)))
