# Grasshopper definition Gear Simulation.ghx (Grasshopper 1.0.4)
# plug-ins: Kangaroo Components

number_slider = Slider(7.5, range=0..10)
number_slider_2 = Slider(89, range=0..100)
division = Division(A=number_slider, B=Slider(3, range=0..10))
cir = Circle(Plane=PlaneXY(0, 0, 0), Radius=division)
cir_2 = Circle(Plane=PlaneXY(0, 0, 0), Radius=number_slider)
mod = Modulus(A=number_slider_2, B=2)
addition = Addition(A=number_slider_2, B=mod)
pi = Pi(Factor=2)
divide = DivideCurve(Curve=cir_2, Count=addition, Kinks=False)  # -> Points, Tangents, Parameters
division_2 = Division(A=pi, B=addition)
number_slider_3 = Slider(2.2, range=0..10)
dispatch = Dispatch(List=divide.Points, DispatchPattern=[True, False])  # -> ListA, ListB
ln = Line(StartPoint=dispatch.ListA, EndPoint=dispatch.ListB)
pi_2 = Pi(Factor=-0.5)
Z = UnitZ(Factor=1)
vec = Vector(ln)
vrot = Rotate(Vector=vec, Axis=Z, Angle=pi_2)
amp = Amplitude(Vector=vrot, Amplitude=number_slider_3)
number_slider_4 = Slider(0.57, range=0..1)
crv = Curve(ln)
move = Move(Geometry=ln, Motion=amp)  # -> Geometry, Transform
eval = EvaluateLength(Curve=crv, Length=0.5, Normalized=True)  # -> Point, Tangent, Parameter
eval_2 = EvaluateLength(Curve=move.Geometry, Length=0.5, Normalized=True)  # -> Point, Tangent, Parameter
division_3 = Division(A="1", B=number_slider_4)
scale = Scale(Geometry=crv, Center=eval.Point, Factor=division_3)  # -> Geometry, Transform
scale_2 = Scale(Geometry=move.Geometry, Center=eval_2.Point, Factor=number_slider_4)  # -> Geometry, Transform
shift = ShiftList(List=scale.Geometry, Shift=1, Wrap=True)
end = EndPoints(Curve=scale_2.Geometry)  # -> Start, End
end_2 = EndPoints(Curve=scale.Geometry)  # -> Start, End
end_3 = EndPoints(Curve=shift)  # -> Start, End
ln_2 = Line(StartPoint=end_2.End, EndPoint=end_3.Start)
ln_3 = Line(StartPoint=end.Start, EndPoint=end_2.Start)
ln_4 = Line(StartPoint=end.End, EndPoint=end_2.End)
merge = Merge(Data1=scale_2.Geometry, Data2=ln_3, Data3=ln_4, Data4=ln_2)  # -> flatten(Result)
num = Number(division_2)
division_4 = Division(A=num, B=2)
num_2 = Number(number_slider)
num_3 = Number(number_slider_3)
join = JoinCurves(Curves=merge, Preserve=False)
multiplication = Multiplication(A=num_2, B=2)
neg = Negative(Value=division_4)
timer = Timer(TimerInterval=20, Target=counter)  # disabled
addition_2 = Addition(A=multiplication, B=num_3)
rotate = Rotate(Geometry=join, Angle=neg, Plane=PlaneXY(0, 0, 0))  # -> Geometry, Transform
counter = Counter(Reset=Toggle(False))
addition_3 = Addition(A=addition_2, B=Slider(0.96, range=0..2))
X = UnitX(Factor=addition_3)
multiplication_2 = Multiplication(A=counter, B=Slider(3, range=0..10))
pt = ConstructPoint(XCoordinate=addition_3, YCoordinate=0, ZCoordinate=0)
rotate_2 = Rotate(Geometry=join, Angle=division_4, Plane=PlaneXY(0, 0, 0))  # -> Geometry, Transform
move_2 = Move(Geometry=rotate.Geometry, Motion=X)  # -> Geometry, Transform
rad = Radians(Degrees=multiplication_2)
rotate_3 = Rotate(Geometry=rotate_2.Geometry, Angle=rad, Plane=PlaneXY(0, 0, 0))  # -> Geometry, Transform
crv_2 = Curve(cir)
number_slider_5 = Slider(4, range=0..10)
merge_2 = Merge(Data1=crv_2, Data2=rotate_3.Geometry)  # -> flatten(Result)
c_script = CSharpScript(D=rotate_3.Geometry, FI=move_2.Geometry, AX=pt, R=Button())  # -> out, FO, CO, AN; inputs D: list of Curve, FI: Curve, AX: Point3d, CI: list of Curve, P: Boolean, R: Boolean
# ---------- c_script: C# ----------
    List<Curve> list = D;
    Curve curve = FI;
    Point3d point3d = AX;
    List<Curve> list2 = CI;
    bool flag = P;
    bool flag2 = R;
    double num = 0.0001;
    double num2 = 0.001;
    if (flag2 || !this.initialized)
    {
      this.turn = 0.0;
      this.axleOriginalPosition = point3d;
      this.initialized = true;
    }
    curve.Translate(point3d - this.axleOriginalPosition);
    curve.Rotate(this.turn, Vector3d.ZAxis, point3d);
    curve.Domain = new Interval(0.0, 1.0);

    if (curve.ClosedCurveOrientation(Plane.WorldXY) == CurveOrientation.CounterClockwise)
    {
      curve.Reverse();
    }
    foreach (Curve curve2 in list)
    {
      curve2.Domain = new Interval(0.0, 1.0);
      if (curve2.ClosedCurveOrientation(Plane.WorldXY) == CurveOrientation.CounterClockwise)
      {
        curve2.Reverse();
      }
    }
    double num3 = 1.0;
    double num4 = 0.0;
    while (num3 > num & num4 < 200.0)
    {
      num3 = 0.0;
      if (flag)
      {
        Point3d pointA;
        Point3d pointA2;
        list[0].ClosestPoints(curve, out pointA, out pointA2);
        Vector3d vector3d = pointA - point3d;
        Vector3d vector3d2 = pointA2 - point3d;
        double num5 = Vector3d.VectorAngle(vector3d2, vector3d, Plane.WorldXY);
        curve.Rotate(num5, Vector3d.ZAxis, point3d);
        this.turn += num5;
        num3 += Math.Abs(num5);
      }
      foreach (Curve curve2 in list)
      {
        Rhino.Geometry.Intersect.CurveIntersections curveIntersections = Rhino.Geometry.Intersect.Intersection.CurveCurve(curve, curve2, 0.001, 0.001);
        if (curveIntersections != null && curveIntersections.Count > 1)
        {
          for (int i = 0; i < curveIntersections.Count - 1; i += 2)
          {
            Point3d pointA = curveIntersections[i].PointA;
            Point3d pointA2 = curveIntersections[i + 1].PointA;
            Vector3d vector3d;
            Vector3d vector3d2;
            int num6;
            if (Vector3d.CrossProduct(pointA - point3d, pointA2 - point3d).Z > 0.0)
            {
              vector3d = pointA - point3d;
              vector3d2 = pointA2 - point3d;
              num6 = -1;
            }
            else
            {
              vector3d = pointA2 - point3d;
              vector3d2 = pointA - point3d;
              num6 = 1;
            }
            double num7 = vector3d2.Length - vector3d.Length;
            double num5 = num7 * (double) num6 * num2;
            curve.Rotate(num5, Vector3d.ZAxis, point3d);
            this.turn += num5;
            num3 += Math.Abs(num5);
          }
        }
      }
      num4 += 1.0;
    }
    FO = curve;
    List<Curve> list3 = new List<Curve>();
    for (int i = 0; i < list2.Count; i++)
    {
      if (list2[i] != null)
      {
        list2[i].Translate(point3d - this.axleOriginalPosition);
        list2[i].Rotate(this.turn, Vector3d.ZAxis, point3d);
        list3.Add(list2[i]);
      }
    }
    CO = list3;
    AN = this.turn;
# ---------- c_script: C# additional code ----------
  public double turn;
  public bool initialized;
  public Point3d axleOriginalPosition;
# ---------- end c_script ----------
boundary = BoundarySurfaces(Edges=merge_2)
Z_2 = UnitZ(Factor=number_slider_5)
crv_3 = Curve(c_script.FO)
move_3 = Move(Geometry=crv_2, Motion=X)  # -> Geometry, Transform
merge_3 = Merge(Data1=move_3.Geometry, Data2=crv_3)  # -> flatten(Result)
boundary_2 = BoundarySurfaces(Edges=merge_3)
Z_3 = UnitZ(Factor=number_slider_5)
extr = Extrude(Base=boundary, Direction=Z_2)
extr_2 = Extrude(Base=boundary_2, Direction=Z_3)
preview = CustomPreview(Geometry=extr, Material=ColourSwatch(SwatchColor=RGB(255, 79, 79)))
preview_2 = CustomPreview(Geometry=extr_2, Material=ColourSwatch(SwatchColor=RGB(46, 168, 255)))
