# Grasshopper definition Rose Garden.ghx (Grasshopper 1.0.5)
# plug-ins: Weaverbird

pt = ConstructPoint(XCoordinate=0, YCoordinate=0, ZCoordinate=0)
X = UnitX(Factor=1)
line = LineSDL(Start=pt, Direction=X, Length=Slider(21, range=0..100))
crv = Curve(reparameterize(line))
divide = DivideCurve(Curve=crv, Count=Slider(380, range=0..1000), Kinks=False)  # -> Points, Tangents, Parameters
graph = GraphMapper(
    divide.Parameters,
    x0=0,
    x1=1,
    y0=0,
    y1=1,
    container_name="Bezier",
    cpx=[0, 0.5216055512, 0.5773766637, 1],
    cpy=[1, 1, 0, 0])
lng = ListLength(List=divide.Points)
series = Series(Start=0, Step=Slider(26, range=0..100), Count=lng)
rad = Radians(Degrees=series)
multiplication = Multiplication(A=graph, B=Slider(40, range=0..100))
rotate = Rotate(Geometry=divide.Points, Angle=rad, Plane=PlaneXY(0, 0, 0))  # -> Geometry, Transform
Z = UnitZ(Factor=multiplication)
dup = DuplicateData(Data="False", Number=Slider(10, range=0..10), Order=True)
move = Move(Geometry=rotate.Geometry, Motion=Z)  # -> Geometry, Transform
merge = Merge(Data1=flatten("True"), Data2=flatten(dup))
intcrv = Interpolate(Vertices=move.Geometry, Degree=3, Periodic=False, KnotStyle=1)  # -> reparameterize(Curve), Length, Domain
dispatch = Dispatch(List=move.Geometry, DispatchPattern=merge)  # -> ListA, ListB
geo = Geometry(dispatch.ListA)
crv_cp = CurveClosestPoint(Point=geo, Curve=intcrv.Curve)  # -> Point, Parameter, Distance
lng_2 = ListLength(List=crv_cp.Point)  # -> expr("x-1", Length)
panel = Panel(dispatch.ListA)
eval = EvaluateCurve(Curve=intcrv.Curve, Parameter=crv_cp.Parameter)  # -> Point, Tangent, Angle
range = Range(Domain=Domain(0, 1), Steps=lng_2)
graph_2 = GraphMapper(
    range,
    x0=0,
    x1=1,
    y0=0,
    y1=1,
    container_name="Bezier",
    cpx=[0, 0.06480252743, 0.5778817534, 1],
    cpy=[0, 0.6342930794, 0.9431880116, 1])
dom = ConstructDomain(DomainStart=Slider(8.4, range=0..10), DomainEnd=Slider(42.6, range=0..100))
dom_2 = ConstructDomain(DomainStart=Slider(0.96, range=0..1), DomainEnd=Slider(1.51, range=0..10))
dom_3 = ConstructDomain(DomainStart=Slider(3.7, range=0..100), DomainEnd=Slider(16.8, range=0..100))
dom_4 = ConstructDomain(DomainStart=Slider(1.9, range=0..5), DomainEnd=Slider(6, range=0..10))
Z_2 = UnitZ(Factor=1)
remap = RemapNumbers(Value=graph_2, Source=Domain(0, 1), Target=dom)  # -> Mapped, Clipped
multiplication_2 = Multiplication(A=remap.Mapped, B=-0.5)
remap_2 = RemapNumbers(Value=graph_2, Source=Domain(0, 1), Target=dom_2)  # -> Mapped, Clipped
remap_3 = RemapNumbers(Value=graph_2, Source=Domain(0, 1), Target=dom_3)  # -> Mapped, Clipped
remap_4 = RemapNumbers(Value=range, Source=Domain(0, 1), Target=dom_4)  # -> Mapped, Clipped
line_2 = LineSDL(Start=eval.Point, Direction=eval.Tangent, Length=remap.Mapped)
amp = Amplitude(Vector=eval.Tangent, Amplitude=multiplication_2)
multiplication_3 = Multiplication(A=remap.Mapped, B=Slider(0.245, range=0..1))
vrot = Rotate(Vector=eval.Tangent, Axis=Z_2, Angle="-Rad(90)")
move_2 = Move(Geometry=line_2, Motion=amp)  # -> Geometry, Transform
amp_2 = Amplitude(Vector=vrot, Amplitude=multiplication_3)
move_3 = Move(Geometry=eval.Point, Motion=amp_2)  # -> Geometry, Transform
end = EndPoints(Curve=move_2.Geometry)  # -> Start, End
neg = Negative(Value=Slider(20, range=0..100))
arc = Arc3Pt(PointA=end.Start, PointB=move_3.Geometry, PointC=end.End)  # -> Arc, Plane, Radius
pt_2 = ConstructPoint(XCoordinate=0, YCoordinate=0, ZCoordinate=neg)
number_slider = Slider(9, range=0..10)
scale = Scale(Geometry=arc.Arc, Center=pt_2, Factor=remap_2.Mapped)  # -> Geometry, Transform
graft = GraftTree(Tree=scale.Geometry, IncludeEmptyLists=True, IncludeNullItems=True)  # -> simplify(Tree)
graft_2 = GraftTree(Tree=arc.Arc, IncludeEmptyLists=True, IncludeNullItems=True)  # -> simplify(Tree)
divide_2 = DivideCurve(Curve=graft, Count=number_slider, Kinks=False)  # -> simplify(Points), Tangents, Parameters
multiplication_4 = Multiplication(A=divide_2.Points, B=Slider(42, range=0..100))
divide_3 = DivideCurve(Curve=graft_2, Count=number_slider, Kinks=False)  # -> simplify(Points), Tangents, Parameters
random = Random(Range=Domain(0, 1), Number=1, Seed=multiplication_4)  # -> simplify(Random)
graft_3 = GraftTree(Tree=remap_3.Mapped, IncludeEmptyLists=True, IncludeNullItems=True)
pshift = ShiftPaths(Data=random, Offset=-1)
nurbs = NurbsCurve(Vertices=divide_3.Points, Degree=3, Periodic=False)  # -> simplify(Curve), Length, Domain
vec2pt = Vector2Pt(PointA=divide_3.Points, PointB=divide_2.Points, Unitize=False)  # -> Vector, Length
multiplication_5 = Multiplication(A=pshift, B=graft_3)
amp_3 = Amplitude(Vector=vec2pt.Vector, Amplitude=multiplication_5)
move_4 = Move(Geometry=divide_2.Points, Motion=amp_3)  # -> Geometry, Transform
nurbs_2 = NurbsCurve(Vertices=move_4.Geometry, Degree=3, Periodic=False)  # -> simplify(Curve), Length, Domain
merge_2 = Merge(Data1=nurbs.Curve, Data2=nurbs_2.Curve)
loft = Loft(Curves=merge_2, Options={Adjust=False, Closed=False, LoftEnds=0, LoftSimp=0, LoftType=0, Rebuild=10, Refit=0.01})
number_slider_2 = Slider(10.79, range=0..20)
graft_4 = GraftTree(Tree=remap_4.Mapped, IncludeEmptyLists=True, IncludeNullItems=True)  # -> simplify(Tree)
custom_mesh_settings = SettingsCustom(
    StitchSeams=True,
    SimplePlanes=False,
    Refine=True,
    MinCount=16,
    MaxCount=400,
    AspectRatio=20,
    MaxDistance=0,
    MaxAngle=20,
    MinEdge=number_slider_2,
    MaxEdge=number_slider_2)
sph = Sphere(Base=PlaneXY(0, 0, 0), Radius=Slider(250, range=0..1000))  # -> reparameterize(Sphere)
mesh = MeshBrep(Brep=loft, Settings=custom_mesh_settings)
popgeo = PopulateGeometry(Geometry=sph, Count=Slider(120, range=0..1000), Seed=1)
preview = CustomPreview(Geometry=sph, Material=ColourSwatch(SwatchColor=RGB(255, 255, 255)))
wbthicken = WeaverbirdsMeshThicken(MeshCurves=mesh, Distance=graft_4, OffsetType=0)
pi = Pi(Factor=2)
multiplication_6 = Multiplication(A=popgeo, B=Slider(100, range=0..100))
srf_cp = SurfaceClosestPoint(Point=popgeo, Surface=sph)  # -> Point, UVPoint, Distance
wbcatmullclark = WeaverbirdsCatmullClarkSubdivision(MeshCurves=wbthicken, Level=1, SmoothNakedEdges=1)
dom_5 = ConstructDomain(DomainStart=0, DomainEnd=pi)
dom_6 = ConstructDomain(DomainStart=Slider(0.7, range=0..1), DomainEnd=Slider(1, range=0..1))
random_2 = Random(Range=dom_5, Number=1, Seed=multiplication_6)  # -> simplify(Random)
random_3 = Random(Range=dom_6, Number=1, Seed=multiplication_6)  # -> simplify(Random)
evalsrf = EvaluateSurface(Surface=sph, Point=srf_cp.UVPoint)  # -> Point, Normal, UDirection, VDirection, Frame
flatten = FlattenTree(Tree=wbcatmullclark, Path="{0}")
flatten_2 = FlattenTree(Tree=random_2, Path="{0}")
group = Group(Objects=flatten)
xy = XYPlane(Origin=Point(0, 0, 0))
rotate_2 = Rotate(Geometry=evalsrf.Frame, Angle=flatten_2, Plane=evalsrf.Frame)  # -> Geometry, Transform
orient = Orient(Geometry=group, Source=xy, Target=rotate_2.Geometry)  # -> Geometry, Transform
scale_2 = Scale(Geometry=orient.Geometry, Center=rotate_2.Geometry, Factor=flatten(random_3))  # -> Geometry, Transform
ungroup = Ungroup(Group=scale_2.Geometry)  # -> simplify(Objects)
lng_3 = ListLength(List=ungroup)  # -> expr("x-1", Length)
range_2 = Range(Domain=Domain(0, 1), Steps=lng_3)
multiplication_7 = Multiplication(A=random_3, B=range_2)
gradient = Gradient(LowerLimit=0, UpperLimit=1, Parameter=multiplication_7, stops=[0.15: RGB(229, 240, 216), 0.85: RGB(93, 176, 16)])
col = Colour(simplify(gradient))
graft_5 = GraftTree(Tree=ungroup, IncludeEmptyLists=True, IncludeNullItems=True)  # -> simplify(Tree)
graft_6 = GraftTree(Tree=col, IncludeEmptyLists=True, IncludeNullItems=True)  # -> simplify(Tree)
preview_2 = CustomPreview(Geometry=graft_5, Material=graft_6)
