# Grasshopper definition Swarm Intelligence.ghx (Grasshopper 1.0.7)

sph = Sphere(Base=PlaneXY(0, 0, 0), Radius=1)
python = GhPythonScript()  # -> out, agent
# ---------- python: Python ----------
import rhinoscriptsyntax as rs
import Rhino.Geometry as geo

class Agent:
    def __init__(self, _pos, _vel, _maxspeed, _sr, _cr, _ar, _ssc, _csc, _asc, _size):
        self.type = "agent"
        self.maxspeed = _maxspeed
        self.maxforce = self.maxspeed * 0.05
        self.vel = _vel        
        self.acc = geo.Vector3d(0,0,0)
        self.pos = _pos
        self.sep_rad = _sr
        self.coh_rad = _cr
        self.ali_rad = _ar
        self.sep_scale = _ssc
        self.coh_scale = _csc
        self.ali_scale = _asc
        self.boundary_size = _size
        self.pop = []
        
    def sep(self, pop, rad, scale, coh=False):
        steer = geo.Vector3d(0,0,0)
        count=0.0
        for other in pop:
            if other is not self and other is not None:
                dist = (self.pos - other.pos).Length
                if dist < rad:
                    dir = geo.Vector3d(0,0,0)
                    if(coh is False):
                        dir = self.pos - other.pos
                    else:
                        dir = other.pos - self.pos
                    dir.Unitize()
                    dir = dir / dist
                    steer = steer + dir
                    count += 1.0
                    if count > 5:
                        break
        if count > 0:
            steer /= count
        if steer.Length > self.maxforce:
            steer.Unitize()
            steer *= (self.maxforce * scale)
            self.acc += steer
    
    def coh(self, pop, rad, scale):
        self.sep(pop, rad, scale, True)
        
    def align(self, pop, rad, scale):
        steer = geo.Vector3d(0,0,0)
        count=0.0
        for other in pop:
            if other is not self and other is not None:
                dist = (self.pos - other.pos).Length
                if dist < rad:
                    dir = geo.Vector3d(other.vel)
                    dir.Unitize()
                    dir /= dist
                    steer = steer + dir
                    count += 1.0
                    if count > 5:
                        break
        if count > 0:
            steer /= count
        if steer.Length > self.maxforce:
            steer.Unitize()
            steer *= (self.maxforce * scale)
            self.acc += steer
    
    def boundary(self, size):
        if(abs(self.pos.X) > size / 2.0):
            self.vel.X *= -1
        
        if(abs(self.pos.Y) > size / 2.0):
            self.vel.Y *= -1
        
        if(abs(self.pos.Z) > size / 2.0):
            self.vel.Z *= -1
    
    def update(self, pop):
        self.sep(pop, self.sep_rad, self.sep_scale)
        self.coh(pop, self.coh_rad, self.coh_scale)
        self.align(pop, self.ali_rad, self.ali_scale)
        self.boundary(self.boundary_size)
        
        self.vel += self.acc
        if(self.vel.Length > self.maxspeed):
            self.vel.Unitize()
            self.vel *= self.maxspeed
        self.pos += self.vel
        self.acc = geo.Vector3d(0,0,0)
    
    def draw(self, isLine=True):
        self.update(self.pop)
        
        pt = self.pos
        if isLine:
            dpt = self.pos + self.vel
            line = geo.Line(pt, dpt)
            return line
        else:
            return pt
    
    def updatePop(self, pop):
        self.pop = pop

agent = Agent
"""
agent = Agent(geo.Point3d(0,0,0), geo.Vector3d(0,0,0))
list = []
for i in range(10):
    list.append(Agent(geo.Point3d(0.1 * i, 0.1, 0), geo.Vector3d(0.1, 0.4, -0.3)))
    
agent.sep(list, 0.5, 1.5)
agent.coh(list, 0.2, 1.0)
agent.align(list, 0.2, 1.0)
agent.update()


a = agent.draw()
"""
# ---------- end python ----------
popgeo = PopulateGeometry(Geometry=sph, Count=Slider(1000, range=0..2000), Seed=1)
python_2 = GhPythonScript(
    agent=python.agent,
    positions=popgeo,
    max_speed=Slider(0.22, range=0..1),
    sep_radius=Slider(1, range=0..10),
    coh_radius=Slider(2, range=0..10),
    ali_radius=Slider(2, range=0..10),
    sep_scale=Slider(1.5, range=0..10),
    coh_scale=Slider(1, range=0..10),
    ali_scale=Slider(1, range=0..10),
    boundary_size=Slider(10, range=0..100),
    reset=Button())  # -> out, instances; inputs positions: list of Point3d
# ---------- python_2: Python ----------
import rhinoscriptsyntax as rs
import random as rd
import Rhino.Geometry as geo

insts = []
for pos in positions:
    instance = agent(pos, geo.Vector3d(rd.random() * 2.0 -1.0, rd.random() * 2.0 -1.0, rd.random() * 2.0 -1.0), max_speed,
    sep_radius, coh_radius, ali_radius, sep_scale, coh_scale, ali_scale, boundary_size)
    insts.append(instance)

for inst in insts:
    inst.updatePop(insts)

instances = insts
# ---------- end python_2 ----------
timer = Timer(TimerInterval=20, Target=python_3)  # disabled
python_3 = GhPythonScript(agent=python.agent, instances=python_2.instances, run=Toggle(True), parallel=Toggle(True))  # -> out, result; inputs instances: list
# ---------- python_3: Python ----------
import rhinoscriptsyntax as rs
import ghpythonlib.parallel as par

list = []
if run:
    
    if parallel:
        list = par.run(agent.draw, instances, True)
    else:
        for instance in instances:
            list.append(instance.draw(True))

result = list
# ---------- end python_3 ----------
