# Grasshopper definition Arc Windmill.gh (Grasshopper 1.0.7)

pt = ConstructPoint(XCoordinate=0, YCoordinate=0, ZCoordinate=0)
Y = UnitY(Factor=1)
line = LineSDL(Start=pt, Direction=Y, Length=Slider(65.1, range=0..100))
number_slider = Slider(26.49, range=0..100)
divide = DivideCurve(Curve=line, Count="2", Kinks=False)  # -> simplify(graft(Points)), Tangents, Parameters
scale = Scale(Geometry=divide.Points, Center=pt, Factor=Slider(0.79, range=0..1))  # -> Geometry, Transform
pi = Pi(Factor="2")
range = Range(Domain=pi, Steps=Slider(7, range=0..50))
bang = ExplodeTree(Data=scale.Geometry)  # -> Branch0, Branch1, Branch2
bang_2 = ExplodeTree(Data=divide.Points)  # -> Branch0, Branch1, Branch2
vec = VectorXYZ(XComponent=number_slider, YComponent=0, ZComponent=0)  # -> Vector, Length
vec_2 = VectorXYZ(XComponent=number_slider, YComponent=0, ZComponent=Slider(19.46, range=0..100))  # -> Vector, Length
cull_i = CullIndex(List=reverse(range), Indices="0", Wrap=True)  # -> reverse(List)
move = Move(Geometry=bang.Branch1, Motion=vec.Vector)  # -> Geometry, Transform
move_2 = Move(Geometry=bang_2.Branch1, Motion=vec_2.Vector)  # -> Geometry, Transform
item = ListItem(List=cull_i, Index="1", Wrap=True)
arc = Arc3Pt(PointA=bang.Branch0, PointB=move.Geometry, PointC=bang.Branch2)  # -> Arc, Plane, Radius
arc_2 = Arc3Pt(PointA=bang_2.Branch0, PointB=move_2.Geometry, PointC=bang_2.Branch2)  # -> Arc, Plane, Radius
division = Division(A=item, B="2")
addition = Addition(A=cull_i, B=division)
mod = Modulus(A=addition, B=pi)
rotate = Rotate(Geometry=arc_2.Arc, Angle=cull_i, Plane=PlaneXY(0, 0, 0))  # -> Geometry, Transform
rotate_2 = Rotate(Geometry=arc.Arc, Angle=mod, Plane=PlaneXY(0, 0, 0))  # -> Geometry, Transform
weave = Weave(Pattern=[0, 1], Stream0=rotate.Geometry, Stream1=rotate_2.Geometry, NullGaps=False)
loft = Loft(Curves=weave, Options={Adjust=False, Closed=True, LoftEnds=0, LoftSimp=0, LoftType=3, Rebuild=10, Refit=0.01})
mesh = Mesh(loft)
preview = CustomPreview(Geometry=mesh, Material=ColourSwatch(SwatchColor=RGB(61, 226, 255)))
