# Grasshopper definition Braided Honeycomb.gh (Grasshopper 1.0.7)
# plug-ins: Weaverbird

number_slider = Slider(1, range=0..1)
hexgrid = Hexagonal(Plane=PlaneXY(0, 0, 0), Size=number_slider, ExtentX=Slider(10, range=0..10), ExtentY=Slider(10, range=0..10))  # -> simplify(Cells), simplify(Points)
cp = ControlPoints(Curve=hexgrid.Cells)  # -> Points, Weights, Knots
pt = Point(hexgrid.Points)
tstat = TreeStatistics(Tree=hexgrid.Cells)  # -> Paths, Length, Count
graft = GraftTree(Tree=pt, IncludeEmptyLists=True, IncludeNullItems=True)
lng = ListLength(List=tstat.Paths)
vec2pt = Vector2Pt(PointA=graft, PointB=cp.Points, Unitize=False)  # -> Vector, Length
X = UnitX(Factor=1)
series = Series(Start=0, Step=1, Count=lng)
angle = Angle(VectorA=vec2pt.Vector, VectorB=X)  # -> Angle, Reflex
neg = Negative(Value="1")
mod = Modulus(A=series, B=2)
dom = ConstructDomain(DomainStart=neg, DomainEnd="1")
deg = Degrees(Radians=angle.Angle)
larger = LargerThan(FirstNumber=deg, SecondNumber="90")  # -> LargerThan, OrEqualTo
remap = RemapNumbers(Value=mod, Source=Domain(0, 1), Target=dom)  # -> Mapped, Clipped
dispatch = Dispatch(List=cp.Points, DispatchPattern=larger.LargerThan)  # -> ListA, ListB
multiplication = Multiplication(A=remap.Mapped, B=Slider(0.113, range=0..1))
pt_2 = Point(dispatch.ListB)
Z = UnitZ(Factor=multiplication)
pt_3 = Point(dispatch.ListA)
graft_2 = GraftTree(Tree=Z, IncludeEmptyLists=True, IncludeNullItems=True)  # -> simplify(Tree)
pshift = ShiftPaths(Data=pt_2, Offset=-1)
pshift_2 = ShiftPaths(Data=pt_3, Offset=-1)
panel = Panel(remap.Mapped)
neg_2 = Negative(Value=graft_2)
move = Move(Geometry=pshift, Motion=graft_2)  # -> Geometry, Transform
move_2 = Move(Geometry=pshift_2, Motion=neg_2)  # -> Geometry, Transform
move_3 = Move(Geometry=pshift, Motion=neg_2)  # -> Geometry, Transform
move_4 = Move(Geometry=pshift_2, Motion=graft_2)  # -> Geometry, Transform
unflatten = UnflattenTree(Tree=move.Geometry, Guide=pt_2)
unflatten_2 = UnflattenTree(Tree=move_2.Geometry, Guide=pt_3)
unflatten_3 = UnflattenTree(Tree=move_3.Geometry, Guide=pt_2)
unflatten_4 = UnflattenTree(Tree=move_4.Geometry, Guide=pt_3)
Z_2 = UnitZ(Factor=1)
X_2 = UnitX(Factor=1)
weave = Weave(Pattern=larger.LargerThan, Stream0=unflatten, Stream1=unflatten_2, NullGaps=False)
weave_2 = Weave(Pattern=larger.LargerThan, Stream0=unflatten_3, Stream1=unflatten_4, NullGaps=False)
vrot = Rotate(Vector=X_2, Axis=Z_2, Angle="Rad(60)")
pline = PolyLine(Vertices=weave_2, Closed=False)
amp = Amplitude(Vector=vrot, Amplitude=number_slider)
move_5 = Move(Geometry=weave_2, Motion=amp)  # -> Geometry, Transform
move_6 = Move(Geometry=pline, Motion=amp)  # -> Geometry, Transform
pline_2 = PolyLine(Vertices=weave, Closed=False)
cull_i = CullIndex(List=move_5.Geometry, Indices=0, Wrap=True)
cull_i_2 = CullIndex(List=weave, Indices=0, Wrap=True)
number_slider_2 = Slider(0.78, range=0..1)
avr = Average(Input=cull_i_2)  # -> simplify(ArithmeticMean)
avr_2 = Average(Input=cull_i)
scale = Scale(Geometry=pline_2, Center=avr, Factor=number_slider_2)  # -> Geometry, Transform
scale_2 = Scale(Geometry=move_6.Geometry, Center=avr_2, Factor=number_slider_2)  # -> Geometry, Transform
merge = Merge(Data1=simplify(move_6.Geometry), Data2=simplify(scale_2.Geometry))
merge_2 = Merge(Data1=pline_2, Data2=scale.Geometry)
loft = Loft(Curves=merge, Options={Adjust=False, Closed=False, LoftEnds=0, LoftSimp=0, LoftType=0, Rebuild=10, Refit=0.01})
loft_2 = Loft(Curves=merge_2, Options={Adjust=False, Closed=False, LoftEnds=0, LoftSimp=0, LoftType=0, Rebuild=10, Refit=0.01})
merge_3 = Merge(Data1=loft_2, Data2=loft)  # -> flatten(Result)
join = BrepJoin(Breps=merge_3)  # -> Breps, Closed
smesh = SimpleMesh(Brep=join.Breps)
wbcatmullclark = WeaverbirdsCatmullClarkSubdivision(MeshCurves=smesh, Level=Slider(3, range=0..10), SmoothNakedEdges=1)
demesh = DeconstructMesh(Mesh=wbcatmullclark)  # -> Vertices, Faces, Colours, Normals
pdecon = Deconstruct(Point=demesh.Vertices)  # -> XComponent, YComponent, ZComponent
bnd = Bounds(Numbers=flatten(pdecon.ZComponent))
remap_2 = RemapNumbers(Value=pdecon.ZComponent, Source=bnd, Target=Domain(0, 1))  # -> Mapped, Clipped
gradient = Gradient(
    LowerLimit=0,
    UpperLimit=1,
    Parameter=remap_2.Mapped,
    stops=[0.00519: RGB(69, 41, 48), 0.169: RGB(21, 191, 230), 1: RGB(135, 248, 250)])
conmesh = ConstructMesh(Vertices=demesh.Vertices, Faces=demesh.Faces, Colours=gradient)
