# Grasshopper definition Plate Bent Sculpture.gh (Grasshopper 1.0.7)

thickness = Slider(1, range=0..1)
hole_width = Slider(0.2883, range=0..1)
line_height = Slider(10, range=0..10)
line_offset = Slider(1.25, range=0..3)
line_connection_bulge = Slider(5, range=1..5)
line_rotate = Slider(23, range=20..45)
obj_rotate = Slider(1.82, range=1.6..2.5)
end_arc_length = Slider(0.621, range=0..1)
min_width_mult = Slider(0.259, range=0..1)
max_width = Slider(8.44, range=0..10)
hole_length = Slider(0.4979, range=0.49..0.5)
diffuse = ColourSwatch(SwatchColor=RGB(46, 255, 23))
emission = ColourSwatch(SwatchColor=RGB(255, 0, 0))
multiplication = Multiplication(A=line_rotate, B=obj_rotate)
neg = Negative(Value=line_height)
pt = ConstructPoint(XCoordinate=0, YCoordinate=0, ZCoordinate=neg)
pt_2 = ConstructPoint(XCoordinate=0, YCoordinate=0, ZCoordinate=line_height)
rad = Radians(Degrees=line_rotate)
neg_2 = Negative(Value=rad)
xz = XZPlane(Origin=Point(0, 0, 0))
ln = Line(StartPoint=pt, EndPoint=pt_2)
rotate = Rotate(Geometry=ln, Angle=neg_2, Plane=xz)  # -> Geometry, Transform
num = Number(line_offset)
X = UnitX(Factor=num)
neg_3 = Negative(Value=X)
mirror = Mirror(Geometry=rotate.Geometry, Plane=PlaneYZ(0, 0, 0))  # -> Geometry, Transform
flip = FlipCurve(Curve=mirror.Geometry)  # -> Curve, Flag
move = Move(Geometry=rotate.Geometry, Motion=X)  # -> Geometry, Transform
move_2 = Move(Geometry=rotate.Geometry, Motion=neg_3)  # -> Geometry, Transform
rad_2 = Radians(Degrees=multiplication)
merge = Merge(Data1=move_2.Geometry, Data2=flip.Curve, Data3=move.Geometry)
connect = ConnectCurves(Curves=merge, Continuity=1, Close=False, Bulge=line_connection_bulge)
xz_2 = XZPlane(Origin=Point(0, 0, 0))
rotate_2 = Rotate(Geometry=connect, Angle=rad_2, Plane=xz_2)  # -> Geometry, Transform
box_corners = BoxCorners(Box=rotate_2.Geometry)  # -> CornerA, CornerB, CornerC, CornerD, CornerE, CornerF, CornerG, CornerH
eval = EvaluateLength(Curve=rotate_2.Geometry, Length="0", Normalized=True)  # -> Point, Tangent, Parameter
rotate_3 = Rotate(Geometry=move_2.Geometry, Angle=rad_2, Plane=xz_2)  # -> Geometry, Transform
ln_2 = Line(StartPoint=box_corners.CornerA, EndPoint=box_corners.CornerB)
circlett = CircleTanTan(CurveA=ln_2, CurveB=rotate_3.Geometry, Point=eval.Point)
len = Length(Curve=circlett)
subtraction = Subtraction(A="1", B=end_arc_length)
multiplication_2 = Multiplication(A=len, B=subtraction)
neg_4 = Negative(Value=multiplication_2)
ext = ExtendCurve(Curve=circlett, Type=0, Start=neg_4, End="0")
pi = Pi(Factor=1)
xz_3 = XZPlane(Origin=Point(0, 0, 0))
rotate_4 = Rotate(Geometry=ext, Angle=pi, Plane=xz_3)  # -> Geometry, Transform
merge_2 = Merge(Data1=rotate_2.Geometry, Data2=ext, Data3=rotate_4.Geometry)
pi_2 = Pi(Factor="4")
join = JoinCurves(Curves=merge_2, Preserve=False)  # -> reparameterize(Curves)
subtraction_2 = Subtraction(A="1", B=hole_length)
divide = DivideCurve(Curve=join, Count=Slider(100, range=0..100), Kinks=False)  # -> Points, Tangents, Parameters
multiplication_3 = Multiplication(A=divide.Parameters, B=pi_2)
cos = Cosine(Value=multiplication_3)
max = Maximum(A=divide.Parameters, B=hole_length)
bnd = Bounds(Numbers=cos)
min = Minimum(A=max, B=subtraction_2)
remap = RemapNumbers(Value=cos, Source=bnd, Target=Domain(0, 1))  # -> Mapped, Clipped
pi_3 = Pi(Factor=1)
bnd_2 = Bounds(Numbers=min)
remap_2 = RemapNumbers(Value=min, Source=bnd_2, Target=pi_3)  # -> Mapped, Clipped
max_2 = Maximum(A=remap.Mapped, B=Slider(0.25, range=0..1))
sin = Sine(Value=remap_2.Mapped)
multiplication_4 = Multiplication(A=min_width_mult, B=max_width)
dom = ConstructDomain(DomainStart=multiplication_4, DomainEnd=max_width)
remap_3 = RemapNumbers(Value=hole_width, Source=Domain(0, 1), Target=dom)  # -> Mapped, Clipped
multiplication_5 = Multiplication(A=remap_3.Mapped, B=sin)
bnd_3 = Bounds(Numbers=max_2)
Y = UnitY(Factor=multiplication_5)
remap_4 = RemapNumbers(Value=max_2, Source=bnd_3, Target=dom)  # -> Mapped, Clipped
move_3 = Move(Geometry=divide.Points, Motion=Y)  # -> Geometry, Transform
Y_2 = UnitY(Factor=remap_4.Mapped)
pt_3 = Point(divide.Points)
nurbs = NurbsCurve(Vertices=move_3.Geometry, Degree=3, Periodic=False)  # -> Curve, Length, Domain
move_4 = Move(Geometry=pt_3, Motion=Y_2)  # -> Geometry, Transform
nurbs_2 = NurbsCurve(Vertices=move_4.Geometry, Degree=3, Periodic=False)  # -> Curve, Length, Domain
merge_3 = Merge(Data1=flatten(nurbs.Curve), Data2=flatten(nurbs_2.Curve))
xz_4 = XZPlane(Origin=Point(0, 0, 0))
loft = Loft(Curves=merge_3, Options={Adjust=False, Closed=False, LoftEnds=0, LoftSimp=0, LoftType=0, Rebuild=10, Refit=0.01})
mirror_2 = Mirror(Geometry=loft, Plane=xz_4)  # -> Geometry, Transform
merge_4 = Merge(Data1=loft, Data2=mirror_2.Geometry)
join_2 = BrepJoin(Breps=merge_4)  # -> Breps, Closed
division = Division(A=thickness, B=2)
graft = GraftTree(Tree=join_2.Breps, IncludeEmptyLists=True, IncludeNullItems=True)  # -> simplify(Tree)
neg_5 = Negative(Value=division)
offset = OffsetSurface(Surface=graft, Distance=neg_5, Retrim=True)  # -> simplify(Surface)
offset_2 = OffsetSurface(Surface=graft, Distance=division, Retrim=True)  # -> simplify(Surface)
edges = BrepEdges(Brep=offset)  # -> Naked, Interior, NonManifold
edges_2 = BrepEdges(Brep=offset_2)  # -> Naked, Interior, NonManifold
join_3 = JoinCurves(Curves=edges.Naked, Preserve=False)
join_4 = JoinCurves(Curves=edges_2.Naked, Preserve=False)
merge_5 = Merge(Data1=join_3, Data2=join_4)
loft_2 = Loft(Curves=merge_5, Options={Adjust=False, Closed=False, LoftEnds=0, LoftSimp=0, LoftType=0, Rebuild=10, Refit=0.01})  # -> simplify(Loft)
merge_6 = Merge(Data1=offset, Data2=offset_2, Data3=loft_2)
material = CreateMaterial(Diffuse=diffuse, Specular=RGB(255, 255, 255), Emission=emission, Transparency=0, Shine=0)
join_5 = BrepJoin(Breps=merge_6)  # -> Breps, Closed
sunion = SolidUnion(Breps=flatten(join_5.Breps))  # disabled
preview = CustomPreview(Geometry=join_5.Breps, Material=material)
