# Grasshopper definition Sofa with SubD.gh (Grasshopper 1.0.7)

md_slider = MDSlider(
    SliderMode=0,
    slider_value=Point(0, 0.8374763349, 0.5),
    x_domain=Domain(0, 1),
    y_domain=Domain(0, 1),
    z_domain=Domain(0, 1))
number_slider = Slider(10, range=0..10)
number_slider_2 = Slider(13.19, range=0..20)
sph = Sphere(Base=PlaneXY(0, 0, 0), Radius=number_slider)
msphereex = MeshSphereEx(Base=PlaneXY(0, 0, 0), Radius=number_slider, Count=Slider(5, range=0..10))
evalsrf = EvaluateSurface(Surface=reparameterize(sph), Point=md_slider)  # -> Point, Normal, UDirection, VDirection, Frame
demesh = DeconstructMesh(Mesh=msphereex)  # -> Vertices, Faces, Colours, Normals
sph_2 = Sphere(Base=evalsrf.Point, Radius=number_slider_2)
graft = GraftTree(Tree=demesh.Vertices, IncludeEmptyLists=True, IncludeNullItems=True)  # -> simplify(Tree)
neg = Negative(Value=evalsrf.Normal)
brepinc = PointInBrep(Brep=sph_2, Point=graft, Strict=False)
brep_cp = BrepClosestPoint(Point=graft, Brep=sph_2)  # -> Point, Normal, Distance
dispatch = Dispatch(List=graft, DispatchPattern=brepinc)  # -> ListA, ListB
multiplication = Multiplication(A=number_slider_2, B="2", C=brepinc)
dispatch_2 = Dispatch(List=brep_cp.Distance, DispatchPattern=brepinc)  # -> ListA, ListB
line = LineSDL(Start=graft, Direction=neg, Length=multiplication)
flatten = FlattenTree(Tree=dispatch_2.ListA, Path="{0}")
bcx = BrepCurve(Brep=sph_2, Curve=line)  # -> Curves, Points
bnd = Bounds(Numbers=flatten)
remap = RemapNumbers(Value=flatten, Source=bnd, Target=Domain(0, 1))  # -> Mapped, Clipped
vec2pt = Vector2Pt(PointA=dispatch.ListA, PointB=bcx.Points, Unitize=False)  # -> Vector, Length
graph = GraphMapper(remap.Mapped, x0=0, x1=1, y0=0, y1=1, container_name="Bezier", cpx=[0, 0, 1, 1], cpy=[0, 0.5737627149, 0.354403019, 1])
unflatten = UnflattenTree(Tree=graph, Guide=dispatch_2.ListA)
multiplication_2 = Multiplication(A=unflatten, B=vec2pt.Vector)
move = Move(Geometry=dispatch.ListA, Motion=multiplication_2)  # -> Geometry, Transform
merge = Merge(Data1=move.Geometry, Data2=dispatch.ListB)
flatten_2 = FlattenTree(Tree=merge, Path="{0}")
conmesh = ConstructMesh(Vertices=flatten_2, Faces=demesh.Faces)
subdmesh = SubDFromMesh(Mesh=conmesh, Creases=1, Corners=1, Interpolate=False)
panel = Panel(multiplication_2)
brep = Brep(subdmesh)
preview = CustomPreview(Geometry=brep, Material=ColourSwatch(SwatchColor=RGB(41, 176, 255)))
