# Grasshopper definition GHtoHoudini.gh (Grasshopper 1.0.7)

cir = Circle(Plane=PlaneXY(0, 0, 0), Radius=Slider(100, range=0..100))
divide = DivideCurve(Curve=reparameterize(cir), Count=Slider(21, range=0..100), Kinks=False)  # -> Points, Tangents, Parameters
Z = UnitZ(Factor=1)
rad = Radians(Degrees="90")
vrot = Rotate(Vector=Z, Axis=divide.Tangents, Angle=rad)
path = FilePath("F:\odrive\Google Drive\JH\Projects\[051] GrasshopperHowtos\GH Files\GrasshopperHowtos\0127 GH to Houdini\geo\ring2.obj")
pi = Pi(Factor="2")
c_script = CSharpScript(file=path, import=Toggle(False), reset=Toggle(False))  # -> out, geometries; inputs file: String, import: Boolean, reset: Boolean
# ---------- c_script: C# usings ----------
using System.Linq;
using Rhino.DocObjects;
# ---------- c_script: C# ----------
    if(import){
      RhinoDoc.ActiveDoc.Objects.UnselectAll();
      string cmd = "!_-Import " + "\"" + file + "\"" + " _Enter";
      Rhino.RhinoApp.RunScript(cmd, false);
      var selectedObjs = RhinoDoc.ActiveDoc.Objects.GetSelectedObjects(false, false).ToList();
      geos = new List<GeometryBase>();
      foreach(RhinoObject selectedObj in selectedObjs){
        var geo = selectedObj.Geometry;
        geos.Add(geo);
        RhinoDoc.ActiveDoc.Objects.Delete(selectedObj, true);
      }
    }
    
    if(reset){
      geos.Clear();
    }
    

    geometries = geos;
# ---------- c_script: C# additional code ----------
  private List<GeometryBase> geos = new List<GeometryBase>();
# ---------- end c_script ----------
line = LineSDL(Start=divide.Points, Direction=vrot, Length=Slider(36, range=0..100))
multiplication = Multiplication(A=pi, B=Slider(4, range=0..10))
remap = RemapNumbers(Value=divide.Parameters, Source=Domain(0, 1), Target=multiplication)  # -> Mapped, Clipped
rot3d = Rotate3D(Geometry=line, Angle=remap.Mapped, Center=divide.Points, Axis=divide.Tangents)  # -> Geometry, Transform
subdmesh = SubDFromMesh(Mesh=c_script.geometries, Creases=1, Corners=1, Interpolate=False)
end = EndPoints(Curve=rot3d.Geometry)  # -> Start, End
brep = Brep(subdmesh)
intcrv = Interpolate(Vertices=end.End, Degree=3, Periodic=True, KnotStyle=1)  # -> Curve, Length, Domain
intcrv_2 = Interpolate(Vertices=divide.Points, Degree=3, Periodic=True, KnotStyle=1)  # -> Curve, Length, Domain
preview = CustomPreview(Geometry=brep, Material=ColourSwatch(SwatchColor=RGB(130, 172, 255)))
merge = Merge(Data1=rot3d.Geometry, Data2=intcrv.Curve, Data3=intcrv_2.Curve)
flatten = FlattenTree(Tree=merge, Path="{0}")
path_2 = FilePath("F:\odrive\Google Drive\JH\Projects\[051] GrasshopperHowtos\GH Files\GrasshopperHowtos\0127 GH to Houdini\geo\")
c_script_2 = CSharpScript(geometries=flatten, filename="ring2.iges", directory=path_2, export=Toggle(False))  # inputs geometries: tree of GeometryBase, filename: String, directory: String, export: Boolean
# ---------- c_script_2: C# usings ----------
using System.IO;
# ---------- c_script_2: C# ----------
    if(export){

      var guids = new List<Guid>();

      for(int i = 0; i < geometries.BranchCount; i++){
        for(int n = 0; n < geometries.Branches[i].Count; n++){
          var geom = geometries.Branches[i][n];
          var guid = Rhino.RhinoDoc.ActiveDoc.Objects.Add(geom);
          guids.Add(guid);
        }
      }

      Rhino.RhinoDoc.ActiveDoc.Objects.Select(guids);

      string filepath = Path.Combine(directory, filename);
      string cmd = "_-Export " + "\"" + filepath + "\"" + " _Enter _Enter";

      Rhino.RhinoApp.RunScript(cmd, false);

      Rhino.RhinoDoc.ActiveDoc.Objects.Delete(guids, true);
    }
# ---------- end c_script_2 ----------
