# Grasshopper definition Shelf for Lasercut.gh (Grasshopper 1.0.7)

number_slider = Slider(5, range=0..10)
number_slider_2 = Slider(500, range=0..1000)
number_slider_3 = Slider(300, range=0..1000)
number_slider_4 = Slider(15, range=0..30)
number_slider_5 = Slider(1200, range=0..10000)
number_slider_6 = Slider(20, range=0..100)

pi = Pi(Factor=Slider(0.8, range=0..2))
subtraction = Subtraction(A=number_slider_5, B=number_slider_6)
range = Range(Domain=pi, Steps=number_slider_4)
polygon = Polygon(Plane=PlaneXY(0, 0, 0), Radius=number_slider_3, Segments=number_slider, FilletRadius=0)  # -> Polygon, Length
polygon_2 = Polygon(Plane=PlaneXY(0, 0, 0), Radius=number_slider_2, Segments=number_slider, FilletRadius=0)  # -> Polygon, Length
range_2 = Range(Domain=subtraction, Steps=number_slider_4)
dup = DuplicateData(Data=polygon.Polygon, Number=expr("x + 1", number_slider_4), Order=True)
rotate = Rotate(Geometry=polygon_2.Polygon, Angle=range, Plane=PlaneXY(0, 0, 0))  # -> Geometry, Transform
explode = Explode(Curve=polygon.Polygon, Recursive=True)  # -> Segments, Vertices
subtraction_2 = Subtraction(A=number_slider_2, B=number_slider_3)
graft = GraftTree(Tree=range_2, IncludeEmptyLists=True, IncludeNullItems=True)
graft_2 = GraftTree(Tree=dup, IncludeEmptyLists=True, IncludeNullItems=True)  # -> simplify(Tree)
graft_3 = GraftTree(Tree=rotate.Geometry, IncludeEmptyLists=True, IncludeNullItems=True)  # -> simplify(Tree)
eval = EvaluateLength(Curve=explode.Segments, Length="0.5", Normalized=True)  # -> Point, Tangent, Parameter
merge = Merge(Data1=graft_2, Data2=graft_3)
Z = UnitZ(Factor=1)
pi_2 = Pi(Factor="0.5")
boundary = BoundarySurfaces(Edges=merge)
Z_2 = UnitZ(Factor=number_slider_6)
vrot = Rotate(Vector=eval.Tangent, Axis=Z, Angle=pi_2)
multiplication = Multiplication(A="0.5", B=subtraction_2)
multiplication_2 = Multiplication(A=multiplication, B="0.5")
line = LineSDL(Start=eval.Point, Direction=vrot, Length=multiplication)
extr = Extrude(Base=boundary, Direction=Z_2)
Z_3 = UnitZ(Factor=graft)
neg = Negative(Value=multiplication_2)
num = Number(number_slider_6)
amp = Amplitude(Vector=vrot, Amplitude=neg)
move = Move(Geometry=line, Motion=amp)  # -> Geometry, Transform
amp_2 = Amplitude(Vector=eval.Tangent, Amplitude=num)
multiplication_3 = Multiplication(A=amp_2, B="0.5")
extr_2 = Extrude(Base=move.Geometry, Direction=amp_2)
neg_2 = Negative(Value=multiplication_3)
num_2 = Number(number_slider_5)
move_2 = Move(Geometry=extr_2, Motion=neg_2)  # -> Geometry, Transform
move_3 = Move(Geometry=extr, Motion=Z_3)  # -> Geometry, Transform
Z_4 = UnitZ(Factor=num_2)
extr_3 = Extrude(Base=move_2.Geometry, Direction=Z_4)  # -> flatten(Extrusion)
flatten = FlattenTree(Tree=move_3.Geometry, Path="{0}")
sdiff = SolidDifference(BrepsA=extr_3, BrepsB=flatten)
sdiff_2 = SolidDifference(BrepsA=flatten, BrepsB=extr_3)
move_4 = Move(Geometry=sdiff, Motion=amp)  # -> Geometry, Transform

preview = CustomPreview(Geometry=move_4.Geometry, Material=ColourSwatch(SwatchColor=RGBA(0, 123, 255, 171)))
preview_2 = CustomPreview(Geometry=sdiff_2, Material=ColourSwatch(SwatchColor=RGBA(255, 38, 0, 87)))
number_slider_7 = Slider(57, range=0..100)

debrep = DeconstructBrep(Brep=sdiff_2)  # -> Faces, Edges, Vertices
area = Area(Geometry=debrep.Faces)  # -> Area, Centroid
sort = SortList(Keys=area.Area, ValuesA=debrep.Faces)  # -> Keys, reverse(ValuesA)
item = ListItem(List=sort.ValuesA, Index=0, Wrap=True)
pt = ConstructPoint(XCoordinate="0.5", YCoordinate="0.5", ZCoordinate=0)
evalsrf = EvaluateSurface(Surface=reparameterize(item), Point=pt)  # -> Point, Normal, UDirection, VDirection, flatten(Frame)
deplane = DeconstructPlane(Plane=evalsrf.Frame)  # -> Origin, XAxis, YAxis, ZAxis
pln = Plane(evalsrf.Frame)
neg_3 = Negative(Value=deplane.YAxis)
pl = ConstructPlane(Origin=deplane.Origin, XAxis=deplane.XAxis, YAxis=neg_3)
flatten_2 = FlattenTree(Tree=pl, Path="{0}")
xy = XYPlane(Origin=Point(0, 0, 0))
orient = Orient(Geometry=sdiff_2, Source=flatten_2, Target=xy)  # -> Geometry, Transform
box_corners = BoxCorners(Box=orient.Geometry)  # -> CornerA, CornerB, CornerC, CornerD, CornerE, CornerF, CornerG, CornerH
dist = Distance(PointA=box_corners.CornerA, PointB=box_corners.CornerB)
number_slider_8 = Slider(300, range=0..1000)

debrep_2 = DeconstructBrep(Brep=move_4.Geometry)  # -> Faces, Edges, Vertices
area_2 = Area(Geometry=debrep_2.Faces)  # -> Area, Centroid
sort_2 = SortList(Keys=area_2.Area, ValuesA=debrep_2.Faces)  # -> Keys, reverse(ValuesA)
pt_2 = ConstructPoint(XCoordinate="0.5", YCoordinate="0.5", ZCoordinate=0)
item_2 = ListItem(List=sort_2.ValuesA, Index=0, Wrap=True)
evalsrf_2 = EvaluateSurface(Surface=reparameterize(item_2), Point=pt_2)  # -> Point, Normal, UDirection, VDirection, flatten(Frame)
deplane_2 = DeconstructPlane(Plane=evalsrf_2.Frame)  # -> Origin, XAxis, YAxis, ZAxis
pln_2 = Plane(evalsrf_2.Frame)
neg_4 = Negative(Value=deplane_2.YAxis)
pl_2 = ConstructPlane(Origin=deplane_2.Origin, XAxis=deplane_2.XAxis, YAxis=neg_4)
flatten_3 = FlattenTree(Tree=pl_2, Path="{0}")
xy_2 = XYPlane(Origin=Point(0, 0, 0))
orient_2 = Orient(Geometry=move_4.Geometry, Source=flatten_3, Target=xy_2)  # -> Geometry, Transform
box_corners_2 = BoxCorners(Box=orient_2.Geometry)  # -> CornerA, CornerB, CornerC, CornerD, CornerE, CornerF, CornerG, CornerH
dist_2 = Distance(PointA=box_corners_2.CornerA, PointB=box_corners_2.CornerB)
addition = Addition(A=dist_2, B=number_slider_7)
consec = ConsecutiveDomains(Numbers=addition, Additive=True)
dedomain = DeconstructDomain(Domain=consec)  # -> Start, End
item_3 = ListItem(List=reverse(dedomain.End), Index=0, Wrap=True)  # -> flatten(Item)
num_3 = Number(dedomain.Start)
merge_2 = Merge(Data1=flatten(num_3), Data2=item_3)
addition_2 = Addition(A=number_slider_8, B=merge_2)
dist_3 = Distance(PointA=box_corners_2.CornerA, PointB=box_corners_2.CornerD)
X = UnitX(Factor=addition_2)
Y = UnitY(Factor=dist_3)
addition_3 = Addition(A=Y, B=X)
move_5 = Move(Geometry=orient_2.Geometry, Motion=addition_3)  # -> Geometry, Transform

addition_4 = Addition(A=number_slider_7, B=dist)

consec_2 = ConsecutiveDomains(Numbers=addition_4, Additive=True)
dedomain_2 = DeconstructDomain(Domain=consec_2)  # -> Start, End
item_4 = ListItem(List=reverse(dedomain_2.End), Index=0, Wrap=True)  # -> flatten(Item)
num_4 = Number(dedomain_2.Start)
merge_3 = Merge(Data1=flatten(num_4), Data2=item_4)
addition_5 = Addition(A=number_slider_8, B=merge_3)
X_2 = UnitX(Factor=addition_5)
move_6 = Move(Geometry=orient.Geometry, Motion=X_2)  # -> Geometry, Transform
preview_3 = CustomPreview(Geometry=move_6.Geometry, Material=ColourSwatch(SwatchColor=RGBA(255, 38, 0, 87)))

preview_4 = CustomPreview(Geometry=move_5.Geometry, Material=ColourSwatch(SwatchColor=RGBA(0, 123, 255, 171)))
